# Grasshopper definition FacadeEmbed.gh (Grasshopper 1.0.7)
# plug-ins: treesloth01, EleFront, Bifocals

panel = Panel("""北京
天津市
塘沽
上海
重庆
石家庄市
蔚县
邢台市
丰宁
围场
张家口市
怀来
承德市
遵化
青龙
秦皇岛市
霸县
唐山市
乐亭
保定市
饶阳
沧州市
黄骅
南宫市
太原市
右玉
大同市
河曲
五寨
兴县
原平
离石
阳泉市
榆社
隰县
介休
临汾市
长治县
运城市
阳城
呼和浩特市
额右旗拉布达林
牙克石市图里河
满洲里市
海拉尔市
鄂伦春小二沟
新巴尔虎右旗
新巴尔虎左旗阿木古朗
牙克石市博克图
扎兰屯市
科右翼前旗阿尔山
科右翼前旗索伦
乌兰浩特市
东乌珠穆沁旗
额济纳旗
额济纳旗拐子湖
阿左旗巴彦毛道
阿拉善右旗
二连浩特市
那仁宝力格
达茂旗满都拉
阿巴嘎旗
苏尼特左旗
乌拉特后旗海力素
苏尼特右旗朱日和
乌拉特中旗海流图
百灵庙
四子王旗
化德
杭锦后旗陕坝
包头市
集宁市
阿拉善左旗吉兰泰
临河市
鄂托克旗
东胜市
阿腾席连
巴彦浩特
西乌珠穆沁旗
扎鲁特鲁北
巴林左旗林东
锡林浩特市
林西
开鲁
通辽市
多伦
翁牛特旗乌丹
赤峰市
敖汉旗宝国图
沈阳市
彰武
阜新市
开原
清原
朝阳市
建平县叶柏寿
黑山
锦州市
鞍山市
本溪市
抚顺市章党
桓仁
绥中
兴城市
营口市
盖县熊岳
本溪县草河口
岫岩
宽甸
丹东市
瓦房店市
新金县皮口
庄河
大连市
长春市
白城市
乾安
前郭尔罗斯
通榆
长岭
扶余市三岔河
双辽
四平市
磐石县烟筒山
吉林市
蛟河
敦化市
梅河口市
桦甸
靖宇
抚松县东岗
延吉市
通化市
浑江市临江
集安市
长白
哈尔滨市
漠河
塔河
新林
呼玛
加格达奇
黑河市
嫩江
孙吴
北安市
克山
富裕
齐齐哈尔市
海伦
明水
伊春市
鹤岗市
富锦
泰来
绥化市
安达市
铁力
佳木斯市
依兰
宝清
通河
尚志
鸡西市
虎林
牡丹江市
绥芬河市
济南市
德州市
惠民
寿光县羊角沟
龙口市
烟台市
威海市
荣成市成山头
莘县朝城
泰安市泰山
泰安市
淄博市张店
沂源
潍坊市
莱阳市
青岛市
海阳
荣城市石岛
菏泽市
兖州
莒县
临沂
日照市
南京市
徐州市
赣榆
盱眙
淮阴市
射阳
镇江
无锡
泰州
连万港
盐城
高邮
东台市
南通市
启东县吕泗
常州市
溧阳
吴县东山
杭州市
临安县天目山
平湖县乍浦
慈溪市
嵊泗
嵊泗县嵊山
舟山市
金华市
嵊县
宁波市
象山县石浦
衢州市
丽水市
龙泉
临海市括苍山
温州市
椒江市洪家
椒江市下大陈
玉环县坎门
瑞安市北麂
合肥市
砀山
亳州市
宿县
寿县
蚌埠市
滁县
六安市
霍山
巢县
安庆市
宁国
黄山
黄山市
阜阳市
南昌市
修水
宜春市
吉安
宁冈
遂川
赣州市
九江
庐山
波阳
景德镇市
樟树市
贵溪
玉山
南城
广昌
寻乌
福州市
邵武市
铅山县七仙山
浦城
建阳
建瓯
福鼎
泰宁
南平市
福鼎县台山
长汀
上杭
永安市
龙岩市
德化县九仙山
屏南
平潭
崇武
厦门市
东山
西安市
榆林市
吴旗
横山
绥德
延安市
长武
洛川
铜川市
宝鸡市
武功
华阴县华山
略阳
汉中市
佛坪
商州市
镇安
石泉
安康市
兰州市
吉诃德
安西
酒泉市
张掖市
武威市
民勤
乌鞘岭
景泰
靖远
临夏市
临洮
华家岭
环县
平凉市
西峰镇
玛曲
夏河县合作
武都
天水市
马宗山
敦煌
玉门市
金塔县鼎新
高台
山丹
永昌
榆中
会宁
岷县
银川市
惠农
陶乐
中卫
中宁
盐池
海源
同心
固原
西吉
西宁市
茫崖
冷湖
祁连县托勒
祁连县野牛沟
祁连
格尔木市小灶火
大柴旦
德令哈市
刚察
门源
格尔木市
都兰县诺木洪
都兰
乌兰县茶卡
共和县恰卜恰
贵德
民和
唐古拉山五道梁
兴海
同德
泽库
格尔木市托托河
治多
杂多
曲麻菜
玉树
玛多
称多县清水河
玛沁县仁峡姆
达日县吉迈
河南
久治
昂欠
班玛
乌鲁木齐市
阿勒泰市
博乐市阿拉山口
克拉玛依市
伊宁市
昭苏
乌鲁木齐县达板城
和静县巴音布鲁克
吐鲁番市
阿克苏市
库车
库尔勒市
乌恰
喀什市
阿合奇
皮山
和田
民丰
民丰县安的河
于田
哈密
哈巴河
吉木乃
福海
富蕴
塔城
和布克赛尔
青河
托里
北塔山
温泉
精河
乌苏
石河子
蔡家湖
奇台
巴仑台
七角井
库米什
焉耆
拜城
轮台
吐尔格特
巴楚
柯坪
阿拉尔
铁干里克
若羌
塔吉克
莎车
且末
红柳河
郑州市
安阳市
新乡市
三门峡市
卢氏
孟津
洛阳市
栾川
许昌市
开封市
西峡
南阳市
宝丰
西华
驻马店市
信阳市
商丘市
固始
武汉市
郧县
房县
老河口市
枣阳市
巴东
钟祥
麻城市
恩施市
巴东县绿葱坡
五峰县
宜昌市
江陵县荆州
天门市
来凤
嘉鱼
英山
黄石市
长沙市
桑植
石门
南县
岳阳市
吉首市
沅陵
常德市
安化
沅江市
平江
芷江
雪峰山
邵阳市
双峰
南岳
通道
武岗
零陵
衡阳市
道县
郴州市
广州市
南雄
连县
韶关
佛岗
连平
梅县
广宁
高要
河源
惠阳
五华
汕头市
惠来
南澳
信宜
罗定
台山
深圳市
汕尾
湛江市
阳江
电白
台山县上川岛
徐闻
南宁市
桂林市
柳州时
蒙山
贺山
百色市
靖西
桂平
梧州市
龙州
灵山
玉林
东兴
北海市
涠州岛
海口市
东方
儋县
琼中
琼海
三亚市
陵水
西沙岛
珊瑚岛
成都市
石渠
若尔盖
甘孜
都江堰市
绵阳市
雅安市
资阳
康定
汉源
九龙
越西
昭觉
雷波
宜宾市
盐源
西昌市
会理
万源
阆中
巴中
达县市
奉节
遂宁市
南充市
梁平
万县市
内江市
涪陵市
泸州市
叙永
德格
色达
道孚
阿坝
马尔康
红原
小金
松潘
新龙
理塘
稻城
峨眉山
金佛山
贵阳市
威宁
盘县
桐梓
习水
毕节
遵义市
湄潭
思南
铜仁
黔西
安顺市
凯里市
三穗
兴仁
罗甸
独山
榕江
昆明市
德钦
贡山
中甸
维西
昭通市
丽江
华坪
会泽
腾冲
泸水
保山市
大理市
元谋
楚雄市
曲靖市沾益
瑞丽
景东
玉溪
宜良
泸西
孟定
临沧
澜沧
景洪
思茅
元江
勐腊
江城
蒙自
屏边
文山
广南
拉萨市
班戈
安多
那曲
日喀则市
乃东县泽当
隆子
索县
昌都
林芝
葛尔
改则
普兰
申扎
当雄
尼木
聂拉木
定日
江孜
错那
帕里
丁青
波密
察隅
台北
新竹
宜兰
台中
花莲
嘉义
马公
台东
冈山
恒春
阿里山
台南
香港
横澜岛
澳门""")
list = ValueList({"50年": 0, "100年": 1}, selected="50年")
panel_2 = Panel("""0.45 	
0.50 	
0.55 	
0.55 	
0.40 	
0.35 	
0.30 	
0.30 	
0.40 	
0.45 	
0.55 	
0.35 	
0.40 	
0.40 	
0.30 	
0.45 	
0.40 	
0.40 	
0.40 	
0.40 	
0.35 	
0.40 	
0.40 	
0.35 	
0.40 	
	
0.55 	
0.50 	
0.40 	
0.45 	
0.60 	
0.45 	
0.40 	
0.30 	
0.35 	
0.40 	
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	
0.55 	
0.50 	
0.55 	
0.45 	
0.60 	
0.45 	
0.40 	
0.55 	
0.35 	
0.65 	
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	
0.45 	
0.30 	
0.30 	
0.30 	
0.30 	
0.30 	
0.30 	
0.35 	
0.55 	
0.40 	
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	
	
	
	
	
	
	
	
	
	
0.65 	
0.65 	
	
0.45 	
0.35 	
0.40 	
0.30 	
0.30 	
0.35 	
0.30 	
0.33 	
0.40 	
0.55 	
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	
	
	
	
	
	
	
	
	
	
	
	
	
	
	
	
	
	
	
	
	
	
	
	
	
	
	
	
	
	
	
0.45 	
0.45 	
0.40 	
0.40 	
0.30 	
0.45 	
0.40 	
0.30 	
0.40 	
0.45 	
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	
0.30 	
0.30 	
0.75 	
0.30 	
0.30 	
0.40 	
0.40 	
0.35 	
0.30 	
0.50 	
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	
	
	
	
	
	
	
	
	
	
	
	
	
0.30 	
0.35 	
0.35 	
0.30 	
0.30 	
0.30 	
0.30 	
	
0.30 	
0.30 	
	
0.30 	
0.30 	
	
0.30 	
0.30 	
	
	
0.30 	
0.35 	
0.30 	
0.30 	
0.30 	
0.35 	
0.30 	
0.35 	
0.35 	
0.30 	
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	
	
	
	
	
	
	
	
	
	
	
	
	
	
0.70 	
0.80 	
1.85 	
0.80 	
0.70 	
0.80 	
1.30 	
0.90 	
0.80 	
1.05 	
0.35 	
0.85 	
0.90 	
1.25 	
0.85 	""")
panel_3 = Panel("""0.50 	
0.60 	
0.60 	
0.60 	
0.45 	
0.40 	
0.35 	
0.35 	
0.45 	
0.50 	
0.60 	
0.40 	
0.45 	
0.45 	
0.35 	
0.50 	
0.45 	
0.45 	
0.45 	
0.45 	
0.40 	
0.45 	
0.45 	
0.40 	
0.45 	
	
0.65 	
0.60 	
0.45 	
0.55 	
0.60 	
0.50 	
0.45 	
0.35 	
0.40 	
0.45 	
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	
0.65 	
0.55 	
0.60 	
0.50 	
0.70 	
0.50 	
0.45 	
0.60 	
0.40 	
0.75 	
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	
0.55 	
0.35 	
0.35 	
0.35 	
0.35 	
0.35 	
0.35 	
0.40 	
0.60 	
0.45 	
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	
	
	
	
	
	
	
	
	
	
0.75 	
0.70 	
	
0.50 	
0.40 	
0.45 	
0.35 	
0.35 	
0.40 	
0.35 	
0.40 	
0.45 	
0.60 	
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	
	
	
	
	
	
	
	
	
	
	
	
	
	
	
	
	
	
	
	
	
	
	
	
	
	
	
	
	
	
	
0.50 	
0.55 	
0.45 	
0.45 	
0.35 	
0.50 	
0.45 	
0.35 	
0.45 	
0.50 	
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	
0.35 	
0.35 	
0.85 	
0.35 	
0.35 	
0.45 	
0.45 	
0.40 	
0.35 	
0.60 	
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	
	
	
	
	
	
	
	
	
	
	
	
	
0.35 	
0.40 	
0.40 	
0.35 	
0.35 	
0.35 	
0.35 	
	
0.35 	
0.35 	
	
0.35 	
0.35 	
	
0.35 	
0.35 	
	
	
0.35 	
0.40 	
0.35 	
0.35 	
0.35 	
0.40 	
0.35 	
0.40 	
0.40 	
0.35 	
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	
	
	
	
	
	
	
	
	
	
	
	
	
	
0.85 	
0.95 	
2.30 	
0.90 	
0.85 	
0.95 	
1.55 	
1.05 	
0.95 	
1.20 	
0.40 	
1.00 	
0.95 	
1.40 	
0.90 	""")
mindex = MemberIndex(Set=panel, Member="上海")  # -> Index, Count
filter = StreamFilter(Gate=list, Stream0=panel_2, Stream1=panel_3)
item = ListItem(List=filter, Index=mindex.Index, Wrap=True)
list_2 = ValueList({"板埋": 0, "槽埋": 1}, selected="板埋")
# 板埋几何INPUT
list_3 = ValueList({"顶埋": 0, "侧埋": 1}, selected="侧埋")

list_4 = ValueList({"大面区": 0, "墙角区": 1, "内压": 2, "突出构件": 3, "其他": 4}, selected="大面区")
list_5 = ValueList({"A类": 0, "B类": 1, "C类": 2, "D类": 3}, selected="A类")
panel_4 = Panel(item)

# ---- group: 混凝土
list_6 = ValueList({"C15": 0, "C20": 1, "C25": 2, "C30": 3, "C35": 4, "C40": 5}, selected="C35")

# ---- group: 钢筋牌号
list_7 = ValueList({"HPB300": 0, "HRB400": 1}, selected="HPB300")

# ---- group: 直径
list_8 = ValueList({"10": 0, "12": 1, "16": 2, "18": 3, "20": 4, "25": 5}, selected="12")

# ---- group: 锚筋间距
s_x = Slider(22, range=14..60, expression="X*5")
s_y = Slider(22, range=14..60, expression="X*5")

# ---- group: 列
list_9 = ValueList({"2X": 0, "3X": 1, "4X": 2}, selected="3X")

# ---- group: 行
list_10 = ValueList({"2Y": 0, "3Y": 1, "4Y": 2}, selected="2Y")

# ---- group: 结构线
# 平面定位INPUT
crv = Curve(<curve referenced from the Rhino model>)

# ---- group: 玻璃线
玻璃线 = Curve(<curve referenced from the Rhino model>)
玻璃线_2 = Curve(<curve referenced from the Rhino model>)
玻璃线_3 = Curve(<curve referenced from the Rhino model>)

# ---- group: 定位竖料
crv_2 = Curve([<curve referenced from the Rhino model> x180])
crv_3 = Curve([<curve referenced from the Rhino model> x300])
crv_4 = Curve([<curve referenced from the Rhino model> x383])

# ----
join = JoinCurves(Curves=crv_4, Preserve=False)
filter_2 = StreamFilter(Gate=list_4, Stream0=1.2, Stream1=1.6, Stream2=0.2, Stream3=2, Stream4="1.4")
boundary = BoundarySurfaces(Edges=join)
flip = FlipCurve(Curve=玻璃线_3)  # -> Curve, Flag
filter_3 = StreamFilter(Gate=Toggle(True), Stream0=玻璃线_3, Stream1=flip.Curve)
sunion = SolidUnion(Breps=boundary)
list_11 = ValueList({"大面区": 0, "墙角区": 1, "内压": 2, "突出构件": 3, "其他": 4}, selected="内压")
# 风荷载计算
filter_4 = StreamFilter(Gate=list_5, Stream0=0.12, Stream1=0.15, Stream2=0.22, Stream3=0.3)
filter_5 = StreamFilter(Gate=list_5, Stream0=0.12, Stream1=0.15, Stream2=0.23, Stream3=0.39)
filter_6 = StreamFilter(Gate=list_5, Stream0=1.65, Stream1=1.7, Stream2=2.05, Stream3=2.4)
filter_7 = StreamFilter(Gate=list_5, Stream0=1.284, Stream1=1, Stream2=0.544, Stream3=0.262)
filter_8 = StreamFilter(Gate=list_5, Stream0=1.09, Stream1=1, Stream2=0.65, Stream3=0.51)
filter_9 = StreamFilter(Gate=list_11, Stream0=1.2, Stream1=1.6, Stream2=0.2, Stream3=2, Stream4="1.4")
offset = OffsetCurve(Curve=filter_3, Distance=expr("-x", "375"), Corners=1)
area = Area(Geometry=sunion)  # -> Area, Centroid
filter_10 = StreamFilter(Gate=list_5, Stream0=0.24, Stream1=0.3, Stream2=0.44, Stream3=0.6)
division = Division(A="20", B=10)
explode = Explode(Curve=offset, Recursive=True)  # -> Segments, Vertices
subtraction = Subtraction(A=filter_2, B=filter_9)

# ---- group: 埋件点位
pt = Point(area.Centroid)

# ----
neg = Negative(Value=filter_4)
expression = Expression(x=filter_7, y=division, z=filter_10, Expression="x*y^z")
pt_2 = Point(explode.Vertices)
multiplication = Multiplication(A=subtraction, B="1.2")
pow = Power(A=division, B=neg)

# ---- group: 钢结构预埋
# 随文件数据请勿覆盖
crv_5 = Curve([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])

# ---- group: 槽埋3D
brep = Brep(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)

# ----
expression_2 = Expression(x=filter_5, y=pow, Expression="1+2*2.5*x*y")
max = Maximum(A=s_x, B=s_y)
addition = Addition(A=multiplication, B=filter_9)
merge = Merge(Data1=addition, Data2=filter_2)
cp = ClosestPoint(Point=pt_2, Cloud=pt)  # -> ClosestPoint, CPIndex, Distance
item_2 = ListItem(List=sunion, Index=cp.CPIndex, Wrap=True)
explode_2 = Explode(Curve=item_2, Recursive=True)  # -> Segments, Vertices
python = GhPythonScript(x="1.2")  # -> out, a
# ---------- python: Python ----------
__author__ = "xi.ding"
__version__ = "2021.09.27"

import rhinoscriptsyntax as rs

if x >0:
    a = 0;
else:
    a = 1;
# ---------- end python ----------
division_2 = Division(A=max, B=8)
filter_11 = StreamFilter(Gate=list_6, Stream0=7.2, Stream1=9.6, Stream2=11.9, Stream3=14.3, Stream4=16.7, Stream5=19.1)
filter_12 = StreamFilter(Gate=list_7, Stream0=270, Stream1=360)
filter_13 = StreamFilter(Gate=list_8, Stream0=10, Stream1=12, Stream2=16, Stream3=18, Stream4=20, Stream5=25)
filter_14 = StreamFilter(Gate=list_6, Stream0=0.91, Stream1=1.1, Stream2=1.27, Stream3=1.43, Stream4=1.57, Stream5=1.71)
filter_15 = StreamFilter(Gate=list_7, Stream0=0.16, Stream1=0.14)
addition_2 = Addition(A=list_9, B=1)
addition_3 = Addition(A=list_10, B=1)
addition_4 = Addition(A=list_9, B=2)
addition_5 = Addition(A=list_10, B=2)
crv_6 = Curve(simplify(explode_2.Segments))
larger = LargerThan(FirstNumber=expression, SecondNumber=filter_8)  # -> LargerThan, OrEqualTo
len = Length(Curve=crv_6)
item_3 = ListItem(List=merge, Index=python.a, Wrap=True)
smaller = SmallerThan(FirstNumber=expression_2, SecondNumber=filter_6)  # -> SmallerThan, OrEqualTo
panel_5 = Panel(filter_14)
panel_6 = Panel(filter_11)
panel_7 = Panel(filter_15)
filter_16 = StreamFilter(Gate=list_9, Stream0=1, Stream1=0.9, Stream2=0.85)
filter_17 = StreamFilter(Gate=list_10, Stream0=1, Stream1=0.9, Stream2=0.85)
t = Integer(division_2)
min = Minimum(A=filter_12, B=300)
multiplication_2 = Multiplication(A=s_x, B=addition_2)
multiplication_3 = Multiplication(A=s_y, B=addition_3)
multiplication_4 = Multiplication(A=addition_4, B=addition_5)
cull_i = CullIndex(List=pt, Indices=cp.CPIndex, Wrap=True)

# ---- group: find points in bounding box
pt_3 = Point(pt_2)
item_4 = ListItem(List=sunion, Index=cp.CPIndex, Wrap=True)
incurves = PointInCurves(Point=pt_3, Curves=item_4)  # -> Relationship, Index, Point
equals = Equality(FirstNumber=incurves.Relationship, SecondNumber="2")  # -> Equality, Inequality
dispatch = Dispatch(List=pt_3, DispatchPattern=equals.Equality)  # -> ListA, ListB
data = Data(dispatch.ListA)

# ----
panel_8 = Panel(expression_2)
sort = SortList(Keys=len, ValuesA=crv_6)  # -> Keys, ValuesA

panel_9 = Panel(larger.LargerThan)
panel_10 = Panel(smaller.SmallerThan)

panel_11 = Panel(expression)
panel_12 = Panel(min)
panel_13 = Panel(filter_16)
panel_14 = Panel(filter_17)
item_5 = ListItem(List=sort.ValuesA, Index=0, Wrap=True)  # -> Item2, Item1, Item
crv_7 = Curve([item_5.Item2, item_5.Item1])
mm = MassMultiplication(Input=flatten([expression_2, expression, item_3, panel_4]))  # -> Result, PartialResults
expression_3 = Expression(A=filter_15, fy=filter_12, ft=filter_14, d=filter_13, Expression="(int((0.6*1.1*A*fy/ft*d)/5)+1)*5")
expression_4 = Expression(fc=filter_11, fy=min, d=filter_13, Expression="If((4-0.08*d)*sqrt(fc/fy)≤0.7, (4-0.08*d)*sqrt(fc/fy), 0.7)")
expression_5 = Expression(t=t, d=filter_13, Expression="If((0.6+0.25*t/d)≤1, 0.6+0.25*t/d, 1)")

panel_15 = Panel(mm.Result)

filter_18 = StreamFilter(Gate=list_3, Stream0="0", Stream1="0")
num = Number(expr("x*1000", filter_18))

multiplication_5 = Multiplication(B="0")

num_2 = Number(expr("x*1000000", "1"))
num_3 = Number(expr("x*1000000", "5.55"))

brep_2 = Brep(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)
c_script = CSharpScript(board=list_2, top=list_3)  # -> out, result; inputs board: String, top: String
# ---------- c_script: C# ----------
    if(board == "0" && top =="0"){
      result = true;
    }
    else{
      result = false;}
# ---------- end c_script ----------

# ---- group: 槽埋
# 槽埋Modeling
brep_3 = Brep(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)
brep_4 = Brep(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)
bbox = BoundingBox(Content=brep_3, Plane=PlaneXY(0, 0, 0))  # -> Box, Box_2
area_2 = Area(Geometry=brep_3)  # -> Area, Centroid
# 3D
debox = DeconstructBox(Box=bbox.Box)  # -> Plane, X, Y, Z
pdecon = Deconstruct(Point=area_2.Centroid)  # -> XComponent, YComponent, ZComponent
dedomain = DeconstructDomain(Domain=debox.Z)  # -> Start, End
pt_4 = ConstructPoint(XCoordinate=pdecon.XComponent, YCoordinate=pdecon.YComponent, ZCoordinate=dedomain.End)
xy = XYPlane(Origin=Point(0, 0, 0))
pl_origin = PlaneOrigin(Base=xy, Origin=pt_4)
xy_2 = XYPlane(Origin=Point(0, 0, 0))
orient = Orient(Geometry=brep_3, Source=pl_origin, Target=xy_2)  # -> Geometry, Transform

# ----
expression_6 = Expression(d=filter_13, n=multiplication_4, Expression="3.1415926*d²/4*n")
panel_16 = Panel("""Top
Perspective
Front
Right""")
m2d_rhino = Make2DRhinoView(Name=panel_16, Clip=True)
number_slider = Slider(2, range=0..10)
pt_5 = Point(Point(957.9296072, 367.7685097, 0))
pt_6 = Point("0,0,0")
recgrid = Rectangular(
    Plane=pt_5,
    SizeX=Slider(12, range=1..20, expression="X*50"),
    SizeY=Slider(10, range=1..20, expression="X*50"),
    ExtentX=number_slider,
    ExtentY=number_slider)  # -> Cells, Points
flatten = FlattenTree(Tree=recgrid.Points, Path="{0}")

# ---- group: 钢结构预埋
crv_8 = Curve([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])

# ----
# 自定义块所在图层
# 自定义块所在图层颜色
panel_17 = Panel("Embeded::Embeded")
# 自定义块名称
swatch = ColourSwatch(SwatchColor=RGB(255, 0, 0))
layer = DefineLayer(Name=panel_17, Color=swatch)
attributes = DefineObjectAttributes(Layer=layer)

# ---- group: 板槽
# Rhino 文件中导入的块名
panel_18 = Panel("xxx")
inblock = InsertBlock(BlockName=panel_18, SourcePlane=PlaneXY(0, 0, 0))

# ----
item_6 = ListItem(List=pt, Index=cp.CPIndex, Wrap=True)
crv_cp = CurveClosestPoint(Point=item_6, Curve=offset)  # -> Point, Parameter, Distance
eval = EvaluateCurve(Curve=offset, Parameter=crv_cp.Parameter)  # -> Point, Tangent, Angle
crv_9 = Curve(offset)

槽埋单体 = Brep(orient.Geometry)

# ----
# 板埋Modeling
multiplication_6 = Multiplication(A=s_x, B=addition_2)
multiplication_7 = Multiplication(A=s_y, B=addition_3)
recgrid_2 = Rectangular(Plane=PlaneXY(0, 0, 0), SizeX=s_x, SizeY=s_y, ExtentX=addition_2, ExtentY=addition_3)  # -> Cells, Points
division_3 = Division(A=multiplication_6, B=2)
division_4 = Division(A=multiplication_7, B=2)
vec = VectorXYZ(XComponent=expr("-x", division_3), YComponent=expr("-x", division_4), ZComponent=0)  # -> Vector, Length
直径 = Text(filter_13)
move = Move(Geometry=recgrid_2.Points, Motion=vec.Vector)  # -> Geometry, Transform
division_5 = Division(A=直径, B=2)
cyl = Cylinder(Base=move.Geometry, Radius=division_5, Length=expr("-x", expression_3))
X = UnitX(Factor=直径)
multiplication_8 = Multiplication(A=直径, B=6)
edges = BrepEdges(Brep=cyl)  # -> Naked, Interior, NonManifold
item_7 = ListItem(List=edges.Naked, Index=0, Wrap=True)
max_2 = Maximum(A=multiplication_8, B=70)
move_2 = Move(Geometry=item_7, Motion=X)  # -> Geometry, Transform
multiplication_9 = Multiplication(A=max_2, B=2)
addition_6 = Addition(A=multiplication_6, B=multiplication_9)
addition_7 = Addition(A=multiplication_7, B=multiplication_9)
division_6 = Division(A=t, B=2)
expression_7 = Expression(x=addition_7, Expression="Ceiling(x/10)*10/2")
expression_8 = Expression(x=addition_6, Expression="Ceiling(x/10)*10/2")
round = Round(Number=division_6)  # -> Nearest, Floor, Ceiling
multiplication_10 = Multiplication(A=round.Ceiling, B=2)
dom = ConstructDomain(DomainStart=expr("-x", expression_7), DomainEnd=expression_7)
dom_2 = ConstructDomain(DomainStart=expr("-x", expression_8), DomainEnd=expression_8)
box = DomainBox(Base=PlaneXY(0, 0, 0), X=dom_2, Y=dom, Z=multiplication_10)
Z = UnitZ(Factor=expr("-x", multiplication_10))
move_3 = Move(Geometry=box, Motion=Z)  # -> Geometry, Transform
Z_2 = UnitZ(Factor=expr("-x", multiplication_10))

multiplication_11 = Multiplication(A=直径, B=5)

Z_3 = UnitZ(Factor=multiplication_11)
extr = Extrude(Base=move_2.Geometry, Direction=Z_3)
cap = CapHoles(Brep=[extr, cyl])
merge_2 = Merge(Data1=cap, Data2=box)
flatten_2 = FlattenTree(Tree=merge_2, Path="{0}")
move_4 = Move(Geometry=flatten_2, Motion=Z_2)  # -> Geometry, Transform

box_2 = DomainBox(Base=PlaneXY(0, 0, 0), X=dom_2, Y=dom_2, Z=multiplication_10)
merge_3 = Merge(Data1=cap, Data2=box_2)
flatten_3 = FlattenTree(Tree=merge_3, Path="{0}")
move_5 = Move(Geometry=flatten_3, Motion=Z_2)  # -> Geometry, Transform
entwine = Entwine(Branch00=move_4.Geometry, Branch01=move_5.Geometry, FlattenInputs=True)
# 如果无法完整的生成埋件的三视图，
# 建议选择埋件的3D在Rhino中将
# Perspective/Top/Front/Right 试图缩放至合适大小后重新运行
顶埋or槽埋 = StreamFilter(Gate=list_2, Stream0=entwine, Stream1=orient.Geometry)

Z_4 = UnitZ(Factor=expr("-x", multiplication_10))
move_6 = Move(Geometry=cap, Motion=Z_4)  # -> Geometry, Transform
debrep = DeconstructBrep(Brep=move_6.Geometry)  # -> Faces, Edges, Vertices
panel_19 = Panel("""1
4""")
pshift = ShiftPaths(Data=debrep.Edges, Offset=-1)
crv_10 = Curve(pshift)
item_8 = ListItem(List=crv_10, Index=panel_19, Wrap=True)
debrep_2 = DeconstructBrep(Brep=move_3.Geometry)  # -> Faces, Edges, Vertices
bang = ExplodeTree(Data=item_8)
item_9 = ListItem(List=debrep_2.Edges, Index=0, Wrap=True)  # -> Item, Item1
item_10 = ListItem(List=debrep_2.Edges, Index=Slider(9, range=0..10), Wrap=True)
pshift_2 = ShiftPaths(Data=bang, Offset=-2)
merge_4 = Merge(Data1=item_9.Item, Data2=item_9.Item1, Data3=item_10, Data4=pshift_2)

make2d = Make2D(Geometry=顶埋or槽埋, View=m2d_rhino, TangentEdges=False, TangentSeams=False, AutoComputeMake2D=False)  # -> VisibleCurves, VisibleIndex, VisibleType, HiddenCurves, HiddenIndex, HiddenType
bang_2 = ExplodeTree(Data=make2d.VisibleCurves)  # -> Branch0, Branch1, Branch2, Branch3, Branch4, Branch5, Branch6, Branch7
bang_3 = ExplodeTree(Data=make2d.VisibleCurves)  # -> Branch0, Branch1, Branch2, Branch3, Branch4, Branch5, Branch6, Branch7
divdist = DivideDistance(Curve=make2d.HiddenCurves, Distance=Slider(1, range=0..10))  # -> Points, Tangents, Parameters
graft = GraftTree(Tree=make2d.HiddenCurves, IncludeEmptyLists=True, IncludeNullItems=True)
shatter = Shatter(Curve=graft, Parameters=divdist.Parameters)
dispatch_2 = Dispatch(List=shatter, DispatchPattern=[True, False])  # -> ListA, ListB
crv_11 = Curve(dispatch_2.ListA)
pshift_3 = ShiftPaths(Data=crv_11, Offset=-1)
# hidden lines of top+pers view
pshift_4 = ShiftPaths(Data=pshift_3, Offset=-1)
bang_4 = ExplodeTree(Data=pshift_4)  # -> Branch0, Branch1, Branch2, Branch3, Branch4, Branch5, Branch6, Branch7
bang_5 = ExplodeTree(Data=pshift_4)  # -> Branch0, Branch1, Branch2, Branch3, Branch4, Branch5, Branch6, Branch7
entwine_2 = Entwine(Branch00=bang_4.Branch4, Branch01=bang_3.Branch4, FlattenInputs=True)  # -> flatten(Result)
entwine_3 = Entwine(Branch00=bang_4.Branch5, Branch01=bang_3.Branch5, FlattenInputs=True)  # -> flatten(Result)
# 三视图
entwine_4 = Entwine(Branch00=bang_5.Branch0, Branch01=bang_2.Branch0, FlattenInputs=True)  # -> flatten(Result)
entwine_5 = Entwine(Branch00=bang_5.Branch1, Branch01=bang_2.Branch1, FlattenInputs=True)  # -> flatten(Result)
entwine_6 = Entwine(Branch00=entwine_2, Branch01=entwine_3, Branch02=bang_3.Branch6, Branch03=bang_3.Branch7, FlattenInputs=True)
entwine_7 = Entwine(Branch00=entwine_4, Branch01=entwine_5, Branch02=bang_2.Branch2, Branch03=bang_2.Branch3, FlattenInputs=True)
group = Group(Objects=entwine_7)
group_2 = Group(Objects=entwine_6)
entwine_8 = Entwine(Branch00=group, Branch01=group_2, FlattenInputs=True)
pshift_5 = ShiftPaths(Data=entwine_8, Offset=-1)
pshift_6 = ShiftPaths(Data=entwine_8, Offset=-1)
boxprop = BoxProperties(Box=pshift_5)  # -> Center, Diagonal, Area, Volume, Degeneracy
vec2pt = Vector2Pt(PointA=boxprop.Center, PointB=pt_6, Unitize=False)  # -> Vector, Length
# move to center
move_7 = Move(Geometry=pshift_6, Motion=vec2pt.Vector)  # -> flatten(Geometry), Transform
orient_2 = Orient(Geometry=flatten(move_7.Geometry), Source=PlaneXY(0, 0, 0), Target=flatten)  # -> Geometry, Transform
cull_i_2 = CullIndex(List=orient_2.Geometry, Indices="-1", Wrap=True)
split = SplitList(List=cull_i_2, Index="4")  # -> ListA, ListB
data_2 = Data(split.ListA)
data_3 = Data(split.ListB)
entwine_9 = Entwine(Branch00=data_2, Branch01=data_3, FlattenInputs=True)
geo = Geometry(entwine_9)

bbox_2 = BoundingBox(Content=geo, Plane=PlaneXY(0, 0, 0))  # -> Box, Box_2
debrep_3 = DeconstructBrep(Brep=bbox_2.Box)  # -> Faces, Edges, Vertices
item_11 = ListItem(List=debrep_3.Edges, Index=0, Wrap=True)  # -> Item, Item1
end = EndPoints(Curve=item_11.Item1)  # -> Start, End
end_2 = EndPoints(Curve=item_11.Item)  # -> Start, End
# 加工图标注
aligndim = AlignedDimension(
    Plane=PlaneXY(0, 0, 0),
    PointA=[end_2.Start, end.Start],
    PointB=[end_2.End, end.End],
    Offset=expr("-x", Slider(70, range=0..100)),
    Text="{0:0.00}",
    Size=Slider(35, range=0..100))

panel_20 = Panel("""Perspective
Top
Front
Right""")
m2d_rhino_2 = Make2DRhinoView(Name=panel_20, Clip=True)
make2d_2 = Make2D(Geometry=merge_4, View=m2d_rhino_2, TangentEdges=False, TangentSeams=False, AutoComputeMake2D=False)  # -> VisibleCurves, VisibleIndex, VisibleType, HiddenCurves, HiddenIndex, HiddenType
bang_6 = ExplodeTree(Data=make2d_2.VisibleCurves)  # -> Branch0, Branch1, Branch2, Branch3
pt_7 = Point(Point(957.9296072, 367.7685097, 0))
group_3 = Group(Objects=[bang_6.Branch1, bang_6.Branch2, bang_6.Branch3, bang_6.Branch0])
recgrid_3 = Rectangular(
    Plane=pt_7,
    SizeX=Slider(12, range=1..20, expression="X*50"),
    SizeY=Slider(10, range=1..20, expression="X*50"),
    ExtentX=1,
    ExtentY=1)  # -> Cells, Points
flatten_4 = FlattenTree(Tree=recgrid_3.Points, Path="{0}")
vec2pt_2 = Vector2Pt(PointA=boxprop.Center, PointB="0,0,0", Unitize=False)  # -> Vector, Length
move_8 = Move(Geometry=group_3, Motion=vec2pt_2.Vector)  # -> flatten(Geometry), Transform
orient_3 = Orient(Geometry=move_8.Geometry, Source=PlaneXY(0, 0, 0), Target=flatten_4)  # -> Geometry, Transform
ungroup = Ungroup(Group=orient_3.Geometry)
curvepoint = PointOnCurve(ungroup, parameter=0.5)
crv_cp_2 = CurveClosestPoint(Point=curvepoint, Curve=ungroup)  # -> Point, Parameter, Distance
ungroup_2 = Ungroup(Group=orient_3.Geometry)
pframe = PerpFrame(Curve=ungroup, Parameter=crv_cp_2.Parameter)
end_3 = EndPoints(Curve=ungroup_2)  # -> Start, End
deplane = DeconstructPlane(Plane=pframe)  # -> Origin, XAxis, YAxis, ZAxis
aligndim_2 = AlignedDimension(
    Plane=PlaneXY(0, 0, 0),
    PointA=end_3.Start,
    PointB=end_3.End,
    Offset=Slider(28, range=0..100),
    Text="{0:0.00}",
    Size=Slider(8, range=0..10))
line = LineSDL(Start=deplane.Origin, Direction=deplane.YAxis, Length=Slider(19, range=0..100))
number_slider_2 = Slider(500, range=0..1000)
ext = ExtendCurve(Curve=line, Type=0, Start=number_slider_2, End=number_slider_2)
crv_12 = Curve(simplify(debrep_3.Edges))
graft_2 = GraftTree(Tree=ext, IncludeEmptyLists=True, IncludeNullItems=True)  # -> simplify(Tree)
bang_7 = ExplodeTree(Data=ext)  # -> Branch0, Branch1, Branch2, Branch3
ccx = CurveCurve(CurveA=crv_12, CurveB=graft_2)  # -> Points, ParamsA, ParamsB
crv_13 = Curve(bang_7.Branch3)
pshift_7 = ShiftPaths(Data=ccx.Points, Offset=-1)
graft_3 = GraftTree(Tree=deplane.Origin, IncludeEmptyLists=True, IncludeNullItems=True)
dist = Distance(PointA=pshift_7, PointB=graft_3)
sort_2 = SortList(Keys=dist, ValuesA=pshift_7)  # -> Keys, ValuesA
item_12 = ListItem(List=sort_2.ValuesA, Index=0, Wrap=True)
ln = Line(StartPoint=item_12, EndPoint=graft_3)

# ---- group: 板埋or槽埋
# 侧埋与顶埋
number_slider_3 = Slider(0, range=0..10)
item_13 = ListItem(List=geo, Index=number_slider_3, Wrap=True)
item_14 = ListItem(List=geo, Index=2, Wrap=True)
cluster = Cluster(G=item_13)
cluster_2 = Cluster(G=item_14)
filter_19 = StreamFilter(Gate=list_3, Stream0=cluster, Stream1=cluster_2)
filter_20 = StreamFilter(Gate=list_2, Stream0=filter_19, Stream1=filter_19)  # -> flatten(Stream)

# ----
item_15 = ListItem(List=filter_20, Index=0, Wrap=True)
block = DefineBlock(Geometry=filter_19, Attributes=attributes, BlockName="Steel Plate", BasePlane=PlaneXY(0, 0, 0))
multiplication_12 = Multiplication(A=expression_7, B=2)
addition_8 = Addition(A=multiplication_12, B=expression_8)
# 侧埋与顶埋
filter_21 = StreamFilter(Gate=list_3, Stream0=addition_8, Stream1=expression_8)
# 侧埋与顶埋
filter_22 = StreamFilter(Gate=list_3, Stream0=expression_8, Stream1=expression_8)

# ---- group: 大面
# 大面埋件布置
number_slider_4 = Slider(0.002, range=0..0.01)
filter_23 = StreamFilter(Gate=list_3, Stream0=expression_7, Stream1=number_slider_4)
filter_24 = StreamFilter(Gate=list_2, Stream0=filter_23, Stream1=expression_7)
offset_2 = OffsetCurve(Curve=offset, Distance=expr("-x", filter_24), Plane=PlaneXY(0, 0, 0), Corners=1)
crv_cp_3 = CurveClosestPoint(Point=cull_i, Curve=offset_2)  # -> Point, Parameter, Distance
# 埋件平面中心线
crv_cp_4 = CurveClosestPoint(Point=cull_i, Curve=offset)  # -> Point, Parameter, Distance
vec2pt_3 = Vector2Pt(PointA=crv_cp_3.Point, PointB=crv_cp_4.Point, Unitize=False)  # -> expr("-x", Vector), Length
eval_2 = EvaluateCurve(Curve=offset, Parameter=crv_cp_4.Parameter)  # -> Point, Tangent, Angle
pl = ConstructPlane(Origin=crv_cp_4.Point, XAxis=eval_2.Tangent, YAxis=vec2pt_3.Vector)
# 埋件平面中心
orient_4 = Orient(Geometry=block, Source=PlaneXY(0, 0, 0), Target=pl)  # -> flatten(Geometry), Transform

# ----
shatter_2 = Shatter(Curve=offset, Parameters=crv_cp_4.Parameter)
len_2 = Length(Curve=shatter_2)
sort_3 = SortList(Keys=expr("x/1000", len_2))  # -> Keys, ValuesA
first_last = FirstLast(List=sort_3.Keys)  # -> FirstValue, LastValue

multiplication_13 = Multiplication(A="3", B=first_last.LastValue)
multiplication_14 = Multiplication(A=multiplication_13, B=panel_15)
multiplication_15 = Multiplication(A=multiplication_13, B="1.5")
multiplication_16 = Multiplication(A=multiplication_14, B="1.5")
multiplication_17 = Multiplication(A=multiplication_15, B="1.3")
multiplication_18 = Multiplication(A=multiplication_16, B="0")
filter_25 = StreamFilter(Gate=list_3, Stream0=multiplication_17, Stream1=multiplication_16)
filter_26 = StreamFilter(Gate=list_3, Stream0=multiplication_16, Stream1=multiplication_17)
num_4 = Number(expr("x*1000", filter_25))
num_5 = Number(expr("x*1000", filter_26))
expression_9 = Expression(Vy=num_5, ex="0", ey="0", e0="25", Mxx=num_2, N=num_4, Expression="Vy*(ex+e0)+Mxx+N*(ey+e0)")
expression_10 = Expression(Vy=num_5, ex="0", ey="0", e0="25", Mxx=num_2, N=num_4, Expression="Vy*(ey+e0)+Mxx+N*(ex+e0)")
expression_11 = Expression(Vx=num, ex="0", ey="0", e0="25", Myy=num_3, N=num_4, Expression="Vx*(ey+e0)+Myy+N*e0")
expression_12 = Expression(Vx=num, ex="0", ey="0", e0="25", Myy=num_3, N=num_4, Expression="Vx*(ex+e0)+Myy+N*e0")
filter_27 = StreamFilter(Gate=list_3, Stream0=expression_10, Stream1=expression_9)
filter_28 = StreamFilter(Gate=list_3, Stream0=expression_11, Stream1=expression_12)
# 受拉
expression_13 = Expression(
    Vx=num,
    Vy=num_5,
    N=num_4,
    Mx=filter_28,
    My=filter_27,
    Arx=filter_16,
    Ary=filter_17,
    Av=expression_4,
    Ab=expression_5,
    fy=min,
    zx=multiplication_2,
    zy=multiplication_3,
    Expression="Vx/Arx/Av/fy+Vy/Ary/Av/fy+N/0.8/Ab/fy+Mx/1.3/Ary/Ab/fy/zy+My/1.3/Arx/Ab/fy/zx")
expression_14 = Expression(
    N=num_4,
    Mx=filter_28,
    My=filter_27,
    Arx=filter_16,
    Ary=filter_17,
    Ab=expression_5,
    fy=min,
    zx=multiplication_2,
    zy=multiplication_3,
    Expression="If((Mx-0.4*N*zy)>0, Mx-0.4*N*zy, 0)/0.4/Ary/Ab/fy/zy+If((My-0.4*N*zx)>0, My-0.4*N*zx, 0)/0.4/Arx/Ab/fy/zx")
# 受压
expression_15 = Expression(
    Vx=num,
    Vy=num_5,
    N=num_4,
    Mx=filter_28,
    My=filter_27,
    Arx=filter_16,
    Ary=filter_17,
    Av=expression_4,
    Ab=expression_5,
    fy=min,
    zx=multiplication_2,
    zy=multiplication_3,
    Expression="(Vx-0.3*N)/Arx/Av/fy+(Vy-0.3*N)/Ary/Av/fy+If((Mx-0.4*N*zy)>0, Mx-0.4*N*zy, 0)/1.3/Ary/Ab/fy/zy+If((My-0.4*N*zx)>0, My-0.4*N*zx, 0)/1.3/Arx/Ab/fy/zx")
expression_16 = Expression(
    N=num_4,
    Mx=filter_28,
    My=filter_27,
    Arx=filter_16,
    Ary=filter_17,
    Ab=expression_5,
    fy=min,
    zx=multiplication_2,
    zy=multiplication_3,
    Expression="N/0.8/Ab/fy+Mx/0.4/Ary/Ab/fy/zy+My/0.4/Arx/Ab/fy/zx")
max_3 = Maximum(A=expression_13, B=expression_16)
max_4 = Maximum(A=expression_15, B=expression_14)
larger_2 = LargerThan(FirstNumber=expression_6, SecondNumber=max_3)  # -> LargerThan, OrEqualTo
larger_3 = LargerThan(FirstNumber=expression_6, SecondNumber=max_4)  # -> LargerThan, OrEqualTo

panel_21 = Panel(larger_3.LargerThan)
panel_22 = Panel(larger_2.LargerThan)

crv_cp_5 = CurveClosestPoint(Point=item_6, Curve=offset_2)  # -> Point, Parameter, Distance
vec2pt_4 = Vector2Pt(PointA=crv_cp_5.Point, PointB=crv_cp.Point, Unitize=False)  # -> expr("-x", Vector), Length
angle = Angle(VectorA=eval.Tangent, VectorB=vec2pt_4.Vector)  # -> Angle, Reflex
deg = Degrees(Radians=angle.Angle)
smaller_2 = SmallerThan(FirstNumber=deg, SecondNumber=89)  # -> SmallerThan, OrEqualTo
dispatch_3 = Dispatch(List=item_6, DispatchPattern=smaller_2.SmallerThan)  # -> ListA, ListB
# 板埋与槽埋
filter_29 = StreamFilter(Gate=list_2, Stream0=filter_21, Stream1=Slider(150, range=0..1000))
# 板埋与槽埋
filter_30 = StreamFilter(Gate=list_2, Stream0=filter_22, Stream1=Slider(150, range=0..1000))

# ---- group: 阴角
# 阴角埋件布置
explode_3 = Explode(Curve=crv_9, Recursive=True)  # -> Segments, Vertices
cp_2 = ClosestPoint(Point=dispatch_3.ListB, Cloud=explode_3.Vertices)  # -> ClosestPoint, CPIndex, Distance
cir = Circle(Plane=cp_2.ClosestPoint, Radius=filter_30)
ccx_2 = CurveCurve(CurveA=cir, CurveB=offset)  # -> Points, ParamsA, ParamsB
crv_cp_6 = CurveClosestPoint(Point=ccx_2.Points, Curve=offset_2)  # -> Point, Parameter, Distance
crv_cp_7 = CurveClosestPoint(Point=ccx_2.Points, Curve=offset)  # -> Point, Parameter, Distance
vec2pt_5 = Vector2Pt(PointA=crv_cp_6.Point, PointB=crv_cp_7.Point, Unitize=False)  # -> expr("-x", Vector), Length
eval_3 = EvaluateCurve(Curve=offset, Parameter=crv_cp_7.Parameter)  # -> Point, Tangent, Angle
pl_2 = ConstructPlane(Origin=crv_cp_7.Point, XAxis=eval_3.Tangent, YAxis=vec2pt_5.Vector)
orient_5 = Orient(Geometry=block, Source=PlaneXY(0, 0, 0), Target=pl_2)  # -> Geometry, Transform

# ---- group: 阳角
# 阳角埋件布置
explode_4 = Explode(Curve=crv_9, Recursive=True)  # -> Segments, Vertices
cp_3 = ClosestPoint(Point=dispatch_3.ListA, Cloud=explode_4.Vertices)  # -> ClosestPoint, CPIndex, Distance
cir_2 = Circle(Plane=cp_3.ClosestPoint, Radius=filter_29)
ccx_3 = CurveCurve(CurveA=cir_2, CurveB=offset)  # -> Points, ParamsA, ParamsB
crv_cp_8 = CurveClosestPoint(Point=ccx_3.Points, Curve=offset_2)  # -> Point, Parameter, Distance
crv_cp_9 = CurveClosestPoint(Point=ccx_3.Points, Curve=offset)  # -> Point, Parameter, Distance
vec2pt_6 = Vector2Pt(PointA=crv_cp_8.Point, PointB=crv_cp_9.Point, Unitize=False)  # -> expr("-x", Vector), Length
eval_4 = EvaluateCurve(Curve=offset, Parameter=crv_cp_9.Parameter)  # -> Point, Tangent, Angle
pl_3 = ConstructPlane(Origin=crv_cp_9.Point, XAxis=eval_4.Tangent, YAxis=vec2pt_6.Vector)
orient_6 = Orient(Geometry=block, Source=PlaneXY(0, 0, 0), Target=pl_3)  # -> Geometry, Transform

# ----
# 埋件平面定位辅助点
pt_8 = Point(cp_3.ClosestPoint)
item_16 = ListItem(List=ccx_3.Points, Index=0, Wrap=True)  # -> Item, Item1
ln_2 = Line(StartPoint=graft(pt_8), EndPoint=graft(item_16.Item))  # -> flatten(Line)
ln_3 = Line(StartPoint=graft(pt_8), EndPoint=graft(item_16.Item1))  # -> flatten(Line)
pl_4 = ConstructPlane(Origin=pt_8, XAxis=ln_2, YAxis=ln_3)
item_17 = ListItem(List=filter_20, Index="1", Wrap=True)
bbox_3 = BoundingBox(Content=graft(item_17), Plane=PlaneXY(0, 0, 0))  # -> Box, Box_2
srf = Surface(bbox_3.Box)
explode_5 = Explode(Curve=srf, Recursive=True)  # -> Segments, Vertices

lng = ListLength(List=orient_4.Geometry)
division_7 = Division(A=lng, B=2)
split_2 = SplitList(List=orient_4.Geometry, Index=division_7)  # -> ListA, ListB
data_4 = Data(split_2.ListA)

item_18 = ListItem(List=explode_5.Vertices, Index=0, Wrap=True)  # -> Item, Item1, Item2
ln_4 = Line(StartPoint=graft(item_18.Item1), EndPoint=graft(item_18.Item))
ln_5 = Line(StartPoint=graft(item_18.Item1), EndPoint=graft(item_18.Item2))
pl_5 = ConstructPlane(Origin=item_18.Item1, XAxis=ln_4, YAxis=ln_5)
bbox_4 = BoundingBox(Content=data_4, Plane=PlaneXY(0, 0, 0))  # -> Box, Box_2
orient_7 = Orient(Geometry=item_17, Source=pl_5, Target=pl_4)  # -> Geometry, Transform
entwine_10 = Entwine(Branch00=data_4, Branch01=bbox_4.Box, FlattenInputs=True)
bbox_5 = BoundingBox(Content=orient_7.Geometry, Plane=PlaneXY(0, 0, 0))  # -> Box, Box_2
flip_2 = FlipMatrix(Data=entwine_10)
entwine_11 = Entwine(Branch00=orient_7.Geometry, Branch01=bbox_5.Box, FlattenInputs=True)
item_19 = ListItem(List=flip_2, Index=-1, Wrap=True)  # -> flatten(Item)
flip_3 = FlipMatrix(Data=entwine_11)
item_20 = ListItem(List=flip_2, Index="0", Wrap=True)  # -> flatten(Item)
item_21 = ListItem(List=flip_3, Index=-1, Wrap=True)  # -> flatten(Item)

c_script_2 = CSharpScript(BrepMain=item_19, BrepStay=item_21)  # -> out, BrepInters, BrepRemain, IndexM, IndexS; inputs BrepMain: list of Brep, BrepStay: list of Brep
# ---------- c_script_2: C# ----------
    List<Brep> BrepI = new List<Brep>();
    List<Brep> BrepR = new List<Brep>();
    List<int> num = new List<int>();
    List<int> numS = new List<int>();


    double tolr = Rhino.RhinoDoc.ActiveDoc.ModelAbsoluteTolerance;

    for(int j = 0; j < BrepMain.Count;j++){
      for(int i = 0; i < BrepStay.Count;i++){
        bool test = Rhino.Geometry.Intersect.Intersection.BrepBrep(BrepMain[j], BrepStay[i], tolr, out crv, out pts);
        if(test && crv.Length != 0){
          tryThis = true;
          numS.Add(i);
          break;}
        else{
          tryThis = false;}
      }
      if(tryThis){
        BrepI.Add(BrepMain[j]);
        num.Add(j);
      }
      else{
        BrepR.Add(BrepMain[j]);
      }
    }



    BrepInters = BrepI;
    BrepRemain = BrepR;
    IndexM = num;
    IndexS = numS;
# ---------- c_script_2: C# additional code ----------
  Rhino.Geometry.Curve[] crv;
  Rhino.Geometry.Point3d[] pts;
  bool tryThis;
# ---------- end c_script_2 ----------

cull_i_3 = CullIndex(List=item_20, Indices=c_script_2.IndexM, Wrap=True)
item_22 = ListItem(List=item_19, Index=c_script_2.IndexM, Wrap=True)  # -> graft(Item)
item_23 = ListItem(List=item_21, Index=c_script_2.IndexS, Wrap=True)  # -> graft(Item)
item_24 = ListItem(List=item_20, Index=c_script_2.IndexM, Wrap=True)  # -> graft(Item)
area_3 = Area(Geometry=item_22)  # -> Area, Centroid

bbx = BrepBrep(BrepA=item_22, BrepB=item_23)  # -> simplify(Curves), Points
area_4 = Area(Geometry=bbx.Curves)  # -> Area, Centroid
ln_6 = Line(StartPoint=area_3.Centroid, EndPoint=area_4.Centroid)
amp = Amplitude(Vector=ln_6, Amplitude=Slider(1000, range=0..1000))
move_9 = Move(Geometry=area_4.Centroid, Motion=amp)  # -> Geometry, Transform
ln_7 = Line(StartPoint=move_9.Geometry, EndPoint=area_3.Centroid)
ccx_4 = CurveCurve(CurveA=ln_7, CurveB=bbx.Curves)  # -> Points, ParamsA, ParamsB
item_25 = ListItem(List=ccx_4.Points, Index=0, Wrap=True)  # -> Item, Item1
ln_8 = Line(StartPoint=item_25.Item, EndPoint=item_25.Item1)
move_10 = Move(Geometry=item_24, Motion=ln_8)  # -> simplify(Geometry), Transform

geo_2 = Geometry(cull_i_3)
geo_3 = Geometry(orient_7.Geometry)
merge_5 = Merge(Data1=geo_2, Data2=move_10.Geometry, Data3=geo_3)
geo_4 = Geometry(orient_5.Geometry)

merge_6 = Merge(Data1=merge_5, Data2=geo_4)

alongcrv = SortAlongCurve(Points=flatten([crv_cp_4.Point, cp_3.ClosestPoint, cp_2.ClosestPoint]), Curve=offset)  # -> Points, Indices
shift = ShiftList(List=alongcrv.Points, Shift=1, Wrap=True)  # -> flatten(List)
aligndim_3 = AlignedDimension(
    Plane=PlaneXY(0, 0, 0),
    PointA=alongcrv.Points,
    PointB=shift,
    Offset=-1000,
    Text="{0:0}",
    Size=Slider(108, range=0..1000))
subtraction_2 = Subtraction(A="0", B=1000)
lineardim = DefineLinearDimension(Point1=alongcrv.Points, Point2=shift, Offset=subtraction_2, DimensionStyle="TSSD_100_100$0")

bake = BakeObjects(Geometry=flatten([orient_4.Geometry, orient_6.Geometry, orient_5.Geometry]), BakeName="Steel Plate", Bake=Toggle(False))

geo_5 = Geometry([orient_4.Geometry, orient_6.Geometry, orient_5.Geometry])
bbox_6 = BoundingBox(Content=orient_4.Geometry, Plane=PlaneXY(0, 0, 0))  # -> Box, Box_2
bbox_7 = BoundingBox(Content=orient_6.Geometry, Plane=PlaneXY(0, 0, 0))  # -> simplify(Box), Box_2
clash = Clash(FirstSet=bbox_7.Box, SecondSet=bbox_6.Box, Distance=0, L=100)  # -> ClashCount, ClashPoints, ClashRadii, FirstIndex, SecondIndex
pshift_8 = ShiftPaths(Data=clash.FirstIndex, Offset=-1)  # -> simplify(Data)
tstat = TreeStatistics(Tree=pshift_8)  # -> Paths, Length, Count
item_26 = ListItem(List=bbox_7.Box, Index=clash.FirstIndex, Wrap=True)
larger_4 = LargerThan(FirstNumber=tstat.Length, SecondNumber=0)  # -> LargerThan, OrEqualTo
dispatch_4 = Dispatch(List=tstat.Paths, DispatchPattern=larger_4.LargerThan)  # -> ListA, ListB
graft_4 = GraftTree(Tree=cp_3.ClosestPoint, IncludeEmptyLists=True, IncludeNullItems=True)  # -> simplify(Tree)
simplify = SimplifyTree(Tree=orient_6.Geometry, Front=False)
split_3 = SplitTree(Data=graft_4, Masks=flatten(dispatch_4.ListA))  # -> Positive, Negative
split_4 = SplitTree(Data=simplify, Masks=flatten(dispatch_4.ListA))  # -> Positive, Negative
orient_8 = Orient(Geometry=block, Source=PlaneXY(0, 0, 0), Target=split_3.Positive)  # -> simplify(Geometry), Transform
cull_i_4 = CullIndex(List=split_4.Positive, Indices="1", Wrap=True)
replace = ReplaceItems(List=simplify(cull_i_4), Item=orient_8.Geometry, Indices=0, Wrap=False)
merge_7 = Merge(Data1=simplify(replace), Data2=split_4.Negative)

# ==== cluster Cluster
G = ClusterInput()
rotate = Rotate(Geometry=G, Angle=3.141592654, Plane=PlaneXY(0, 0, 0))  # -> Geometry, Transform
boxprop = BoxProperties(Box=rotate.Geometry)  # -> Center, Diagonal, Area, Volume, Degeneracy
bbox = BoundingBox(Content=rotate.Geometry, Plane=PlaneXY(0, 0, 0))  # -> Box, Box_2
debox = DeconstructBox(Box=bbox.Box)  # -> Plane, X, Y, Z
pdecon = Deconstruct(Point=boxprop.Center)  # -> XComponent, YComponent, ZComponent
dedomain = DeconstructDomain(Domain=debox.Y)  # -> Start, End
pt = ConstructPoint(XCoordinate=pdecon.XComponent, YCoordinate=dedomain.Start, ZCoordinate=pdecon.ZComponent)
xy = XYPlane(Origin=Point(0, 0, 0))
pl_origin = PlaneOrigin(Base=xy, Origin=pt)
orient = Orient(Geometry=rotate.Geometry, Source=pl_origin, Target=xy)  # -> Geometry, Transform
G_2 = ClusterOutput(orient.Geometry)
