# Grasshopper definition FacadeEmbed_JinQiao_Podium.gh (Grasshopper 1.0.7)
# plug-ins: EleFront, TT Toolbox, Pufferfish, Hare, treesloth01

# ----
# 线段延长长度
number_slider = Slider(1001, range=0..10000)  # disabled

# ----
# remove duplicate curves
geo = Geometry()  # disabled
number_slider_2 = Slider(0.1, range=0..0.1)  # disabled
boundary = BoundarySurfaces(Edges=geo)  # disabled
area = Area(Geometry=boundary)  # -> Area, Centroid; disabled
cullduppoints = RemoveDuplicatePoints(InputPoints=area.Centroid, Tolerance=number_slider_2)  # -> OutputPoints, FirstPointIndexes; disabled
null = NullItem(Item=cullduppoints.FirstPointIndexes)  # -> NullFlags, InvalidFlags, Description; disabled
dispatch = Dispatch(List=boundary, DispatchPattern=null.NullFlags)  # -> ListA, ListB; disabled
geo_2 = Geometry(dispatch.ListA)  # disabled

# ----
# 调换阴阳角设定
toggle = BooleanToggle(False)  # disabled

# ----
# 导入下层建筑线
# 格式：Line-0-建筑
panel = Panel("Line-0-建筑-Whole")
reflay = ReferenceByLayer(LayerName=panel)

# ----
# 导入上层建筑线+檐口线
# 格式：Line-1-
panel_2 = Panel("Line-1-檐口")
# 按照图层导入建筑、檐口线、特殊区域线
# 
# Step1:将不同类型的curve按照以下图层分类放入Rhino中
# Step2:依次点击每个Update按钮
panel_3 = Panel("Line-1-建筑-Whole")
reflay_2 = ReferenceByLayer(LayerName=panel_3)
reflay_3 = ReferenceByLayer(LayerName=panel_2)

# ----
# 导入檐口出特殊区域参考线
# 格式：Line-1-
panel_4 = Panel("Line-1-檐口-车道等灰空间区域")
reflay_4 = ReferenceByLayer(LayerName=panel_4)
reflay_5 = ReferenceByLayer(LayerName="Line-1-檐口-吊顶处理区域")

# ----
# Step1.输入block names
# Step2:点击Update按钮
data = Data(["PX-GLAZ-F2$0$PX-GLAZ-F2$0$fin", "PX-GLAZ-F2$0$PX-GLAZ-F1$0$fin"])
panel_5 = Panel(data)
# （1）导入埋件定位点
panel_6 = Panel("")
refblock = ReferenceBlockByName(BlockName=panel_5)

# ----
# Input Curves
# 
# Step1：选中其中一个curve,得到该图层所有curves
# Step2：点击Update按钮
# （2）导入整个site的建筑线
crv = Curve(<curve referenced from the Rhino model>)

# ----
# 埋件编号tag的Offset
number_slider_3 = Slider(190, range=0..1000)

# ----
# Embed Layer Color
swatch = ColourSwatch(SwatchColor=RGB(255, 132, 79))

# ----
# 钢结构截面列表
txt = Text(["GL2A-1\tHN 250x125x6x9\t\tQ235B\t热轧", "GL3-1\tHN 300x150x6.5x9\t\tQ235B\t热轧", "GL3-2\tH 300x100x8x10\t\tQ235B\t焊接H型", "GL3-3\tH 300x200x8x16\t\tQ355B\t焊接H型", "GL3-4\tHW 300x300x10x15\t\tQ355B\t热轧", "GL4-1\tHN 400x200x8x13\t\tQ355B\t热轧", "GL4-2\tH 400x200x10x16\t\tQ355B\t焊接H型", "GL4-3\tH 400x250x10x20\t\tQ355B\t焊接H型", "GL4-4\tH 400x350x16x35\t\tQ355B\t焊接H型", "GL4a-1\tH 450x200x9x14\t\tQ355B\t热轧", "GL5-1\tHN 500x200x10x16\t\tQ355B\t热轧", "GL5-2\tH 500x200x10x20\t\tQ355B\t焊接H型", "GL5-3\tH 500x300x14x20\t\tQ355B\t焊接H型", "GL5a-1\tH 550x250x10x25\t\tQ355B\t焊接H型", "GL5a-2\tH 550x300x14x25\t\tQ355B\t焊接H型", "GL6-1\tHN 600x200x11x17\t\tQ355B\t热轧", "GL6-2\tH 600x300x12x20\t\tQ355B\t焊接H型", "GL6-3\tH 600x350x12x25\t\tQ355B\t焊接H型", "GL6-4\tH 600x350x16x35\t\tQ355B\t焊接H型", "GL7-1\tHN 700x300x13x24\t\tQ355B\t热轧", "GL7-2\tH 700x350x14x30\t\tQ355B\t焊接H型", "GL7-3\tH 700x350x14x35\t\tQ355B\t焊接H型", "GL8-1\tHN 800x300x14x26\t\tQ355B\t热轧", "GL8-2\tH 800x300x20x40\t\tQ345GJB\t焊接H型", "GL9-1\tH 900x300x20x30\t\tQ355B\t焊接H型", "GL9-2\tH 900x400x20x40\t\tQ345GJB\t焊接H型", "GL10-1\tH 1000x400x20x30\t\tQ355B\t焊接H型", "GL10-2\tH 1000x500x20x30\t\tQ355B\t焊接H型", "GL10-3\tH 1000x500x20x35\t\tQ355B\t焊接H型", "GL10-4\tH 1000x400x20x40\t\tQ345GJB\t焊接H型", "GL10-5\tH 1000x500x20x40\t\tQ345GJB\t焊接H型", "GL10-6\t□ 1000x400x20x40\t\tQ345GJB\t焊接箱型", "GL12-1\tH 1200x400x25x50\t\tQ345GJB\t焊接H型"])

# ----
# Dimension Style
# （5）导入Default Embed
panel_7 = Panel("图例2-地上$0$XD100$0")

# ----
# 埋件编号tag
panel_8 = Panel("3-3")

# ----
# 钢埋板长度（按需设定）
number_slider_4 = Slider(350, range=0..1000)

# ----
# 钢埋板厚度（按需设定）
number_slider_5 = Slider(16, range=0..100)

# ----
# 1.导入建筑线-普遍适用
panel_9 = Panel("Arch_curve_smooth")
# Step1:将不同类型的curve按照以下图层分类放入Rhino中（图层命名格式：Arch_curve_）
# Step2:依次点击每个Update按钮
panel_10 = Panel("Arch_curve_Whole")
reflay_6 = ReferenceByLayer(LayerName=panel_10)
reflay_7 = ReferenceByLayer(LayerName=panel_9)
reflay_8 = ReferenceByLayer(LayerName="Arch_curve_withLocation")
reflay_9 = ReferenceByLayer(LayerName="Arch_curve_angular")

# ----
# 2.导入建筑线-此项目特殊处理：
# （3）导入单体建筑的参考线
panel_11 = Panel("Arch_curve_other")
reflay_10 = ReferenceByLayer(LayerName=panel_11)

# ----
# (Block & Curve的形式)
# Input Blocks (Plane的Y轴向外)
# 
# Step1.输入Block所在图层
# Step2:点击Update按钮
data_2 = Data(["PX-GLAZ-F2$0$PX-GLAZ-F1$0$标准块", "PX-GLAZ-F2$0$PX-GLAZ-F2$0$标准块", "PX-GLAZ-F2$0$PX-GLAZ-F3$0$标准块"])

# ----
# 埋件编号tag的Offset
number_slider_6 = Slider(190, range=0..1000)

# ----
# Embed Layer Color
swatch_2 = ColourSwatch(SwatchColor=RGB(255, 196, 79))

# ----
# 钢结构截面列表
txt_2 = Text(["GL2A-1\tHN 250x125x6x9\t\tQ235B\t热轧", "GL3-1\tHN 300x150x6.5x9\t\tQ235B\t热轧", "GL3-2\tH 300x100x8x10\t\tQ235B\t焊接H型", "GL3-3\tH 300x200x8x16\t\tQ355B\t焊接H型", "GL3-4\tHW 300x300x10x15\t\tQ355B\t热轧", "GL4-1\tHN 400x200x8x13\t\tQ355B\t热轧", "GL4-2\tH 400x200x10x16\t\tQ355B\t焊接H型", "GL4-3\tH 400x250x10x20\t\tQ355B\t焊接H型", "GL4-4\tH 400x350x16x35\t\tQ355B\t焊接H型", "GL4a-1\tH 450x200x9x14\t\tQ355B\t热轧", "GL5-1\tHN 500x200x10x16\t\tQ355B\t热轧", "GL5-2\tH 500x200x10x20\t\tQ355B\t焊接H型", "GL5-3\tH 500x300x14x20\t\tQ355B\t焊接H型", "GL5a-1\tH 550x250x10x25\t\tQ355B\t焊接H型", "GL5a-2\tH 550x300x14x25\t\tQ355B\t焊接H型", "GL6-1\tHN 600x200x11x17\t\tQ355B\t热轧", "GL6-2\tH 600x300x12x20\t\tQ355B\t焊接H型", "GL6-3\tH 600x350x12x25\t\tQ355B\t焊接H型", "GL6-4\tH 600x350x16x35\t\tQ355B\t焊接H型", "GL7-1\tHN 700x300x13x24\t\tQ355B\t热轧", "GL7-2\tH 700x350x14x30\t\tQ355B\t焊接H型", "GL7-3\tH 700x350x14x35\t\tQ355B\t焊接H型", "GL8-1\tHN 800x300x14x26\t\tQ355B\t热轧", "GL8-2\tH 800x300x20x40\t\tQ345GJB\t焊接H型", "GL9-1\tH 900x300x20x30\t\tQ355B\t焊接H型", "GL9-2\tH 900x400x20x40\t\tQ345GJB\t焊接H型", "GL10-1\tH 1000x400x20x30\t\tQ355B\t焊接H型", "GL10-2\tH 1000x500x20x30\t\tQ355B\t焊接H型", "GL10-3\tH 1000x500x20x35\t\tQ355B\t焊接H型", "GL10-4\tH 1000x400x20x40\t\tQ345GJB\t焊接H型", "GL10-5\tH 1000x500x20x40\t\tQ345GJB\t焊接H型", "GL10-6\t□ 1000x400x20x40\t\tQ345GJB\t焊接箱型", "GL12-1\tH 1200x400x25x50\t\tQ345GJB\t焊接H型"])

# ----
# 钢埋板长度（按需设定）
number_slider_7 = Slider(350, range=0..1000)

# ----
# 钢埋板厚度（按需设定）
number_slider_8 = Slider(16, range=0..100)

# ----
# 肋板倒角距离（按需设定）
number_slider_9 = Slider(30, range=0..100)

# ----
# Dimension Style
panel_12 = Panel("图例2-地上$0$XD100$0")

# ----
# 埋件编号tag
panel_13 = Panel("2-2")

# ----
# 输入
# 
# 1.Embed的结构编号
# 2.Embed的Tag命名
# 需要出图的钢结构编号
panel_14 = Panel("GL3-3H")

# ----
# 埋件编号tag的Offset
number_slider_10 = Slider(190, range=0..1000)

# ----
# Embed Layer Color
swatch_3 = ColourSwatch(SwatchColor=RGB(136, 235, 148))

# ----
# 钢结构截面列表
txt_3 = Text(["GL2A-1\tHN 250x125x6x9\t\tQ235B\t热轧", "GL3-1\tHN 300x150x6.5x9\t\tQ235B\t热轧", "GL3-2\tH 300x100x8x10\t\tQ235B\t焊接H型", "GL3-3\tH 300x200x8x16\t\tQ355B\t焊接H型", "GL3-4\tHW 300x300x10x15\t\tQ355B\t热轧", "GL4-1\tHN 400x200x8x13\t\tQ355B\t热轧", "GL4-2\tH 400x200x10x16\t\tQ355B\t焊接H型", "GL4-3\tH 400x250x10x20\t\tQ355B\t焊接H型", "GL4-4\tH 400x350x16x35\t\tQ355B\t焊接H型", "GL4a-1\tH 450x200x9x14\t\tQ355B\t热轧", "GL5-1\tHN 500x200x10x16\t\tQ355B\t热轧", "GL5-2\tH 500x200x10x20\t\tQ355B\t焊接H型", "GL5-3\tH 500x300x14x20\t\tQ355B\t焊接H型", "GL5a-1\tH 550x250x10x25\t\tQ355B\t焊接H型", "GL5a-2\tH 550x300x14x25\t\tQ355B\t焊接H型", "GL6-1\tHN 600x200x11x17\t\tQ355B\t热轧", "GL6-2\tH 600x300x12x20\t\tQ355B\t焊接H型", "GL6-3\tH 600x350x12x25\t\tQ355B\t焊接H型", "GL6-4\tH 600x350x16x35\t\tQ355B\t焊接H型", "GL7-1\tHN 700x300x13x24\t\tQ355B\t热轧", "GL7-2\tH 700x350x14x30\t\tQ355B\t焊接H型", "GL7-3\tH 700x350x14x35\t\tQ355B\t焊接H型", "GL8-1\tHN 800x300x14x26\t\tQ355B\t热轧", "GL8-2\tH 800x300x20x40\t\tQ345GJB\t焊接H型", "GL9-1\tH 900x300x20x30\t\tQ355B\t焊接H型", "GL9-2\tH 900x400x20x40\t\tQ345GJB\t焊接H型", "GL10-1\tH 1000x400x20x30\t\tQ355B\t焊接H型", "GL10-2\tH 1000x500x20x30\t\tQ355B\t焊接H型", "GL10-3\tH 1000x500x20x35\t\tQ355B\t焊接H型", "GL10-4\tH 1000x400x20x40\t\tQ345GJB\t焊接H型", "GL10-5\tH 1000x500x20x40\t\tQ345GJB\t焊接H型", "GL10-6\t□ 1000x400x20x40\t\tQ345GJB\t焊接箱型", "GL12-1\tH 1200x400x25x50\t\tQ345GJB\t焊接H型"])

# ----
# 钢埋板长度（按需设定）
number_slider_11 = Slider(350, range=0..1000)

# ----
# 钢埋板厚度（按需设定）
number_slider_12 = Slider(16, range=0..100)

# ----
# 肋板倒角距离（按需设定）
number_slider_13 = Slider(30, range=0..100)

# ----
# Dimension Style
panel_15 = Panel("图例2-地上$0$XD100$0")

# ----
# block names
listblockd = ListBlockDocument()

# ----
# Input Blocks (Plane的Y轴向内)
# 
# Step1:输入Block所在图层
# Step2:点击Update按钮
data_3 = Data("PX-GLAZ-F2$0$T3T")

# ----
# 肋板倒角距离（按需设定）
number_slider_14 = Slider(30, range=0..100)

# ----
# 肋板倒角距离（按需设定）
number_slider_15 = Slider(30, range=0..100)

# ----
# （4）导入结构线+生成对应的钢板焊埋件
# 操作步骤如下
# 
# Step1:依次根据结构编号在Rhino中按照图层分类结构线
# Step2:按照结构编号依次建立 梁中线+Offset值+埋件单体组合包
# Step3:导入对应结构编号图层中的梁线Curve
# Step4:埋件编号Tag命名
# Step5:依次将每个组合包中的Curve,Offset值和Embed连接到右侧的3个Entwine组件上
# 导入梁线curve
crv_2 = Curve(<curve referenced from the Rhino model>)

# ----
# 埋件编号tag
panel_16 = Panel("1-1")

# ----
# 埋件编号tag的Offset
number_slider_16 = Slider(190, range=0..1000)

# ----
# Embed Layer Color
swatch_4 = ColourSwatch(SwatchColor=RGB(221, 255, 0))

# ----
# Dimension Style
panel_17 = Panel("图例2-地上$0$XD100$0")

# ----
# 钢结构截面列表
txt_4 = Text(["GL2A-1\tHN 250x125x6x9\t\tQ235B\t热轧", "GL3-1\tHN 300x150x6.5x9\t\tQ235B\t热轧", "GL3-2\tH 300x100x8x10\t\tQ235B\t焊接H型", "GL3-3\tH 300x200x8x16\t\tQ355B\t焊接H型", "GL3-4\tHW 300x300x10x15\t\tQ355B\t热轧", "GL4-1\tHN 400x200x8x13\t\tQ355B\t热轧", "GL4-2\tH 400x200x10x16\t\tQ355B\t焊接H型", "GL4-3\tH 400x250x10x20\t\tQ355B\t焊接H型", "GL4-4\tH 400x350x16x35\t\tQ355B\t焊接H型", "GL4a-1\tH 450x200x9x14\t\tQ355B\t热轧", "GL5-1\tHN 500x200x10x16\t\tQ355B\t热轧", "GL5-2\tH 500x200x10x20\t\tQ355B\t焊接H型", "GL5-3\tH 500x300x14x20\t\tQ355B\t焊接H型", "GL5a-1\tH 550x250x10x25\t\tQ355B\t焊接H型", "GL5a-2\tH 550x300x14x25\t\tQ355B\t焊接H型", "GL6-1\tHN 600x200x11x17\t\tQ355B\t热轧", "GL6-2\tH 600x300x12x20\t\tQ355B\t焊接H型", "GL6-3\tH 600x350x12x25\t\tQ355B\t焊接H型", "GL6-4\tH 600x350x16x35\t\tQ355B\t焊接H型", "GL7-1\tHN 700x300x13x24\t\tQ355B\t热轧", "GL7-2\tH 700x350x14x30\t\tQ355B\t焊接H型", "GL7-3\tH 700x350x14x35\t\tQ355B\t焊接H型", "GL8-1\tHN 800x300x14x26\t\tQ355B\t热轧", "GL8-2\tH 800x300x20x40\t\tQ345GJB\t焊接H型", "GL9-1\tH 900x300x20x30\t\tQ355B\t焊接H型", "GL9-2\tH 900x400x20x40\t\tQ345GJB\t焊接H型", "GL10-1\tH 1000x400x20x30\t\tQ355B\t焊接H型", "GL10-2\tH 1000x500x20x30\t\tQ355B\t焊接H型", "GL10-3\tH 1000x500x20x35\t\tQ355B\t焊接H型", "GL10-4\tH 1000x400x20x40\t\tQ345GJB\t焊接H型", "GL10-5\tH 1000x500x20x40\t\tQ345GJB\t焊接H型", "GL10-6\t□ 1000x400x20x40\t\tQ345GJB\t焊接箱型", "GL12-1\tH 1200x400x25x50\t\tQ345GJB\t焊接H型"])

# ----
# 钢埋板长度（按需设定）
number_slider_17 = Slider(350, range=0..1000)

# ----
# 钢埋板厚度（按需设定）
number_slider_18 = Slider(16, range=0..100)

# ----
# 埋件编号tag
panel_18 = Panel("4-4")

# ----
# 输入
# 
# Embed的Tag命名
# 埋件编号
panel_19 = Panel("5-5")

# ----
# 长
panel_20 = Panel("-175 To 175")

# ----
# 宽
panel_21 = Panel("-125 To 125")

# ----
# Dimension Style
panel_22 = Panel("图例2-地上$0$XD100$0")

# ----
# Dimension Style
panel_23 = Panel("图例2-地上$0$XD100$0")

# ----
# 埋件编号tag的Offset
number_slider_19 = Slider(353, range=0..1000)

# ----
# 埋件编号tag
panel_24 = Panel("6-6")

# ---- group: 混凝土
# 板埋几何INPUT
list = ValueList({"C15": 0, "C20": 1, "C25": 2, "C30": 3, "C35": 4, "C40": 5}, selected="C35")

# ---- group: 钢筋牌号
list_2 = ValueList({"HPB300": 0, "HRB400": 1}, selected="HPB300")

# ---- group: 直径
list_3 = ValueList({"10": 0, "12": 1, "16": 2, "18": 3, "20": 4, "25": 5}, selected="12")

# ---- group: 锚筋间距
s_y = Slider(22, range=14..60, expression="X*5")
s_x = Slider(22, range=14..60, expression="X*5")

# ---- group: 列
list_4 = ValueList({"2X": 0, "3X": 1, "4X": 2}, selected="3X")

# ---- group: 行
# （7）生成底埋钢埋件
list_5 = ValueList({"2Y": 0, "3Y": 1, "4Y": 2}, selected="2Y")

# ---- group: 参考线起点
number_slider_20 = Slider(0.806, range=0..1)

# ---- group: Dimension Offset Input 2
number_slider_21 = Slider(1000, range=0..1000)

# ---- group: 移除重复位置点-容差
number_slider_22 = Slider(200, range=0..1000)

# ---- group: Dimension Offset Input 1
number_slider_23 = Slider(2000, range=0..10000)

# ---- group: 标注区域-单一轴网
标准范围_符合单一轴网方向 = Curve(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)

# ---- group: 轴网XY2个方向的线
crv_3 = Curve(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)
crv_4 = Curve(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)

# ---- group: 参考线: 符合轴网方向+囊括整个建筑
# (9)Bake Me!!
# 下层图纸-单一区域
crv_5 = Curve(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)

# ----
# (8) 撞到梁交点-Offset
number_slider_24 = Slider(450, range=0..1000)

# ---- group: 移除重复位置点-容差
number_slider_25 = Slider(200, range=0..1000)

# ---- group: 参考线起点
number_slider_26 = Slider(0.548, range=0..1)

# ---- group: Dimension Offset Input 2
number_slider_27 = Slider(1000, range=0..1000)

# ---- group: Dimension Offset Input 1
number_slider_28 = Slider(2000, range=0..10000)

# ---- group: 标注区域-单一轴网
标准范围_符合单一轴网方向_2 = Curve(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)

# ---- group: 轴网XY2个方向的线
crv_6 = Curve(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)
crv_7 = Curve(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)

# ----
layer = ObjectLayer(Guid=crv)  # -> LayerIndex, LayerPathName
panel_25 = Panel(data_2)
panel_27 = Panel(layer.LayerPathName)
panel_28 = Panel(data_3)
refblock_2 = ReferenceBlockByName(BlockName=panel_25)
refblock_3 = ReferenceBlockByName(BlockName=panel_28)
reflay_11 = ReferenceByLayer(LayerName=panel_27)

# ---- group: 参考线: 符合轴网方向+囊括整个建筑
# (9)Bake Me!!
# 上层图纸-单一区域
crv_8 = Curve(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)

# ----
panel_29 = Panel(txt_3)

# ----
# （0）准备阶段
# 检测各个图层Block的Plane
panel_30 = Panel(listblockd)
deblock = DeconstructBlock(Block=refblock)  # -> Name, Plane, Geometry

# ----
# Step3.检测plane是否存在+查看Plane的Y轴方向
pln = Plane(deblock.Plane)

deblock_2 = DeconstructBlock(Block=refblock_3)  # -> Name, Plane, Geometry
deblock_3 = DeconstructBlock(Block=refblock_2)  # -> Name, Plane, Geometry

# ----
# Step4.如果不存在则Blake geometry
# 并在rhino里面清理线段
geo_3 = Geometry(deblock.Geometry)

# ---- group: the Dimension Reference Curve
seam = Seam(Curve=reparameterize(crv_5), Seam=number_slider_20)

# ---- group: The Start Point of the Dimension Reference Curve
eval = EvaluateCurve(Curve=reparameterize(crv_5), Parameter=number_slider_20)  # -> Point, Tangent, Angle

# ---- group: Dimension Style
panel_31 = Panel("图例2-地上$0$XD100$0")

# ---- group: The Start Point of the Dimension Reference Curve
eval_2 = EvaluateCurve(Curve=reparameterize(crv_8), Parameter=number_slider_26)  # -> Point, Tangent, Angle

# ---- group: the Dimension Reference Curve
seam_2 = Seam(Curve=reparameterize(crv_8), Seam=number_slider_26)

# ---- group: Dimension Style
panel_32 = Panel("图例2-地上$0$XD100$0")

# ----
xy = XYPlane(Origin=Point(0, 0, 0))
xy_2 = XYPlane(Origin=Point(0, 0, 0))
xy_3 = XYPlane(Origin=Point(0, 0, 0))
project = Project(Geometry=refblock_2, Plane=xy)  # -> Geometry, Transform
project_2 = Project(Geometry=refblock_3, Plane=xy_2)  # -> Geometry, Transform
project_3 = Project(Geometry=reflay_11, Plane=xy_3)  # -> Geometry, Transform

cluster = Cluster_3(
    structure_number=panel_14,
    tag_text=panel_18,
    text_offset=number_slider_10,
    embed_color=swatch_3,
    T=txt_3,
    A=number_slider_11,
    A_2=number_slider_12,
    B=number_slider_13,
    dimension_style=panel_15)  # -> R, G_2, R_2
data_4 = Data(flatten(cluster.R_2))
item = ListItem(List=data_4, Index=0, Wrap=True)  # -> Item, Item1
merge = Merge(Data1=item.Item, Data2=item.Item1)

xy_4 = XYPlane(Origin=Point(0, 0, 0))
xy_5 = XYPlane(Origin=Point(0, 0, 0))
xy_6 = XYPlane(Origin=Point(0, 0, 0))
xy_7 = XYPlane(Origin=Point(0, 0, 0))
xy_8 = XYPlane(Origin=Point(0, 0, 0))
xy_9 = XYPlane(Origin=Point(0, 0, 0))
xy_10 = XYPlane(Origin=Point(0, 0, 0))
xy_11 = XYPlane(Origin=Point(0, 0, 0))
xy_12 = XYPlane(Origin=Point(0, 0, 0))
xy_13 = XYPlane(Origin=Point(0, 0, 0))
project_4 = Project(Geometry=reflay_6, Plane=xy_4)  # -> Geometry, Transform
project_5 = Project(Geometry=reflay_7, Plane=xy_5)  # -> Geometry, Transform
project_6 = Project(Geometry=reflay_8, Plane=xy_6)  # -> Geometry, Transform
project_7 = Project(Geometry=reflay_9, Plane=xy_7)  # -> Geometry, Transform
project_8 = Project(Geometry=reflay_10, Plane=xy_8)  # -> Geometry, Transform
project_9 = Project(Geometry=reflay_2, Plane=xy_9)  # -> Geometry, Transform
project_10 = Project(Geometry=reflay_3, Plane=xy_10)  # -> Geometry, Transform
project_11 = Project(Geometry=reflay_5, Plane=xy_11)  # -> Geometry, Transform
project_12 = Project(Geometry=reflay_4, Plane=xy_12)  # -> Geometry, Transform
project_13 = Project(Geometry=reflay, Plane=xy_13)  # -> Geometry, Transform
crv_9 = Curve(project_8.Geometry)
crv_10 = Curve(project_6.Geometry)
crv_11 = Curve(project_10.Geometry)
crv_12 = Curve(project_11.Geometry)
crv_13 = Curve(project_12.Geometry)
crv_14 = Curve(project_13.Geometry)
crv_15 = Curve(project_4.Geometry)
crv_16 = Curve(project_5.Geometry)
crv_17 = Curve(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)
crv_18 = Curve(project_7.Geometry)
crv_19 = Curve(project_9.Geometry)

# ----
# 单体选型
list_6 = ValueList({"顶埋": 0, "侧埋": 1}, selected="顶埋")

# ---- group: F2 Arch Outline
crv_20 = Curve(crv_19)

# ---- group: 车道区域 / 檐口线Input
crv_21 = Curve(crv_17)

# ----
# 选要重塑的线段长度
number_slider_29 = Slider(1200, range=0..10000)

# ---- group: 车道区域 / 吊顶区域
crv_22 = Curve(crv_12)

# ----
# 调整重塑线段的平滑度
number_slider_30 = Slider(11, range=0..11)

# ----
# 区分内外梁边线
# 1.根据F2建筑线制作轮廓线
explode = Explode(Curve=crv_20, Recursive=True)  # -> Segments, Vertices
len = Length(Curve=explode.Segments)
sort = SortList(Keys=len)  # -> Keys, ValuesA
larger = LargerThan(FirstNumber=len, SecondNumber=number_slider_29)  # -> LargerThan, OrEqualTo
panel_33 = Panel(sort.Keys)
dispatch_2 = Dispatch(List=explode.Segments, DispatchPattern=larger.LargerThan)  # -> ListA, ListB
data_5 = Data(dispatch_2.ListA)
data_6 = Data(dispatch_2.ListB)
join = JoinCurves(Curves=data_6, Preserve=False)
disc = Discontinuity(Curve=join, Level=1)  # -> Points, Parameters
nurbs = NurbsCurve(Vertices=disc.Points, Degree=number_slider_30, Periodic=False)  # -> flatten(Curve), Length, Domain
join_2 = JoinCurves(Curves=flatten([data_5, nurbs.Curve]), Preserve=False)
offset = OffsetCurve(Curve=join_2, Distance=Slider(6859, range=0..10000), Corners=1)

# ---- group: F2 Archline - Smoothed
reb = RebuildCurve(Curve=offset, Count=Slider(17, range=0..100), Tangents=invert(False))

# ----
# InputCurve
crv_23 = Curve()

# ----
# Curve-框住要分析的建筑单体
# 如果要用自己导入Curve作为分析线，
# 请在InputCurve那里导入curve,
# 然后在上方的选型列表选择Input Curve。
# 
# 如果要用Grasshopper自动生成的Curve,
# 请在上方的选型列表选择Default Curve。
list_7 = ValueList({"Default Curve": 0, "Input Curve": 1}, selected="Default Curve")
filter = StreamFilter(Gate=list_7, Stream0=reb, Stream1=crv_23)

# ----
# 埋件向外探索最远出的梁的距离
number_slider_31 = Slider(5000, range=0..10000)

# ---- group: F2 Arch Line
crv_24 = Curve(crv_19)

# ---- group: F1 Arch Line
crv_25 = Curve(crv_14)

# ---- group: 容差
number_slider_32 = Slider(1.1, range=0..10)

# ----
# 是否有吊顶：
# 下层幕墙边线在结构边梁以内>350
# 
# （最外层结构线）
number_slider_33 = Slider(350, range=0..1000)

# ---- group: F1 Arch Line
crv_26 = Curve(crv_14)

# ----
# 3.2下层建筑边线内侧300-600mm范围内
number_slider_34 = Slider(600, range=0..1000)
crv_27 = Curve(crv_26)
offset_2 = OffsetCurve(Curve=crv_27, Distance=expr("-x", Slider(300, range=0..1000)), Corners=1)
offset_3 = OffsetCurve(Curve=crv_27, Distance=expr("-x", number_slider_34), Corners=1)

# ----
# 3.1下层建筑边线外侧50-350mm范围内
number_slider_35 = Slider(350, range=0..1000)
crv_28 = Curve(crv_26)
offset_4 = OffsetCurve(Curve=crv_28, Distance=Slider(50, range=0..100), Corners=1)
offset_5 = OffsetCurve(Curve=crv_28, Distance=number_slider_35, Corners=1)

# ----
# 4下层建筑内侧到300到外侧50内
# 有钢结构
number_slider_36 = Slider(50, range=0..1000)
crv_29 = Curve(crv_26)
offset_6 = OffsetCurve(Curve=crv_29, Distance=expr("-x", Slider(300, range=0..1000)), Corners=1)
offset_7 = OffsetCurve(Curve=crv_29, Distance=number_slider_36, Corners=1)

# ----
# （3.1）导入轴线
crv_30 = Curve(<curve referenced from the Rhino model>)
layer_2 = ObjectLayer(Guid=crv_30)  # -> LayerIndex, LayerPathName
panel_34 = Panel(layer_2.LayerPathName)
reflay_12 = ReferenceByLayer(LayerName=panel_34)
xy_14 = XYPlane(Origin=Point(0, 0, 0))
project_14 = Project(Geometry=reflay_12, Plane=xy_14)  # -> Geometry, Transform

data_7 = Data(flatten(merge))
item_2 = ListItem(List=data_7, Index=0, Wrap=True)
item_3 = ListItem(List=data_7, Index="-1", Wrap=True)

# ----
# 求内部曲线转折点
crv_31 = Curve()  # disabled
number_slider_37 = Slider(300, range=0..1000)  # disabled
neg = Negative(Value=number_slider_37)  # disabled
filter_2 = StreamFilter(Gate=toggle, Stream0=number_slider_37, Stream1=neg)  # disabled
number_slider_38 = Slider(60, range=0..100)  # disabled

ext = ExtendCurve(Curve=crv_31, Type=0, Start=number_slider, End=number_slider)  # disabled

# ----
# 第二层
# 
# Curves(location point)+ Smooth Curves(architecture line)
# 第二层-区分阴阳角
area_2 = Area(Geometry=geo_2)  # -> Area, Centroid; disabled
crv_32 = Curve(crv_31)  # disabled
pull = PullPoint(Point=area_2.Centroid, Geometry=crv_32, ClosestOnly=True)  # -> ClosestPoint, Distance; disabled
number_slider_39 = Slider(200, range=0..1000)  # disabled
number_slider_40 = Slider(100, range=0..300)  # disabled

# ----
# 第二层-阴阳角
panel_35 = Panel("0.5 * Pi")  # disabled
toggle_2 = BooleanToggle(True)  # disabled
neg_2 = Negative(Value=panel_35)  # disabled
filter_3 = StreamFilter(Gate=toggle_2, Stream0=panel_35, Stream1=neg_2)  # disabled

# ----
# 第二层-大面定位
panel_36 = Panel("0.5 * Pi")  # disabled
toggle_3 = BooleanToggle(True)  # disabled
neg_3 = Negative(Value=panel_36)  # disabled
filter_4 = StreamFilter(Gate=toggle_3, Stream0=panel_36, Stream1=neg_3)  # disabled

number_slider_41 = Slider(300, range=0..1000)  # disabled
number_slider_42 = Slider(1.5, range=0..10)  # disabled

number_slider_43 = Slider(300, range=0..1000)  # disabled
number_slider_44 = Slider(1.5, range=0..10)  # disabled

number_slider_45 = Slider(300, range=0..1000)  # disabled
number_slider_46 = Slider(1.5, range=0..10)  # disabled

# ----
# 显示"False"时要选择线段延长
list_8 = ValueList({"线段不延长": 0, "线段延长": 1}, selected="线段延长")  # disabled

filter_5 = StreamFilter(Gate=list_8, Stream0=crv_31, Stream1=ext)  # disabled

disc_2 = Discontinuity(Curve=graft(filter_5), Level=1)  # -> Points, Parameters; disabled
crv_cp = CurveClosestPoint(Point=disc_2.Points, Curve=graft(filter_5))  # -> Point, Parameter, Distance; disabled
eval_3 = EvaluateCurve(Curve=graft(filter_5), Parameter=crv_cp.Parameter)  # -> flatten(Point), Tangent, flatten(Angle); disabled
deg = Degrees(Radians=eval_3.Angle)  # disabled
offset_8 = OffsetCurve(Curve=filter_5, Distance=expr("-X", filter_2), Corners=1)  # disabled
panel_37 = Panel(deg)  # disabled
larger_2 = LargerThan(FirstNumber=deg, SecondNumber=number_slider_38)  # -> LargerThan, OrEqualTo; disabled
disc_3 = Discontinuity(Curve=offset_8, Level=1)  # -> flatten(Points), Parameters; disabled
dispatch_3 = Dispatch(List=eval_3.Point, DispatchPattern=larger_2.LargerThan)  # -> ListA, ListB; disabled
end = EndPoints(Curve=filter_5)  # -> Start, End; disabled
data_8 = Data(dispatch_3.ListA)  # disabled
pull_2 = PullPoint(Point=data_8, Geometry=flatten(offset_8), ClosestOnly=True)  # -> ClosestPoint, Distance; disabled
testpoint = TestPoint(archPoint=pull_2.ClosestPoint, crvPoint=disc_3.Points)  # -> out, specialPt; inputs archPoint: list of Point3d, crvPoint: list of Point3d; disabled
# ---------- testpoint: C# ----------
    List<int> passIndex = new List<int>();

    for(int i = 0; i < archPoint.Count; i++){
      foreach(Point3d t in crvPoint){
        if(archPoint[i].X == t.X && archPoint[i].Y == t.Y && archPoint[i].Z == t.Z){
          Print("pass");
          passIndex.Add(i);}
      }
    }

    specialPt = passIndex;
# ---------- end testpoint ----------

# ----
# 阴角
item_4 = ListItem(List=data_8, Index=testpoint.specialPt, Wrap=True)  # disabled

# ----
# SmoothCurve-阴角&阳角
# 阳角
cull_i = CullIndex(List=data_8, Indices=testpoint.specialPt, Wrap=True)  # disabled

dist = Distance(PointA=pull.ClosestPoint, PointB=data_8)  # disabled
sort_2 = SortList(Keys=dist)  # -> Keys, ValuesA; disabled
panel_38 = Panel(sort_2.Keys)  # disabled
smaller = SmallerThan(FirstNumber=dist, SecondNumber=number_slider_39)  # -> SmallerThan, OrEqualTo; disabled
dispatch_4 = Dispatch(List=geo_2, DispatchPattern=smaller.SmallerThan)  # -> ListA, ListB; disabled
crv_33 = Curve(filter_5)  # disabled

data_9 = Data(dispatch_4.ListA)  # disabled
explode_2 = Explode(Curve=data_9, Recursive=True)  # -> Segments, Vertices; disabled
len_2 = Length(Curve=explode_2.Segments)  # disabled
sort_3 = SortList(Keys=reverse(len_2), ValuesA=explode_2.Segments)  # -> Keys, ValuesA; disabled
item_5 = ListItem(List=sort_3.ValuesA, Index=0, Wrap=True)  # -> flatten(Item); disabled
area_3 = Area(Geometry=data_9)  # -> Area, Centroid; disabled
midpt = CurveMiddle(Curve=item_5)  # disabled
move2pt = MoveToPoint(Geometry=item_5, PointA=midpt, PointB=area_3.Centroid)  # -> Moved, Vector, Transform; disabled
end_2 = EndPoints(Curve=move2pt.Moved)  # -> Start, End; disabled
ln = Line(StartPoint=end_2.Start, EndPoint=end_2.End)  # disabled
xy_15 = XYPlane(Origin=end_2.End)  # disabled
rotate = Rotate(Geometry=ln, Angle=filter_3, Plane=xy_15)  # -> Geometry, Transform; disabled
pl = ConstructPlane(Origin=end_2.End, XAxis=rotate.Geometry, YAxis=ln)  # disabled

data_10 = Data(dispatch_4.ListB)  # disabled
explode_3 = Explode(Curve=data_10, Recursive=True)  # -> Segments, Vertices; disabled
len_3 = Length(Curve=explode_3.Segments)  # disabled
sort_4 = SortList(Keys=reverse(len_3), ValuesA=explode_3.Segments)  # -> Keys, ValuesA; disabled
item_6 = ListItem(List=sort_4.ValuesA, Index=0, Wrap=True)  # -> flatten(Item); disabled
area_4 = Area(Geometry=data_10)  # -> Area, Centroid; disabled
midpt_2 = CurveMiddle(Curve=item_6)  # disabled
move2pt_2 = MoveToPoint(Geometry=item_6, PointA=midpt_2, PointB=area_4.Centroid)  # -> Moved, Vector, Transform; disabled
end_3 = EndPoints(Curve=move2pt_2.Moved)  # -> Start, End; disabled
ln_2 = Line(StartPoint=end_3.Start, EndPoint=end_3.End)  # disabled
xy_16 = XYPlane(Origin=end_3.End)  # disabled
rotate_2 = Rotate(Geometry=ln_2, Angle=filter_4, Plane=xy_16)  # -> Geometry, Transform; disabled
pl_2 = ConstructPlane(Origin=end_3.End, XAxis=rotate_2.Geometry, YAxis=ln_2)  # disabled

data_11 = Data(flatten(pl_2))  # disabled
deplane = DeconstructPlane(Plane=data_11)  # -> Origin, XAxis, YAxis, ZAxis; disabled
amp = Amplitude(Vector=deplane.YAxis, Amplitude=number_slider_43)  # disabled
move = Move(Geometry=deplane.Origin, Motion=amp)  # -> Geometry, Transform; disabled
ln_3 = Line(StartPoint=deplane.Origin, EndPoint=move.Geometry)  # disabled
midpt_3 = CurveMiddle(Curve=ln_3)  # disabled
scale = Scale(Geometry=ln_3, Center=midpt_3, Factor=number_slider_44)  # -> Geometry, Transform; disabled
ccx = CurveCurve(CurveA=scale.Geometry, CurveB=crv_33)  # -> Points, ParamsA, ParamsB; disabled

dist_2 = Distance(PointA=graft(end_2.End), PointB=cull_i)  # disabled
sort_5 = SortList(Keys=dist_2)  # -> Keys, ValuesA; disabled
item_7 = ListItem(List=sort_5.Keys, Index=0, Wrap=True)  # disabled
smaller_2 = SmallerThan(FirstNumber=item_7, SecondNumber=number_slider_40)  # -> SmallerThan, OrEqualTo; disabled
flatten = FlattenTree(Tree=item_7, Path="{0}")  # disabled
dispatch_5 = Dispatch(List=graft(pl), DispatchPattern=smaller_2.SmallerThan)  # -> ListA, ListB; disabled
panel_39 = Panel(flatten)  # disabled
flatten_2 = FlattenTree(Tree=ccx.Points, Path="{0}")  # disabled
lng = ListLength(List=scale.Geometry)  # disabled
lng_2 = ListLength(List=flatten_2)  # disabled

data_12 = Data(flatten(dispatch_5.ListA))  # disabled
deplane_2 = DeconstructPlane(Plane=data_12)  # -> Origin, XAxis, YAxis, ZAxis; disabled
amp_2 = Amplitude(Vector=deplane_2.YAxis, Amplitude=number_slider_41)  # disabled
move_2 = Move(Geometry=deplane_2.Origin, Motion=amp_2)  # -> Geometry, Transform; disabled
ln_4 = Line(StartPoint=deplane_2.Origin, EndPoint=move_2.Geometry)  # disabled
midpt_4 = CurveMiddle(Curve=ln_4)  # disabled
scale_2 = Scale(Geometry=ln_4, Center=midpt_4, Factor=number_slider_42)  # -> Geometry, Transform; disabled
ccx_2 = CurveCurve(CurveA=scale_2.Geometry, CurveB=crv_33)  # -> Points, ParamsA, ParamsB; disabled

data_13 = Data(flatten(dispatch_5.ListB))  # disabled
deplane_3 = DeconstructPlane(Plane=data_13)  # -> Origin, XAxis, YAxis, ZAxis; disabled
amp_3 = Amplitude(Vector=deplane_3.YAxis, Amplitude=number_slider_45)  # disabled
move_3 = Move(Geometry=deplane_3.Origin, Motion=amp_3)  # -> Geometry, Transform; disabled
ln_5 = Line(StartPoint=deplane_3.Origin, EndPoint=move_3.Geometry)  # disabled
midpt_5 = CurveMiddle(Curve=ln_5)  # disabled
scale_3 = Scale(Geometry=ln_5, Center=midpt_5, Factor=number_slider_46)  # -> Geometry, Transform; disabled
ccx_3 = CurveCurve(CurveA=scale_3.Geometry, CurveB=crv_33)  # -> Points, ParamsA, ParamsB; disabled

equals = Equality(FirstNumber=lng, SecondNumber=lng_2)  # -> Equality, Inequality; disabled
panel_40 = Panel(equals.Equality)  # disabled

# ----
# InsideCurve-大面
move2pt_3 = MoveToPoint(Geometry=data_11, PointA=flatten(deplane.Origin), PointB=flatten(ccx.Points))  # -> Moved, Vector, Transform; disabled

# ----
# InsideCurve-阳角
move2pt_4 = MoveToPoint(Geometry=data_12, PointA=deplane_2.Origin, PointB=ccx_2.Points)  # -> Moved, Vector, Transform; disabled

# ----
# InsideCurve-阴角
move2pt_5 = MoveToPoint(Geometry=data_13, PointA=deplane_3.Origin, PointB=ccx_3.Points)  # -> Moved, Vector, Transform; disabled

# ----
# 梁中线+Offset值+埋件单体组合包
crv_34 = Curve(<curve referenced from the Rhino model>)
layer_3 = ObjectLayer(Guid=crv_34)  # -> LayerIndex, LayerPathName
panel_41 = Panel(txt)

# ----
# 需要出图的钢结构编号
panel_42 = Panel(layer_3.LayerPathName)

reflay_13 = ReferenceByLayer(LayerName=panel_42)
cluster_2 = Cluster_3(
    structure_number=panel_42,
    tag_text=panel_8,
    text_offset=number_slider_3,
    T=txt,
    G=reflay_13,
    A=number_slider_4,
    A_2=number_slider_5,
    B=number_slider_15,
    dimension_style=panel_7)  # -> R, G_2, R_2

# ----
# 要连接的梁中线Offest值
num = Number(cluster_2.R)

# ----
# 要连接的embed
data_14 = Data(cluster_2.R_2)

# ----
# 要连接的梁中线curve
crv_35 = Curve(cluster_2.G_2)

# ----
# 梁中线+Offset值+埋件单体组合包
crv_36 = Curve(<curve referenced from the Rhino model>)
layer_4 = ObjectLayer(Guid=crv_36)  # -> LayerIndex, LayerPathName
panel_43 = Panel(txt_2)

# ----
# 需要出图的钢结构编号
panel_44 = Panel(layer_4.LayerPathName)

reflay_14 = ReferenceByLayer(LayerName=panel_44)
cluster_3 = Cluster_3(
    structure_number=panel_44,
    tag_text=panel_13,
    text_offset=number_slider_6,
    T=txt_2,
    G=reflay_14,
    A=number_slider_7,
    A_2=number_slider_8,
    B=number_slider_9,
    dimension_style=panel_12)  # -> R, G_2, R_2

# ----
# 要连接的梁中线Offest值
num_2 = Number(cluster_3.R)

# ----
# 要连接的梁中线curve
crv_37 = Curve(cluster_3.G_2)

# ----
# 要连接的embed
data_15 = Data(cluster_3.R_2)

# ----
# (9)Bake Me!!
# 埋件和阴阳角定位
panel_45 = Panel("阴阳角定位")
swatch_5 = ColourSwatch(SwatchColor=RGB(140, 140, 140))

layer_5 = DefineLayer(Name=panel_45, Color=swatch_5)
attributes = DefineObjectAttributes(Layer=layer_5, Color=swatch_5)

swatch_6 = ColourSwatch(SwatchColor=RGB(255, 212, 0))

swatch_7 = ColourSwatch(SwatchColor=RGB(255, 242, 66))

swatch_8 = ColourSwatch(SwatchColor=RGB(255, 242, 66))

swatch_9 = ColourSwatch(SwatchColor=RGB(180, 255, 66))

swatch_10 = ColourSwatch(SwatchColor=RGB(66, 255, 69))

swatch_11 = ColourSwatch(SwatchColor=RGB(66, 255, 236))

swatch_12 = ColourSwatch(SwatchColor=RGB(66, 167, 255))

swatch_13 = ColourSwatch(SwatchColor=RGB(66, 98, 255))

# ----
# 1.1-掩口出侧埋遗漏
panel_46 = Panel("1.1-掩口出侧埋遗漏")
layer_6 = DefineLayer(Name=panel_46)
attributes_2 = DefineObjectAttributes(Layer=layer_6)

# ----
# 梁中线+Offset值+埋件单体组合包
layer_7 = ObjectLayer(Guid=crv_2)  # -> LayerIndex, LayerPathName
panel_47 = Panel(txt_4)

# ----
# 需要出图的钢结构编号
panel_48 = Panel(layer_7.LayerPathName)

reflay_15 = ReferenceByLayer(LayerName=panel_48)
cluster_4 = Cluster_3(
    structure_number=panel_48,
    tag_text=panel_16,
    text_offset=number_slider_16,
    embed_color=swatch_4,
    T=txt_4,
    G=reflay_15,
    A=number_slider_17,
    A_2=number_slider_18,
    B=number_slider_14,
    dimension_style=panel_17)  # -> R, G_2, R_2

# ----
# 要连接的梁中线Offest值
num_3 = Number(cluster_4.R)

# ----
# 要连接的梁中线curve
crv_38 = Curve(cluster_4.G_2)

# ----
# 要连接的embed
data_16 = Data(cluster_4.R_2)

# ----
# 依次连接
# embed
entwine = Entwine(Branch00=data_16, Branch01=data_15, Branch02=data_14, FlattenInputs=True)

# ----
# 依次连接
# curve
entwine_2 = Entwine(Branch00=crv_38, Branch01=crv_37, Branch02=crv_35, FlattenInputs=True)

# ----
# 依次连接
# 梁中线Offest值
entwine_3 = Entwine(Branch00=num_3, Branch01=num_2, Branch02=num, FlattenInputs=True)

# ----
# Rhino 文件中导入的块名
data_17 = Data(entwine)
item_8 = ListItem(List=data_17, Index=0, Wrap=True)
item_9 = ListItem(List=data_17, Index="-1", Wrap=True)
# 这里如果跑红也不要紧，
# 说明单体没有出现相撞的情况
data_18 = Data(entwine)
item_10 = ListItem(List=data_18, Index=0, Wrap=True)
item_11 = ListItem(List=data_18, Index="-1", Wrap=True)
data_19 = Data(entwine)
item_12 = ListItem(List=data_19, Index=0, Wrap=True)
item_13 = ListItem(List=data_19, Index="-1", Wrap=True)
rotate_3 = Rotate(Geometry=item_13, Angle="Pi", Plane=item_13)  # -> Geometry, Transform
data_20 = Data(entwine)
data_21 = Data(entwine)
item_14 = ListItem(List=data_20, Index=0, Wrap=True)
item_15 = ListItem(List=data_20, Index="-1", Wrap=True)
item_16 = ListItem(List=data_21, Index=0, Wrap=True)
item_17 = ListItem(List=data_21, Index="-1", Wrap=True)
rotate_4 = Rotate(Geometry=item_15, Angle="Pi", Plane=item_15)  # -> Geometry, Transform

layer_8 = DefineLayer(Name="Tag::1-1-02钢板焊埋件", Color=swatch_6)
layer_9 = DefineLayer(Name="Embed::1-1-02钢板焊埋件", Color=swatch_6)
entwine_4 = Entwine(Branch00=layer_9, Branch01=layer_8, FlattenInputs=True)
attributes_3 = DefineObjectAttributes(Layer=entwine_4, Color=swatch_6)

layer_10 = DefineLayer(Name="Tag::2-1-03钢板焊埋件", Color=swatch_8)
layer_11 = DefineLayer(Name="Embed::2-1-03钢板焊埋件", Color=swatch_8)
entwine_5 = Entwine(Branch00=layer_11, Branch01=layer_10, FlattenInputs=True)
attributes_4 = DefineObjectAttributes(Layer=entwine_5, Color=swatch_8)

layer_12 = DefineLayer(Name="Tag::1-0-01钢板焊埋件", Color=swatch_7)
layer_13 = DefineLayer(Name="Embed::1-0-01钢板焊埋件", Color=swatch_7)
entwine_6 = Entwine(Branch00=layer_13, Branch01=layer_12, FlattenInputs=True)
attributes_5 = DefineObjectAttributes(Layer=entwine_6, Color=swatch_7)

layer_14 = DefineLayer(Name="Tag::3-1-03钢板焊埋件", Color=swatch_9)
layer_15 = DefineLayer(Name="Embed::3-1-03钢板焊埋件", Color=swatch_9)
entwine_7 = Entwine(Branch00=layer_15, Branch01=layer_14, FlattenInputs=True)
attributes_6 = DefineObjectAttributes(Layer=entwine_7, Color=swatch_9)

layer_16 = DefineLayer(Name="Tag::3-2-03钢板焊埋件", Color=swatch_10)
layer_17 = DefineLayer(Name="Embed::3-2-03钢板焊埋件", Color=swatch_10)
entwine_8 = Entwine(Branch00=layer_17, Branch01=layer_16, FlattenInputs=True)
attributes_7 = DefineObjectAttributes(Layer=entwine_8, Color=swatch_10)

layer_18 = DefineLayer(Name="Tag::4-1钢板焊底埋", Color=swatch_11)
layer_19 = DefineLayer(Name="Embed::4-1钢板焊底埋", Color=swatch_11)
entwine_9 = Entwine(Branch00=layer_19, Branch01=layer_18, FlattenInputs=True)
attributes_8 = DefineObjectAttributes(Layer=entwine_9, Color=swatch_11)

layer_20 = DefineLayer(Name="Tag::5-04板埋", Color=swatch_13)
layer_21 = DefineLayer(Name="Embed::5-04板埋", Color=swatch_13)
entwine_10 = Entwine(Branch00=layer_21, Branch01=layer_20, FlattenInputs=True)
attributes_9 = DefineObjectAttributes(Layer=entwine_10, Color=swatch_13)

layer_22 = DefineLayer(Name="Tag::4-0-03默认钢板焊", Color=swatch_12)
layer_23 = DefineLayer(Name="Embed::4-0-03默认钢板焊", Color=swatch_12)
entwine_11 = Entwine(Branch00=layer_23, Branch01=layer_22, FlattenInputs=True)
attributes_10 = DefineObjectAttributes(Layer=entwine_11, Color=swatch_12)

crv_39 = Curve(join_2)
panel_49 = Panel("""Dimension::Dim1
Dimension::Dim2
Dimension::Dim3
Dimension::Dim4""")
layer_24 = DefineLayer(Name=panel_49)  # -> graft(Layer)
attributes_11 = DefineObjectAttributes(Layer=layer_24)

# ----
# 生成底埋钢埋件
rectangle = Rectangle(Plane=PlaneXY(0, 0, 0), XSize=panel_20, YSize=panel_21, Radius=0)  # -> Rectangle, Length
rec = Rectangle(rectangle.Rectangle)
pln_2 = Plane(rectangle.Rectangle)

deplane_4 = DeconstructPlane(Plane=pln_2)  # -> Origin, XAxis, YAxis, ZAxis
dedomain = DeconstructDomain(Domain=panel_21)  # -> Start, End
amp_4 = Amplitude(Vector=deplane_4.YAxis, Amplitude=dedomain.End)
move_4 = Move(Geometry=deplane_4.Origin, Motion=amp_4)  # -> Geometry, Transform
ln_6 = Line(StartPoint=deplane_4.Origin, EndPoint=move_4.Geometry)
amp_5 = Amplitude(Vector=ln_6, Amplitude=Slider(190, range=0..1000))
move_5 = Move(Geometry=deplane_4.Origin, Motion=amp_5)  # -> Geometry, Transform

text = DefineTextObject(Text=panel_19, Plane=move_5.Geometry, DimensionStyle=panel_22, OutputType="Text")
group = Group(Objects=[rec, text])
merge_2 = Merge(Data1=group, Data2=pln_2)

data_22 = Data(merge_2)
item_18 = ListItem(List=data_22, Index="-1", Wrap=True)
item_19 = ListItem(List=data_22, Index=0, Wrap=True)

crv_40 = Curve(join_2)
panel_50 = Panel("""Dimension::Dim1
Dimension::Dim2
Dimension::Dim3
Dimension::Dim4""")
layer_25 = DefineLayer(Name=panel_50)  # -> graft(Layer)
attributes_12 = DefineObjectAttributes(Layer=layer_25)

# ----
# 板埋：制作板埋三视图
max = Maximum(A=s_x, B=s_y)
filter_6 = StreamFilter(Gate=list, Stream0=7.2, Stream1=9.6, Stream2=11.9, Stream3=14.3, Stream4=16.7, Stream5=19.1)
filter_7 = StreamFilter(Gate=list_2, Stream0=270, Stream1=360)
filter_8 = StreamFilter(Gate=list_3, Stream0=10, Stream1=12, Stream2=16, Stream3=18, Stream4=20, Stream5=25)
filter_9 = StreamFilter(Gate=list, Stream0=0.91, Stream1=1.1, Stream2=1.27, Stream3=1.43, Stream4=1.57, Stream5=1.71)
filter_10 = StreamFilter(Gate=list_2, Stream0=0.16, Stream1=0.14)
addition = Addition(A=list_4, B=1)
addition_2 = Addition(A=list_5, B=1)
division = Division(A=max, B=8)
t = Integer(division)
panel_51 = Panel(filter_9)
panel_52 = Panel(filter_6)
panel_53 = Panel(filter_10)
min = Minimum(A=filter_7, B=300)
panel_54 = Panel(min)
expression = Expression(A=filter_10, fy=filter_7, ft=filter_9, d=filter_8, Expression="(int((0.6*1.1*A*fy/ft*d)/5)+1)*5")

# ----
# 测试Smooth Curve是否与每个Block相切
# blocks + smooth curves
# remove duplicate blocks
# blocks + special curves
deblock_4 = DeconstructBlock(Block=project_2.Geometry)  # -> Name, Plane, Geometry
pln_3 = Plane(flatten(deblock_4.Plane))
deplane_5 = DeconstructPlane(Plane=pln_3)  # -> Origin, XAxis, YAxis, ZAxis
cullduppoints_2 = RemoveDuplicatePoints(InputPoints=deplane_5.Origin, Tolerance=0.001)  # -> OutputPoints, FirstPointIndexes
null_2 = NullItem(Item=cullduppoints_2.FirstPointIndexes)  # -> NullFlags, InvalidFlags, Description
dispatch_6 = Dispatch(List=flatten(project_2.Geometry), DispatchPattern=null_2.InvalidFlags)  # -> ListA, ListB
dispatch_7 = Dispatch(List=pln_3, DispatchPattern=null_2.InvalidFlags)  # -> ListA, ListB
pln_4 = Plane(dispatch_7.ListA)
data_23 = Data(flatten(pln_4))
deplane_6 = DeconstructPlane(Plane=data_23)  # -> Origin, XAxis, YAxis, ZAxis
pln_5 = Plane(data_23)
amp_6 = Amplitude(Vector=deplane_6.YAxis, Amplitude=Slider(300, range=0..1000))
move_6 = Move(Geometry=deplane_6.Origin, Motion=amp_6)  # -> Geometry, Transform
ln_7 = Line(StartPoint=deplane_6.Origin, EndPoint=move_6.Geometry)
crv_41 = Curve(crv_16)
midpt_6 = CurveMiddle(Curve=ln_7)
scale_4 = Scale(Geometry=ln_7, Center=midpt_6, Factor=Slider(7.8, range=0..10))  # -> Geometry, Transform
merge_3 = Merge(Data1=scale_4.Geometry, Data2=crv_41)
mcx = MultipleCurves(Curves=flatten(merge_3))  # -> Points, IndexA, IndexB, ParamA, ParamB
item_20 = ListItem(List=pln_5, Index=mcx.IndexA, Wrap=True)
cull_i_2 = CullIndex(List=flatten(pln_5), Indices=mcx.IndexA, Wrap=True)
pln_6 = Plane(item_20)
pln_7 = Plane(cull_i_2)

deblock_5 = DeconstructBlock(Block=dispatch_6.ListA)  # -> Name, Plane, Geometry
data_24 = Data(dispatch_6.ListA)

item_21 = ListItem(List=flatten(data_24), Index=mcx.IndexA, Wrap=True)
cull_i_3 = CullIndex(List=flatten(data_24), Indices=mcx.IndexA, Wrap=True)
data_25 = Data(item_21)
data_26 = Data(cull_i_3)

# ----
# 找埋件定位点+区分阴阳角
# 测试Smooth Curve是否与每个Block相切
# blocks + smooth curves
# remove duplicate blocks
# blocks + special curves
deblock_6 = DeconstructBlock(Block=project.Geometry)  # -> Name, Plane, Geometry
pln_8 = Plane(flatten(deblock_6.Plane))
deplane_7 = DeconstructPlane(Plane=pln_8)  # -> Origin, XAxis, YAxis, ZAxis
cullduppoints_3 = RemoveDuplicatePoints(InputPoints=deplane_7.Origin, Tolerance=0.001)  # -> OutputPoints, FirstPointIndexes
null_3 = NullItem(Item=cullduppoints_3.FirstPointIndexes)  # -> NullFlags, InvalidFlags, Description
dispatch_8 = Dispatch(List=pln_8, DispatchPattern=null_3.InvalidFlags)  # -> ListA, ListB
dispatch_9 = Dispatch(List=flatten(project.Geometry), DispatchPattern=null_3.InvalidFlags)  # -> ListA, ListB
pln_9 = Plane(dispatch_8.ListA)
data_27 = Data(flatten(pln_9))
deplane_8 = DeconstructPlane(Plane=data_27)  # -> Origin, XAxis, YAxis, ZAxis
pln_10 = Plane(data_27)
amp_7 = Amplitude(Vector=deplane_8.YAxis, Amplitude=Slider(300, range=0..1000))
move_7 = Move(Geometry=deplane_8.Origin, Motion=amp_7)  # -> Geometry, Transform
crv_42 = Curve(crv_16)
ln_8 = Line(StartPoint=deplane_8.Origin, EndPoint=move_7.Geometry)
midpt_7 = CurveMiddle(Curve=ln_8)
scale_5 = Scale(Geometry=ln_8, Center=midpt_7, Factor=Slider(7.8, range=0..10))  # -> Geometry, Transform
merge_4 = Merge(Data1=scale_5.Geometry, Data2=crv_42)
mcx_2 = MultipleCurves(Curves=flatten(merge_4))  # -> Points, IndexA, IndexB, ParamA, ParamB
item_22 = ListItem(List=pln_10, Index=mcx_2.IndexA, Wrap=True)
cull_i_4 = CullIndex(List=flatten(pln_10), Indices=mcx_2.IndexA, Wrap=True)
pln_11 = Plane(item_22)
pln_12 = Plane(cull_i_4)

deblock_7 = DeconstructBlock(Block=dispatch_9.ListA)  # -> Name, Plane, Geometry
data_28 = Data(dispatch_9.ListA)

item_23 = ListItem(List=flatten(data_28), Index=mcx_2.IndexA, Wrap=True)
cull_i_5 = CullIndex(List=flatten(data_28), Indices=mcx_2.IndexA, Wrap=True)
data_29 = Data(item_23)
data_30 = Data(cull_i_5)

# ----
# 第一层
# 
# Special Curves(architecture line)
crv_43 = Curve(crv_10)
pln_13 = Plane(pln_12)
deplane_9 = DeconstructPlane(Plane=pln_13)  # -> Origin, XAxis, YAxis, ZAxis
disc_4 = Discontinuity(Curve=crv_43, Level=1)  # -> Points, Parameters
pull_3 = PullPoint(Point=deplane_9.Origin, Geometry=disc_4.Points, ClosestOnly=True)  # -> ClosestPoint, Distance
sort_6 = SortList(Keys=pull_3.Distance)  # -> reverse(Keys), ValuesA
panel_55 = Panel(sort_6.Keys)
larger_3 = LargerThan(FirstNumber=pull_3.Distance, SecondNumber=Slider(300, range=0..1000))  # -> LargerThan, OrEqualTo
dispatch_10 = Dispatch(List=pln_13, DispatchPattern=larger_3.LargerThan)  # -> ListA, ListB
data_31 = Data(dispatch_10.ListB)
deplane_10 = DeconstructPlane(Plane=data_31)  # -> Origin, XAxis, YAxis, ZAxis
pull_4 = PullPoint(Point=deplane_10.Origin, Geometry=disc_4.Points, ClosestOnly=True)  # -> ClosestPoint, Distance
pl_3 = ConstructPlane(Origin=pull_4.ClosestPoint, XAxis=deplane_10.XAxis, YAxis=deplane_10.YAxis)

# ----
# 板埋Modeling
multiplication = Multiplication(A=s_x, B=addition)
multiplication_2 = Multiplication(A=s_y, B=addition_2)
recgrid = Rectangular(Plane=PlaneXY(0, 0, 0), SizeX=s_x, SizeY=s_y, ExtentX=addition, ExtentY=addition_2)  # -> Cells, Points
直径 = Text(filter_8)
division_2 = Division(A=multiplication, B=2)
division_3 = Division(A=multiplication_2, B=2)
vec = VectorXYZ(XComponent=expr("-x", division_2), YComponent=expr("-x", division_3), ZComponent=0)  # -> Vector, Length
move_8 = Move(Geometry=recgrid.Points, Motion=vec.Vector)  # -> Geometry, Transform
division_4 = Division(A=直径, B=2)
cyl = Cylinder(Base=move_8.Geometry, Radius=division_4, Length=expr("-x", expression))
X = UnitX(Factor=直径)
multiplication_3 = Multiplication(A=直径, B=6)
edges = BrepEdges(Brep=cyl)  # -> Naked, Interior, NonManifold
item_24 = ListItem(List=edges.Naked, Index=0, Wrap=True)
max_2 = Maximum(A=multiplication_3, B=70)
move_9 = Move(Geometry=item_24, Motion=X)  # -> Geometry, Transform
multiplication_4 = Multiplication(A=max_2, B=2)
addition_3 = Addition(A=multiplication, B=multiplication_4)
addition_4 = Addition(A=multiplication_2, B=multiplication_4)
division_5 = Division(A=t, B=2)
expression_2 = Expression(x=addition_4, Expression="Ceiling(x/10)*10/2")
expression_3 = Expression(x=addition_3, Expression="Ceiling(x/10)*10/2")
round = Round(Number=division_5)  # -> Nearest, Floor, Ceiling
multiplication_5 = Multiplication(A=round.Ceiling, B=2)
dom = ConstructDomain(DomainStart=expr("-x", expression_2), DomainEnd=expression_2)
dom_2 = ConstructDomain(DomainStart=expr("-x", expression_3), DomainEnd=expression_3)
box = DomainBox(Base=PlaneXY(0, 0, 0), X=dom_2, Y=dom, Z=multiplication_5)
Z = UnitZ(Factor=expr("-x", multiplication_5))

multiplication_6 = Multiplication(A=直径, B=5)

Z_2 = UnitZ(Factor=multiplication_6)
extr = Extrude(Base=move_9.Geometry, Direction=Z_2)
cap = CapHoles(Brep=[extr, cyl])
merge_5 = Merge(Data1=cap, Data2=box)
flatten_3 = FlattenTree(Tree=merge_5, Path="{0}")
move_10 = Move(Geometry=flatten_3, Motion=Z)  # -> Geometry, Transform

geo_4 = Geometry(project_3.Geometry)
boundary_2 = BoundarySurfaces(Edges=geo_4)
area_5 = Area(Geometry=boundary_2)  # -> Area, Centroid
cullduppoints_4 = RemoveDuplicatePoints(InputPoints=area_5.Centroid, Tolerance=Slider(0.1, range=0..0.1))  # -> OutputPoints, FirstPointIndexes
null_4 = NullItem(Item=cullduppoints_4.FirstPointIndexes)  # -> NullFlags, InvalidFlags, Description
dispatch_11 = Dispatch(List=boundary_2, DispatchPattern=null_4.NullFlags)  # -> ListA, ListB
geo_5 = Geometry(dispatch_11.ListA)
crv_44 = Curve(crv_16)
area_6 = Area(Geometry=geo_5)  # -> Area, Centroid
pull_5 = PullPoint(Point=area_6.Centroid, Geometry=crv_44, ClosestOnly=True)  # -> ClosestPoint, Distance
neg_4 = Negative(Value="0.5 * Pi")
neg_5 = Negative(Value="1.5 * Pi")
filter_11 = StreamFilter(Gate=Toggle(True), Stream0="0.5 * Pi", Stream1=neg_4)
filter_12 = StreamFilter(Gate=Toggle(True), Stream0="1.5 * Pi", Stream1=neg_5)
crv_45 = Curve(crv_16)

# ----
# 第一层
# 
# Angular Curves(architecture line)
crv_46 = Curve(crv_18)
disc_5 = Discontinuity(Curve=crv_46, Level=1)  # -> Points, Parameters
end_4 = EndPoints(Curve=crv_46)  # -> Start, End
flatten_4 = FlattenTree(Tree=disc_5.Points, Path="{0}")

# ----
# 第一层
# 
# Angular Curves(architecture line)
number_slider_47 = Slider(84, range=0..1000)
crv_47 = Curve(crv_9)
disc_6 = Discontinuity(Curve=crv_47, Level=1)  # -> Points, Parameters
end_5 = EndPoints(Curve=crv_47)  # -> Start, End
flatten_5 = FlattenTree(Tree=disc_6.Points, Path="{0}")

# ----
# 第一层
# 
# Curves(location point)+ Smooth Curves(architecture line)
clscrv = CloseCurve(Curve=crv_15, CloseType=0, Bulge=0.5, Tolerance=0)  # -> Closed, R
crv_48 = Curve(crv_16)
disc_7 = Discontinuity(Curve=graft(crv_48), Level=1)  # -> Points, Parameters
crv_cp_2 = CurveClosestPoint(Point=disc_7.Points, Curve=graft(crv_48))  # -> Point, Parameter, Distance
eval_4 = EvaluateCurve(Curve=graft(crv_48), Parameter=crv_cp_2.Parameter)  # -> flatten(Point), Tangent, flatten(Angle)
deg_2 = Degrees(Radians=eval_4.Angle)
offset_9 = OffsetCurve(Curve=clscrv.Closed, Distance=expr("-X", Slider(300, range=0..1000)), Corners=1)
panel_56 = Panel(deg_2)
larger_4 = LargerThan(FirstNumber=deg_2, SecondNumber=Slider(60, range=0..100))  # -> LargerThan, OrEqualTo
disc_8 = Discontinuity(Curve=offset_9, Level=1)  # -> flatten(Points), Parameters
dispatch_12 = Dispatch(List=eval_4.Point, DispatchPattern=larger_4.LargerThan)  # -> ListA, ListB
data_32 = Data(dispatch_12.ListA)
pull_6 = PullPoint(Point=data_32, Geometry=flatten(offset_9), ClosestOnly=True)  # -> ClosestPoint, Distance
pull_7 = PullPoint(Point=flatten(pln_11), Geometry=crv_48, ClosestOnly=True)  # -> ClosestPoint, Distance
testpoint_2 = TestPoint(archPoint=pull_6.ClosestPoint, crvPoint=disc_8.Points)  # -> out, specialPt; inputs archPoint: list of Point3d, crvPoint: list of Point3d; same code as testpoint
pull_8 = PullPoint(Point=pull_7.ClosestPoint, Geometry=data_32, ClosestOnly=True)  # -> ClosestPoint, Distance
flatten_6 = FlattenTree(Tree=data_29, Path="{0}")
sort_7 = SortList(Keys=pull_8.Distance, ValuesA=flatten_6)  # -> Keys, ValuesA
panel_57 = Panel(sort_7.Keys)
smaller_3 = SmallerThan(FirstNumber=sort_7.Keys, SecondNumber=Slider(100, range=0..100))  # -> SmallerThan, OrEqualTo
dispatch_13 = Dispatch(List=sort_7.ValuesA, DispatchPattern=smaller_3.SmallerThan)  # -> ListA, ListB
data_33 = Data(dispatch_13.ListA)
deblock_8 = DeconstructBlock(Block=data_33)  # -> Name, Plane, Geometry
deplane_11 = DeconstructPlane(Plane=deblock_8.Plane)  # -> Origin, XAxis, YAxis, ZAxis
pt = Point(data_32)
pull_9 = PullPoint(Point=deplane_11.Origin, Geometry=pt, ClosestOnly=True)  # -> ClosestPoint, Distance
cir = Circle(Plane=pull_9.ClosestPoint, Radius=Slider(300, range=0..1000))
crv_49 = Curve(crv_48)
amp_8 = Amplitude(Vector=deplane_11.YAxis, Amplitude=Slider(200, range=0..1000))
ccx_4 = CurveCurve(CurveA=cir, CurveB=crv_49)  # -> Points, ParamsA, ParamsB
move_11 = Move(Geometry=pull_9.ClosestPoint, Motion=amp_8)  # -> Geometry, Transform
item_25 = ListItem(List=ccx_4.Points, Index=0, Wrap=True)
clean = CleanTree(RemoveNulls=True, RemoveInvalid=True, RemoveEmpty=Toggle(True), Tree=item_25)
ln_9 = Line(StartPoint=pull_9.ClosestPoint, EndPoint=clean)
ln_10 = Line(StartPoint=pull_9.ClosestPoint, EndPoint=move_11.Geometry)
angle = Angle(VectorA=ln_10, VectorB=ln_9)  # -> Angle, Reflex
deg_3 = Degrees(Radians=angle.Angle)
flatten_7 = FlattenTree(Tree=deg_3, Path="{0}")
panel_58 = Panel(flatten_7)
c_script = CSharpScript(angle=flatten_7, minus=Slider(80, range=0..100))  # -> out, results; inputs angle: list of Double, minus: Double
# ---------- c_script: C# ----------
    List<double> MyAngle = new List<double>();
    for(int i = 0; i < angle.Count; i++){
      if (angle[i] > minus){
        angleEach = angle[i] - 90;
        Print("!!!!!!!!");
        MyAngle.Add(angleEach);
      }
      else{
        angleEach = angle[i];
        Print("00000");
        MyAngle.Add(angleEach);
      }

    }

    results = MyAngle;
# ---------- c_script: C# additional code ----------
  double angleEach = 0;
# ---------- end c_script ----------
larger_5 = LargerThan(FirstNumber=c_script.results, SecondNumber=Slider(30, range=0..100))  # -> LargerThan, OrEqualTo
panel_59 = Panel(c_script.results)
dispatch_14 = Dispatch(List=flatten(data_33), DispatchPattern=flatten(larger_5.LargerThan))  # -> ListA, ListB
data_34 = Data(dispatch_14.ListA)
deblock_9 = DeconstructBlock(Block=data_34)  # -> Name, Plane, Geometry
pln_14 = Plane(flatten(pln_11))
deplane_12 = DeconstructPlane(Plane=flatten(deblock_9.Plane))  # -> Origin, XAxis, YAxis, ZAxis
deplane_13 = DeconstructPlane(Plane=pln_14)  # -> Origin, XAxis, YAxis, ZAxis
testpoint_3 = TestPoint(archPoint=deplane_13.Origin, crvPoint=deplane_12.Origin)  # -> out, specialPt; inputs archPoint: list of Point3d, crvPoint: list of Point3d; same code as testpoint
cull_i_6 = CullIndex(List=pln_14, Indices=testpoint_3.specialPt, Wrap=True)
pln_15 = Plane(deblock_9.Plane)
crv_50 = Curve(crv_16)
pln_16 = Plane(cull_i_6)
data_35 = Data(flatten(pln_16))
deplane_14 = DeconstructPlane(Plane=data_35)  # -> Origin, XAxis, YAxis, ZAxis
amp_9 = Amplitude(Vector=deplane_14.YAxis, Amplitude=Slider(300, range=0..1000))
move_12 = Move(Geometry=deplane_14.Origin, Motion=amp_9)  # -> Geometry, Transform
ln_11 = Line(StartPoint=deplane_14.Origin, EndPoint=move_12.Geometry)
midpt_8 = CurveMiddle(Curve=ln_11)
scale_6 = Scale(Geometry=ln_11, Center=midpt_8, Factor=Slider(4.7, range=0..10))  # -> Geometry, Transform
ccx_5 = CurveCurve(CurveA=graft(scale_6.Geometry), CurveB=crv_50)  # -> flatten(Points), ParamsA, ParamsB
move2pt_6 = MoveToPoint(Geometry=data_35, PointA=deplane_14.Origin, PointB=ccx_5.Points)  # -> Moved, Vector, Transform

crv_51 = Curve(clscrv.Closed)
offset_10 = OffsetCurve(Curve=crv_51, Distance=expr("-x", Slider(84, range=0..1000)), Corners=1)  # -> flatten(Curve)
pull_10 = PullPoint(Point=disc_5.Points, Geometry=offset_10, ClosestOnly=True)  # -> ClosestPoint, Distance
disc_9 = Discontinuity(Curve=offset_10, Level=1)  # -> Points, Parameters
pull_11 = PullPoint(Point=flatten(pull_10.ClosestPoint), Geometry=flatten(disc_9.Points), ClosestOnly=True)  # -> ClosestPoint, Distance
check_same_points = CheckSamePoints(archPoint=flatten(pull_10.ClosestPoint), crvPoint=flatten(pull_11.ClosestPoint))  # -> out, specialPt; inputs archPoint: list of Point3d, crvPoint: list of Point3d; same code as testpoint
cull_i_7 = CullIndex(List=flatten(disc_5.Points), Indices=check_same_points.specialPt, Wrap=True)
merge_6 = Merge(Data1=end_4.Start, Data2=end_4.End, Data3=cull_i_7)
check_same_points_2 = CheckSamePoints(archPoint=flatten(flatten_4), crvPoint=flatten(merge_6))  # -> out, specialPt; inputs archPoint: list of Point3d, crvPoint: list of Point3d; same code as testpoint
cull_i_8 = CullIndex(List=flatten(flatten_4), Indices=check_same_points_2.specialPt, Wrap=True)
pull_12 = PullPoint(Point=cull_i_8, Geometry=offset_10, ClosestOnly=True)  # -> ClosestPoint, Distance
ln_12 = Line(StartPoint=cull_i_8, EndPoint=pull_12.ClosestPoint)
rotate_5 = Rotate(Geometry=ln_12, Angle="Pi", Plane=cull_i_8)  # -> Geometry, Transform
rotate_6 = Rotate(Geometry=rotate_5.Geometry, Angle=-1.570796327, Plane=cull_i_8)  # -> Geometry, Transform
pl_4 = ConstructPlane(Origin=cull_i_8, XAxis=rotate_5.Geometry, YAxis=rotate_6.Geometry)

crv_52 = Curve(clscrv.Closed)
offset_11 = OffsetCurve(Curve=crv_52, Distance=expr("-x", number_slider_47), Corners=1)  # -> flatten(Curve)
pull_13 = PullPoint(Point=disc_6.Points, Geometry=offset_11, ClosestOnly=True)  # -> ClosestPoint, Distance
disc_10 = Discontinuity(Curve=offset_11, Level=1)  # -> Points, Parameters
pull_14 = PullPoint(Point=flatten(pull_13.ClosestPoint), Geometry=flatten(disc_10.Points), ClosestOnly=True)  # -> ClosestPoint, Distance
check_same_points_3 = CheckSamePoints(archPoint=flatten(pull_13.ClosestPoint), crvPoint=flatten(pull_14.ClosestPoint))  # -> out, specialPt; inputs archPoint: list of Point3d, crvPoint: list of Point3d; same code as testpoint
cull_i_9 = CullIndex(List=flatten(disc_6.Points), Indices=check_same_points_3.specialPt, Wrap=True)
merge_7 = Merge(Data1=end_5.Start, Data2=end_5.End, Data3=cull_i_9)
check_same_points_4 = CheckSamePoints(archPoint=flatten(flatten_5), crvPoint=flatten(merge_7))  # -> out, specialPt; inputs archPoint: list of Point3d, crvPoint: list of Point3d; same code as testpoint
cull_i_10 = CullIndex(List=flatten(flatten_5), Indices=check_same_points_4.specialPt, Wrap=True)
pull_15 = PullPoint(Point=cull_i_10, Geometry=offset_11, ClosestOnly=True)  # -> ClosestPoint, Distance
ln_13 = Line(StartPoint=cull_i_10, EndPoint=pull_15.ClosestPoint)
rotate_7 = Rotate(Geometry=ln_13, Angle="Pi", Plane=cull_i_10)  # -> Geometry, Transform
rotate_8 = Rotate(Geometry=ln_13, Angle=1.570796327, Plane=cull_i_10)  # -> Geometry, Transform
pl_5 = ConstructPlane(Origin=cull_i_10, XAxis=rotate_7.Geometry, YAxis=rotate_8.Geometry)

# ----
# 阳角
item_26 = ListItem(List=data_32, Index=testpoint_2.specialPt, Wrap=True)

# ----
# 阴角
cull_i_11 = CullIndex(List=data_32, Indices=testpoint_2.specialPt, Wrap=True)

dist_3 = Distance(PointA=graft(deplane_12.Origin), PointB=item_26)
sort_8 = SortList(Keys=dist_3)  # -> Keys, ValuesA
item_27 = ListItem(List=sort_8.Keys, Index=0, Wrap=True)
flatten_8 = FlattenTree(Tree=item_27, Path="{0}")
smaller_4 = SmallerThan(FirstNumber=item_27, SecondNumber=Slider(100, range=0..300))  # -> SmallerThan, OrEqualTo
panel_60 = Panel(flatten_8)
dispatch_15 = Dispatch(List=graft(pln_15), DispatchPattern=smaller_4.SmallerThan)  # -> ListA, ListB
data_36 = Data(flatten(dispatch_15.ListA))
data_37 = Data(flatten(dispatch_15.ListB))
deplane_15 = DeconstructPlane(Plane=data_36)  # -> Origin, XAxis, YAxis, ZAxis
deplane_16 = DeconstructPlane(Plane=data_37)  # -> Origin, XAxis, YAxis, ZAxis
amp_10 = Amplitude(Vector=deplane_15.YAxis, Amplitude=Slider(300, range=0..1000))
amp_11 = Amplitude(Vector=deplane_16.YAxis, Amplitude=Slider(300, range=0..1000))
move_13 = Move(Geometry=deplane_15.Origin, Motion=amp_10)  # -> Geometry, Transform
move_14 = Move(Geometry=deplane_16.Origin, Motion=amp_11)  # -> Geometry, Transform
ln_14 = Line(StartPoint=deplane_15.Origin, EndPoint=move_13.Geometry)
ln_15 = Line(StartPoint=deplane_16.Origin, EndPoint=move_14.Geometry)
midpt_9 = CurveMiddle(Curve=ln_14)
midpt_10 = CurveMiddle(Curve=ln_15)
scale_7 = Scale(Geometry=ln_14, Center=midpt_9, Factor=Slider(1.5, range=0..10))  # -> Geometry, Transform
scale_8 = Scale(Geometry=ln_15, Center=midpt_10, Factor=Slider(1.5, range=0..10))  # -> Geometry, Transform
ccx_6 = CurveCurve(CurveA=graft(scale_7.Geometry), CurveB=crv_50)  # -> flatten(Points), ParamsA, ParamsB
ccx_7 = CurveCurve(CurveA=graft(scale_8.Geometry), CurveB=crv_50)  # -> flatten(Points), ParamsA, ParamsB
move2pt_7 = MoveToPoint(Geometry=data_36, PointA=deplane_15.Origin, PointB=ccx_6.Points)  # -> Moved, Vector, Transform
move2pt_8 = MoveToPoint(Geometry=data_37, PointA=deplane_16.Origin, PointB=ccx_7.Points)  # -> Moved, Vector, Transform

clscrv_2 = CloseCurve(Curve=crv_15, CloseType=0, Bulge=0.5, Tolerance=0)  # -> Closed, R
crv_53 = Curve(crv_16)
disc_11 = Discontinuity(Curve=graft(crv_53), Level=1)  # -> Points, Parameters
crv_cp_3 = CurveClosestPoint(Point=disc_11.Points, Curve=graft(crv_53))  # -> Point, Parameter, Distance
eval_5 = EvaluateCurve(Curve=graft(crv_53), Parameter=crv_cp_3.Parameter)  # -> flatten(Point), Tangent, flatten(Angle)
deg_4 = Degrees(Radians=eval_5.Angle)
offset_12 = OffsetCurve(Curve=clscrv_2.Closed, Distance=expr("-X", Slider(300, range=0..1000)), Corners=1)
panel_61 = Panel(deg_4)
larger_6 = LargerThan(FirstNumber=deg_4, SecondNumber=Slider(60, range=0..100))  # -> LargerThan, OrEqualTo
disc_12 = Discontinuity(Curve=offset_12, Level=1)  # -> flatten(Points), Parameters
dispatch_16 = Dispatch(List=eval_5.Point, DispatchPattern=larger_6.LargerThan)  # -> ListA, ListB
data_38 = Data(dispatch_16.ListA)
pull_16 = PullPoint(Point=data_38, Geometry=flatten(offset_12), ClosestOnly=True)  # -> ClosestPoint, Distance
testpoint_4 = TestPoint(archPoint=pull_16.ClosestPoint, crvPoint=disc_12.Points)  # -> out, specialPt; inputs archPoint: list of Point3d, crvPoint: list of Point3d; same code as testpoint
pull_17 = PullPoint(Point=flatten(pln_6), Geometry=crv_53, ClosestOnly=True)  # -> ClosestPoint, Distance
pull_18 = PullPoint(Point=pull_17.ClosestPoint, Geometry=data_38, ClosestOnly=True)  # -> ClosestPoint, Distance
flatten_9 = FlattenTree(Tree=data_25, Path="{0}")
sort_9 = SortList(Keys=pull_18.Distance, ValuesA=flatten_9)  # -> Keys, ValuesA
panel_62 = Panel(sort_9.Keys)
smaller_5 = SmallerThan(FirstNumber=sort_9.Keys, SecondNumber=Slider(100, range=0..100))  # -> SmallerThan, OrEqualTo
dispatch_17 = Dispatch(List=sort_9.ValuesA, DispatchPattern=smaller_5.SmallerThan)  # -> ListA, ListB
data_39 = Data(dispatch_17.ListA)
deblock_10 = DeconstructBlock(Block=data_39)  # -> Name, Plane, Geometry
deplane_17 = DeconstructPlane(Plane=deblock_10.Plane)  # -> Origin, XAxis, YAxis, ZAxis
pt_2 = Point(data_38)
pull_19 = PullPoint(Point=deplane_17.Origin, Geometry=pt_2, ClosestOnly=True)  # -> ClosestPoint, Distance
cir_2 = Circle(Plane=pull_19.ClosestPoint, Radius=Slider(300, range=0..1000))
crv_54 = Curve(crv_53)
amp_12 = Amplitude(Vector=deplane_17.YAxis, Amplitude=Slider(200, range=0..1000))
ccx_8 = CurveCurve(CurveA=cir_2, CurveB=crv_54)  # -> Points, ParamsA, ParamsB
move_15 = Move(Geometry=pull_19.ClosestPoint, Motion=amp_12)  # -> Geometry, Transform
item_28 = ListItem(List=ccx_8.Points, Index=0, Wrap=True)
clean_2 = CleanTree(RemoveNulls=True, RemoveInvalid=True, RemoveEmpty=Toggle(True), Tree=item_28)
item_29 = ListItem(List=data_38, Index=testpoint_4.specialPt, Wrap=True)
cull_i_12 = CullIndex(List=data_38, Indices=testpoint_4.specialPt, Wrap=True)
ln_16 = Line(StartPoint=pull_19.ClosestPoint, EndPoint=clean_2)
ln_17 = Line(StartPoint=pull_19.ClosestPoint, EndPoint=move_15.Geometry)
angle_2 = Angle(VectorA=ln_17, VectorB=ln_16)  # -> Angle, Reflex
deg_5 = Degrees(Radians=angle_2.Angle)
flatten_10 = FlattenTree(Tree=deg_5, Path="{0}")
panel_63 = Panel(flatten_10)
c_script_2 = CSharpScript(angle=flatten_10, minus=Slider(80, range=0..100))  # -> out, results; inputs angle: list of Double, minus: Double; same code as c_script
larger_7 = LargerThan(FirstNumber=c_script_2.results, SecondNumber=Slider(30, range=0..100))  # -> LargerThan, OrEqualTo
panel_64 = Panel(c_script_2.results)
dispatch_18 = Dispatch(List=flatten(data_39), DispatchPattern=flatten(larger_7.LargerThan))  # -> ListA, ListB
data_40 = Data(dispatch_18.ListA)
deblock_11 = DeconstructBlock(Block=data_40)  # -> Name, Plane, Geometry
pln_17 = Plane(flatten(pln_6))
deplane_18 = DeconstructPlane(Plane=flatten(deblock_11.Plane))  # -> Origin, XAxis, YAxis, ZAxis
deplane_19 = DeconstructPlane(Plane=pln_17)  # -> Origin, XAxis, YAxis, ZAxis
testpoint_5 = TestPoint(archPoint=deplane_19.Origin, crvPoint=deplane_18.Origin)  # -> out, specialPt; inputs archPoint: list of Point3d, crvPoint: list of Point3d; same code as testpoint
cull_i_13 = CullIndex(List=pln_17, Indices=testpoint_5.specialPt, Wrap=True)
pln_18 = Plane(deblock_11.Plane)
dist_4 = Distance(PointA=graft(deplane_18.Origin), PointB=item_29)
sort_10 = SortList(Keys=dist_4)  # -> Keys, ValuesA
item_30 = ListItem(List=sort_10.Keys, Index=0, Wrap=True)
flatten_11 = FlattenTree(Tree=item_30, Path="{0}")
smaller_6 = SmallerThan(FirstNumber=item_30, SecondNumber=Slider(100, range=0..300))  # -> SmallerThan, OrEqualTo
panel_65 = Panel(flatten_11)
dispatch_19 = Dispatch(List=graft(pln_18), DispatchPattern=smaller_6.SmallerThan)  # -> ListA, ListB
crv_55 = Curve(crv_16)
pln_19 = Plane(cull_i_13)

data_41 = Data(flatten(dispatch_19.ListB))
deplane_20 = DeconstructPlane(Plane=data_41)  # -> Origin, XAxis, YAxis, ZAxis
amp_13 = Amplitude(Vector=deplane_20.YAxis, Amplitude=Slider(300, range=0..1000))
move_16 = Move(Geometry=deplane_20.Origin, Motion=amp_13)  # -> Geometry, Transform
ln_18 = Line(StartPoint=deplane_20.Origin, EndPoint=move_16.Geometry)
midpt_11 = CurveMiddle(Curve=ln_18)
scale_9 = Scale(Geometry=ln_18, Center=midpt_11, Factor=Slider(1.5, range=0..10))  # -> Geometry, Transform
ccx_9 = CurveCurve(CurveA=graft(scale_9.Geometry), CurveB=crv_55)  # -> flatten(Points), ParamsA, ParamsB

data_42 = Data(flatten(dispatch_19.ListA))
deplane_21 = DeconstructPlane(Plane=data_42)  # -> Origin, XAxis, YAxis, ZAxis
amp_14 = Amplitude(Vector=deplane_21.YAxis, Amplitude=Slider(300, range=0..1000))
move_17 = Move(Geometry=deplane_21.Origin, Motion=amp_14)  # -> Geometry, Transform
ln_19 = Line(StartPoint=deplane_21.Origin, EndPoint=move_17.Geometry)
midpt_12 = CurveMiddle(Curve=ln_19)
scale_10 = Scale(Geometry=ln_19, Center=midpt_12, Factor=Slider(1.5, range=0..10))  # -> Geometry, Transform
ccx_10 = CurveCurve(CurveA=graft(scale_10.Geometry), CurveB=crv_55)  # -> flatten(Points), ParamsA, ParamsB

data_43 = Data(flatten(pln_19))
deplane_22 = DeconstructPlane(Plane=data_43)  # -> Origin, XAxis, YAxis, ZAxis
amp_15 = Amplitude(Vector=deplane_22.YAxis, Amplitude=Slider(300, range=0..1000))
move_18 = Move(Geometry=deplane_22.Origin, Motion=amp_15)  # -> Geometry, Transform
ln_20 = Line(StartPoint=deplane_22.Origin, EndPoint=move_18.Geometry)
midpt_13 = CurveMiddle(Curve=ln_20)
scale_11 = Scale(Geometry=ln_20, Center=midpt_13, Factor=Slider(4.7, range=0..10))  # -> Geometry, Transform
ccx_11 = CurveCurve(CurveA=graft(scale_11.Geometry), CurveB=crv_55)  # -> flatten(Points), ParamsA, ParamsB

move2pt_9 = MoveToPoint(Geometry=data_43, PointA=deplane_22.Origin, PointB=ccx_11.Points)  # -> Moved, Vector, Transform
move2pt_10 = MoveToPoint(Geometry=data_42, PointA=deplane_21.Origin, PointB=ccx_10.Points)  # -> Moved, Vector, Transform
move2pt_11 = MoveToPoint(Geometry=data_41, PointA=deplane_20.Origin, PointB=ccx_9.Points)  # -> Moved, Vector, Transform
xy_17 = XYPlane(Origin=move2pt_9.Moved)
xy_18 = XYPlane(Origin=move2pt_10.Moved)
xy_19 = XYPlane(Origin=move2pt_11.Moved)
rotate_9 = Rotate(Geometry=move2pt_9.Moved, Angle="Pi", Plane=xy_17)  # -> Geometry, Transform
rotate_10 = Rotate(Geometry=move2pt_10.Moved, Angle="Pi", Plane=xy_18)  # -> Geometry, Transform
rotate_11 = Rotate(Geometry=move2pt_11.Moved, Angle="Pi", Plane=xy_19)  # -> Geometry, Transform
filter_13 = StreamFilter(Gate=Toggle(True), Stream0=move2pt_10.Moved, Stream1=rotate_10.Geometry)
filter_14 = StreamFilter(Gate=Toggle(True), Stream0=move2pt_11.Moved, Stream1=rotate_11.Geometry)
filter_15 = StreamFilter(Gate=Toggle(True), Stream0=move2pt_9.Moved, Stream1=rotate_9.Geometry)

dist_5 = Distance(PointA=pull_5.ClosestPoint, PointB=data_32)
sort_11 = SortList(Keys=dist_5)  # -> Keys, ValuesA
panel_66 = Panel(sort_11.Keys)
smaller_7 = SmallerThan(FirstNumber=dist_5, SecondNumber=Slider(200, range=0..1000))  # -> SmallerThan, OrEqualTo
dispatch_20 = Dispatch(List=geo_5, DispatchPattern=smaller_7.SmallerThan)  # -> ListA, ListB
data_44 = Data(dispatch_20.ListB)
explode_4 = Explode(Curve=data_44, Recursive=True)  # -> Segments, Vertices
len_4 = Length(Curve=explode_4.Segments)
sort_12 = SortList(Keys=reverse(len_4), ValuesA=explode_4.Segments)  # -> Keys, ValuesA
item_31 = ListItem(List=sort_12.ValuesA, Index=0, Wrap=True)  # -> flatten(Item)
area_7 = Area(Geometry=data_44)  # -> Area, Centroid
midpt_14 = CurveMiddle(Curve=item_31)
move2pt_12 = MoveToPoint(Geometry=item_31, PointA=midpt_14, PointB=area_7.Centroid)  # -> Moved, Vector, Transform
end_6 = EndPoints(Curve=move2pt_12.Moved)  # -> Start, End
pull_20 = PullPoint(Point=end_6.Start, Geometry=crv_44, ClosestOnly=True)  # -> ClosestPoint, Distance
crv_cp_4 = CurveClosestPoint(Point=graft(pull_20.ClosestPoint), Curve=crv_44)  # -> Point, Parameter, Distance
eval_6 = EvaluateCurve(Curve=crv_44, Parameter=crv_cp_4.Parameter)  # -> Point, Tangent, Angle
pull_21 = PullPoint(Point=eval_6.Point, Geometry=pull_20.ClosestPoint, ClosestOnly=True)  # -> ClosestPoint, Distance
sort_13 = SortList(Keys=pull_21.Distance, ValuesA=eval_6.Point)  # -> Keys, ValuesA
sort_14 = SortList(Keys=pull_21.Distance, ValuesA=eval_6.Tangent)  # -> Keys, ValuesA
item_32 = ListItem(List=sort_14.ValuesA, Index="0", Wrap=True)
item_33 = ListItem(List=sort_13.ValuesA, Index="0", Wrap=True)
amp_16 = Amplitude(Vector=item_32, Amplitude=Slider(100, range=0..100))
move_19 = Move(Geometry=item_33, Motion=amp_16)  # -> Geometry, Transform
xy_20 = XYPlane(Origin=item_33)
rotate_12 = Rotate(Geometry=move_19.Geometry, Angle="1 * Pi", Plane=xy_20)  # -> Geometry, Transform
ln_21 = Line(StartPoint=item_33, EndPoint=rotate_12.Geometry)
rotate_13 = Rotate(Geometry=ln_21, Angle=filter_12, Plane=xy_20)  # -> Geometry, Transform
pl_6 = ConstructPlane(Origin=move_19.Geometry, XAxis=ln_21, YAxis=rotate_13.Geometry)

# ----
# 转角点
data_45 = Data(dispatch_20.ListA)

explode_5 = Explode(Curve=data_45, Recursive=True)  # -> Segments, Vertices
len_5 = Length(Curve=explode_5.Segments)
sort_15 = SortList(Keys=reverse(len_5), ValuesA=explode_5.Segments)  # -> Keys, ValuesA
item_34 = ListItem(List=sort_15.ValuesA, Index=0, Wrap=True)  # -> flatten(Item)
area_8 = Area(Geometry=data_45)  # -> Area, Centroid
midpt_15 = CurveMiddle(Curve=item_34)
move2pt_13 = MoveToPoint(Geometry=item_34, PointA=midpt_15, PointB=area_8.Centroid)  # -> Moved, Vector, Transform
end_7 = EndPoints(Curve=move2pt_13.Moved)  # -> Start, End
ln_22 = Line(StartPoint=end_7.Start, EndPoint=end_7.End)
xy_21 = XYPlane(Origin=end_7.End)
rotate_14 = Rotate(Geometry=ln_22, Angle=filter_11, Plane=xy_21)  # -> Geometry, Transform
pl_7 = ConstructPlane(Origin=end_7.End, XAxis=rotate_14.Geometry, YAxis=ln_22)
dist_6 = Distance(PointA=graft(end_7.End), PointB=item_26)
sort_16 = SortList(Keys=dist_6)  # -> Keys, ValuesA
item_35 = ListItem(List=sort_16.Keys, Index=0, Wrap=True)
smaller_8 = SmallerThan(FirstNumber=item_35, SecondNumber=Slider(100, range=0..300))  # -> SmallerThan, OrEqualTo
flatten_12 = FlattenTree(Tree=item_35, Path="{0}")
dispatch_21 = Dispatch(List=graft(pl_7), DispatchPattern=smaller_8.SmallerThan)  # -> ListA, ListB
panel_67 = Panel(flatten_12)
data_46 = Data(flatten(dispatch_21.ListA))
data_47 = Data(flatten(dispatch_21.ListB))
deplane_23 = DeconstructPlane(Plane=data_46)  # -> Origin, XAxis, YAxis, ZAxis
deplane_24 = DeconstructPlane(Plane=data_47)  # -> Origin, XAxis, YAxis, ZAxis
amp_17 = Amplitude(Vector=deplane_23.YAxis, Amplitude=Slider(300, range=0..1000))
amp_18 = Amplitude(Vector=deplane_24.YAxis, Amplitude=Slider(300, range=0..1000))
move_20 = Move(Geometry=deplane_23.Origin, Motion=amp_17)  # -> Geometry, Transform
move_21 = Move(Geometry=deplane_24.Origin, Motion=amp_18)  # -> Geometry, Transform
ln_23 = Line(StartPoint=deplane_23.Origin, EndPoint=move_20.Geometry)
ln_24 = Line(StartPoint=deplane_24.Origin, EndPoint=move_21.Geometry)
midpt_16 = CurveMiddle(Curve=ln_23)
midpt_17 = CurveMiddle(Curve=ln_24)
scale_12 = Scale(Geometry=ln_23, Center=midpt_16, Factor=Slider(1.5, range=0..10))  # -> Geometry, Transform
scale_13 = Scale(Geometry=ln_24, Center=midpt_17, Factor=Slider(1.5, range=0..10))  # -> Geometry, Transform
ccx_12 = CurveCurve(CurveA=graft(scale_13.Geometry), CurveB=crv_45)  # -> flatten(Points), ParamsA, ParamsB
ccx_13 = CurveCurve(CurveA=graft(scale_12.Geometry), CurveB=crv_45)  # -> flatten(Points), ParamsA, ParamsB
move2pt_14 = MoveToPoint(Geometry=data_46, PointA=deplane_23.Origin, PointB=ccx_13.Points)  # -> Moved, Vector, Transform
move2pt_15 = MoveToPoint(Geometry=data_47, PointA=deplane_24.Origin, PointB=ccx_12.Points)  # -> Moved, Vector, Transform

# ----
# 阴阳角
number_slider_48 = Slider(1000, range=0..1000)
cir_3 = Circle(Plane=move2pt_7.Moved, Radius=number_slider_48)
cir_4 = Circle(Plane=move2pt_8.Moved, Radius=number_slider_48)
cir_5 = Circle(Plane=filter_13, Radius=1)
cir_6 = Circle(Plane=filter_13, Radius=number_slider_48)
cir_7 = Circle(Plane=move2pt_14.Moved, Radius=number_slider_48)
cir_8 = Circle(Plane=move2pt_15.Moved, Radius=number_slider_48)
merge_8 = Merge(Data1=cir_3, Data2=cir_4, Data3=cir_5, Data4=cir_6, Data5=cir_7, Data6=cir_8)

data_48 = Data(merge_8)
bake = BakeObjects(Geometry=data_48, Attributes=attributes, BakeName=panel_45, Bake=False)

# ----
# SIte-所有的定位点
merge_9 = Merge(Data1=move2pt_6.Moved, Data2=filter_15, Data3=pl_6, Data4=pl_4, Data5=pl_3, Data6=pl_5)  # -> flatten(Result)

# ----
# 三视图
# hidden lines of top+pers view
# move to center
# 如果无法完整的生成埋件的三视图，
# 建议选择埋件的3D在Rhino中将
# Top/Perspective/Front/Right 试图缩放至合适大小后重新运行
panel_68 = Panel("""Top
Perspective
Front
Right""")
m2d_rhino = Make2DRhinoView(Name=panel_68, Clip=True)
number_slider_49 = Slider(1, range=0..10)
pt_3 = Point(Point(957.9296072, 367.7685097, 0))
pt_4 = Point("0,0,0")
recgrid_2 = Rectangular(
    Plane=pt_3,
    SizeX=Slider(12, range=1..20, expression="X*50"),
    SizeY=Slider(10, range=1..20, expression="X*50"),
    ExtentX=number_slider_49,
    ExtentY=number_slider_49)  # -> Cells, Points
flatten_13 = FlattenTree(Tree=recgrid_2.Points, Path="{0}")
# 钢埋板高度，工字钢尺寸决定
panel_69 = Panel("4")

# ----
# （6）生成板埋埋件
# 注意：
# 1.记得点一下Compute按钮
# 2.如果无法完整的生成埋件的三视图，
# 建议选择埋件的3D在Rhino中将
# Top/Perspective/Front/Right 试图缩放至合适大小后重新运行
make2d = Make2D(Geometry=move_10.Geometry, View=m2d_rhino, TangentEdges=False, TangentSeams=False, AutoComputeMake2D=False)  # -> VisibleCurves, VisibleIndex, VisibleType, HiddenCurves, HiddenIndex, HiddenType

bang = ExplodeTree(Data=make2d.VisibleCurves)  # -> Branch0, Branch1, Branch2, Branch3, Branch4, Branch5, Branch6, Branch7
divdist = DivideDistance(Curve=make2d.HiddenCurves, Distance=Slider(1, range=0..10))  # -> Points, Tangents, Parameters
graft = GraftTree(Tree=make2d.HiddenCurves, IncludeEmptyLists=True, IncludeNullItems=True)
shatter = Shatter(Curve=graft, Parameters=divdist.Parameters)
dispatch_22 = Dispatch(List=shatter, DispatchPattern=[True, False])  # -> ListA, ListB
crv_56 = Curve(dispatch_22.ListA)
pshift = ShiftPaths(Data=crv_56, Offset=-1)
pshift_2 = ShiftPaths(Data=pshift, Offset=-1)
bang_2 = ExplodeTree(Data=pshift_2)  # -> Branch0, Branch1, Branch2, Branch3, Branch4, Branch5, Branch6, Branch7
entwine_12 = Entwine(Branch00=bang_2.Branch0, Branch01=bang.Branch0, FlattenInputs=True)  # -> flatten(Result)
entwine_13 = Entwine(Branch00=bang_2.Branch1, Branch01=bang.Branch1, FlattenInputs=True)  # -> flatten(Result)
entwine_14 = Entwine(Branch00=entwine_12, Branch01=entwine_13, Branch02=bang.Branch2, Branch03=bang.Branch3, FlattenInputs=True)
group_2 = Group(Objects=entwine_14)
pshift_3 = ShiftPaths(Data=group_2, Offset=-1)
pshift_4 = ShiftPaths(Data=group_2, Offset=-1)
boxprop = BoxProperties(Box=pshift_3)  # -> Center, Diagonal, Area, Volume, Degeneracy
vec2pt = Vector2Pt(PointA=boxprop.Center, PointB=pt_4, Unitize=False)  # -> Vector, Length
move_22 = Move(Geometry=pshift_4, Motion=vec2pt.Vector)  # -> flatten(Geometry), Transform
orient = Orient(Geometry=flatten(move_22.Geometry), Source=PlaneXY(0, 0, 0), Target=flatten_13)  # -> Geometry, Transform
cull_i_14 = CullIndex(List=orient.Geometry, Indices="-1", Wrap=True)
split = SplitList(List=cull_i_14, Index=panel_69)  # -> ListA, ListB
geo_6 = Geometry(split.ListA)

# ---- group: 单体定Top/Side
item_36 = ListItem(List=geo_6, Index=Slider(0, range=0..10), Wrap=True)
item_37 = ListItem(List=geo_6, Index=2, Wrap=True)
cluster_5 = Cluster(G=item_36)
cluster_6 = Cluster(G=item_37)

# ----
ungroup = Ungroup(Group=cluster_6)
ungroup_2 = Ungroup(Group=cluster_5)

# ---- group: Top/Side
filter_16 = StreamFilter(Gate=list_6, Stream0=ungroup_2, Stream1=ungroup)

# ---- group: Block
attributes_13 = DefineObjectAttributes(Color=ColourSwatch(SwatchColor=RGB(255, 0, 0)))
block = DefineBlock(Geometry=ungroup_2, Attributes=attributes_13, BlockName="Board Plate", BasePlane=PlaneXY(0, 0, 0))

# ----
deblock_12 = DeconstructBlock(Block=block)  # -> Name, flatten(Plane), flatten(Geometry)
boundary_3 = BoundarySurfaces(Edges=deblock_12.Geometry)
deplane_25 = DeconstructPlane(Plane=deblock_12.Plane)  # -> Origin, XAxis, YAxis, ZAxis
area_9 = Area(Geometry=boundary_3)  # -> Area, Centroid
move2pt_16 = MoveToPoint(Geometry=flatten(deplane_25.Origin), PointA=flatten(deplane_25.Origin), PointB=flatten(area_9.Centroid))  # -> Moved, Vector, Transform
pl_8 = ConstructPlane(Origin=move2pt_16.Moved, XAxis=deplane_25.XAxis, YAxis=deplane_25.YAxis)  # -> graft(Plane)

deplane_26 = DeconstructPlane(Plane=deblock_12.Plane)  # -> Origin, XAxis, YAxis, ZAxis
amp_19 = Amplitude(Vector=deplane_26.YAxis, Amplitude=number_slider_19)
move_23 = Move(Geometry=deplane_26.Origin, Motion=amp_19)  # -> Geometry, Transform

text_2 = DefineTextObject(Text=panel_24, Plane=move_23.Geometry, DimensionStyle=panel_23, OutputType="Text")
group_3 = Group(Objects=flatten([block, text_2]))
entwine_15 = Entwine(Branch00=group_3, Branch01=pl_8, FlattenInputs=True)

data_49 = Data(flatten(entwine_15))
item_38 = ListItem(List=data_49, Index=0, Wrap=True)
item_39 = ListItem(List=data_49, Index="-1", Wrap=True)

# ---- group: 车道区域
# 1.是否有檐口线
toggle_4 = BooleanToggle(True)
clean_3 = CleanTree(RemoveNulls=True, RemoveInvalid=True, RemoveEmpty=toggle_4, Tree=merge_9)
crv_57 = Curve(crv_13)
merge_10 = Merge(Data1=crv_22, Data2=crv_57)

# ---- group: 车道区域 / Input ???
deplane_27 = DeconstructPlane(Plane=clean_3)  # -> Origin, XAxis, YAxis, ZAxis

# ---- group: 车道区域 (continued)
incurve = PointInCurve(Point=deplane_27.Origin, Curve=crv_21)  # -> Relationship, Point
equals_2 = Equality(FirstNumber=incurve.Relationship, SecondNumber="2")  # -> Equality, Inequality
dispatch_23 = Dispatch(List=clean_3, DispatchPattern=equals_2.Equality)  # -> ListA, ListB

# Site - 有檐口线的定位点
pln_20 = Plane(dispatch_23.ListA)

# Site - 无檐口线的定位点
pln_21 = Plane(dispatch_23.ListB)

incurves = PointInCurves(Point=pln_20, Curves=crv_57)  # -> Relationship, Index, Point
incurves_2 = PointInCurves(Point=pln_20, Curves=merge_10)  # -> Relationship, Index, Point
equals_3 = Equality(FirstNumber=incurves_2.Relationship, SecondNumber="2")  # -> Equality, Inequality
equals_4 = Equality(FirstNumber=incurves.Relationship, SecondNumber="0")  # -> Equality, Inequality
dispatch_24 = Dispatch(List=pln_20, DispatchPattern=equals_3.Equality)  # -> ListA, ListB
dispatch_25 = Dispatch(List=pln_20, DispatchPattern=equals_4.Inequality)  # -> ListA, ListB

# ---- group: 车道区域 / 檐口线-Site
pln_22 = Plane(dispatch_24.ListB)

# ---- group: 车道区域
# 檐口出特殊处理:
# 比如作为吊顶处理
# +车道处特殊处理
pln_23 = Plane(dispatch_24.ListA)

# 车道处特殊处理
pln_24 = Plane(dispatch_25.ListA)

# ---- group: Input 下层定位点
# 1.1有檐口线
pln_25 = Plane(pln_22)

# ----
# 1.0无檐口线初筛
pln_26 = Plane(pln_21)

# ----
# 0 檐口出特殊处理
# 比如作为吊顶处理
pln_27 = Plane(pln_23)
pt_5 = Point(pln_27)

# ----
# 区分内外梁边线
# 2.根据是否相交判定内外梁(平行于建筑边线方向）
crv_58 = Curve(entwine_2)
num_4 = Number(entwine_3)
crv_59 = Curve(filter)
offcrv = OffsetCurve(Curve=crv_58, Plane=PlaneXY(0, 0, 0), Distance=num_4, BothSides=expr("-x", num_4), Kinks=0, CapType="0")
midpt_18 = CurveMiddle(Curve=offcrv)
offcrv_2 = OffsetCurve(Curve=crv_58, Plane=PlaneXY(0, 0, 0), Distance=num_4, BothSides=expr("-x", num_4), Kinks=0, CapType="1")
crv_60 = Curve(offcrv)
item_40 = ListItem(List=midpt_18, Index=0, Wrap=True)
item_41 = ListItem(List=crv_60, Index=0, Wrap=True)
item_42 = ListItem(List=crv_60, Index="-1", Wrap=True)
graft_2 = GraftTree(Tree=crv_58, IncludeEmptyLists=True, IncludeNullItems=True)

# ---- group: 梁中线-中点
midpt_19 = CurveMiddle(Curve=crv_58)

# ---- group: Pull到轮廓线
pull_22 = PullPoint(Point=midpt_19, Geometry=crv_59, ClosestOnly=True)  # -> ClosestPoint, Distance

# ----
# 梁线闭合
shift = ShiftPaths(Data=offcrv_2, Offset=-1)

# ---- group: 和某组梁边线相连
ln_25 = Line(StartPoint=item_40, EndPoint=graft(pull_22.ClosestPoint))

# ---- group: 有交点为内
ccx_14 = CurveCurve(CurveA=ln_25, CurveB=graft_2)  # -> Points, ParamsA, ParamsB

# ----
null_5 = NullItem(Item=ccx_14.Points)  # -> NullFlags, InvalidFlags, Description
dispatch_26 = Dispatch(List=item_41, DispatchPattern=null_5.InvalidFlags)  # -> ListA, ListB
dispatch_27 = Dispatch(List=item_42, DispatchPattern=null_5.InvalidFlags)  # -> ListA, ListB

# ----
# 梁边线-内
merge_11 = Merge(Data1=dispatch_26.ListB, Data2=dispatch_27.ListA)

# ----
# 梁边线-外
merge_12 = Merge(Data1=dispatch_26.ListA, Data2=dispatch_27.ListB)

deplane_28 = DeconstructPlane(Plane=pln_26)  # -> Origin, XAxis, YAxis, ZAxis
crv_61 = Curve(crv_59)
incurves_3 = PointInCurves(Point=deplane_28.Origin, Curves=flatten(crv_61))  # -> Relationship, Index, Point
equals_5 = Equality(FirstNumber=incurves_3.Relationship, SecondNumber="2")  # -> Equality, Inequality
dispatch_28 = Dispatch(List=pln_26, DispatchPattern=equals_5.Equality)  # -> ListA, ListB
crv_62 = Curve(crv_22)
data_50 = Data(dispatch_28.ListB)

pln_28 = Plane(dispatch_28.ListA)
incurves_4 = PointInCurves(Point=pln_28, Curves=flatten(crv_62))  # -> Relationship, Index, Point
equals_6 = Equality(FirstNumber=incurves_4.Relationship, SecondNumber="0")  # -> Equality, Inequality
dispatch_29 = Dispatch(List=pln_28, DispatchPattern=equals_6.Equality)  # -> ListA, ListB
pln_29 = Plane(dispatch_29.ListB)

# ---- group: 梁-外侧
crv_63 = Curve(merge_12)

# ----
# 1.0无檐口线
pln_30 = Plane(dispatch_29.ListA)

# ---- group: 梁外侧
# 阳角
# 阴角
crv_64 = Curve(merge_12)

# ----
crv_65 = Curve(shift)

# ----
# 1.0
crv_66 = Curve(shift)

crv_67 = Curve(shift)

crv_68 = Curve(shift)

crv_69 = Curve(shift)

crv_70 = Curve(shift)

crv_71 = Curve(shift)

crv_72 = Curve(shift)

crv_73 = Curve(shift)

# ----
# 1.1 有檐口-整个site一起处理
pln_31 = Plane(pln_25)
deplane_29 = DeconstructPlane(Plane=pln_31)  # -> Origin, XAxis, YAxis, ZAxis
amp_20 = Amplitude(Vector=deplane_29.YAxis, Amplitude=number_slider_31)
move_24 = Move(Geometry=deplane_29.Origin, Motion=amp_20)  # -> Geometry, Transform
ln_26 = Line(StartPoint=deplane_29.Origin, EndPoint=move_24.Geometry)
ccx_15 = CurveCurve(CurveA=graft(ln_26), CurveB=flatten(crv_63))  # -> Points, ParamsA, ParamsB
shift_2 = ShiftPaths(Data=ccx_15.Points, Offset=-1)
sort_17 = SortList(Keys=shift_2, ValuesA=shift_2)  # -> Keys, ValuesA
pull_23 = PullPoint(Point=sort_17.ValuesA, Geometry=graft(deplane_29.Origin), ClosestOnly=True)  # -> ClosestPoint, Distance
sort_18 = SortList(Keys=pull_23.Distance, ValuesA=sort_17.ValuesA)  # -> Keys, ValuesA
crv_74 = Curve(shift)

# ---- group: 最外侧的交点
item_43 = ListItem(List=sort_18.ValuesA, Index="-1", Wrap=True)

# ----
# 1.0 无檐口线+上下层幕墙边线连续
pln_32 = Plane(pln_30)
deplane_30 = DeconstructPlane(Plane=pln_32)  # -> Origin, XAxis, YAxis, ZAxis
number_slider_50 = Slider(3584, range=0..10000)
amp_21 = Amplitude(Vector=deplane_30.YAxis, Amplitude=number_slider_50)
amp_22 = Amplitude(Vector=deplane_30.YAxis, Amplitude=expr("-x", number_slider_50))
move_25 = Move(Geometry=deplane_30.Origin, Motion=amp_21)  # -> Geometry, Transform
move_26 = Move(Geometry=deplane_30.Origin, Motion=amp_22)  # -> Geometry, Transform
ln_27 = Line(StartPoint=move_26.Geometry, EndPoint=move_25.Geometry)
# 阳角
# 阴角
pln_33 = Plane(pln_32)

# ---- group: F2-交点
ccx_16 = CurveCurve(CurveA=ln_27, CurveB=crv_24)  # -> flatten(Points), ParamsA, ParamsB

# ---- group: F1-交点
ccx_17 = CurveCurve(CurveA=ln_27, CurveB=crv_25)  # -> flatten(Points), ParamsA, ParamsB

# ----
null_6 = NullItem(Item=flatten(item_43))  # -> NullFlags, InvalidFlags, Description
dispatch_30 = Dispatch(List=item_43, DispatchPattern=item_43)  # -> ListA, ListB
dispatch_31 = Dispatch(List=pln_31, DispatchPattern=null_6.InvalidFlags)  # -> ListA, ListB

# ---- group: 交点对应的初始Plane
data_51 = Data(dispatch_31.ListB)

# ---- group: 交点Point
data_52 = Data(dispatch_30.ListA)

# ----
# 按照梁分类定位点
pt_6 = Point(data_52)
incurves_5 = PointInCurves(Point=flatten(pt_6), Curves=crv_74)  # -> Relationship, Index, Point
equals_7 = Equality(FirstNumber=incurves_5.Relationship, SecondNumber="0")  # -> Equality, Inequality
dispatch_32 = Dispatch(List=flatten(pt_6), DispatchPattern=equals_7.Inequality)  # -> ListA, ListB

# ----
# 按照梁分类定位点
pt_7 = Point(data_52)
incurves_6 = PointInCurves(Point=flatten(pt_7), Curves=crv_74)  # -> Relationship, Index, Point
equals_8 = Equality(FirstNumber=incurves_6.Relationship, SecondNumber="0")  # -> Equality, Inequality
dispatch_33 = Dispatch(List=flatten(data_51), DispatchPattern=equals_8.Inequality)  # -> ListA, ListB

# ---- group: Plane-属于那个梁
data_53 = Data(dispatch_33.ListA)

# ---- group: 交点-属于哪个梁
data_54 = Data(dispatch_32.ListA)

# ----
move2pt_17 = MoveToPoint(Geometry=data_53, PointA=data_53, PointB=data_54)  # -> Moved, Vector, Transform
null_7 = NullItem(Item=move2pt_17.Moved)  # -> NullFlags, InvalidFlags, Description
dispatch_34 = Dispatch(List=move2pt_17.Moved, DispatchPattern=null_7.InvalidFlags)  # -> ListA, ListB

check_same_points_5 = CheckSamePoints(archPoint=pln_31, crvPoint=data_51)  # -> out, specialPt; inputs archPoint: list of Point3d, crvPoint: list of Point3d; same code as testpoint

# ---- group: 檐口-首次筛选的有效起始Plane
data_55 = Data(dispatch_34.ListB)

# ----
# 0无檐口线
# 与梁不相交
cull_i_15 = CullIndex(List=pln_31, Indices=check_same_points_5.specialPt, Wrap=True)

# ----
# 0 檐口出定位点
# 与结构无交点
pln_34 = Plane(cull_i_15)

# ----
# 0.Missing Point-二次筛选檐口处
# 埋件定位点Offset，没有找到和梁的交点
number_slider_51 = Slider(5000, range=0..10000)
deplane_31 = DeconstructPlane(Plane=pln_34)  # -> Origin, XAxis, YAxis, ZAxis
amp_23 = Amplitude(Vector=deplane_31.YAxis, Amplitude=number_slider_51)
move_27 = Move(Geometry=deplane_31.Origin, Motion=amp_23)  # -> Geometry, Transform
ln_28 = Line(StartPoint=move_27.Geometry, EndPoint=deplane_31.Origin)
amp_24 = Amplitude(Vector=deplane_31.XAxis, Amplitude=number_slider_24)
amp_25 = Amplitude(Vector=deplane_31.XAxis, Amplitude=expr("-x", number_slider_24))

# ---- group: 2条Offset的探针找交点
move_28 = Move(Geometry=ln_28, Motion=amp_24)  # -> Geometry, Transform
move_29 = Move(Geometry=ln_28, Motion=amp_25)  # -> Geometry, Transform

# ----
# 1.1 檐口处侧埋，钢板焊
# 02：钢板焊埋件[钢梁外侧]
# @钢边梁宽@钢边梁高
pln_35 = Plane(data_55)

pull_24 = PullPoint(Point=ccx_17.Points, Geometry=ccx_16.Points, ClosestOnly=True)  # -> ClosestPoint, Distance
sort_19 = SortList(Keys=pull_24.Distance, ValuesA=pull_24.ClosestPoint)  # -> Keys, ValuesA
panel_70 = Panel(sort_19.Keys)
larger_8 = LargerThan(FirstNumber=sort_19.Keys, SecondNumber=number_slider_32)  # -> LargerThan, OrEqualTo

# ---- group: 2组交点距离大于容差-默认不同点
dispatch_35 = Dispatch(List=sort_19.ValuesA, DispatchPattern=larger_8.LargerThan)  # -> ListA, ListB

# ----
pt_8 = Point(dispatch_35.ListA)
pt_9 = Point(dispatch_35.ListB)
pull_25 = PullPoint(Point=deplane_30.Origin, Geometry=graft(pt_9), ClosestOnly=True)  # -> ClosestPoint, Distance
sort_20 = SortList(Keys=pull_25.Distance, ValuesA=pln_33)  # -> Keys, ValuesA
item_44 = ListItem(List=sort_20.ValuesA, Index=0, Wrap=True)
check_same_points_6 = CheckSamePoints(archPoint=pln_33, crvPoint=flatten(item_44))  # -> out, specialPt; inputs archPoint: list of Point3d, crvPoint: list of Point3d; same code as testpoint

# ---- group: 有效Plane-上下建筑线在该处连续
item_45 = ListItem(List=pln_33, Index=check_same_points_6.specialPt, Wrap=True)

# ----
cull_i_16 = CullIndex(List=pln_33, Indices=check_same_points_6.specialPt, Wrap=True)
pln_36 = Plane(pln_25)
merge_13 = Merge(Data1=cull_i_16, Data2=pln_36)  # -> flatten(Result)

# ----
# 和下层楼板发生关系的定位点
pln_37 = Plane(pln_36)

# ---- group: 起始Plane
pln_38 = Plane(pln_37)

# ----
pln_39 = Plane(pln_38)
number_slider_52 = Slider(3584, range=0..10000)
deplane_32 = DeconstructPlane(Plane=pln_39)  # -> Origin, XAxis, YAxis, ZAxis
crv_75 = Curve(merge_12)
boundary_4 = BoundarySurfaces(Edges=[offset_3, offset_2])
scx = SurfaceCurve(Surface=boundary_4, Curve=crv_75)  # -> flatten(Curves), Points, UVPoints, Normals, Parameters, Tangents
amp_26 = Amplitude(Vector=deplane_32.YAxis, Amplitude=number_slider_52)
amp_27 = Amplitude(Vector=deplane_32.YAxis, Amplitude=expr("-x", number_slider_52))
move_30 = Move(Geometry=deplane_32.Origin, Motion=amp_27)  # -> Geometry, Transform
move_31 = Move(Geometry=deplane_32.Origin, Motion=amp_26)  # -> Geometry, Transform
ln_29 = Line(StartPoint=move_30.Geometry, EndPoint=move_31.Geometry)
ccx_18 = CurveCurve(CurveA=graft(ln_29), CurveB=scx.Curves)  # -> Points, ParamsA, ParamsB
shift_3 = ShiftPaths(Data=ccx_18.Points, Offset=-1)
pull_26 = PullPoint(Point=graft(pln_39), Geometry=shift_3, ClosestOnly=True)  # -> ClosestPoint, Distance
sort_21 = SortList(Keys=pull_26.Distance, ValuesA=pull_26.ClosestPoint)  # -> Keys, ValuesA
item_46 = ListItem(List=sort_21.ValuesA, Index=0, Wrap=True)
null_8 = NullItem(Item=item_46)  # -> NullFlags, simplify(InvalidFlags), Description
null_9 = NullItem(Item=sort_21.ValuesA)  # -> NullFlags, simplify(InvalidFlags), Description
dispatch_36 = Dispatch(List=simplify(graft(pln_39)), DispatchPattern=null_9.InvalidFlags)  # -> ListA, ListB
dispatch_37 = Dispatch(List=simplify(graft(item_46)), DispatchPattern=null_8.InvalidFlags)  # -> ListA, ListB
pln_40 = Plane(dispatch_36.ListB)
pln_41 = Plane(dispatch_36.ListA)
pt_10 = Point(dispatch_37.ListB)

# ----
# 可能的结构交点-大量
pln_42 = Plane(pln_41)

# ----
# 0 檐口出定位点
# 与结构无交点
pln_43 = Plane(flatten(pln_42))

deplane_33 = DeconstructPlane(Plane=item_45)  # -> Origin, XAxis, YAxis, ZAxis
amp_28 = Amplitude(Vector=deplane_33.YAxis, Amplitude=expr("-x", Slider(2756, range=0..10000)))
move_32 = Move(Geometry=deplane_33.Origin, Motion=amp_28)  # -> Geometry, Transform

# ---- group: 相内探索
ln_30 = Line(StartPoint=deplane_33.Origin, EndPoint=move_32.Geometry)

# ----
ccx_19 = CurveCurve(CurveA=graft(move_29.Geometry), CurveB=flatten(merge_12))  # -> Points, ParamsA, ParamsB
shift_4 = ShiftPaths(Data=ccx_19.Points, Offset=-1)
sort_22 = SortList(Keys=shift_4, ValuesA=shift_4)  # -> Keys, ValuesA
pull_27 = PullPoint(Point=sort_22.ValuesA, Geometry=graft(pln_34), ClosestOnly=True)  # -> ClosestPoint, Distance
sort_23 = SortList(Keys=pull_27.Distance, ValuesA=sort_22.ValuesA)  # -> Keys, ValuesA

# ---- group: 最远交点
item_47 = ListItem(List=sort_23.ValuesA, Index="-1", Wrap=True)

# ----
null_10 = NullItem(Item=flatten(item_47))  # -> NullFlags, InvalidFlags, Description
dispatch_38 = Dispatch(List=simplify(item_47), DispatchPattern=simplify(graft(null_10.InvalidFlags)))  # -> ListA, ListB
dispatch_39 = Dispatch(List=pln_34, DispatchPattern=null_10.InvalidFlags)  # -> ListA, ListB
pt_11 = Point(dispatch_38.ListB)
pln_44 = Plane(dispatch_39.ListB)

# ----
# 按照梁分类定位点
pln_45 = Plane(pln_44)
pt_12 = Point(pt_11)
incurves_7 = PointInCurves(Point=flatten(pt_12), Curves=crv_65)  # -> Relationship, Index, Point
equals_9 = Equality(FirstNumber=incurves_7.Relationship, SecondNumber="0")  # -> Equality, Inequality
dispatch_40 = Dispatch(List=flatten(pln_45), DispatchPattern=equals_9.Inequality)  # -> ListA, ListB
data_56 = Data(dispatch_40.ListA)

# ----
# 按照梁分类定位点
pt_13 = Point(pt_11)
incurves_8 = PointInCurves(Point=flatten(pt_13), Curves=crv_65)  # -> Relationship, Index, Point
equals_10 = Equality(FirstNumber=incurves_8.Relationship, SecondNumber="0")  # -> Equality, Inequality
dispatch_41 = Dispatch(List=flatten(pt_13), DispatchPattern=equals_10.Inequality)  # -> ListA, ListB
data_57 = Data(dispatch_41.ListA)

move2pt_18 = MoveToPoint(Geometry=data_56, PointA=data_56, PointB=data_57)  # -> Moved, Vector, Transform
null_11 = NullItem(Item=move2pt_18.Moved)  # -> NullFlags, InvalidFlags, Description
dispatch_42 = Dispatch(List=move2pt_18.Moved, DispatchPattern=null_11.InvalidFlags)  # -> ListA, ListB
pln_46 = Plane(dispatch_42.ListB)

ccx_20 = CurveCurve(CurveA=graft(move_28.Geometry), CurveB=flatten(merge_12))  # -> Points, ParamsA, ParamsB
shift_5 = ShiftPaths(Data=ccx_20.Points, Offset=-1)
sort_24 = SortList(Keys=shift_5, ValuesA=shift_5)  # -> Keys, ValuesA
pull_28 = PullPoint(Point=sort_24.ValuesA, Geometry=graft(pln_34), ClosestOnly=True)  # -> ClosestPoint, Distance
sort_25 = SortList(Keys=pull_28.Distance, ValuesA=sort_24.ValuesA)  # -> Keys, ValuesA

# ---- group: 最远交点
item_48 = ListItem(List=sort_25.ValuesA, Index="-1", Wrap=True)

# ----
null_12 = NullItem(Item=flatten(item_48))  # -> NullFlags, InvalidFlags, Description
dispatch_43 = Dispatch(List=simplify(item_48), DispatchPattern=simplify(graft(null_12.InvalidFlags)))  # -> ListA, ListB
dispatch_44 = Dispatch(List=pln_34, DispatchPattern=null_12.InvalidFlags)  # -> ListA, ListB
pln_47 = Plane(dispatch_44.ListB)
pt_14 = Point(dispatch_43.ListB)

# ----
# 按照梁分类定位点
pln_48 = Plane(pln_47)
pt_15 = Point(pt_14)
incurves_9 = PointInCurves(Point=flatten(pt_15), Curves=crv_65)  # -> Relationship, Index, Point
equals_11 = Equality(FirstNumber=incurves_9.Relationship, SecondNumber="0")  # -> Equality, Inequality
dispatch_45 = Dispatch(List=flatten(pln_48), DispatchPattern=equals_11.Inequality)  # -> ListA, ListB
data_58 = Data(dispatch_45.ListA)

# ----
# 按照梁分类定位点
pt_16 = Point(pt_14)
incurves_10 = PointInCurves(Point=flatten(pt_16), Curves=crv_65)  # -> Relationship, Index, Point
equals_12 = Equality(FirstNumber=incurves_10.Relationship, SecondNumber="0")  # -> Equality, Inequality
dispatch_46 = Dispatch(List=flatten(pt_16), DispatchPattern=equals_12.Inequality)  # -> ListA, ListB
data_59 = Data(dispatch_46.ListA)

move2pt_19 = MoveToPoint(Geometry=data_58, PointA=data_58, PointB=data_59)  # -> Moved, Vector, Transform
null_13 = NullItem(Item=move2pt_19.Moved)  # -> NullFlags, InvalidFlags, Description
dispatch_47 = Dispatch(List=move2pt_19.Moved, DispatchPattern=null_13.InvalidFlags)  # -> ListA, ListB
pln_49 = Plane(dispatch_47.ListB)

# ----
# 撞到梁交点
pln_50 = Plane(pln_49)
pln_51 = Plane(pln_46)

merge_14 = Merge(Data1=pln_35, Data2=pln_50, Data3=pln_51)
pln_52 = Plane(dispatch_44.ListA)
orient_2 = Orient(Geometry=item_8, Source=item_9, Target=merge_14)  # -> Geometry, Transform

data_60 = Data(orient_2.Geometry)
ungroup_3 = Ungroup(Group=data_60)
item_49 = ListItem(List=ungroup_3, Index=0, Wrap=True)  # -> flatten(Item)
item_50 = ListItem(List=ungroup_3, Index="-1", Wrap=True)  # -> flatten(Item)

entwine_16 = Entwine(Branch00=item_49, Branch01=item_50, FlattenInputs=True)
bake_2 = BakeObjects(Geometry=entwine_16, Attributes=attributes_3, BakeName="Embed::1-1-02钢板焊埋件", Bake=False)

# ----
# 未生成檐口线
pt_17 = Point(pln_52)

# ----
# （10）需人工排布
pt_18 = Point(pt_17)
bake_3 = BakeObjects(Geometry=pt_18, Attributes=attributes_2, BakeName=panel_46, Bake=False)

ccx_21 = CurveCurve(CurveA=graft(ln_30), CurveB=flatten(crv_64))  # -> Points, ParamsA, ParamsB
shift_6 = ShiftPaths(Data=ccx_21.Points, Offset=-1)
pull_29 = PullPoint(Point=deplane_33.Origin, Geometry=shift_6, ClosestOnly=True)  # -> ClosestPoint, Distance
sort_26 = SortList(Keys=pull_29.Distance, ValuesA=pull_29.ClosestPoint)  # -> Keys, ValuesA

# ---- group: 与梁最近交点
item_51 = ListItem(List=sort_26.ValuesA, Index=0, Wrap=True)

# ----
null_14 = NullItem(Item=flatten(item_51))  # -> NullFlags, InvalidFlags, Description
dispatch_48 = Dispatch(List=item_45, DispatchPattern=null_14.InvalidFlags)  # -> ListA, ListB
dispatch_49 = Dispatch(List=flatten(item_51), DispatchPattern=null_14.InvalidFlags)  # -> ListA, ListB

# ---- group: 有效起始Plane
data_61 = Data(dispatch_48.ListB)

# ---- group: 去除Null的交点
data_62 = Data(dispatch_49.ListB)

# ----
flatten_14 = FlattenTree(Tree=data_62, Path="{0}")
move2pt_20 = MoveToPoint(Geometry=data_61, PointA=data_61, PointB=flatten(data_62))  # -> Moved, Vector, Transform
ln_31 = Line(StartPoint=data_61, EndPoint=flatten_14)
len_6 = Length(Curve=ln_31)
sort_27 = SortList(Keys=len_6)  # -> reverse(Keys), ValuesA

# ----
# 与梁无交点的定位点
pln_53 = Plane(dispatch_48.ListA)

# ----
# 1.0
number_slider_53 = Slider(50, range=0..100)
number = NumberGroups(Number=sort_27.Keys, Difference=number_slider_53)  # -> simplify(Groups), Indices
panel_71 = Panel(number.Groups)
tstat = TreeStatistics(Tree=number.Groups)  # -> Paths, Length, Count
lng_3 = ListLength(List=tstat.Paths)
smaller_9 = SmallerThan(FirstNumber=lng_3, SecondNumber="2")  # -> SmallerThan, OrEqualTo
dispatch_50 = Dispatch(List=smaller_9.SmallerThan, DispatchPattern=[True, False])  # -> ListA, ListB
filter_17 = StreamFilter(Gate=dispatch_50.ListA, Stream0="-2", Stream1="-1")
item_52 = ListItem(List=tstat.Paths, Index=filter_17, Wrap=True)
branch = TreeBranch(Tree=number.Groups, Path=item_52, MaintainPaths=True)
sort_28 = SortList(Keys=branch)  # -> reverse(Keys), ValuesA
round_2 = Round(Number=sort_28.Keys)  # -> Nearest, Floor, Ceiling
item_53 = ListItem(List=round_2.Ceiling, Index=0, Wrap=True)

# ----
# 挑出反常点-交点距离起始点过远
list_9 = ValueList({"自己输入Value": 0, "GH Defaut Value": 1}, selected="GH Defaut Value")
panel_72 = Panel(item_53)
filter_18 = StreamFilter(Gate=list_9, Stream0=Slider(1000, range=0..10000), Stream1=panel_72)

larger_9 = LargerThan(FirstNumber=len_6, SecondNumber=filter_18)  # -> LargerThan, OrEqualTo
dispatch_51 = Dispatch(List=flatten_14, DispatchPattern=larger_9.LargerThan)  # -> ListA, ListB
dispatch_52 = Dispatch(List=data_61, DispatchPattern=larger_9.LargerThan)  # -> ListA, ListB
data_63 = Data(dispatch_52.ListB)
data_64 = Data(dispatch_51.ListB)

# ----
# 按照梁分类定位点
pt_19 = Point(data_64)
pln_54 = Plane(data_63)
incurves_11 = PointInCurves(Point=flatten(pt_19), Curves=crv_66)  # -> Relationship, Index, Point
equals_13 = Equality(FirstNumber=incurves_11.Relationship, SecondNumber="0")  # -> Equality, Inequality
dispatch_53 = Dispatch(List=flatten(pln_54), DispatchPattern=equals_13.Inequality)  # -> ListA, ListB
data_65 = Data(dispatch_53.ListA)

incurves_12 = PointInCurves(Point=flatten(pt_19), Curves=crv_66)  # -> Relationship, Index, Point
equals_14 = Equality(FirstNumber=incurves_12.Relationship, SecondNumber="0")  # -> Equality, Inequality
dispatch_54 = Dispatch(List=flatten(pt_19), DispatchPattern=equals_14.Inequality)  # -> ListA, ListB
data_66 = Data(dispatch_54.ListA)

move2pt_21 = MoveToPoint(Geometry=data_65, PointA=data_65, PointB=data_66)  # -> Moved, Vector, Transform
null_15 = NullItem(Item=move2pt_21.Moved)  # -> NullFlags, InvalidFlags, Description
dispatch_55 = Dispatch(List=move2pt_21.Moved, DispatchPattern=null_15.InvalidFlags)  # -> ListA, ListB
pln_55 = Plane(dispatch_55.ListB)

# ----
# 离梁过远的定位点
pln_56 = Plane(dispatch_52.ListA)

# ----
# 1.0无檐口线
# 与梁不相交
merge_15 = Merge(Data1=pln_53, Data2=pln_56)

# ----
# 0 檐口出定位点
# 与结构无交点
pln_57 = Plane(flatten(merge_15))

# ----
# 1.0.Missing Point
# 埋件定位点Offset，没有找到和梁的交点
number_slider_54 = Slider(5000, range=0..10000)
deplane_34 = DeconstructPlane(Plane=pln_57)  # -> Origin, XAxis, YAxis, ZAxis
amp_29 = Amplitude(Vector=deplane_34.YAxis, Amplitude=expr("-x", number_slider_54))
move_33 = Move(Geometry=deplane_34.Origin, Motion=amp_29)  # -> Geometry, Transform
ln_32 = Line(StartPoint=move_33.Geometry, EndPoint=deplane_34.Origin)
crv_76 = Curve(crv_64)
amp_30 = Amplitude(Vector=deplane_34.XAxis, Amplitude=number_slider_24)
amp_31 = Amplitude(Vector=deplane_34.XAxis, Amplitude=expr("-x", number_slider_24))

# ---- group: 2组探索针
move_34 = Move(Geometry=ln_32, Motion=amp_31)  # -> Geometry, Transform
move_35 = Move(Geometry=ln_32, Motion=amp_30)  # -> Geometry, Transform

# ----
ccx_22 = CurveCurve(CurveA=graft(move_34.Geometry), CurveB=flatten(crv_76))  # -> Points, ParamsA, ParamsB
shift_7 = ShiftPaths(Data=ccx_22.Points, Offset=-1)
sort_29 = SortList(Keys=shift_7, ValuesA=shift_7)  # -> Keys, ValuesA
pull_30 = PullPoint(Point=sort_29.ValuesA, Geometry=graft(pln_57), ClosestOnly=True)  # -> ClosestPoint, Distance
sort_30 = SortList(Keys=pull_30.Distance, ValuesA=sort_29.ValuesA)  # -> Keys, ValuesA
# SmoothCurve-阴角
# SmoothCurve-阳角
# SmoothCurve-阴角
# SmoothCurve-正常
# Angular Curve - All
# Special Curve(with location)- All
# Curve for this project only - All
panel_73 = Panel("0")
item_54 = ListItem(List=sort_30.ValuesA, Index=panel_73, Wrap=True)
null_16 = NullItem(Item=flatten(item_54))  # -> NullFlags, InvalidFlags, Description
dispatch_56 = Dispatch(List=simplify(item_54), DispatchPattern=simplify(graft(null_16.InvalidFlags)))  # -> ListA, ListB
dispatch_57 = Dispatch(List=pln_57, DispatchPattern=null_16.InvalidFlags)  # -> ListA, ListB
pln_58 = Plane(dispatch_57.ListB)
pt_20 = Point(dispatch_56.ListB)

ccx_23 = CurveCurve(CurveA=graft(move_35.Geometry), CurveB=flatten(crv_76))  # -> Points, ParamsA, ParamsB
shift_8 = ShiftPaths(Data=ccx_23.Points, Offset=-1)
sort_31 = SortList(Keys=shift_8, ValuesA=shift_8)  # -> Keys, ValuesA
pull_31 = PullPoint(Point=sort_31.ValuesA, Geometry=graft(pln_57), ClosestOnly=True)  # -> ClosestPoint, Distance
sort_32 = SortList(Keys=pull_31.Distance, ValuesA=sort_31.ValuesA)  # -> Keys, ValuesA
item_55 = ListItem(List=sort_32.ValuesA, Index="0", Wrap=True)
null_17 = NullItem(Item=flatten(item_55))  # -> NullFlags, InvalidFlags, Description
dispatch_58 = Dispatch(List=simplify(item_55), DispatchPattern=simplify(graft(null_17.InvalidFlags)))  # -> ListA, ListB
dispatch_59 = Dispatch(List=pln_57, DispatchPattern=null_17.InvalidFlags)  # -> ListA, ListB
pt_21 = Point(dispatch_58.ListB)
pln_59 = Plane(dispatch_59.ListB)

# ----
# 按照梁分类定位点
pln_60 = Plane(pln_59)
pt_22 = Point(pt_21)
incurves_13 = PointInCurves(Point=flatten(pt_22), Curves=crv_67)  # -> Relationship, Index, Point
equals_15 = Equality(FirstNumber=incurves_13.Relationship, SecondNumber="0")  # -> Equality, Inequality
dispatch_60 = Dispatch(List=flatten(pln_60), DispatchPattern=equals_15.Inequality)  # -> ListA, ListB
data_67 = Data(dispatch_60.ListA)

# ----
# 按照梁分类定位点
pln_61 = Plane(pln_58)
pt_23 = Point(pt_20)
incurves_14 = PointInCurves(Point=flatten(pt_23), Curves=crv_67)  # -> Relationship, Index, Point
equals_16 = Equality(FirstNumber=incurves_14.Relationship, SecondNumber="0")  # -> Equality, Inequality
dispatch_61 = Dispatch(List=flatten(pln_61), DispatchPattern=equals_16.Inequality)  # -> ListA, ListB
data_68 = Data(dispatch_61.ListA)

incurves_15 = PointInCurves(Point=flatten(pt_23), Curves=crv_67)  # -> Relationship, Index, Point
equals_17 = Equality(FirstNumber=incurves_15.Relationship, SecondNumber="0")  # -> Equality, Inequality
dispatch_62 = Dispatch(List=flatten(pt_23), DispatchPattern=equals_17.Inequality)  # -> ListA, ListB
data_69 = Data(dispatch_62.ListA)

incurves_16 = PointInCurves(Point=flatten(pt_22), Curves=crv_67)  # -> Relationship, Index, Point
equals_18 = Equality(FirstNumber=incurves_16.Relationship, SecondNumber="0")  # -> Equality, Inequality
dispatch_63 = Dispatch(List=flatten(pt_22), DispatchPattern=equals_18.Inequality)  # -> ListA, ListB
data_70 = Data(dispatch_63.ListA)

move2pt_22 = MoveToPoint(Geometry=data_67, PointA=data_67, PointB=data_70)  # -> Moved, Vector, Transform
null_18 = NullItem(Item=move2pt_22.Moved)  # -> NullFlags, InvalidFlags, Description
dispatch_64 = Dispatch(List=move2pt_22.Moved, DispatchPattern=null_18.InvalidFlags)  # -> ListA, ListB
pln_62 = Plane(dispatch_64.ListB)

move2pt_23 = MoveToPoint(Geometry=data_68, PointA=data_68, PointB=data_69)  # -> Moved, Vector, Transform
null_19 = NullItem(Item=move2pt_23.Moved)  # -> NullFlags, InvalidFlags, Description
dispatch_65 = Dispatch(List=move2pt_23.Moved, DispatchPattern=null_19.InvalidFlags)  # -> ListA, ListB
pln_63 = Plane(dispatch_65.ListB)

# ----
# 1.0无檐口线+上下层幕墙边线连续
# 01：钢板焊埋件[钢梁外侧]
# @钢边梁宽@钢边梁高
pln_64 = Plane(pln_55)

# ----
# 撞到梁交点
merge_16 = Merge(Data1=pln_62, Data2=pln_63)

merge_17 = Merge(Data1=pln_64, Data2=merge_16)
orient_3 = Orient(Geometry=item_10, Source=item_11, Target=merge_17)  # -> Geometry, Transform

data_71 = Data(orient_3.Geometry)
ungroup_4 = Ungroup(Group=data_71)
item_56 = ListItem(List=ungroup_4, Index=0, Wrap=True)  # -> flatten(Item)
item_57 = ListItem(List=ungroup_4, Index="-1", Wrap=True)  # -> flatten(Item)

entwine_17 = Entwine(Branch00=item_56, Branch01=item_57, FlattenInputs=True)
bake_4 = BakeObjects(Geometry=entwine_17, Attributes=attributes_5, BakeName="Embed::1-0-01钢板焊埋件", Bake=False)

# ----
# 2是否有吊顶
# 梁以内>350
deplane_35 = DeconstructPlane(Plane=pln_37)  # -> Origin, XAxis, YAxis, ZAxis
number_slider_55 = Slider(5000, range=0..10000)
amp_32 = Amplitude(Vector=deplane_35.YAxis, Amplitude=expr("-x", number_slider_55))
amp_33 = Amplitude(Vector=deplane_35.YAxis, Amplitude=number_slider_55)
move_36 = Move(Geometry=deplane_35.Origin, Motion=amp_33)  # -> Geometry, Transform
move_37 = Move(Geometry=deplane_35.Origin, Motion=amp_32)  # -> Geometry, Transform
ln_33 = Line(StartPoint=move_36.Geometry, EndPoint=move_37.Geometry)
crv_77 = Curve(crv_14)
crv_78 = Curve(merge_11)

# ---- group: 和下层建筑的交点
ccx_24 = CurveCurve(CurveA=ln_33, CurveB=crv_77)  # -> Points, ParamsA, ParamsB

# ----
null_20 = NullItem(Item=ccx_24.Points)  # -> NullFlags, InvalidFlags, Description
dispatch_66 = Dispatch(List=simplify(ccx_24.Points), DispatchPattern=simplify(null_20.NullFlags))  # -> ListA, ListB
dispatch_67 = Dispatch(List=simplify(graft(pln_37)), DispatchPattern=simplify(null_20.NullFlags))  # -> ListA, ListB
pt_24 = Point(dispatch_66.ListB)
pln_65 = Plane(flatten(dispatch_67.ListB))
pt_25 = Point(pln_65)
pull_32 = PullPoint(Point=flatten(pt_25), Geometry=flatten(pt_24), ClosestOnly=True)  # -> ClosestPoint, Distance
ln_34 = Line(StartPoint=pln_65, EndPoint=pull_32.ClosestPoint)

# ----
# 定位点Project到下层建筑线
move2pt_24 = MoveToPoint(Geometry=pln_65, PointA=pln_65, PointB=pull_32.ClosestPoint)  # -> Moved, Vector, Transform

# ----
# 可能的点-离结构很远
pln_66 = Plane(dispatch_67.ListA)

deplane_36 = DeconstructPlane(Plane=move2pt_24.Moved)  # -> Origin, XAxis, YAxis, ZAxis
amp_34 = Amplitude(Vector=deplane_36.YAxis, Amplitude=Slider(5000, range=0..10000))
move_38 = Move(Geometry=deplane_36.Origin, Motion=amp_34)  # -> Geometry, Transform
ln_35 = Line(StartPoint=move_38.Geometry, EndPoint=deplane_36.Origin)

# ---- group: 和内测梁交点
ccx_25 = CurveCurve(CurveA=graft(ln_35), CurveB=flatten(crv_78))  # -> simplify(Points), ParamsA, ParamsB

# ----
shift_9 = ShiftPaths(Data=ccx_25.Points, Offset=-1)
null_21 = NullItem(Item=shift_9)  # -> NullFlags, InvalidFlags, Description
dispatch_68 = Dispatch(List=simplify(graft(move2pt_24.Moved)), DispatchPattern=null_21.NullFlags)  # -> ListA, ListB
dispatch_69 = Dispatch(List=simplify(graft(ln_35)), DispatchPattern=null_21.NullFlags)  # -> ListA, ListB
pln_67 = Plane(dispatch_68.ListA)
crv_79 = Curve(dispatch_69.ListB)
pln_68 = Plane(dispatch_68.ListB)
ccx_26 = CurveCurve(CurveA=graft(crv_79), CurveB=flatten(crv_78))  # -> Points, ParamsA, ParamsB
shift_10 = ShiftPaths(Data=simplify(ccx_26.Points), Offset=-1)
pull_33 = PullPoint(Point=pln_68, Geometry=shift_10, ClosestOnly=True)  # -> ClosestPoint, Distance
sort_33 = SortList(Keys=pull_33.Distance, ValuesA=pull_33.ClosestPoint)  # -> Keys, ValuesA

# ---- group: 交点对应的起始定位点
item_58 = ListItem(List=sort_33.ValuesA, Index=0, Wrap=True)

# ----
ln_36 = Line(StartPoint=pln_68, EndPoint=item_58)
len_7 = Length(Curve=ln_36)
larger_10 = LargerThan(FirstNumber=len_7, SecondNumber=number_slider_33)  # -> LargerThan, OrEqualTo
panel_74 = Panel(len_7)
dispatch_70 = Dispatch(List=item_58, DispatchPattern=larger_10.LargerThan)  # -> ListA, ListB
dispatch_71 = Dispatch(List=pln_68, DispatchPattern=larger_10.LargerThan)  # -> ListA, ListB
pln_69 = Plane(dispatch_71.ListB)

# ---- group: 起始点
pt_26 = Point(dispatch_70.ListA)

# ---- group: 最终Plane
pln_70 = Plane(dispatch_71.ListA)

# ---- group: 分类后的Plane
# 按照梁分类定位点
pln_71 = Plane(pln_70)
pt_27 = Point(pt_26)
incurves_17 = PointInCurves(Point=flatten(pt_27), Curves=crv_68)  # -> Relationship, Index, Point
equals_19 = Equality(FirstNumber=incurves_17.Relationship, SecondNumber="0")  # -> Equality, Inequality
dispatch_72 = Dispatch(List=flatten(pln_71), DispatchPattern=equals_19.Inequality)  # -> ListA, ListB
data_72 = Data(dispatch_72.ListA)

incurves_18 = PointInCurves(Point=flatten(pt_27), Curves=crv_68)  # -> Relationship, Index, Point
equals_20 = Equality(FirstNumber=incurves_18.Relationship, SecondNumber="0")  # -> Equality, Inequality
dispatch_73 = Dispatch(List=flatten(pt_27), DispatchPattern=equals_20.Inequality)  # -> ListA, ListB
data_73 = Data(dispatch_73.ListA)

move2pt_25 = MoveToPoint(Geometry=data_72, PointA=data_72, PointB=data_73)  # -> Moved, Vector, Transform
null_22 = NullItem(Item=move2pt_25.Moved)  # -> NullFlags, InvalidFlags, Description
dispatch_74 = Dispatch(List=move2pt_25.Moved, DispatchPattern=null_22.InvalidFlags)  # -> ListA, ListB

pln_72 = Plane(dispatch_74.ListB)

# ----
# 可能的结构交点-大量
pln_73 = Plane(pln_67)

# ----
# 可能的结构交点
pln_74 = Plane(pln_69)

# ----
# 2.1 梁以内>350
# 
# 侧埋，钢板焊
# 03：钢板焊埋件[钢梁内侧]
# @钢边梁宽@钢边梁高
pln_75 = Plane(pln_72)

# ----
# 2.1 Missing Point
# 埋件定位点Offset，没有找到和梁的交点
merge_18 = Merge(Data1=pln_66, Data2=pln_74, Data3=pln_73)
crv_80 = Curve(crv_78)

# ----
# 0 檐口出定位点
# 与结构无交点
pln_76 = Plane(flatten(merge_18))

deplane_37 = DeconstructPlane(Plane=pln_76)  # -> Origin, XAxis, YAxis, ZAxis
amp_35 = Amplitude(Vector=deplane_37.YAxis, Amplitude=Slider(5000, range=0..10000))
move_39 = Move(Geometry=deplane_37.Origin, Motion=amp_35)  # -> Geometry, Transform
ln_37 = Line(StartPoint=move_39.Geometry, EndPoint=deplane_37.Origin)
amp_36 = Amplitude(Vector=deplane_37.XAxis, Amplitude=number_slider_24)
amp_37 = Amplitude(Vector=deplane_37.XAxis, Amplitude=expr("-x", number_slider_24))
move_40 = Move(Geometry=ln_37, Motion=amp_36)  # -> Geometry, Transform
move_41 = Move(Geometry=ln_37, Motion=amp_37)  # -> Geometry, Transform

ccx_27 = CurveCurve(CurveA=graft(move_40.Geometry), CurveB=flatten(crv_80))  # -> Points, ParamsA, ParamsB
shift_11 = ShiftPaths(Data=ccx_27.Points, Offset=-1)
sort_34 = SortList(Keys=shift_11, ValuesA=shift_11)  # -> Keys, ValuesA
pull_34 = PullPoint(Point=sort_34.ValuesA, Geometry=graft(pln_76), ClosestOnly=True)  # -> ClosestPoint, Distance
sort_35 = SortList(Keys=pull_34.Distance, ValuesA=sort_34.ValuesA)  # -> Keys, ValuesA
item_59 = ListItem(List=sort_35.ValuesA, Index="-1", Wrap=True)
null_23 = NullItem(Item=flatten(item_59))  # -> NullFlags, InvalidFlags, Description
end_8 = EndPoints(Curve=move_40.Geometry)  # -> Start, End
dispatch_75 = Dispatch(List=graft(pln_76), DispatchPattern=graft(null_23.InvalidFlags))  # -> ListA, ListB
dispatch_76 = Dispatch(List=simplify(item_59), DispatchPattern=simplify(graft(null_23.InvalidFlags)))  # -> ListA, ListB
pt_28 = Point(dispatch_76.ListB)
pln_77 = Plane(dispatch_75.ListB)
dispatch_77 = Dispatch(List=simplify(graft(end_8.End)), DispatchPattern=simplify(graft(null_23.InvalidFlags)))  # -> ListA, ListB
pt_29 = Point(dispatch_77.ListB)
ln_38 = Line(StartPoint=pt_29, EndPoint=pt_28)
len_8 = Length(Curve=ln_38)
larger_11 = LargerThan(FirstNumber=len_8, SecondNumber=Slider(350, range=0..1000))  # -> LargerThan, OrEqualTo
dispatch_78 = Dispatch(List=pln_77, DispatchPattern=larger_11.LargerThan)  # -> ListA, ListB
dispatch_79 = Dispatch(List=pt_29, DispatchPattern=larger_11.LargerThan)  # -> ListA, ListB
pln_78 = Plane(dispatch_78.ListA)
pt_30 = Point(dispatch_79.ListA)

ccx_28 = CurveCurve(CurveA=graft(move_41.Geometry), CurveB=flatten(crv_80))  # -> Points, ParamsA, ParamsB
shift_12 = ShiftPaths(Data=ccx_28.Points, Offset=-1)
sort_36 = SortList(Keys=shift_12, ValuesA=shift_12)  # -> Keys, ValuesA
pull_35 = PullPoint(Point=sort_36.ValuesA, Geometry=graft(pln_76), ClosestOnly=True)  # -> ClosestPoint, Distance
sort_37 = SortList(Keys=pull_35.Distance, ValuesA=sort_36.ValuesA)  # -> Keys, ValuesA
item_60 = ListItem(List=sort_37.ValuesA, Index="-1", Wrap=True)
null_24 = NullItem(Item=flatten(item_60))  # -> NullFlags, InvalidFlags, Description
end_9 = EndPoints(Curve=move_41.Geometry)  # -> Start, End
dispatch_80 = Dispatch(List=simplify(item_60), DispatchPattern=simplify(graft(null_24.InvalidFlags)))  # -> ListA, ListB
dispatch_81 = Dispatch(List=graft(pln_76), DispatchPattern=flatten(null_24.InvalidFlags))  # -> ListA, ListB
dispatch_82 = Dispatch(List=simplify(graft(end_9.End)), DispatchPattern=simplify(graft(null_24.InvalidFlags)))  # -> ListA, ListB
pln_79 = Plane(dispatch_81.ListB)
pt_31 = Point(dispatch_80.ListB)
pt_32 = Point(dispatch_82.ListB)
ln_39 = Line(StartPoint=pt_32, EndPoint=pt_28)
len_9 = Length(Curve=ln_39)
larger_12 = LargerThan(FirstNumber=len_9, SecondNumber=Slider(350, range=0..1000))  # -> LargerThan, OrEqualTo
dispatch_83 = Dispatch(List=pln_79, DispatchPattern=larger_12.LargerThan)  # -> ListA, ListB
dispatch_84 = Dispatch(List=pt_32, DispatchPattern=larger_12.LargerThan)  # -> ListA, ListB
pln_80 = Plane(dispatch_83.ListA)
pt_33 = Point(dispatch_84.ListA)

# ----
# 按照梁分类定位点
pln_81 = Plane(pln_78)
pt_34 = Point(pt_30)
incurves_19 = PointInCurves(Point=flatten(pt_34), Curves=crv_69)  # -> Relationship, Index, Point
equals_21 = Equality(FirstNumber=incurves_19.Relationship, SecondNumber="0")  # -> Equality, Inequality
dispatch_85 = Dispatch(List=flatten(pln_81), DispatchPattern=equals_21.Inequality)  # -> ListA, ListB
data_74 = Data(dispatch_85.ListA)

# ----
# 按照梁分类定位点
pln_82 = Plane(pln_80)
pt_35 = Point(pt_33)
incurves_20 = PointInCurves(Point=flatten(pt_35), Curves=crv_69)  # -> Relationship, Index, Point
equals_22 = Equality(FirstNumber=incurves_20.Relationship, SecondNumber="0")  # -> Equality, Inequality
dispatch_86 = Dispatch(List=flatten(pln_82), DispatchPattern=equals_22.Inequality)  # -> ListA, ListB
data_75 = Data(dispatch_86.ListA)

incurves_21 = PointInCurves(Point=flatten(pt_35), Curves=crv_69)  # -> Relationship, Index, Point
equals_23 = Equality(FirstNumber=incurves_21.Relationship, SecondNumber="0")  # -> Equality, Inequality
dispatch_87 = Dispatch(List=flatten(pt_35), DispatchPattern=equals_23.Inequality)  # -> ListA, ListB
data_76 = Data(dispatch_87.ListA)

incurves_22 = PointInCurves(Point=flatten(pt_34), Curves=crv_69)  # -> Relationship, Index, Point
equals_24 = Equality(FirstNumber=incurves_22.Relationship, SecondNumber="0")  # -> Equality, Inequality
dispatch_88 = Dispatch(List=flatten(pt_34), DispatchPattern=equals_24.Inequality)  # -> ListA, ListB
data_77 = Data(dispatch_88.ListA)

move2pt_26 = MoveToPoint(Geometry=data_74, PointA=data_74, PointB=data_77)  # -> Moved, Vector, Transform
null_25 = NullItem(Item=move2pt_26.Moved)  # -> NullFlags, InvalidFlags, Description
dispatch_89 = Dispatch(List=move2pt_26.Moved, DispatchPattern=null_25.InvalidFlags)  # -> ListA, ListB

move2pt_27 = MoveToPoint(Geometry=data_75, PointA=data_75, PointB=data_76)  # -> Moved, Vector, Transform
null_26 = NullItem(Item=move2pt_27.Moved)  # -> NullFlags, InvalidFlags, Description
dispatch_90 = Dispatch(List=move2pt_27.Moved, DispatchPattern=null_26.InvalidFlags)  # -> ListA, ListB
pln_83 = Plane(dispatch_90.ListB)

# ---- group: 2次筛选所得
pln_84 = Plane(dispatch_89.ListB)

# ----
# 撞到梁交点
merge_19 = Merge(Data1=pln_84, Data2=pln_83)

merge_20 = Merge(Data1=pln_75, Data2=merge_19)
orient_4 = Orient(Geometry=item_12, Source=rotate_3.Geometry, Target=merge_20)  # -> Geometry, Transform

data_78 = Data(orient_4.Geometry)
ungroup_5 = Ungroup(Group=data_78)
item_61 = ListItem(List=ungroup_5, Index=0, Wrap=True)  # -> flatten(Item)
item_62 = ListItem(List=ungroup_5, Index="-1", Wrap=True)  # -> flatten(Item)

entwine_18 = Entwine(Branch00=item_61, Branch01=item_62, FlattenInputs=True)
bake_5 = BakeObjects(Geometry=entwine_18, Attributes=attributes_4, BakeName="Embed::2-1-03钢板焊埋件", Bake=False)

number_slider_56 = Slider(3584, range=0..10000)
deplane_38 = DeconstructPlane(Plane=pln_38)  # -> Origin, XAxis, YAxis, ZAxis
amp_38 = Amplitude(Vector=deplane_38.YAxis, Amplitude=number_slider_56)
amp_39 = Amplitude(Vector=deplane_38.YAxis, Amplitude=expr("-x", number_slider_56))
boundary_5 = BoundarySurfaces(Edges=[offset_4, offset_5])
crv_81 = Curve(merge_11)
move_42 = Move(Geometry=deplane_38.Origin, Motion=amp_39)  # -> Geometry, Transform
move_43 = Move(Geometry=deplane_38.Origin, Motion=amp_38)  # -> Geometry, Transform
ln_40 = Line(StartPoint=move_42.Geometry, EndPoint=move_43.Geometry)

# ---- group: 50-350建筑结构交点
scx_2 = SurfaceCurve(Surface=boundary_5, Curve=crv_81)  # -> flatten(Curves), Points, UVPoints, Normals, Parameters, Tangents

# ---- group: 该区间的定位点
ccx_29 = CurveCurve(CurveA=graft(ln_40), CurveB=scx_2.Curves)  # -> Points, ParamsA, ParamsB

# ----
shift_13 = ShiftPaths(Data=ccx_29.Points, Offset=-1)
pull_36 = PullPoint(Point=graft(pln_38), Geometry=shift_13, ClosestOnly=True)  # -> ClosestPoint, Distance
sort_38 = SortList(Keys=pull_36.Distance, ValuesA=pull_36.ClosestPoint)  # -> Keys, ValuesA
null_27 = NullItem(Item=sort_38.ValuesA)  # -> NullFlags, simplify(InvalidFlags), Description
item_63 = ListItem(List=sort_38.ValuesA, Index=0, Wrap=True)
dispatch_91 = Dispatch(List=simplify(graft(pln_38)), DispatchPattern=null_27.InvalidFlags)  # -> ListA, ListB
dispatch_92 = Dispatch(List=simplify(graft(item_63)), DispatchPattern=null_27.InvalidFlags)  # -> ListA, ListB
pln_85 = Plane(dispatch_91.ListB)
pln_86 = Plane(dispatch_91.ListA)
pt_36 = Point(dispatch_92.ListB)

# ----
# 可能的结构交点-大量
pln_87 = Plane(pln_86)

# ----
# 0 檐口出定位点
# 与结构无交点
pln_88 = Plane(flatten(pln_87))

crv_82 = Curve(shift)

# ----
# 按照梁分类定位点
pt_37 = Point(pt_36)
pln_89 = Plane(pln_85)
incurves_23 = PointInCurves(Point=flatten(pt_37), Curves=crv_82)  # -> Relationship, Index, Point
equals_25 = Equality(FirstNumber=incurves_23.Relationship, SecondNumber="0")  # -> Equality, Inequality
dispatch_93 = Dispatch(List=flatten(pln_89), DispatchPattern=equals_25.Inequality)  # -> ListA, ListB
data_79 = Data(dispatch_93.ListA)

incurves_24 = PointInCurves(Point=flatten(pt_37), Curves=crv_82)  # -> Relationship, Index, Point
equals_26 = Equality(FirstNumber=incurves_24.Relationship, SecondNumber="0")  # -> Equality, Inequality
dispatch_94 = Dispatch(List=flatten(pt_37), DispatchPattern=equals_26.Inequality)  # -> ListA, ListB
data_80 = Data(dispatch_94.ListA)

move2pt_28 = MoveToPoint(Geometry=data_79, PointA=data_79, PointB=data_80)  # -> Moved, Vector, Transform
null_28 = NullItem(Item=move2pt_28.Moved)  # -> NullFlags, InvalidFlags, Description
dispatch_95 = Dispatch(List=move2pt_28.Moved, DispatchPattern=null_28.InvalidFlags)  # -> ListA, ListB
pln_90 = Plane(dispatch_95.ListB)

# ----
# 3.1
# 下层建筑边线外侧50-350mm
# 03：钢板焊埋件[钢梁内侧]
# @钢边梁宽@钢边梁高
pln_91 = Plane(pln_90)

crv_83 = Curve(shift)

# ----
# 按照梁分类定位点
pt_38 = Point(pt_10)
pln_92 = Plane(pln_40)
incurves_25 = PointInCurves(Point=flatten(pt_38), Curves=crv_83)  # -> Relationship, Index, Point
equals_27 = Equality(FirstNumber=incurves_25.Relationship, SecondNumber="0")  # -> Equality, Inequality
dispatch_96 = Dispatch(List=flatten(pln_92), DispatchPattern=equals_27.Inequality)  # -> ListA, ListB
data_81 = Data(dispatch_96.ListA)

incurves_26 = PointInCurves(Point=flatten(pt_38), Curves=crv_83)  # -> Relationship, Index, Point
equals_28 = Equality(FirstNumber=incurves_26.Relationship, SecondNumber="0")  # -> Equality, Inequality
dispatch_97 = Dispatch(List=flatten(pt_38), DispatchPattern=equals_28.Inequality)  # -> ListA, ListB
data_82 = Data(dispatch_97.ListA)

move2pt_29 = MoveToPoint(Geometry=data_81, PointA=data_81, PointB=data_82)  # -> Moved, Vector, Transform
null_29 = NullItem(Item=move2pt_29.Moved)  # -> NullFlags, InvalidFlags, Description
dispatch_98 = Dispatch(List=move2pt_29.Moved, DispatchPattern=null_29.InvalidFlags)  # -> ListA, ListB
pln_93 = Plane(dispatch_98.ListB)

# ----
# 3.2
# 下层建筑边线内侧300-600mm范围
# 03：钢板焊埋件[钢梁外侧]
# @钢边梁宽@钢边梁高
pln_94 = Plane(pln_93)

# ----
# 3.1 Missing Point
# 埋件定位点Offset，没有找到和梁的交点
number_slider_57 = Slider(5000, range=0..10000)
deplane_39 = DeconstructPlane(Plane=pln_88)  # -> Origin, XAxis, YAxis, ZAxis
amp_40 = Amplitude(Vector=deplane_39.YAxis, Amplitude=number_slider_57)
crv_84 = Curve(scx_2.Curves)
move_44 = Move(Geometry=deplane_39.Origin, Motion=amp_40)  # -> Geometry, Transform
ln_41 = Line(StartPoint=move_44.Geometry, EndPoint=deplane_39.Origin)
amp_41 = Amplitude(Vector=deplane_39.XAxis, Amplitude=expr("-x", number_slider_24))
amp_42 = Amplitude(Vector=deplane_39.XAxis, Amplitude=number_slider_24)
move_45 = Move(Geometry=ln_41, Motion=amp_42)  # -> Geometry, Transform
move_46 = Move(Geometry=ln_41, Motion=amp_41)  # -> Geometry, Transform
pln_95 = Plane(pln_86)

ccx_30 = CurveCurve(CurveA=graft(move_46.Geometry), CurveB=flatten(crv_84))  # -> Points, ParamsA, ParamsB
shift_14 = ShiftPaths(Data=ccx_30.Points, Offset=-1)
sort_39 = SortList(Keys=shift_14, ValuesA=shift_14)  # -> Keys, ValuesA
pull_37 = PullPoint(Point=sort_39.ValuesA, Geometry=graft(pln_88), ClosestOnly=True)  # -> ClosestPoint, Distance
sort_40 = SortList(Keys=pull_37.Distance, ValuesA=sort_39.ValuesA)  # -> Keys, ValuesA
item_64 = ListItem(List=sort_40.ValuesA, Index="-1", Wrap=True)
null_30 = NullItem(Item=flatten(item_64))  # -> NullFlags, InvalidFlags, Description
dispatch_99 = Dispatch(List=flatten(item_64), DispatchPattern=null_30.InvalidFlags)  # -> ListA, ListB
dispatch_100 = Dispatch(List=pln_88, DispatchPattern=null_30.InvalidFlags)  # -> ListA, ListB
pt_39 = Point(dispatch_99.ListB)
pln_96 = Plane(dispatch_100.ListB)

ccx_31 = CurveCurve(CurveA=graft(move_45.Geometry), CurveB=flatten(crv_84))  # -> Points, ParamsA, ParamsB
shift_15 = ShiftPaths(Data=ccx_31.Points, Offset=-1)
sort_41 = SortList(Keys=shift_15, ValuesA=shift_15)  # -> Keys, ValuesA
pull_38 = PullPoint(Point=sort_41.ValuesA, Geometry=graft(pln_88), ClosestOnly=True)  # -> ClosestPoint, Distance
sort_42 = SortList(Keys=pull_38.Distance, ValuesA=sort_41.ValuesA)  # -> Keys, ValuesA
item_65 = ListItem(List=sort_42.ValuesA, Index="-1", Wrap=True)
null_31 = NullItem(Item=flatten(item_65))  # -> NullFlags, InvalidFlags, Description
dispatch_101 = Dispatch(List=flatten(item_65), DispatchPattern=null_31.InvalidFlags)  # -> ListA, ListB
dispatch_102 = Dispatch(List=pln_88, DispatchPattern=null_31.InvalidFlags)  # -> ListA, ListB
pln_97 = Plane(dispatch_102.ListB)
pt_40 = Point(dispatch_101.ListB)

merge_21 = Merge(Data1=pln_97, Data2=pln_96)  # -> flatten(Result)
check_same_points_7 = CheckSamePoints(archPoint=flatten(pln_95), crvPoint=merge_21)  # -> out, specialPt; inputs archPoint: list of Point3d, crvPoint: list of Point3d; same code as testpoint

# ----
# pass
cull_i_17 = CullIndex(List=flatten(pln_95), Indices=check_same_points_7.specialPt, Wrap=True)

# ----
# 按照梁分类定位点
pln_98 = Plane(pln_97)
pt_41 = Point(pt_40)
incurves_27 = PointInCurves(Point=flatten(pt_41), Curves=crv_70)  # -> Relationship, Index, Point
equals_29 = Equality(FirstNumber=incurves_27.Relationship, SecondNumber="0")  # -> Equality, Inequality
dispatch_103 = Dispatch(List=flatten(pln_98), DispatchPattern=equals_29.Inequality)  # -> ListA, ListB
data_83 = Data(dispatch_103.ListA)

# ----
# 按照梁分类定位点
pln_99 = Plane(pln_96)
pt_42 = Point(pt_39)
incurves_28 = PointInCurves(Point=flatten(pt_42), Curves=crv_70)  # -> Relationship, Index, Point
equals_30 = Equality(FirstNumber=incurves_28.Relationship, SecondNumber="0")  # -> Equality, Inequality
dispatch_104 = Dispatch(List=flatten(pln_99), DispatchPattern=equals_30.Inequality)  # -> ListA, ListB
data_84 = Data(dispatch_104.ListA)

incurves_29 = PointInCurves(Point=flatten(pt_42), Curves=crv_70)  # -> Relationship, Index, Point
equals_31 = Equality(FirstNumber=incurves_29.Relationship, SecondNumber="0")  # -> Equality, Inequality
dispatch_105 = Dispatch(List=flatten(pt_42), DispatchPattern=equals_31.Inequality)  # -> ListA, ListB
data_85 = Data(dispatch_105.ListA)

incurves_30 = PointInCurves(Point=flatten(pt_41), Curves=crv_70)  # -> Relationship, Index, Point
equals_32 = Equality(FirstNumber=incurves_30.Relationship, SecondNumber="0")  # -> Equality, Inequality
dispatch_106 = Dispatch(List=flatten(pt_41), DispatchPattern=equals_32.Inequality)  # -> ListA, ListB
data_86 = Data(dispatch_106.ListA)

move2pt_30 = MoveToPoint(Geometry=data_83, PointA=data_83, PointB=data_86)  # -> Moved, Vector, Transform
null_32 = NullItem(Item=move2pt_30.Moved)  # -> NullFlags, InvalidFlags, Description
dispatch_107 = Dispatch(List=move2pt_30.Moved, DispatchPattern=null_32.InvalidFlags)  # -> ListA, ListB
pln_100 = Plane(dispatch_107.ListB)

move2pt_31 = MoveToPoint(Geometry=data_84, PointA=data_84, PointB=data_85)  # -> Moved, Vector, Transform
null_33 = NullItem(Item=move2pt_31.Moved)  # -> NullFlags, InvalidFlags, Description
dispatch_108 = Dispatch(List=move2pt_31.Moved, DispatchPattern=null_33.InvalidFlags)  # -> ListA, ListB
pln_101 = Plane(dispatch_108.ListB)

# ----
# 撞到梁交点
merge_22 = Merge(Data1=pln_100, Data2=pln_101)

merge_23 = Merge(Data1=pln_91, Data2=merge_22)
orient_5 = Orient(Geometry=item_14, Source=rotate_4.Geometry, Target=merge_23)  # -> Geometry, Transform

data_87 = Data(orient_5.Geometry)
ungroup_6 = Ungroup(Group=data_87)
item_66 = ListItem(List=ungroup_6, Index=0, Wrap=True)  # -> flatten(Item)
item_67 = ListItem(List=ungroup_6, Index="-1", Wrap=True)  # -> flatten(Item)

entwine_19 = Entwine(Branch00=item_66, Branch01=item_67, FlattenInputs=True)
bake_6 = BakeObjects(Geometry=entwine_19, Attributes=attributes_6, BakeName="Embed::3-1-03钢板焊埋件", Bake=False)

# ----
# 3.2  Missing Point
# 埋件定位点Offset，没有找到和梁的交点
number_slider_58 = Slider(5000, range=0..10000)
crv_85 = Curve(scx.Curves)
deplane_40 = DeconstructPlane(Plane=pln_43)  # -> Origin, XAxis, YAxis, ZAxis
amp_43 = Amplitude(Vector=deplane_40.YAxis, Amplitude=number_slider_58)
move_47 = Move(Geometry=deplane_40.Origin, Motion=amp_43)  # -> Geometry, Transform
ln_42 = Line(StartPoint=move_47.Geometry, EndPoint=deplane_40.Origin)
amp_44 = Amplitude(Vector=deplane_40.XAxis, Amplitude=number_slider_24)
amp_45 = Amplitude(Vector=deplane_40.XAxis, Amplitude=expr("-x", number_slider_24))
move_48 = Move(Geometry=ln_42, Motion=amp_44)  # -> Geometry, Transform
move_49 = Move(Geometry=ln_42, Motion=amp_45)  # -> Geometry, Transform
pln_102 = Plane(pln_41)

ccx_32 = CurveCurve(CurveA=graft(move_49.Geometry), CurveB=flatten(crv_85))  # -> Points, ParamsA, ParamsB
shift_16 = ShiftPaths(Data=ccx_32.Points, Offset=-1)
sort_43 = SortList(Keys=shift_16, ValuesA=shift_16)  # -> Keys, ValuesA
pull_39 = PullPoint(Point=sort_43.ValuesA, Geometry=graft(pln_43), ClosestOnly=True)  # -> ClosestPoint, Distance
sort_44 = SortList(Keys=pull_39.Distance, ValuesA=sort_43.ValuesA)  # -> Keys, ValuesA
item_68 = ListItem(List=sort_44.ValuesA, Index="-1", Wrap=True)
null_34 = NullItem(Item=flatten(item_68))  # -> NullFlags, InvalidFlags, Description
dispatch_109 = Dispatch(List=flatten(item_68), DispatchPattern=null_34.InvalidFlags)  # -> ListA, ListB
dispatch_110 = Dispatch(List=pln_43, DispatchPattern=null_34.InvalidFlags)  # -> ListA, ListB
pt_43 = Point(dispatch_109.ListB)
pln_103 = Plane(dispatch_110.ListB)

ccx_33 = CurveCurve(CurveA=graft(move_48.Geometry), CurveB=flatten(crv_85))  # -> Points, ParamsA, ParamsB
shift_17 = ShiftPaths(Data=ccx_33.Points, Offset=-1)
sort_45 = SortList(Keys=shift_17, ValuesA=shift_17)  # -> Keys, ValuesA
pull_40 = PullPoint(Point=sort_45.ValuesA, Geometry=graft(pln_43), ClosestOnly=True)  # -> ClosestPoint, Distance
sort_46 = SortList(Keys=pull_40.Distance, ValuesA=sort_45.ValuesA)  # -> Keys, ValuesA
item_69 = ListItem(List=sort_46.ValuesA, Index="-1", Wrap=True)
null_35 = NullItem(Item=flatten(item_69))  # -> NullFlags, InvalidFlags, Description
dispatch_111 = Dispatch(List=flatten(item_69), DispatchPattern=null_35.InvalidFlags)  # -> ListA, ListB
dispatch_112 = Dispatch(List=pln_43, DispatchPattern=null_35.InvalidFlags)  # -> ListA, ListB
pln_104 = Plane(dispatch_112.ListB)
pt_44 = Point(dispatch_111.ListB)

merge_24 = Merge(Data1=pln_104, Data2=pln_103)  # -> flatten(Result)
check_same_points_8 = CheckSamePoints(archPoint=flatten(pln_102), crvPoint=merge_24)  # -> out, specialPt; inputs archPoint: list of Point3d, crvPoint: list of Point3d; same code as testpoint

# ----
# pass
cull_i_18 = CullIndex(List=flatten(pln_102), Indices=check_same_points_8.specialPt, Wrap=True)

# ----
# 按照梁分类定位点
pln_105 = Plane(pln_104)
pt_45 = Point(pt_44)
incurves_31 = PointInCurves(Point=flatten(pt_45), Curves=crv_71)  # -> Relationship, Index, Point
equals_33 = Equality(FirstNumber=incurves_31.Relationship, SecondNumber="0")  # -> Equality, Inequality
dispatch_113 = Dispatch(List=flatten(pln_105), DispatchPattern=equals_33.Inequality)  # -> ListA, ListB
data_88 = Data(dispatch_113.ListA)

# ----
# 按照梁分类定位点
pln_106 = Plane(pln_103)
pt_46 = Point(pt_43)
incurves_32 = PointInCurves(Point=flatten(pt_46), Curves=crv_71)  # -> Relationship, Index, Point
equals_34 = Equality(FirstNumber=incurves_32.Relationship, SecondNumber="0")  # -> Equality, Inequality
dispatch_114 = Dispatch(List=flatten(pln_106), DispatchPattern=equals_34.Inequality)  # -> ListA, ListB
data_89 = Data(dispatch_114.ListA)

incurves_33 = PointInCurves(Point=flatten(pt_46), Curves=crv_71)  # -> Relationship, Index, Point
equals_35 = Equality(FirstNumber=incurves_33.Relationship, SecondNumber="0")  # -> Equality, Inequality
dispatch_115 = Dispatch(List=flatten(pt_46), DispatchPattern=equals_35.Inequality)  # -> ListA, ListB
data_90 = Data(dispatch_115.ListA)

incurves_34 = PointInCurves(Point=flatten(pt_45), Curves=crv_71)  # -> Relationship, Index, Point
equals_36 = Equality(FirstNumber=incurves_34.Relationship, SecondNumber="0")  # -> Equality, Inequality
dispatch_116 = Dispatch(List=flatten(pt_45), DispatchPattern=equals_36.Inequality)  # -> ListA, ListB
data_91 = Data(dispatch_116.ListA)

move2pt_32 = MoveToPoint(Geometry=data_88, PointA=data_88, PointB=data_91)  # -> Moved, Vector, Transform
null_36 = NullItem(Item=move2pt_32.Moved)  # -> NullFlags, InvalidFlags, Description
dispatch_117 = Dispatch(List=move2pt_32.Moved, DispatchPattern=null_36.InvalidFlags)  # -> ListA, ListB
pln_107 = Plane(dispatch_117.ListB)

move2pt_33 = MoveToPoint(Geometry=data_89, PointA=data_89, PointB=data_90)  # -> Moved, Vector, Transform
null_37 = NullItem(Item=move2pt_33.Moved)  # -> NullFlags, InvalidFlags, Description
dispatch_118 = Dispatch(List=move2pt_33.Moved, DispatchPattern=null_37.InvalidFlags)  # -> ListA, ListB
pln_108 = Plane(dispatch_118.ListB)

# ----
# 撞到梁交点
merge_25 = Merge(Data1=pln_107, Data2=pln_108)

pln_109 = Plane(cull_i_18)
pln_110 = Plane(cull_i_17)

# ----
# 3.1下层建筑内侧到300到外侧50内是否有钢结构
deplane_41 = DeconstructPlane(Plane=pln_110)  # -> Origin, XAxis, YAxis, ZAxis
deplane_42 = DeconstructPlane(Plane=pln_109)  # -> Origin, XAxis, YAxis, ZAxis
check_same_points_9 = CheckSamePoints(archPoint=deplane_42.Origin, crvPoint=deplane_41.Origin)  # -> out, specialPt; inputs archPoint: list of Point3d, crvPoint: list of Point3d; same code as testpoint

merge_26 = Merge(Data1=pln_94, Data2=merge_25)
orient_6 = Orient(Geometry=item_16, Source=item_17, Target=merge_26)  # -> Geometry, Transform

data_92 = Data(orient_6.Geometry)
ungroup_7 = Ungroup(Group=data_92)
item_70 = ListItem(List=ungroup_7, Index=0, Wrap=True)  # -> flatten(Item)
item_71 = ListItem(List=ungroup_7, Index="-1", Wrap=True)  # -> flatten(Item)

entwine_20 = Entwine(Branch00=item_70, Branch01=item_71, FlattenInputs=True)
bake_7 = BakeObjects(Geometry=entwine_20, Attributes=attributes_7, BakeName="Embed::3-2-03钢板焊埋件", Bake=False)

# ----
# 同时满足N
item_72 = ListItem(List=pln_109, Index=check_same_points_9.specialPt, Wrap=True)

pln_111 = Plane(item_72)
flatten_15 = FlattenTree(Tree=crv_58, Path="{0}")
number_slider_59 = Slider(3584, range=0..10000)
deplane_43 = DeconstructPlane(Plane=pln_111)  # -> Origin, XAxis, YAxis, ZAxis
boundary_6 = BoundarySurfaces(Edges=[offset_7, offset_6])
crv_86 = Curve(flatten_15)
amp_46 = Amplitude(Vector=deplane_43.YAxis, Amplitude=number_slider_59)
amp_47 = Amplitude(Vector=deplane_43.YAxis, Amplitude=expr("-x", number_slider_59))
scx_3 = SurfaceCurve(Surface=boundary_6, Curve=crv_86)  # -> flatten(Curves), Points, UVPoints, Normals, Parameters, Tangents
move_50 = Move(Geometry=deplane_43.Origin, Motion=amp_47)  # -> Geometry, Transform
move_51 = Move(Geometry=deplane_43.Origin, Motion=amp_46)  # -> Geometry, Transform
ln_43 = Line(StartPoint=move_50.Geometry, EndPoint=move_51.Geometry)
ccx_34 = CurveCurve(CurveA=graft(ln_43), CurveB=scx_3.Curves)  # -> Points, ParamsA, ParamsB
shift_18 = ShiftPaths(Data=ccx_34.Points, Offset=-1)
pull_41 = PullPoint(Point=graft(pln_111), Geometry=shift_18, ClosestOnly=True)  # -> ClosestPoint, Distance
sort_47 = SortList(Keys=pull_41.Distance, ValuesA=pull_41.ClosestPoint)  # -> Keys, ValuesA
item_73 = ListItem(List=sort_47.ValuesA, Index=0, Wrap=True)
null_38 = NullItem(Item=sort_47.ValuesA)  # -> NullFlags, simplify(InvalidFlags), Description
dispatch_119 = Dispatch(List=simplify(graft(pln_111)), DispatchPattern=null_38.InvalidFlags)  # -> ListA, ListB
pln_112 = Plane(dispatch_119.ListB)
pln_113 = Plane(dispatch_119.ListA)

dispatch_120 = Dispatch(List=simplify(graft(item_73)), DispatchPattern=null_38.InvalidFlags)  # -> ListA, ListB
pt_47 = Point(dispatch_120.ListB)

# ----
# 按照梁分类定位点
pt_48 = Point(pt_47)
pln_114 = Plane(pln_112)
incurves_35 = PointInCurves(Point=flatten(pt_48), Curves=crv_72)  # -> Relationship, Index, Point
equals_37 = Equality(FirstNumber=incurves_35.Relationship, SecondNumber="0")  # -> Equality, Inequality
dispatch_121 = Dispatch(List=flatten(pln_114), DispatchPattern=equals_37.Inequality)  # -> ListA, ListB
data_93 = Data(dispatch_121.ListA)

incurves_36 = PointInCurves(Point=flatten(pt_48), Curves=crv_72)  # -> Relationship, Index, Point
equals_38 = Equality(FirstNumber=incurves_36.Relationship, SecondNumber="0")  # -> Equality, Inequality
dispatch_122 = Dispatch(List=flatten(pt_48), DispatchPattern=equals_38.Inequality)  # -> ListA, ListB
data_94 = Data(dispatch_122.ListA)

move2pt_34 = MoveToPoint(Geometry=data_93, PointA=data_93, PointB=data_94)  # -> Moved, Vector, Transform
null_39 = NullItem(Item=move2pt_34.Moved)  # -> NullFlags, InvalidFlags, Description
dispatch_123 = Dispatch(List=move2pt_34.Moved, DispatchPattern=null_39.InvalidFlags)  # -> ListA, ListB
pln_115 = Plane(dispatch_123.ListB)

# ----
# 可能的结构交点-大量
pln_116 = Plane(pln_113)

# ----
# 0 檐口出定位点
# 与结构无交点
pln_117 = Plane(flatten(pln_116))

# ----
# 4.1下层建筑内侧300到外侧50内
# 03底埋，钢板焊
pln_118 = Plane(pln_115)

# ----
# 4 Missing Point
# 埋件定位点Offset，没有找到和梁的交点
number_slider_60 = Slider(5000, range=0..10000)
deplane_44 = DeconstructPlane(Plane=pln_117)  # -> Origin, XAxis, YAxis, ZAxis
crv_87 = Curve(scx_3.Curves)
amp_48 = Amplitude(Vector=deplane_44.YAxis, Amplitude=number_slider_60)
move_52 = Move(Geometry=deplane_44.Origin, Motion=amp_48)  # -> Geometry, Transform
ln_44 = Line(StartPoint=move_52.Geometry, EndPoint=deplane_44.Origin)
amp_49 = Amplitude(Vector=deplane_44.XAxis, Amplitude=number_slider_24)
amp_50 = Amplitude(Vector=deplane_44.XAxis, Amplitude=expr("-x", number_slider_24))
move_53 = Move(Geometry=ln_44, Motion=amp_49)  # -> Geometry, Transform
move_54 = Move(Geometry=ln_44, Motion=amp_50)  # -> Geometry, Transform
pln_119 = Plane(pln_117)

ccx_35 = CurveCurve(CurveA=graft(move_54.Geometry), CurveB=flatten(crv_87))  # -> Points, ParamsA, ParamsB
shift_19 = ShiftPaths(Data=ccx_35.Points, Offset=-1)
sort_48 = SortList(Keys=shift_19, ValuesA=shift_19)  # -> Keys, ValuesA
pull_42 = PullPoint(Point=sort_48.ValuesA, Geometry=graft(pln_117), ClosestOnly=True)  # -> ClosestPoint, Distance
sort_49 = SortList(Keys=pull_42.Distance, ValuesA=sort_48.ValuesA)  # -> Keys, ValuesA
item_74 = ListItem(List=sort_49.ValuesA, Index="-1", Wrap=True)
null_40 = NullItem(Item=flatten(item_74))  # -> NullFlags, InvalidFlags, Description
dispatch_124 = Dispatch(List=flatten(item_74), DispatchPattern=null_40.InvalidFlags)  # -> ListA, ListB
dispatch_125 = Dispatch(List=pln_117, DispatchPattern=null_40.InvalidFlags)  # -> ListA, ListB
pln_120 = Plane(dispatch_125.ListB)
pt_49 = Point(dispatch_124.ListB)

ccx_36 = CurveCurve(CurveA=graft(move_53.Geometry), CurveB=flatten(crv_87))  # -> Points, ParamsA, ParamsB
shift_20 = ShiftPaths(Data=ccx_36.Points, Offset=-1)
sort_50 = SortList(Keys=shift_20, ValuesA=shift_20)  # -> Keys, ValuesA
pull_43 = PullPoint(Point=sort_50.ValuesA, Geometry=graft(pln_117), ClosestOnly=True)  # -> ClosestPoint, Distance
sort_51 = SortList(Keys=pull_43.Distance, ValuesA=sort_50.ValuesA)  # -> Keys, ValuesA
item_75 = ListItem(List=sort_51.ValuesA, Index="-1", Wrap=True)
null_41 = NullItem(Item=flatten(item_75))  # -> NullFlags, InvalidFlags, Description
dispatch_126 = Dispatch(List=pln_117, DispatchPattern=null_41.InvalidFlags)  # -> ListA, ListB
dispatch_127 = Dispatch(List=flatten(item_75), DispatchPattern=null_41.InvalidFlags)  # -> ListA, ListB
pt_50 = Point(dispatch_127.ListB)
pln_121 = Plane(dispatch_126.ListB)

merge_27 = Merge(Data1=pln_121, Data2=pln_120)  # -> flatten(Result)
check_same_points_10 = CheckSamePoints(archPoint=flatten(pln_119), crvPoint=merge_27)  # -> out, specialPt; inputs archPoint: list of Point3d, crvPoint: list of Point3d; same code as testpoint

# ----
# pass
cull_i_19 = CullIndex(List=flatten(pln_119), Indices=check_same_points_10.specialPt, Wrap=True)  # -> simplify(graft(List))

# ----
# 按照梁分类定位点
pln_122 = Plane(pln_121)
pt_51 = Point(pt_50)
incurves_37 = PointInCurves(Point=flatten(pt_51), Curves=crv_73)  # -> Relationship, Index, Point
equals_39 = Equality(FirstNumber=incurves_37.Relationship, SecondNumber="0")  # -> Equality, Inequality
dispatch_128 = Dispatch(List=flatten(pln_122), DispatchPattern=equals_39.Inequality)  # -> ListA, ListB
data_95 = Data(dispatch_128.ListA)

# ----
# 按照梁分类定位点
pln_123 = Plane(pln_120)
pt_52 = Point(pt_49)
incurves_38 = PointInCurves(Point=flatten(pt_52), Curves=crv_73)  # -> Relationship, Index, Point
equals_40 = Equality(FirstNumber=incurves_38.Relationship, SecondNumber="0")  # -> Equality, Inequality
dispatch_129 = Dispatch(List=flatten(pln_123), DispatchPattern=equals_40.Inequality)  # -> ListA, ListB
data_96 = Data(dispatch_129.ListA)

incurves_39 = PointInCurves(Point=flatten(pt_52), Curves=crv_73)  # -> Relationship, Index, Point
equals_41 = Equality(FirstNumber=incurves_39.Relationship, SecondNumber="0")  # -> Equality, Inequality
dispatch_130 = Dispatch(List=flatten(pt_52), DispatchPattern=equals_41.Inequality)  # -> ListA, ListB
data_97 = Data(dispatch_130.ListA)

incurves_40 = PointInCurves(Point=flatten(pt_51), Curves=crv_73)  # -> Relationship, Index, Point
equals_42 = Equality(FirstNumber=incurves_40.Relationship, SecondNumber="0")  # -> Equality, Inequality
dispatch_131 = Dispatch(List=flatten(pt_51), DispatchPattern=equals_42.Inequality)  # -> ListA, ListB
data_98 = Data(dispatch_131.ListA)

move2pt_35 = MoveToPoint(Geometry=data_95, PointA=data_95, PointB=data_98)  # -> Moved, Vector, Transform
null_42 = NullItem(Item=move2pt_35.Moved)  # -> NullFlags, InvalidFlags, Description
dispatch_132 = Dispatch(List=move2pt_35.Moved, DispatchPattern=null_42.InvalidFlags)  # -> ListA, ListB
pln_124 = Plane(dispatch_132.ListB)

move2pt_36 = MoveToPoint(Geometry=data_96, PointA=data_96, PointB=data_97)  # -> Moved, Vector, Transform
null_43 = NullItem(Item=move2pt_36.Moved)  # -> NullFlags, InvalidFlags, Description
dispatch_133 = Dispatch(List=move2pt_36.Moved, DispatchPattern=null_43.InvalidFlags)  # -> ListA, ListB
pln_125 = Plane(dispatch_133.ListB)

# ----
# 撞到梁交点
merge_28 = Merge(Data1=pln_124, Data2=pln_125)

merge_29 = Merge(Data1=flatten(pln_118), Data2=flatten(merge_28))
orient_7 = Orient(Geometry=item_19, Source=item_18, Target=merge_29)  # -> Geometry, Transform

data_99 = Data(orient_7.Geometry)
ungroup_8 = Ungroup(Group=data_99)
item_76 = ListItem(List=ungroup_8, Index=0, Wrap=True)  # -> flatten(Item)
item_77 = ListItem(List=ungroup_8, Index="-1", Wrap=True)  # -> flatten(Item)

entwine_21 = Entwine(Branch00=item_76, Branch01=item_77, FlattenInputs=True)
bake_8 = BakeObjects(Geometry=entwine_21, Attributes=attributes_8, BakeName="Embed::4-1钢板焊底埋", Bake=False)

# ----
# 4.0下层建筑内侧到300到外侧50内
# 无钢结构
# 要求主体结构提供钢结构梁，默认位置为建筑边线向内300mm
number_slider_61 = Slider(300, range=0..1000)
crv_88 = Curve(crv_26)
pln_126 = Plane(cull_i_19)
offset_13 = OffsetCurve(Curve=crv_88, Distance=expr("-x", number_slider_61), Corners=1)
pull_44 = PullPoint(Point=pln_126, Geometry=offset_13, ClosestOnly=True)  # -> ClosestPoint, Distance
sort_52 = SortList(Keys=pull_44.Distance)  # -> Keys, ValuesA
larger_13 = LargerThan(FirstNumber=pull_44.Distance, SecondNumber=Slider(400, range=0..1000))  # -> LargerThan, OrEqualTo
panel_75 = Panel(sort_52.Keys)
number_slider_62 = Slider(3584, range=0..10000)

# ---- group: 删除反常线
dispatch_134 = Dispatch(List=pln_126, DispatchPattern=larger_13.LargerThan)  # -> ListA, ListB

# ----
pln_127 = Plane(flatten(dispatch_134.ListB))
deplane_45 = DeconstructPlane(Plane=pln_127)  # -> Origin, XAxis, YAxis, ZAxis
amp_51 = Amplitude(Vector=deplane_45.YAxis, Amplitude=number_slider_62)
amp_52 = Amplitude(Vector=deplane_45.YAxis, Amplitude=expr("-x", number_slider_62))
move_55 = Move(Geometry=deplane_45.Origin, Motion=amp_52)  # -> Geometry, Transform
move_56 = Move(Geometry=deplane_45.Origin, Motion=amp_51)  # -> Geometry, Transform
ln_45 = Line(StartPoint=move_55.Geometry, EndPoint=move_56.Geometry)
ccx_37 = CurveCurve(CurveA=ln_45, CurveB=offset_13)  # -> Points, ParamsA, ParamsB
flatten_16 = FlattenTree(Tree=ccx_37.Points, Path="{0}")
null_44 = NullItem(Item=simplify(ccx_37.Points))  # -> NullFlags, InvalidFlags, Description
dispatch_135 = Dispatch(List=simplify(graft(pln_127)), DispatchPattern=null_44.NullFlags)  # -> ListA, ListB

# ---- group: 有效点
pull_45 = PullPoint(Point=deplane_45.Origin, Geometry=flatten_16, ClosestOnly=True)  # -> ClosestPoint, Distance

# ----
# 可能的双点
pln_128 = Plane(dispatch_135.ListA)

# ----
# 离结构太远
pln_129 = Plane(dispatch_134.ListA)

merge_30 = Merge(Data1=pln_129, Data2=pln_128)

# ----
# 0 檐口出定位点
# 与结构无交点
pln_130 = Plane(flatten(merge_30))

# ----
# 4.0 默认位置为建筑边线向内300mm
# 侧埋，钢板焊
# 03：钢板焊埋件[钢梁外侧]@钢边梁宽@钢边梁高
move2pt_37 = MoveToPoint(Geometry=pln_127, PointA=deplane_45.Origin, PointB=pull_45.ClosestPoint)  # -> Moved, Vector, Transform

# ----
# 5 上层建筑边线,
# 默认建筑提供上翻，如主结构提供示意则使用结构定位【该项目无】，
# 如无则使用建筑边线向内50mm作为埋件定位
number_slider_63 = Slider(50, range=0..100)
merge_31 = Merge(Data1=pln_24, Data2=pln_38)
crv_89 = Curve(crv_19)
pln_131 = Plane(merge_31)
deplane_46 = DeconstructPlane(Plane=pln_131)  # -> Origin, XAxis, YAxis, ZAxis
number_slider_64 = Slider(3584, range=0..10000)
amp_53 = Amplitude(Vector=deplane_46.YAxis, Amplitude=number_slider_64)
amp_54 = Amplitude(Vector=deplane_46.YAxis, Amplitude=expr("-x", number_slider_64))
move_57 = Move(Geometry=deplane_46.Origin, Motion=amp_54)  # -> Geometry, Transform
move_58 = Move(Geometry=deplane_46.Origin, Motion=amp_53)  # -> Geometry, Transform
ln_46 = Line(StartPoint=move_57.Geometry, EndPoint=move_58.Geometry)

offset_14 = OffsetCurve(Curve=crv_89, Distance=expr("-x", number_slider_63), Corners=1)
ccx_38 = CurveCurve(CurveA=ln_46, CurveB=offset_14)  # -> simplify(Points), ParamsA, ParamsB

ln_47 = Line(StartPoint=ccx_38.Points, EndPoint=simplify(graft(pln_131)))
len_10 = Length(Curve=ln_47)
null_45 = NullItem(Item=ccx_38.Points)  # -> NullFlags, InvalidFlags, Description
sort_53 = SortList(Keys=len_10, ValuesA=simplify(ccx_38.Points))  # -> Keys, ValuesA
dispatch_136 = Dispatch(List=simplify(graft(pln_131)), DispatchPattern=null_45.NullFlags)  # -> ListA, ListB
item_78 = ListItem(List=sort_53.ValuesA, Index=0, Wrap=True)

# ----
# 可能的双点
pln_132 = Plane(dispatch_136.ListA)

# ----
# 0 檐口出定位点
# 与结构无交点
pln_133 = Plane(flatten(pln_132))

# ----
# 5 上层建筑边线,
# 默认建筑提供上翻
# 04：板埋埋件[混凝土楼板上侧]
# @板埋参数xn
move2pt_38 = MoveToPoint(Geometry=simplify(graft(pln_131)), PointA=simplify(graft(pln_131)), PointB=item_78)  # -> flatten(Moved), Vector, Transform

crv_90 = Curve(project_14.Geometry)
crv_91 = Curve([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])
merge_32 = Merge(Data1=crv_90, Data2=crv_91)  # -> flatten(Result)

# ----
# curve
crv_92 = Curve(merge_32)

angle_3 = Angle(VectorA=crv_92, VectorB="1,0,0")  # -> Angle, Reflex
deg_6 = Degrees(Radians=angle_3.Angle)
number_2 = NumberGroups(Number=deg_6, Difference="0.2")  # -> Groups, Indices
item_79 = ListItem(List=crv_92, Index=number_2.Indices, Wrap=True)  # -> simplify(Item)
panel_76 = Panel(number_2.Groups)
item_80 = ListItem(List=item_79, Index=0, Wrap=True)  # -> flatten(Item)
item_81 = ListItem(List=item_79, Index=0, Wrap=True)
bang_3 = ExplodeTree(Data=item_79)  # -> Branch0, Branch1, Branch2, Branch3, Branch4, Branch5
crv_93 = Curve(bang_3.Branch0)
crv_94 = Curve(bang_3.Branch1)
crv_95 = Curve(bang_3.Branch2)
crv_96 = Curve(bang_3.Branch3)
angle_4 = Angle(VectorA=item_81, VectorB=item_80)  # -> Angle, Reflex
deg_7 = Degrees(Radians=angle_4.Angle)
round_3 = Round(Number=deg_7, DecimalPlace="0")  # -> Nearest, Floor, Ceiling
equals_43 = Equality(FirstNumber=round_3.Nearest, SecondNumber="90")  # -> Equality, Inequality
panel_77 = Panel(round_3.Nearest)
dispatch_137 = Dispatch(List=item_80, DispatchPattern=equals_43.Equality)  # -> ListA, ListB
crv_97 = Curve(flatten(dispatch_137.ListA))
index = ItemIndex(List=item_80, Item=crv_97)
concat = Concatenate(FragmentA="{", FragmentB=index)
concat_2 = Concatenate(FragmentA=concat, FragmentB="}")
tstat_2 = TreeStatistics(Tree=item_79)  # -> Paths, Length, Count
item_82 = ListItem(List=tstat_2.Paths, Index=0, Wrap=True)  # -> Item, Item1
item_83 = ListItem(List=concat_2, Index=0, Wrap=True)
# Sort Text
branch_2 = TreeBranch(Tree=item_79, Path=item_82.Item, MaintainPaths=True)
branch_3 = TreeBranch(Tree=item_79, Path=item_83, MaintainPaths=True)

# ----
# 5  Missing Point
# 埋件定位点Offset，没有找到和梁的交点
number_slider_65 = Slider(5000, range=0..10000)
deplane_47 = DeconstructPlane(Plane=pln_133)  # -> Origin, XAxis, YAxis, ZAxis
crv_98 = Curve(crv_89)
amp_55 = Amplitude(Vector=deplane_47.YAxis, Amplitude=number_slider_65)
move_59 = Move(Geometry=deplane_47.Origin, Motion=amp_55)  # -> Geometry, Transform
ln_48 = Line(StartPoint=move_59.Geometry, EndPoint=deplane_47.Origin)
amp_56 = Amplitude(Vector=deplane_47.XAxis, Amplitude=number_slider_24)
amp_57 = Amplitude(Vector=deplane_47.XAxis, Amplitude=expr("-x", number_slider_24))
move_60 = Move(Geometry=ln_48, Motion=amp_56)  # -> Geometry, Transform
move_61 = Move(Geometry=ln_48, Motion=amp_57)  # -> Geometry, Transform
pln_134 = Plane(pln_133)

ccx_39 = CurveCurve(CurveA=graft(move_61.Geometry), CurveB=flatten(crv_98))  # -> Points, ParamsA, ParamsB
shift_21 = ShiftPaths(Data=ccx_39.Points, Offset=-1)
sort_54 = SortList(Keys=shift_21, ValuesA=shift_21)  # -> Keys, ValuesA
pull_46 = PullPoint(Point=sort_54.ValuesA, Geometry=graft(pln_133), ClosestOnly=True)  # -> ClosestPoint, Distance
sort_55 = SortList(Keys=pull_46.Distance, ValuesA=sort_54.ValuesA)  # -> Keys, ValuesA
item_84 = ListItem(List=sort_55.ValuesA, Index="-1", Wrap=True)
null_46 = NullItem(Item=flatten(item_84))  # -> NullFlags, InvalidFlags, Description
dispatch_138 = Dispatch(List=simplify(item_84), DispatchPattern=simplify(graft(null_46.InvalidFlags)))  # -> ListA, ListB
dispatch_139 = Dispatch(List=pln_133, DispatchPattern=null_46.InvalidFlags)  # -> ListA, ListB
pln_135 = Plane(dispatch_139.ListB)
pt_53 = Point(dispatch_138.ListB)

ccx_40 = CurveCurve(CurveA=graft(move_60.Geometry), CurveB=flatten(crv_98))  # -> Points, ParamsA, ParamsB
shift_22 = ShiftPaths(Data=ccx_40.Points, Offset=-1)
sort_56 = SortList(Keys=shift_22, ValuesA=shift_22)  # -> Keys, ValuesA
pull_47 = PullPoint(Point=sort_56.ValuesA, Geometry=graft(pln_133), ClosestOnly=True)  # -> ClosestPoint, Distance
sort_57 = SortList(Keys=pull_47.Distance, ValuesA=sort_56.ValuesA)  # -> Keys, ValuesA
item_85 = ListItem(List=sort_57.ValuesA, Index="-1", Wrap=True)
null_47 = NullItem(Item=flatten(item_85))  # -> NullFlags, InvalidFlags, Description
dispatch_140 = Dispatch(List=simplify(item_85), DispatchPattern=simplify(graft(null_47.InvalidFlags)))  # -> ListA, ListB
dispatch_141 = Dispatch(List=pln_133, DispatchPattern=null_47.InvalidFlags)  # -> ListA, ListB
pln_136 = Plane(dispatch_141.ListB)
pt_54 = Point(dispatch_140.ListB)

merge_33 = Merge(Data1=pln_136, Data2=pln_135)  # -> flatten(Result)
check_same_points_11 = CheckSamePoints(archPoint=flatten(pln_134), crvPoint=merge_33)  # -> out, specialPt; inputs archPoint: list of Point3d, crvPoint: list of Point3d; same code as testpoint

# ----
# 撞到结构
move2pt_39 = MoveToPoint(Geometry=flatten(pln_136), PointA=flatten(pln_136), PointB=flatten(pt_54))  # -> Moved, Vector, Transform
move2pt_40 = MoveToPoint(Geometry=flatten(pln_135), PointA=flatten(pln_135), PointB=flatten(pt_53))  # -> Moved, Vector, Transform

# ----
# pass
cull_i_20 = CullIndex(List=flatten(pln_134), Indices=check_same_points_11.specialPt, Wrap=True)  # -> simplify(graft(List))

# ----
# 撞到梁交点
merge_34 = Merge(Data1=move2pt_39.Moved, Data2=move2pt_40.Moved)

merge_35 = Merge(Data1=move2pt_38.Moved, Data2=merge_34)

# ---- group: All Location Point
merge_36 = Merge(Data1=merge_14, Data2=merge_17, Data3=merge_35)

# ----
orient_8 = Orient(Geometry=item_38, Source=item_39, Target=merge_35)  # -> Geometry, Transform

data_100 = Data(orient_8.Geometry)
ungroup_9 = Ungroup(Group=data_100)
item_86 = ListItem(List=ungroup_9, Index=0, Wrap=True)  # -> flatten(Item)
item_87 = ListItem(List=ungroup_9, Index="-1", Wrap=True)  # -> flatten(Item)

entwine_22 = Entwine(Branch00=item_86, Branch01=item_87, FlattenInputs=True)
bake_9 = BakeObjects(Geometry=entwine_22, Attributes=attributes_9, BakeName="Embed::5-04板埋", Bake=False)

null_48 = NullItem(Item=merge_36)  # -> NullFlags, InvalidFlags, Description
dispatch_142 = Dispatch(List=merge_36, DispatchPattern=null_48.InvalidFlags)  # -> ListA, ListB

# ---- group: 下层图纸-标注定位点
pt_55 = Point(dispatch_142.ListB)

# ----
cluster_7 = Cluster_2(
    outline_curve=标准范围_符合单一轴网方向_2,
    dim_offset_1=number_slider_28,
    dim_offset_2=number_slider_27,
    axis_direction_crv1=crv_6,
    axis_direction_crv2=crv_7,
    f2_arch_outline=crv_40,
    location_point=pt_55,
    dim_style=panel_32,
    directed_outline=seam_2,
    移除重复位置点_容差=number_slider_25)  # -> D_3, D_4, D, D_2
dimension1 = Data(cluster_7.D_3)

# ---- group: Dimension2
data_101 = Data(cluster_7.D_4)

# ---- group: Dimension4
data_102 = Data(cluster_7.D_2)

# ---- group: Dimension3
data_103 = Data(cluster_7.D)

# ----
entwine_23 = Entwine(Branch00=dimension1, Branch01=data_101, Branch02=data_103, Branch03=data_102, FlattenInputs=True)

# ---- group: Refrash Data
# 将所有Input都输入完后要Refresh data
dam = DataDam(DataA=entwine_23, BufferDelay=10000000, BufferMode=0)

# ----
dedim = DeconstructDimension(DimensionObject=dam)  # -> Value, Text, Plane, Points, Style
shift_23 = ShiftPaths(Data=dedim.Text, Offset=-1)
smaller_10 = SmallerThan(FirstNumber=shift_23, SecondNumber=Slider(1, range=0..10))  # -> SmallerThan, OrEqualTo
dispatch_143 = Dispatch(List=dam, DispatchPattern=smaller_10.SmallerThan)  # -> ListA, ListB

# ---- group: Bake Me
bake_10 = BakeObjects(Geometry=dispatch_143.ListB, Attributes=attributes_12, Bake=False)

# ----
data_104 = Data(dispatch_143.ListB)

# ----
# 4.0  Missing Point
# 埋件定位点Offset，没有找到和梁的交点
number_slider_66 = Slider(5000, range=0..10000)
deplane_48 = DeconstructPlane(Plane=pln_130)  # -> Origin, XAxis, YAxis, ZAxis
crv_99 = Curve(scx_3.Curves)
amp_58 = Amplitude(Vector=deplane_48.YAxis, Amplitude=number_slider_66)
move_62 = Move(Geometry=deplane_48.Origin, Motion=amp_58)  # -> Geometry, Transform
ln_49 = Line(StartPoint=move_62.Geometry, EndPoint=deplane_48.Origin)
amp_59 = Amplitude(Vector=deplane_48.XAxis, Amplitude=number_slider_24)
amp_60 = Amplitude(Vector=deplane_48.XAxis, Amplitude=expr("-x", number_slider_24))
move_63 = Move(Geometry=ln_49, Motion=amp_59)  # -> Geometry, Transform
move_64 = Move(Geometry=ln_49, Motion=amp_60)  # -> Geometry, Transform
pln_137 = Plane(pln_130)

ccx_41 = CurveCurve(CurveA=graft(move_64.Geometry), CurveB=flatten(crv_99))  # -> Points, ParamsA, ParamsB
shift_24 = ShiftPaths(Data=ccx_41.Points, Offset=-1)
sort_58 = SortList(Keys=shift_24, ValuesA=shift_24)  # -> Keys, ValuesA
pull_48 = PullPoint(Point=sort_58.ValuesA, Geometry=graft(pln_130), ClosestOnly=True)  # -> ClosestPoint, Distance
sort_59 = SortList(Keys=pull_48.Distance, ValuesA=sort_58.ValuesA)  # -> Keys, ValuesA
item_88 = ListItem(List=sort_59.ValuesA, Index="-1", Wrap=True)
null_49 = NullItem(Item=flatten(item_88))  # -> NullFlags, InvalidFlags, Description
dispatch_144 = Dispatch(List=simplify(item_88), DispatchPattern=simplify(graft(null_49.InvalidFlags)))  # -> ListA, ListB
dispatch_145 = Dispatch(List=pln_130, DispatchPattern=null_49.InvalidFlags)  # -> ListA, ListB
pln_138 = Plane(dispatch_145.ListB)
pt_56 = Point(dispatch_144.ListB)

ccx_42 = CurveCurve(CurveA=graft(move_63.Geometry), CurveB=flatten(crv_99))  # -> Points, ParamsA, ParamsB
shift_25 = ShiftPaths(Data=ccx_42.Points, Offset=-1)
sort_60 = SortList(Keys=shift_25, ValuesA=shift_25)  # -> Keys, ValuesA
pull_49 = PullPoint(Point=sort_60.ValuesA, Geometry=graft(pln_130), ClosestOnly=True)  # -> ClosestPoint, Distance
sort_61 = SortList(Keys=pull_49.Distance, ValuesA=sort_60.ValuesA)  # -> Keys, ValuesA
item_89 = ListItem(List=sort_61.ValuesA, Index="-1", Wrap=True)
null_50 = NullItem(Item=flatten(item_89))  # -> NullFlags, InvalidFlags, Description
dispatch_146 = Dispatch(List=simplify(item_89), DispatchPattern=simplify(graft(null_50.InvalidFlags)))  # -> ListA, ListB
dispatch_147 = Dispatch(List=pln_130, DispatchPattern=null_50.InvalidFlags)  # -> ListA, ListB
pln_139 = Plane(dispatch_147.ListB)
pt_57 = Point(dispatch_146.ListB)

merge_37 = Merge(Data1=pln_139, Data2=pln_138)  # -> flatten(Result)
check_same_points_12 = CheckSamePoints(archPoint=flatten(pln_137), crvPoint=merge_37)  # -> out, specialPt; inputs archPoint: list of Point3d, crvPoint: list of Point3d; same code as testpoint

# ----
# 撞到结构
move2pt_41 = MoveToPoint(Geometry=flatten(pln_139), PointA=flatten(pln_139), PointB=flatten(pt_57))  # -> Moved, Vector, Transform
move2pt_42 = MoveToPoint(Geometry=flatten(pln_138), PointA=flatten(pln_138), PointB=flatten(pt_56))  # -> Moved, Vector, Transform

# ----
# pass
cull_i_21 = CullIndex(List=flatten(pln_137), Indices=check_same_points_12.specialPt, Wrap=True)  # -> simplify(graft(List))

# ----
# 撞到梁交点
merge_38 = Merge(Data1=move2pt_41.Moved, Data2=move2pt_42.Moved)

merge_39 = Merge(Data1=move2pt_37.Moved, Data2=merge_38)

# ---- group: All Location Point
merge_40 = Merge(Data1=merge_20, Data2=merge_23, Data3=merge_26, Data4=merge_29, Data5=merge_39)

# ----
orient_9 = Orient(Geometry=item_2, Source=item_3, Target=merge_39)  # -> Geometry, Transform

data_105 = Data(orient_9.Geometry)
ungroup_10 = Ungroup(Group=data_105)
item_90 = ListItem(List=ungroup_10, Index=0, Wrap=True)  # -> flatten(Item)
item_91 = ListItem(List=ungroup_10, Index="-1", Wrap=True)  # -> flatten(Item)

entwine_24 = Entwine(Branch00=item_90, Branch01=item_91, FlattenInputs=True)
bake_11 = BakeObjects(Geometry=entwine_24, Attributes=attributes_10, BakeName="Embed::4-0-03默认钢板焊", Bake=False)

null_51 = NullItem(Item=merge_40)  # -> NullFlags, InvalidFlags, Description
dispatch_148 = Dispatch(List=merge_40, DispatchPattern=null_51.InvalidFlags)  # -> ListA, ListB

# ---- group: 下层图纸-标注定位点
pt_58 = Point(dispatch_148.ListB)

# ----
cluster_8 = Cluster_2(
    outline_curve=标准范围_符合单一轴网方向,
    dim_offset_1=number_slider_23,
    dim_offset_2=number_slider_21,
    axis_direction_crv1=crv_3,
    axis_direction_crv2=crv_4,
    f2_arch_outline=crv_39,
    location_point=pt_58,
    dim_style=panel_31,
    directed_outline=seam,
    移除重复位置点_容差=number_slider_22)  # -> D_3, D_4, D, D_2
dimension1_2 = Data(cluster_8.D_3)

# ---- group: Dimension2
data_106 = Data(cluster_8.D_4)

# ---- group: Dimension4
data_107 = Data(cluster_8.D_2)

# ---- group: Dimension3
data_108 = Data(cluster_8.D)

# ----
entwine_25 = Entwine(Branch00=dimension1_2, Branch01=data_106, Branch02=data_108, Branch03=data_107, FlattenInputs=True)

# ---- group: Refrash Data
# 将所有Input都输入完后要Refresh data
dam_2 = DataDam(DataA=entwine_25, BufferDelay=10000000, BufferMode=0)

# ----
dedim_2 = DeconstructDimension(DimensionObject=dam_2)  # -> Value, Text, Plane, Points, Style
shift_26 = ShiftPaths(Data=dedim_2.Text, Offset=-1)
smaller_11 = SmallerThan(FirstNumber=shift_26, SecondNumber=Slider(1, range=0..10))  # -> SmallerThan, OrEqualTo
dispatch_149 = Dispatch(List=dam_2, DispatchPattern=smaller_11.SmallerThan)  # -> ListA, ListB

# ---- group: Bake Me
bake_12 = BakeObjects(Geometry=dispatch_149.ListB, Attributes=attributes_11, Bake=False)

# ----
data_109 = Data(dispatch_149.ListB)

# ==== cluster Cluster
G = ClusterInput()
rotate = Rotate(Geometry=G, Angle=3.141592654, Plane=PlaneXY(0, 0, 0))  # -> Geometry, Transform
boxprop = BoxProperties(Box=rotate.Geometry)  # -> Center, Diagonal, Area, Volume, Degeneracy
bbox = BoundingBox(Content=rotate.Geometry, Plane=PlaneXY(0, 0, 0))  # -> Box, Box_2
debox = DeconstructBox(Box=bbox.Box)  # -> Plane, X, Y, Z
pdecon = Deconstruct(Point=boxprop.Center)  # -> XComponent, YComponent, ZComponent
dedomain = DeconstructDomain(Domain=debox.Y)  # -> Start, End
pt = ConstructPoint(XCoordinate=pdecon.XComponent, YCoordinate=dedomain.Start, ZCoordinate=pdecon.ZComponent)
xy = XYPlane(Origin=Point(0, 0, 0))
pl_origin = PlaneOrigin(Base=xy, Origin=pt)
orient = Orient(Geometry=rotate.Geometry, Source=pl_origin, Target=xy)  # -> Geometry, Transform
G_2 = ClusterOutput(orient.Geometry)

# ==== cluster Cluster_2
f2_arch_outline = ClusterInput()
directed_outline = ClusterInput()
location_point = ClusterInput()
移除重复位置点_容差 = ClusterInput()
dim_offset_1 = ClusterInput()
dim_offset_2 = ClusterInput()
axis_direction_crv1 = ClusterInput()
axis_direction_crv2 = ClusterInput()
dim_style = ClusterInput()
outline_curve = ClusterInput()
pt = Point(location_point)
merge = Merge(Data1=axis_direction_crv1, Data2=axis_direction_crv2)
crv = Curve(f2_arch_outline)
number_slider = Slider(61, range=0..100)

incurve = PointInCurve(Point=flatten(pt), Curve=outline_curve)  # -> Relationship, Point
equals = Equality(FirstNumber=incurve.Relationship, SecondNumber="0")  # -> Equality, Inequality
dispatch = Dispatch(List=flatten(pt), DispatchPattern=equals.Inequality)  # -> ListA, ListB
pt_2 = Point(dispatch.ListA)
crv_cp = CurveClosestPoint(Point=pt_2, Curve=directed_outline)  # -> Point, Parameter, Distance
sort = SortList(Keys=crv_cp.Parameter, ValuesA=pt_2)  # -> Keys, ValuesA
pt_3 = Point(sort.ValuesA)
item = ListItem(List=merge, Index=0, Wrap=True)  # -> Item, Item1

# ----
# remove重复定位点生成的2个点
pt_4 = Point(pt_3)
shift = ShiftList(List=pt_4, Shift=1, Wrap=invert(True))
pt_5 = Point(pt_3)
pt_6 = Point(shift)
dist = Distance(PointA=pt_5, PointB=pt_6)
larger = LargerThan(FirstNumber=dist, SecondNumber=移除重复位置点_容差)  # -> LargerThan, OrEqualTo
dispatch_2 = Dispatch(List=pt_5, DispatchPattern=larger.LargerThan)  # -> ListA, ListB
pt_7 = Point(dispatch_2.ListA)
pt_8 = Point(dispatch_2.ListB)

dispatch_3 = Dispatch(List=pt_7, DispatchPattern=[True, False])  # -> ListA, ListB
pt_9 = Point(dispatch_3.ListB)
pt_10 = Point(dispatch_3.ListA)
pl = ConstructPlane(Origin=pt_10, XAxis=item.Item1, YAxis=item.Item)
pl_2 = ConstructPlane(Origin=pt_10, XAxis=item.Item, YAxis=item.Item1)

item_2 = ListItem(List=pt_7, Index=number_slider, Wrap=True)
shift_2 = ShiftList(List=pt_7, Shift=1, Wrap=invert(True))
item_3 = ListItem(List=shift_2, Index=number_slider, Wrap=True)

dispatch_4 = Dispatch(List=shift_2, DispatchPattern=[True, False])  # -> ListA, ListB
item_4 = ListItem(List=merge, Index=0, Wrap=True)  # -> Item, Item1
pt_11 = Point(dispatch_4.ListB)
pt_12 = Point(dispatch_4.ListA)
pl_3 = ConstructPlane(Origin=pt_12, XAxis=item_4.Item1, YAxis=item_4.Item)
pl_4 = ConstructPlane(Origin=pt_12, XAxis=item_4.Item, YAxis=item_4.Item1)

ln = Line(StartPoint=pt_10, EndPoint=pt_9)
ln_2 = Line(StartPoint=pt_12, EndPoint=pt_11)

crv_2 = Curve(crv)
deplane = DeconstructPlane(Plane=pl_3)  # -> Origin, XAxis, YAxis, ZAxis
amp = Amplitude(Vector=deplane.YAxis, Amplitude=Slider(3000, range=0..10000))
move = Move(Geometry=deplane.Origin, Motion=amp)  # -> Geometry, Transform
clscrv = CloseCurve(Curve=crv_2, CloseType=0, Bulge=0.5, Tolerance=0)  # -> Closed, R
pt_13 = Point(move.Geometry)
incurve_2 = PointInCurve(Point=pt_13, Curve=clscrv.Closed)  # -> Relationship, Point
equals_2 = Equality(FirstNumber=incurve_2.Relationship, SecondNumber="2")  # -> Equality, Inequality
lng = ListLength(List=equals_2.Equality)
lng_2 = ListLength(List=equals_2.Equality)
neg = Negative(Value=dim_offset_1)
repeat = RepeatData(Data=graft(neg), Length=lng)
repeat_2 = RepeatData(Data=graft(dim_offset_1), Length=lng_2)
panel = Panel(equals_2.Equality)
dispatch_5 = Dispatch(List=graft(repeat_2), DispatchPattern=graft(equals_2.Equality))  # -> ListA, ListB
dispatch_6 = Dispatch(List=graft(repeat), DispatchPattern=graft(equals_2.Equality))  # -> ListA, ListB
merge_2 = Merge(Data1=dispatch_5.ListA, Data2=dispatch_6.ListB)  # -> flatten(Result)

crv_3 = Curve(crv)
deplane_2 = DeconstructPlane(Plane=pl_4)  # -> Origin, XAxis, YAxis, ZAxis
amp_2 = Amplitude(Vector=deplane_2.YAxis, Amplitude=Slider(3000, range=0..10000))
move_2 = Move(Geometry=deplane_2.Origin, Motion=amp_2)  # -> Geometry, Transform
clscrv_2 = CloseCurve(Curve=crv_3, CloseType=0, Bulge=0.5, Tolerance=0)  # -> Closed, R
pt_14 = Point(move_2.Geometry)
incurve_3 = PointInCurve(Point=pt_14, Curve=clscrv_2.Closed)  # -> Relationship, Point
equals_3 = Equality(FirstNumber=incurve_3.Relationship, SecondNumber="2")  # -> Equality, Inequality
lng_3 = ListLength(List=equals_3.Equality)
neg_2 = Negative(Value=dim_offset_1)
lng_4 = ListLength(List=equals_3.Equality)
repeat_3 = RepeatData(Data=graft(neg_2), Length=lng_4)
repeat_4 = RepeatData(Data=graft(dim_offset_1), Length=lng_3)
panel_2 = Panel(equals_3.Equality)
dispatch_7 = Dispatch(List=graft(repeat_4), DispatchPattern=graft(equals_3.Equality))  # -> ListA, ListB
dispatch_8 = Dispatch(List=graft(repeat_3), DispatchPattern=graft(equals_3.Equality))  # -> ListA, ListB
merge_3 = Merge(Data1=dispatch_7.ListA, Data2=dispatch_8.ListB)  # -> flatten(Result)

crv_4 = Curve(crv)
deplane_3 = DeconstructPlane(Plane=pl)  # -> Origin, XAxis, YAxis, ZAxis
amp_3 = Amplitude(Vector=deplane_3.YAxis, Amplitude=Slider(3000, range=0..10000))
move_3 = Move(Geometry=deplane_3.Origin, Motion=amp_3)  # -> Geometry, Transform
clscrv_3 = CloseCurve(Curve=crv_4, CloseType=0, Bulge=0.5, Tolerance=0)  # -> Closed, R
pt_15 = Point(move_3.Geometry)
incurve_4 = PointInCurve(Point=pt_15, Curve=clscrv_3.Closed)  # -> Relationship, Point
equals_4 = Equality(FirstNumber=incurve_4.Relationship, SecondNumber="2")  # -> Equality, Inequality
lng_5 = ListLength(List=equals_4.Equality)
neg_3 = Negative(Value=dim_offset_2)
lng_6 = ListLength(List=equals_4.Equality)
repeat_5 = RepeatData(Data=graft(neg_3), Length=lng_6)
repeat_6 = RepeatData(Data=graft(dim_offset_2), Length=lng_5)
panel_3 = Panel(equals_4.Equality)
dispatch_9 = Dispatch(List=graft(repeat_6), DispatchPattern=graft(equals_4.Equality))  # -> ListA, ListB
dispatch_10 = Dispatch(List=graft(repeat_5), DispatchPattern=graft(equals_4.Equality))  # -> ListA, ListB
merge_4 = Merge(Data1=dispatch_9.ListA, Data2=dispatch_10.ListB)  # -> flatten(Result)

crv_5 = Curve(crv)
deplane_4 = DeconstructPlane(Plane=pl_2)  # -> Origin, XAxis, YAxis, ZAxis
amp_4 = Amplitude(Vector=deplane_4.YAxis, Amplitude=Slider(3000, range=0..10000))
move_4 = Move(Geometry=deplane_4.Origin, Motion=amp_4)  # -> Geometry, Transform
clscrv_4 = CloseCurve(Curve=crv_5, CloseType=0, Bulge=0.5, Tolerance=0)  # -> Closed, R
pt_16 = Point(move_4.Geometry)
incurve_5 = PointInCurve(Point=pt_16, Curve=clscrv_4.Closed)  # -> Relationship, Point
equals_5 = Equality(FirstNumber=incurve_5.Relationship, SecondNumber="2")  # -> Equality, Inequality
lng_7 = ListLength(List=equals_5.Equality)
neg_4 = Negative(Value=dim_offset_2)
lng_8 = ListLength(List=equals_5.Equality)
repeat_7 = RepeatData(Data=graft(neg_4), Length=lng_8)
repeat_8 = RepeatData(Data=graft(dim_offset_2), Length=lng_7)
panel_4 = Panel(equals_5.Equality)
dispatch_11 = Dispatch(List=graft(repeat_8), DispatchPattern=graft(equals_5.Equality))  # -> ListA, ListB
dispatch_12 = Dispatch(List=graft(repeat_7), DispatchPattern=graft(equals_5.Equality))  # -> ListA, ListB
merge_5 = Merge(Data1=dispatch_11.ListA, Data2=dispatch_12.ListB)  # -> flatten(Result)

lineardim = DefineLinearDimension(
    Point1=simplify(pt_12),
    Point2=simplify(pt_11),
    DimensionPlane=simplify(pl_3),
    Offset=expr("-x", merge_2),
    DimensionStyle=dim_style)
lineardim_2 = DefineLinearDimension(
    Point1=simplify(pt_12),
    Point2=simplify(pt_11),
    DimensionPlane=simplify(pl_4),
    Offset=expr("-x", merge_3),
    DimensionStyle=dim_style)
lineardim_3 = DefineLinearDimension(
    Point1=simplify(pt_10),
    Point2=simplify(pt_9),
    DimensionPlane=simplify(pl),
    Offset=expr("-x", merge_4),
    DimensionStyle=dim_style)
lineardim_4 = DefineLinearDimension(
    Point1=simplify(pt_10),
    Point2=simplify(pt_9),
    DimensionPlane=simplify(pl_2),
    Offset=expr("-x", merge_5),
    DimensionStyle=dim_style)
D = ClusterOutput(lineardim)
D_2 = ClusterOutput(lineardim_2)
D_3 = ClusterOutput(lineardim_3)
D_4 = ClusterOutput(lineardim_4)

# ==== cluster Cluster_3
structure_number = ClusterInput()
tag_text = ClusterInput()
text_offset = ClusterInput()
embed_color = ClusterInput()
T = ClusterInput()
G = ClusterInput()
A = ClusterInput()
A_2 = ClusterInput()
B = ClusterInput()
dimension_style = ClusterInput()

# ----
# 列表文字以空格进行分割
panel = Panel(" ")
split = TextSplit(Text=T, Separators=panel)

钢埋板长度_2 = Division(A=A, B=2)
neg = Negative(Value=钢埋板长度_2)
dom = ConstructDomain(DomainStart=neg, DomainEnd=钢埋板长度_2)
panel_2 = Panel(dom)

钢埋板厚度_2 = Division(A=A_2, B=2)
neg_2 = Negative(Value=钢埋板厚度_2)
dom_2 = ConstructDomain(DomainStart=neg_2, DomainEnd=钢埋板厚度_2)
panel_3 = Panel(dom_2)

# ----
# 钢埋板肋板位置 1/4处
panel_4 = Panel("4")
division = Division(A=A, B=panel_4)

# ----
# 编号和截面尺寸分区
panel_5 = Panel("1")
split_2 = SplitList(List=split, Index=panel_5)  # -> flatten(ListA), flatten(ListB)

# ----
# 求出对应输入编号的钢结构截面尺寸
fsim = FindSimilarMember(Data=structure_number, Set=split_2.ListA)  # -> Hit, Index
item = ListItem(List=split_2.ListB, Index=fsim.Index, Wrap=True)

addition = Addition(A=neg_2, B=division)
addition_2 = Addition(A=钢埋板厚度_2, B=division)
dom_3 = ConstructDomain(DomainStart=addition, DomainEnd=addition_2)
panel_6 = Panel(split_2.ListB)
split_3 = TextSplit(Text=item, Separators="x")
split_4 = TextSplit(Text=split_3, Separators="Q")
item_2 = ListItem(List=split_4, Index="0", Wrap=True)  # -> flatten(Item)
subtraction = Subtraction(A=division, B=钢埋板厚度_2)
subtraction_2 = Subtraction(A=division, B=钢埋板厚度_2)
subtraction_3 = Subtraction(A=division, B=钢埋板厚度_2)
neg_3 = Negative(Value=钢埋板厚度_2)
neg_4 = Negative(Value=钢埋板厚度_2)
neg_5 = Negative(Value=钢埋板厚度_2)
subtraction_4 = Subtraction(A=division, B=钢埋板厚度_2)
addition_3 = Addition(A=subtraction, B=A_2)
addition_4 = Addition(A=subtraction_2, B=A_2)
subtraction_5 = Subtraction(A=neg_3, B=A_2)
subtraction_6 = Subtraction(A=neg_4, B="2")
subtraction_7 = Subtraction(A=division, B=钢埋板厚度_2)
addition_5 = Addition(A=subtraction_3, B="2")
subtraction_8 = Subtraction(A=neg_5, B="2")
neg_6 = Negative(Value=钢埋板厚度_2)
neg_7 = Negative(Value=钢埋板厚度_2)
工字钢_h = ListItem(List=item_2, Index=0, Wrap=True)
工字钢_b = ListItem(List=item_2, Index=1, Wrap=True)
工字钢_tf = ListItem(List=item_2, Index=3, Wrap=True)
工字钢_tw = ListItem(List=item_2, Index=2, Wrap=True)
pt = ConstructPoint(XCoordinate=neg_6, YCoordinate=subtraction_4, ZCoordinate=0)
pt_2 = ConstructPoint(XCoordinate=neg_7, YCoordinate=addition_3, ZCoordinate=0)
pt_3 = ConstructPoint(XCoordinate=subtraction_5, YCoordinate=addition_4, ZCoordinate=0)
pt_4 = ConstructPoint(XCoordinate=subtraction_6, YCoordinate=subtraction_7, ZCoordinate=0)
pt_5 = ConstructPoint(XCoordinate=subtraction_8, YCoordinate=addition_5, ZCoordinate=0)
subtraction_9 = Subtraction(A=工字钢_b, B=工字钢_tw)
division_2 = Division(A=subtraction_9, B="2")
merge = Merge(Data1=pt, Data2=pt_2, Data3=pt_3, Data4=pt_5, Data5=pt_4)
pline = PolyLine(Vertices=merge, Closed=True)
division_3 = Division(A=division_2, B="2")
subtraction_10 = Subtraction(A=division_3, B=A_2)
subtraction_11 = Subtraction(A=division_3, B=钢埋板厚度_2)
neg_8 = Negative(Value=division_3)
subtraction_12 = Subtraction(A=neg_8, B=subtraction_11)
addition_6 = Addition(A=subtraction_12, B=B)
dom_4 = ConstructDomain(DomainStart=addition_6, DomainEnd=subtraction_12)
dom_5 = ConstructDomain(DomainStart=addition, DomainEnd=addition_2)
钢肋板倒角_侧视图 = Rectangle(Plane=PlaneXY(0, 0, 0), XSize=dom_4, YSize=dom_5, Radius=0)  # -> Rectangle, Length
subtraction_13 = Subtraction(A=subtraction_10, B=subtraction_11)
subtraction_14 = Subtraction(A=neg_8, B=subtraction_11)
dom_6 = ConstructDomain(DomainStart=subtraction_13, DomainEnd=subtraction_14)
钢肋板_侧视图 = Rectangle(Plane=PlaneXY(0, 0, 0), XSize=dom_6, YSize=dom_3, Radius=0)  # -> Rectangle, Length
merge_2 = Merge(Data1=钢肋板_侧视图.Rectangle, Data2=pline, Data3=钢肋板倒角_侧视图.Rectangle)
xz = XZPlane(Origin=Point(0, 0, 0))
mirror = Mirror(Geometry=merge_2, Plane=xz)  # -> Geometry, Transform
钢埋板_侧视图 = Rectangle(Plane=PlaneXY(0, 0, 0), XSize=dom_2, YSize=dom, Radius=0)  # -> Rectangle, Length
division_4 = Division(A=工字钢_b, B=2)
侧视图 = Entwine(Branch00=钢埋板_侧视图.Rectangle, Branch01=merge_2, Branch02=mirror.Geometry, FlattenInputs=True)
R = ClusterOutput(division_4)
division_5 = Division(A=工字钢_h, B="2")
subtraction_15 = Subtraction(A=division_5, B=工字钢_tf)
addition_7 = Addition(A=subtraction_15, B=Slider(200, range=0..1000))
addition_8 = Addition(A=addition_7, B=division_2)
X = UnitX(Factor=addition_8)
move = Move(Geometry=侧视图, Motion=X)  # -> Geometry, Transform
split_tree = SplitTree(Data=move.Geometry, Masks=flatten("{0;0}"))  # -> Positive, Negative
dispatch = Dispatch(List=split_tree.Negative, DispatchPattern=[True, False])  # -> flatten(ListA), ListB
merge_3 = Merge(Data1=split_tree.Positive, Data2=dispatch.ListA)
entwine = Entwine(Branch00=merge_3, Branch01=dispatch.ListB, FlattenInputs=True)
flatten = FlattenTree(Tree=entwine, Path="{0}")
group = Group(Objects=flatten)
rotate = Rotate(Geometry=group, Angle=3.141592654, Plane=PlaneXY(0, 0, 0))  # -> Geometry, Transform
boxprop = BoxProperties(Box=rotate.Geometry)  # -> Center, Diagonal, Area, Volume, Degeneracy
bbox = BoundingBox(Content=rotate.Geometry, Plane=PlaneXY(0, 0, 0))  # -> Box, Box_2
debox = DeconstructBox(Box=bbox.Box)  # -> Plane, X, Y, Z
pdecon = Deconstruct(Point=boxprop.Center)  # -> XComponent, YComponent, ZComponent
dedomain = DeconstructDomain(Domain=debox.Y)  # -> Start, End
pt_6 = ConstructPoint(XCoordinate=pdecon.XComponent, YCoordinate=dedomain.Start, ZCoordinate=pdecon.ZComponent)
xy = XYPlane(Origin=Point(0, 0, 0))
concat = Concatenate(FragmentA="Embed", FragmentB=tag_text)
pl_origin = PlaneOrigin(Base=xy, Origin=pt_6)
orient = Orient(Geometry=rotate.Geometry, Source=pl_origin, Target=xy)  # -> Geometry, Transform
xy_2 = XYPlane(Origin=Point(0, 0, 0))
attributes = DefineObjectAttributes(Color=embed_color)
ungroup = Ungroup(Group=orient.Geometry)
block = DefineBlock(Geometry=ungroup, Attributes=attributes, BlockName=concat, BasePlane=PlaneXY(0, 0, 0))
deblock = DeconstructBlock(Block=block)  # -> Name, flatten(Plane), flatten(Geometry)
group_2 = Group(Objects=deblock.Geometry)
bbox_2 = BoundingBox(Content=group_2, Plane=PlaneXY(0, 0, 0))  # -> Box, Box_2
deplane = DeconstructPlane(Plane=deblock.Plane)  # -> Origin, XAxis, YAxis, ZAxis
area = Area(Geometry=bbox_2.Box)  # -> Area, Centroid
move2pt = MoveToPoint(Geometry=flatten(deplane.Origin), PointA=flatten(deplane.Origin), PointB=flatten(area.Centroid))  # -> Moved, Vector, Transform
pl = ConstructPlane(Origin=move2pt.Moved, XAxis=deplane.YAxis, YAxis=deplane.XAxis)  # -> graft(Plane)
deplane_2 = DeconstructPlane(Plane=pl)  # -> Origin, XAxis, YAxis, ZAxis
rotate_2 = Rotate(Geometry=pl, Angle="Pi", Plane=pl)  # -> Geometry, Transform
dedomain_2 = DeconstructDomain(Domain=dom)  # -> Start, End
multiplication = Multiplication(A=dedomain_2.Start, B=dedomain_2.Start)
amp = Amplitude(Vector=deplane_2.YAxis, Amplitude=multiplication)
move_2 = Move(Geometry=deplane_2.Origin, Motion=amp)  # -> Geometry, Transform
srf = Surface(bbox_2.Box)
crv = Curve(srf)
ln = Line(StartPoint=move_2.Geometry, EndPoint=deplane_2.Origin)
ccx = CurveCurve(CurveA=ln, CurveB=crv)  # -> Points, ParamsA, ParamsB
ln_2 = Line(StartPoint=deplane_2.Origin, EndPoint=ccx.Points)
move_3 = Move(Geometry=rotate_2.Geometry, Motion=ln_2)  # -> Geometry, Transform

ln_3 = Line(StartPoint=ccx.Points, EndPoint=deplane_2.Origin)
amp_2 = Amplitude(Vector=ln_3, Amplitude=text_offset)
move_4 = Move(Geometry=rotate_2.Geometry, Motion=amp_2)  # -> Geometry, Transform
text = DefineTextObject(Text=tag_text, Plane=move_4.Geometry, DimensionStyle=dimension_style, OutputType="Text")
group_3 = Group(Objects=[block, text])

entwine_2 = Entwine(Branch00=group_3, Branch01=move_3.Geometry, FlattenInputs=True)
project = Project(Geometry=G, Plane=xy_2)  # -> Geometry, Transform
R_2 = ClusterOutput(entwine_2)
G_2 = ClusterOutput(project.Geometry)
