# Grasshopper definition FacadeEmbed_JinQiao_Podium1123.gh (Grasshopper 1.0.7)
# plug-ins: EleFront, TT Toolbox, Pufferfish, Hare, treesloth01

# ----
# 线段延长长度
number_slider = Slider(1001, range=0..10000)  # disabled

# ----
# remove duplicate curves
geo = Geometry()  # disabled
number_slider_2 = Slider(0.1, range=0..0.1)  # disabled
boundary = BoundarySurfaces(Edges=geo)  # disabled
area = Area(Geometry=boundary)  # -> Area, Centroid; disabled
cullduppoints = RemoveDuplicatePoints(InputPoints=area.Centroid, Tolerance=number_slider_2)  # -> OutputPoints, FirstPointIndexes; disabled
null = NullItem(Item=cullduppoints.FirstPointIndexes)  # -> NullFlags, InvalidFlags, Description; disabled
dispatch = Dispatch(List=boundary, DispatchPattern=null.NullFlags)  # -> ListA, ListB; disabled
geo_2 = Geometry(dispatch.ListA)  # disabled

# ----
# 调换阴阳角设定
toggle = BooleanToggle(False)  # disabled

# ---- group: 下层定位点颜色
# (1)  根据颜色自动导入所以埋件定位点的circle
# 下层、上层、檐口处定位点用不同颜色表示
panel = Panel("Magenta")

# ---- group: 上层定位点颜色
panel_2 = Panel("Yellow")

# ---- group: 檐口定位点颜色
panel_3 = Panel("Cyan")

# ---- group: 檐口线-外侧
crv = Curve(<curve referenced from the Rhino model>)

# ---- group: 檐口线-内侧：没有则清空
crv_2 = Curve([<curve referenced from the Rhino model> x2])

# ---- group: 上层-内部幕墙线: 没有则清空
# 导入下层幕墙线
crv_3 = Curve(<curve referenced from the Rhino model>)

# ---- group: 楼板线
# 导入上层楼板线
# 导入上层幕墙线
crv_4 = Curve(<curve referenced from the Rhino model>)

# ---- group: 导入上层单体幕墙线
crv_5 = Curve(<curve referenced from the Rhino model>)

# ---- group: 导入下层单体幕墙线
crv_6 = Curve(<curve referenced from the Rhino model>)

# ---- group: 导入上层All-外部幕墙线
crv_7 = Curve([<curve referenced from the Rhino model> x3])

# ---- group: 下层All幕墙线
crv_8 = Curve([<curve referenced from the Rhino model> x3])

# ----
# 钢埋板长度（按需设定）
number_slider_3 = Slider(350, range=0..1000)

# ----
# 肋板倒角距离（按需设定）
number_slider_4 = Slider(30, range=0..100)

# ----
# 钢埋板厚度（按需设定）
number_slider_5 = Slider(16, range=0..100)

refcol = ReferenceByColor(Color=panel)
area_2 = Area(Geometry=refcol)  # -> Area, Centroid
null_2 = NullItem(Item=area_2.Area)  # -> NullFlags, InvalidFlags, Description
dispatch_2 = Dispatch(List=refcol, DispatchPattern=null_2.NullFlags)  # -> ListA, ListB
crv_9 = Curve(dispatch_2.ListB)

# ----
# Dimension Style
panel_4 = Panel("图例2-地上$0$XD100$0")

refcol_2 = ReferenceByColor(Color=panel_2)
area_3 = Area(Geometry=refcol_2)  # -> Area, Centroid
null_3 = NullItem(Item=area_3.Area)  # -> NullFlags, InvalidFlags, Description
dispatch_3 = Dispatch(List=refcol_2, DispatchPattern=null_3.NullFlags)  # -> ListA, ListB
crv_10 = Curve(dispatch_3.ListB)

# ---- group: 输入梁编号Texts所在图层
panel_5 = Panel("text-def")

# ----
refcol_3 = ReferenceByColor(Color=panel_3)
area_4 = Area(Geometry=refcol_3)  # -> Area, Centroid
null_4 = NullItem(Item=area_4.Area)  # -> NullFlags, InvalidFlags, Description
dispatch_4 = Dispatch(List=refcol_3, DispatchPattern=null_4.NullFlags)  # -> ListA, ListB
crv_11 = Curve(dispatch_4.ListB)

# ----
# 埋件编号tag的Offset - 所有钢埋件
number_slider_6 = Slider(190, range=0..1000)

# ----
# 钢结构截面列表
txt = Text(["GKL4-1\tH 400x250x16x20", "GKL4-2\tH 400x350x12x30", "GKL4-3\tH 400x350x16x35", "GKL5-1\tH 500x200x14x25", "GKL5-2\tH 500x300x14x20", "GKL5a-1\tH 550x250x12x25", "GKL6-1\tH 600x200x12x18", "GKL6-2\tH 600x300x14x20", "GKL6-3\tH 600x350x12x25", "GKL6-4\tH 600x350x16x35", "GKL7-1\tH 700x300x16x25", "GKL7-2\tH 700x350x14x25", "GKL7-3\tH 700x350x14x30", "GKL7-4\tH 700x350x14x35", "GKL8-1\tH 800x300x20x25", "GKL8-2\tH 800x300x20x40", "GKL8-3\tH 800x400x25x30", "GKL8-4\tH 800x400x25x35", "GKL9-1\tH 900x300x20x30", "GKL9-2\tH 900x400x20x40", "GKL9-3\tH 900x500x20x40", "GKL9-4\tH 900x300x20x40", "GKL10-1\tH 1000x500x20x30", "GKL10-2\tH 1000x500x20x40", "GKL10-3\tH 1000x500x20x35", "GKL10-4\tH 1000x600x20x40", "GKL12-1\tH 1200x400x20x50", "GKL12-2\tH 1200x600x25x50", "GL2A-1\tHN 250x125x6x9", "GL3-1\tHN 300x150x6.5x9", "GL3-2\tH 300x100x8x10", "GL3-3\tH 300x200x8x16", "GL3-4\tHW 300x300x10x15", "GL4-1\tHN 400x200x8x13", "GL4-2\tH 400x200x10x16", "GL4-3\tH 400x250x10x20", "GL4-4\tH 400x350x16x35", "GL4a-1\tH 450x200x9x14", "GL5-1\tHN 500x200x10x16", "GL5-2\tH 500x200x10x20", "GL5-3\tH 500x300x14x20", "GL5a-1\tH 550x250x10x25", "GL5a-2\tH 550x300x14x25", "GL6-1\tHN 600x200x11x17", "GL6-2\tH 600x300x12x20", "GL6-3\tH 600x350x12x25", "GL6-4\tH 600x350x16x35", "GL7-1\tHN 700x300x13x24", "GL7-2\tH 700x350x14x30", "GL7-3\tH 700x350x14x35", "GL8-1\tHN 800x300x14x26", "GL8-2\tH 800x300x20x40", "GL9-1\tH 900x300x20x30", "GL9-2\tH 900x400x20x40", "GL10-1\tH 1000x400x20x30", "GL10-2\tH 1000x500x20x30", "GL10-3\tH 1000x500x20x35", "GL10-4\tH 1000x400x20x40", "GL10-5\tH 1000x500x20x40", "GL12-1\tH 1200x400x25x50"])

# ---- group: 导入一条梁中线
# （4）导入梁中线+结构编号，生成对应的钢板焊埋件
crv_12 = Curve(<curve referenced from the Rhino model>)

# ----
# 手动输入埋件Tag
panel_6 = Panel("""1-1
2-2""")

# ----
# （2）导入单体建筑的参考线
clscrv = CloseCurve(Curve=crv, CloseType=0, Bulge=0.5, Tolerance=0)  # -> Closed, R
clscrv_2 = CloseCurve(Curve=crv_6, CloseType=0, Bulge=0.5, Tolerance=0)  # -> Closed, R
clscrv_3 = CloseCurve(Curve=crv_8, CloseType=0, Bulge=0.5, Tolerance=0)  # -> Closed, R
clscrv_4 = CloseCurve(Curve=crv_4, CloseType=0, Bulge=0.5, Tolerance=0)  # -> Closed, R
clscrv_5 = CloseCurve(Curve=crv_5, CloseType=0, Bulge=0.5, Tolerance=0)  # -> Closed, R
clscrv_6 = CloseCurve(Curve=crv_7, CloseType=0, Bulge=0.5, Tolerance=0)  # -> Closed, R
xy = XYPlane(Origin=Point(0, 0, 0))
xy_2 = XYPlane(Origin=Point(0, 0, 0))
xy_3 = XYPlane(Origin=Point(0, 0, 0))
xy_4 = XYPlane(Origin=Point(0, 0, 0))
xy_5 = XYPlane(Origin=Point(0, 0, 0))
project = Project(Geometry=clscrv_2.Closed, Plane=xy_2)  # -> Geometry, Transform
project_2 = Project(Geometry=clscrv_3.Closed, Plane=xy)  # -> Geometry, Transform
project_3 = Project(Geometry=clscrv_4.Closed, Plane=xy_4)  # -> Geometry, Transform
project_4 = Project(Geometry=clscrv_5.Closed, Plane=xy_3)  # -> Geometry, Transform
project_5 = Project(Geometry=clscrv_6.Closed, Plane=xy_5)  # -> Geometry, Transform

# ----
# Step1.输入block names
# Step2:点击Update按钮
data = Data(["PX-GLAZ-F2$0$PX-GLAZ-F2$0$fin", "PX-GLAZ-F2$0$PX-GLAZ-F1$0$fin"])
panel_7 = Panel(data)
# （1）导入埋件定位点
panel_8 = Panel("")
refblock = ReferenceBlockByName(BlockName=panel_7)

# ----
# Input Curves
# 
# Step1：选中其中一个curve,得到该图层所有curves
# Step2：点击Update按钮
crv_13 = Curve(<curve referenced from the Rhino model>)

# ----
# (Block & Curve的形式)
# Input Blocks (Plane的Y轴向外)
# 
# Step1.输入Block所在图层
# Step2:点击Update按钮
data_2 = Data(["PX-GLAZ-F2$0$PX-GLAZ-F1$0$标准块", "PX-GLAZ-F2$0$PX-GLAZ-F2$0$标准块", "PX-GLAZ-F2$0$PX-GLAZ-F3$0$标准块"])

# ----
# block names
listblockd = ListBlockDocument()

# ----
# Input Blocks (Plane的Y轴向内)
# 
# Step1:输入Block所在图层
# Step2:点击Update按钮
data_3 = Data("PX-GLAZ-F2$0$T3T")

# ----
# Embed Layer Color
swatch = ColourSwatch(SwatchColor=RGB(136, 235, 148))

# ----
# （5）导入Default Embed
# 输入
# 
# 1.Embed的结构编号
# 2.Embed的Tag命名
# 需要出图的钢结构编号
panel_9 = Panel("GL3-3H")

# ----
# 导入梁中线+结构编号
# 注意：
# 导入完之后可能要点一下Update确保导入成功
layer = ObjectLayer(Guid=crv_12)  # -> LayerIndex, LayerPathName
reflay = ReferenceByLayer(LayerName=layer.LayerPathName)
reflay_2 = ReferenceByLayer(LayerName=panel_5)

# ----
# 埋件编号tag
panel_10 = Panel("0-0")

# ---- group: 下-阴阳角
data_4 = Data()

# ----
# 导入檐口线
# 注意：如果没有檐口线或没有内测檐口线，一定要确保对应需要导入檐口线curve的区域为空data
xy_6 = XYPlane(Origin=Point(0, 0, 0))
project_6 = Project(Geometry=clscrv.Closed, Plane=xy_6)  # -> Geometry, Transform

clscrv_7 = CloseCurve(Curve=crv_3, CloseType=0, Bulge=0.5, Tolerance=0)  # -> Closed, R

# ---- group: 混凝土
list = ValueList({"C15": 0, "C20": 1, "C25": 2, "C30": 3, "C35": 4, "C40": 5}, selected="C35")

# ---- group: 钢筋牌号
list_2 = ValueList({"HPB300": 0, "HRB400": 1}, selected="HPB300")

# ---- group: 直径
list_3 = ValueList({"10": 0, "12": 1, "16": 2, "18": 3, "20": 4, "25": 5}, selected="12")

# ---- group: 列
list_4 = ValueList({"2X": 0, "3X": 1, "4X": 2}, selected="3X")

# ---- group: 行
list_5 = ValueList({"2Y": 0, "3Y": 1, "4Y": 2}, selected="2Y")

# ---- group: 锚筋间距
s_y = Slider(22, range=14..60, expression="X*5")
s_x = Slider(22, range=14..60, expression="X*5")

# ----
# 长
panel_11 = Panel("-175 To 175")

# ----
# 埋件编号tag的Offset
number_slider_7 = Slider(353, range=0..1000)

# ----
# 宽
panel_12 = Panel("-125 To 125")

# ----
# 埋件编号tag
# 板埋几何INPUT
panel_13 = Panel("6-6")

# ----
# （7）生成底埋钢埋件
# 输入
# 
# Embed的Tag命名
# 埋件编号
panel_14 = Panel("5-5")

# ---- group: 参考线起点
number_slider_8 = Slider(0.806, range=0..1)

# ---- group: Dimension Offset Input 2
number_slider_9 = Slider(1000, range=0..1000)

# ---- group: 移除重复位置点-容差
number_slider_10 = Slider(200, range=0..1000)

# ----
# (8) 撞到梁交点-Offset
number_slider_11 = Slider(450, range=0..1000)

# ---- group: Dimension Offset Input 1
number_slider_12 = Slider(2000, range=0..10000)

# ---- group: 标注区域-单一轴网
标准范围_符合单一轴网方向 = Curve(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)

# ---- group: 轴网XY2个方向的线
crv_14 = Curve(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)
crv_15 = Curve(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)

# ---- group: 参考线: 符合轴网方向+囊括整个建筑
# (9)Bake Me!!
# 下层图纸-单一区域
crv_16 = Curve(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)

# ---- group: 移除重复位置点-容差
number_slider_13 = Slider(200, range=0..1000)

# ---- group: 参考线起点
number_slider_14 = Slider(0.548, range=0..1)

# ---- group: Dimension Offset Input 2
number_slider_15 = Slider(1000, range=0..1000)

# ---- group: Dimension Offset Input 1
number_slider_16 = Slider(2000, range=0..10000)

# ---- group: 标注区域-单一轴网
标准范围_符合单一轴网方向_2 = Curve(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)

# ---- group: 轴网XY2个方向的线
crv_17 = Curve(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)
crv_18 = Curve(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)

# ----
layer_2 = ObjectLayer(Guid=crv_13)  # -> LayerIndex, LayerPathName
panel_15 = Panel(data_2)
panel_17 = Panel(layer_2.LayerPathName)
panel_18 = Panel(data_3)
refblock_2 = ReferenceBlockByName(BlockName=panel_15)
refblock_3 = ReferenceBlockByName(BlockName=panel_18)
reflay_3 = ReferenceByLayer(LayerName=panel_17)

# ---- group: 参考线: 符合轴网方向+囊括整个建筑
# (9)Bake Me!!
# 上层图纸-单一区域
crv_19 = Curve(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)

# ----
panel_19 = Panel(txt)

xy_7 = XYPlane(Origin=Point(0, 0, 0))
project_7 = Project(Geometry=clscrv_7.Closed, Plane=xy_7)  # -> Geometry, Transform

# ----
# （0）准备阶段
# 检测各个图层Block的Plane
panel_20 = Panel(listblockd)
deblock = DeconstructBlock(Block=refblock)  # -> Name, Plane, Geometry

# ----
# Step3.检测plane是否存在+查看Plane的Y轴方向
pln = Plane(deblock.Plane)

deblock_2 = DeconstructBlock(Block=refblock_3)  # -> Name, Plane, Geometry
deblock_3 = DeconstructBlock(Block=refblock_2)  # -> Name, Plane, Geometry

# ----
# Step4.如果不存在则Blake geometry
# 并在rhino里面清理线段
geo_3 = Geometry(deblock.Geometry)

# ---- group: the Dimension Reference Curve
seam = Seam(Curve=reparameterize(crv_16), Seam=number_slider_8)

# ---- group: The Start Point of the Dimension Reference Curve
eval = EvaluateCurve(Curve=reparameterize(crv_16), Parameter=number_slider_8)  # -> Point, Tangent, Angle

# ---- group: Dimension Style
panel_21 = Panel("图例2-地上$0$XD100$0")

# ---- group: The Start Point of the Dimension Reference Curve
eval_2 = EvaluateCurve(Curve=reparameterize(crv_19), Parameter=number_slider_14)  # -> Point, Tangent, Angle

# ---- group: the Dimension Reference Curve
seam_2 = Seam(Curve=reparameterize(crv_19), Seam=number_slider_14)

# ---- group: Dimension Style
panel_22 = Panel("图例2-地上$0$XD100$0")

# ----
xy_8 = XYPlane(Origin=Point(0, 0, 0))
xy_9 = XYPlane(Origin=Point(0, 0, 0))
xy_10 = XYPlane(Origin=Point(0, 0, 0))

# ---- group: Plan B - 根据图层导入 / 定位点的circle
circle = Curve(<curve referenced from the Rhino model>)

# ---- group: Plan B - 根据图层导入
layer_3 = ObjectLayer(Guid=circle)  # -> LayerIndex, LayerPathName

# ---- group: Plan B - 根据图层导入 / Click Me after Input
reflay_4 = ReferenceByLayer(LayerName=layer_3.LayerPathName)

# ----
# 生成Default Embed
cluster = Cluster_3(
    structure_number=panel_9,
    tag_text=panel_10,
    text_offset=number_slider_6,
    embed_color=swatch,
    T=txt,
    A=number_slider_3,
    A_2=number_slider_5,
    B=number_slider_4,
    dimension_style=panel_4)  # -> R, G_2, R_2
data_5 = Data(flatten(cluster.R_2))
item = ListItem(List=data_5, Index=0, Wrap=True)  # -> Item, Item1
ungroup = Ungroup(Group=item.Item)
item_2 = ListItem(List=ungroup, Index=0, Wrap=True)
bbox = BoundingBox(Content=item_2, Plane=PlaneXY(0, 0, 0))  # -> Box, Box_2
debrep = DeconstructBrep(Brep=bbox.Box)  # -> Faces, Edges, Vertices
len = Length(Curve=debrep.Edges)
sort = SortList(Keys=len, ValuesA=debrep.Edges)  # -> Keys, ValuesA
pln_2 = Plane(item.Item1)
item_3 = ListItem(List=sort.ValuesA, Index=0, Wrap=True)
deplane = DeconstructPlane(Plane=pln_2)  # -> Origin, XAxis, YAxis, ZAxis
amp = Amplitude(Vector=deplane.YAxis, Amplitude=item_3)
move = Move(Geometry=deplane.Origin, Motion=amp)  # -> Geometry, Transform
move2pt = MoveToPoint(Geometry=pln_2, PointA=deplane.Origin, PointB=move.Geometry)  # -> Moved, Vector, Transform

project_8 = Project(Geometry=refblock_2, Plane=xy_8)  # -> Geometry, Transform
project_9 = Project(Geometry=refblock_3, Plane=xy_9)  # -> Geometry, Transform
project_10 = Project(Geometry=reflay_3, Plane=xy_10)  # -> Geometry, Transform

# ---- group: All-下-幕墙线
# 生成下层定位平面
crv_20 = Curve(project_2.Geometry)

# ---- group: 上-幕墙线 - 有内部线
merge = Merge(Data1=project_5.Geometry, Data2=project_7.Geometry)

# ---- group: 上-幕墙线 - 无内部线
# 生成上层定位平面
crv_21 = Curve(project_5.Geometry)

# ---- group: 上层局部幕墙线
crv_22 = Curve(project_4.Geometry)

# ---- group: All-檐口线
# 生成檐口定位平面
merge_2 = Merge(Data1=project_6.Geometry, Data2=crv_2)

# ---- group: 筛选阴阳角的点
crv_23 = Curve(merge_2)
disc = Discontinuity(Curve=graft(crv_23), Level=1)  # -> Points, Parameters
crv_cp = CurveClosestPoint(Point=disc.Points, Curve=graft(crv_23))  # -> Point, Parameter, Distance
eval_3 = EvaluateCurve(Curve=graft(crv_23), Parameter=crv_cp.Parameter)  # -> flatten(Point), Tangent, flatten(Angle)
offset = OffsetCurve(Curve=crv_23, Distance=expr("-X", Slider(300, range=0..1000)), Corners=1)
deg = Degrees(Radians=eval_3.Angle)
larger = LargerThan(FirstNumber=deg, SecondNumber=Slider(70, range=0..100))  # -> LargerThan, OrEqualTo
disc_2 = Discontinuity(Curve=offset, Level=1)  # -> flatten(Points), Parameters
dispatch_5 = Dispatch(List=eval_3.Point, DispatchPattern=larger.LargerThan)  # -> ListA, ListB
dispatch_6 = Dispatch(List=deg, DispatchPattern=larger.LargerThan)  # -> ListA, ListB
data_6 = Data(dispatch_5.ListA)
smaller = SmallerThan(FirstNumber=dispatch_6.ListA, SecondNumber=Slider(100, range=0..100))  # -> SmallerThan, OrEqualTo
dispatch_7 = Dispatch(List=data_6, DispatchPattern=smaller.SmallerThan)  # -> ListA, ListB
data_7 = Data(dispatch_7.ListA)
pull = PullPoint(Point=data_7, Geometry=flatten(offset), ClosestOnly=True)  # -> ClosestPoint, Distance
testpoint = TestPoint(archPoint=pull.ClosestPoint, crvPoint=disc_2.Points)  # -> out, specialPt; inputs archPoint: list of Point3d, crvPoint: list of Point3d
# ---------- testpoint: C# ----------
    List<int> passIndex = new List<int>();

    for(int i = 0; i < archPoint.Count; i++){
      foreach(Point3d t in crvPoint){
        if(archPoint[i].X == t.X && archPoint[i].Y == t.Y && archPoint[i].Z == t.Z){
          Print("pass");
          passIndex.Add(i);}
      }
    }

    specialPt = passIndex;
# ---------- end testpoint ----------

crv_24 = Curve(crv_21)
disc_3 = Discontinuity(Curve=graft(crv_24), Level=1)  # -> Points, Parameters
crv_cp_2 = CurveClosestPoint(Point=disc_3.Points, Curve=graft(crv_24))  # -> Point, Parameter, Distance
eval_4 = EvaluateCurve(Curve=graft(crv_24), Parameter=crv_cp_2.Parameter)  # -> flatten(Point), Tangent, flatten(Angle)
deg_2 = Degrees(Radians=eval_4.Angle)
offset_2 = OffsetCurve(Curve=merge, Distance=expr("-X", Slider(300, range=0..1000)), Corners=1)
larger_2 = LargerThan(FirstNumber=deg_2, SecondNumber=Slider(70, range=0..100))  # -> LargerThan, OrEqualTo
dispatch_8 = Dispatch(List=deg_2, DispatchPattern=larger_2.LargerThan)  # -> ListA, ListB
dispatch_9 = Dispatch(List=eval_4.Point, DispatchPattern=larger_2.LargerThan)  # -> ListA, ListB
disc_4 = Discontinuity(Curve=offset_2, Level=1)  # -> flatten(Points), Parameters
data_8 = Data(dispatch_9.ListA)
smaller_2 = SmallerThan(FirstNumber=dispatch_8.ListA, SecondNumber=Slider(100, range=0..100))  # -> SmallerThan, OrEqualTo
dispatch_10 = Dispatch(List=data_8, DispatchPattern=smaller_2.SmallerThan)  # -> ListA, ListB
data_9 = Data(dispatch_10.ListA)
pull_2 = PullPoint(Point=data_9, Geometry=flatten(offset_2), ClosestOnly=True)  # -> ClosestPoint, Distance
testpoint_2 = TestPoint(archPoint=pull_2.ClosestPoint, crvPoint=disc_4.Points)  # -> out, specialPt; inputs archPoint: list of Point3d, crvPoint: list of Point3d; same code as testpoint

disc_5 = Discontinuity(Curve=graft(crv_20), Level=1)  # -> Points, Parameters
crv_cp_3 = CurveClosestPoint(Point=disc_5.Points, Curve=graft(crv_20))  # -> Point, Parameter, Distance
eval_5 = EvaluateCurve(Curve=graft(crv_20), Parameter=crv_cp_3.Parameter)  # -> flatten(Point), Tangent, flatten(Angle)
offset_3 = OffsetCurve(Curve=crv_20, Distance=expr("-X", Slider(300, range=0..1000)), Corners=1)
deg_3 = Degrees(Radians=eval_5.Angle)
disc_6 = Discontinuity(Curve=offset_3, Level=1)  # -> flatten(Points), Parameters
larger_3 = LargerThan(FirstNumber=deg_3, SecondNumber=Slider(70, range=0..100))  # -> LargerThan, OrEqualTo
dispatch_11 = Dispatch(List=eval_5.Point, DispatchPattern=larger_3.LargerThan)  # -> ListA, ListB
dispatch_12 = Dispatch(List=deg_3, DispatchPattern=larger_3.LargerThan)  # -> ListA, ListB
data_10 = Data(dispatch_11.ListA)
smaller_3 = SmallerThan(FirstNumber=dispatch_12.ListA, SecondNumber=Slider(100, range=0..100))  # -> SmallerThan, OrEqualTo
dispatch_13 = Dispatch(List=data_10, DispatchPattern=smaller_3.SmallerThan)  # -> ListA, ListB

# ---- group: default 钢埋件单体
merge_3 = Merge(Data1=item.Item, Data2=move2pt.Moved)

# ----
钢埋板长度_2 = Division(A=number_slider_3, B=2)
neg = Negative(Value=钢埋板长度_2)
dom = ConstructDomain(DomainStart=neg, DomainEnd=钢埋板长度_2)
panel_23 = Panel(dom)

# ----
# 列表文字以空格进行分割
panel_24 = Panel(" ")
split = TextSplit(Text=txt, Separators=panel_24)

钢埋板厚度_2 = Division(A=number_slider_5, B=2)
neg_2 = Negative(Value=钢埋板厚度_2)
dom_2 = ConstructDomain(DomainStart=neg_2, DomainEnd=钢埋板厚度_2)
panel_25 = Panel(dom_2)

# ----
# 钢埋板肋板位置 1/4处
panel_26 = Panel("4")
division = Division(A=number_slider_3, B=panel_26)

# ---- group: 阴阳角的点
# 阳角
# 阴角
data_11 = Data(dispatch_13.ListA)

# ----
# 编号和截面尺寸分区
panel_27 = Panel("1")
split_2 = SplitList(List=split, Index=panel_27)  # -> flatten(ListA), flatten(ListB)

# ---- group: 下层定位点
movetoplane = MoveToPlane(Geometry=crv_9, Plane=PlaneXY(0, 0, 0), Above=True, Below=True)  # -> Geometry, Transform
area_5 = Area(Geometry=movetoplane.Geometry)  # -> Area, Centroid
pt = Point(area_5.Centroid)

# ---- group: 筛选阴阳角的点
# 阳角
item_4 = ListItem(List=data_9, Index=testpoint_2.specialPt, Wrap=True)

# 阴角
cull_i = CullIndex(List=data_9, Indices=testpoint_2.specialPt, Wrap=True)

# 阴角
cull_i_2 = CullIndex(List=data_7, Indices=testpoint.specialPt, Wrap=True)

# 阳角
item_5 = ListItem(List=data_7, Index=testpoint.specialPt, Wrap=True)

# ----
movetoplane_2 = MoveToPlane(Geometry=crv_11, Plane=PlaneXY(0, 0, 0), Above=True, Below=True)  # -> Geometry, Transform
area_6 = Area(Geometry=movetoplane_2.Geometry)  # -> Area, Centroid
pt_2 = Point(area_6.Centroid)

# ---- group: 上层定位点
movetoplane_3 = MoveToPlane(Geometry=crv_10, Plane=PlaneXY(0, 0, 0), Above=True, Below=True)  # -> Geometry, Transform
area_7 = Area(Geometry=movetoplane_3.Geometry)  # -> Area, Centroid
pt_3 = Point(area_7.Centroid)

# ---- group: 阴阳角的点
merge_4 = Merge(Data1=item_4, Data2=cull_i)  # -> flatten(Result)

merge_5 = Merge(Data1=item_5, Data2=cull_i_2)  # -> flatten(Result)

# ----
xy_11 = XYPlane(Origin=Point(0, 0, 0))
xy_12 = XYPlane(Origin=Point(0, 0, 0))
xy_13 = XYPlane(Origin=Point(0, 0, 0))

# ----
# 单体选型
list_6 = ValueList({"顶埋": 0, "侧埋": 1}, selected="顶埋")

# ---- group: F2 Arch Outline
crv_25 = Curve(crv_22)

# ---- group: 檐口线Input
crv_26 = Curve(project_6.Geometry)

crv_27 = Curve(project_6.Geometry)

crv_28 = Curve(project_6.Geometry)

# ----
# 选要重塑的线段长度
number_slider_17 = Slider(1200, range=0..10000)

# ----
# 调整重塑线段的平滑度
number_slider_18 = Slider(11, range=0..11)

# ----
# 区分内外梁边线
# 1.根据F2建筑线制作轮廓线
explode = Explode(Curve=crv_25, Recursive=True)  # -> Segments, Vertices
len_2 = Length(Curve=explode.Segments)
sort_2 = SortList(Keys=len_2)  # -> Keys, ValuesA
larger_4 = LargerThan(FirstNumber=len_2, SecondNumber=number_slider_17)  # -> LargerThan, OrEqualTo
panel_28 = Panel(sort_2.Keys)
dispatch_14 = Dispatch(List=explode.Segments, DispatchPattern=larger_4.LargerThan)  # -> ListA, ListB
data_12 = Data(dispatch_14.ListA)
data_13 = Data(dispatch_14.ListB)
join = JoinCurves(Curves=data_13, Preserve=False)
disc_7 = Discontinuity(Curve=join, Level=1)  # -> Points, Parameters
nurbs = NurbsCurve(Vertices=disc_7.Points, Degree=number_slider_18, Periodic=False)  # -> flatten(Curve), Length, Domain
join_2 = JoinCurves(Curves=flatten([data_12, nurbs.Curve]), Preserve=False)
offset_4 = OffsetCurve(Curve=join_2, Distance=Slider(10000, range=0..10000), Corners=1)

# ---- group: F2 Archline - Smoothed
reb = RebuildCurve(Curve=offset_4, Count=Slider(17, range=0..100), Tangents=invert(False))

# ----
# InputCurve
crv_29 = Curve()

# ----
# Curve-框住要分析的建筑单体
# 如果要用自己导入Curve作为分析线，
# 请在InputCurve那里导入curve,
# 然后在上方的选型列表选择Input Curve。
# 
# 如果要用Grasshopper自动生成的Curve,
# 请在上方的选型列表选择Default Curve。
list_7 = ValueList({"Default Curve": 0, "Input Curve": 1}, selected="Default Curve")
filter = StreamFilter(Gate=list_7, Stream0=reb, Stream1=crv_29)

crv_30 = Curve(filter)

# ---- group: 檐口线外侧
crv_31 = Curve(project_6.Geometry)

# ---- group: 檐口线内测
crv_32 = Curve(crv_2)

# ----
# 埋件向内探索最远出的梁的距离
number_slider_19 = Slider(500, range=0..10000)

# ----
# 埋件向外探索最远出的梁的距离
number_slider_20 = Slider(0, range=0..10000)

# ---- group: 楼板线
crv_33 = Curve(project_3.Geometry)

# ----
project_11 = Project(Geometry=crv_33, Plane=PlaneXY(0, 0, 0))  # -> Geometry, Transform
reb_2 = RebuildCurve(Curve=project_11.Geometry, Count=Slider(5000, range=0..10000), Tangents=False)

# ---- group: 檐口线外侧
crv_34 = Curve(crv_28)

# ---- group: 下层交点-除重 / 上层幕墙线
crv_35 = Curve(crv_22)

# ---- group: 下层交点-除重 / 下层幕墙线
crv_36 = Curve(project.Geometry)

# ---- group: 下层交点-除重 / 容差
number_slider_21 = Slider(150, range=0..1000)

# ---- group: 上层幕墙线
crv_37 = Curve(crv_35)

# 钢埋板高度，工字钢尺寸决定
crv_38 = Curve(crv_35)

# ----
# 是否有吊顶：
# 下层幕墙边线在结构边梁以内>350
# 
# （最外层结构线）
number_slider_22 = Slider(350, range=0..1000)

merge_6 = Merge(Data1=project_6.Geometry, Data2=crv_2)

# ---- group: All檐口线
crv_39 = Curve(merge_6)

# ----
merge_7 = Merge(Data1=project_6.Geometry, Data2=crv_2)

# ---- group: All檐口线
crv_40 = Curve(merge_7)

# ---- group: 下层Arch Line
crv_41 = Curve()

# ----
# 3.2下层建筑边线内侧300-600mm范围内
number_slider_23 = Slider(600, range=0..1000)
crv_42 = Curve(crv_41)
offset_5 = OffsetCurve(Curve=crv_42, Distance=expr("-x", Slider(300, range=0..1000)), Corners=1)
offset_6 = OffsetCurve(Curve=crv_42, Distance=expr("-x", number_slider_23), Corners=1)

# ----
# 3.1下层建筑边线外侧50-350mm范围内
number_slider_24 = Slider(350, range=0..1000)
crv_43 = Curve(crv_41)
offset_7 = OffsetCurve(Curve=crv_43, Distance=number_slider_24, Corners=1)
offset_8 = OffsetCurve(Curve=crv_43, Distance=Slider(50, range=0..100), Corners=1)

# ---- group: All檐口线
crv_44 = Curve(crv_40)

crv_45 = Curve(crv_40)

crv_46 = Curve(crv_40)

crv_47 = Curve(crv_40)

# ----
# 4.0 -初筛： 下层建筑边线内侧600mm到外侧350内没有钢梁
number_slider_25 = Slider(600, range=0..1000)
crv_48 = Curve(crv_41)
offset_9 = OffsetCurve(Curve=crv_48, Distance=expr("-x", number_slider_25), Corners=1)
offset_10 = OffsetCurve(Curve=crv_48, Distance=Slider(300, range=0..1000), Corners=1)

# ----
# 4下层建筑内侧到300到外侧50内
# 有钢结构
number_slider_26 = Slider(50, range=0..1000)
crv_49 = Curve(crv_41)
offset_11 = OffsetCurve(Curve=crv_49, Distance=expr("-x", Slider(300, range=0..1000)), Corners=1)
offset_12 = OffsetCurve(Curve=crv_49, Distance=number_slider_26, Corners=1)

# ---- group: 建筑线
crv_50 = Curve(filter)

crv_51 = Curve(filter)

# ---- group: 上层幕墙线
crv_52 = Curve(crv_22)

# ----
crv_53 = Curve(crv_52)

# ----
# （3.1）导入轴线
crv_54 = Curve(<curve referenced from the Rhino model>)
layer_4 = ObjectLayer(Guid=crv_54)  # -> LayerIndex, LayerPathName
panel_29 = Panel(layer_4.LayerPathName)
reflay_5 = ReferenceByLayer(LayerName=panel_29)
xy_14 = XYPlane(Origin=Point(0, 0, 0))
project_12 = Project(Geometry=reflay_5, Plane=xy_14)  # -> Geometry, Transform

# ----
# 求内部曲线转折点
crv_55 = Curve()  # disabled
number_slider_27 = Slider(300, range=0..1000)  # disabled
neg_3 = Negative(Value=number_slider_27)  # disabled
filter_2 = StreamFilter(Gate=toggle, Stream0=number_slider_27, Stream1=neg_3)  # disabled
number_slider_28 = Slider(60, range=0..100)  # disabled

ext = ExtendCurve(Curve=crv_55, Type=0, Start=number_slider, End=number_slider)  # disabled

# ----
# 第二层
# 
# Curves(location point)+ Smooth Curves(architecture line)
# 第二层-区分阴阳角
area_8 = Area(Geometry=geo_2)  # -> Area, Centroid; disabled
crv_56 = Curve(crv_55)  # disabled
pull_3 = PullPoint(Point=area_8.Centroid, Geometry=crv_56, ClosestOnly=True)  # -> ClosestPoint, Distance; disabled
number_slider_29 = Slider(200, range=0..1000)  # disabled
number_slider_30 = Slider(100, range=0..300)  # disabled

# ----
# 第二层-阴阳角
panel_30 = Panel("0.5 * Pi")  # disabled
toggle_2 = BooleanToggle(True)  # disabled
neg_4 = Negative(Value=panel_30)  # disabled
filter_3 = StreamFilter(Gate=toggle_2, Stream0=panel_30, Stream1=neg_4)  # disabled

# ----
# 第二层-大面定位
panel_31 = Panel("0.5 * Pi")  # disabled
toggle_3 = BooleanToggle(True)  # disabled
neg_5 = Negative(Value=panel_31)  # disabled
filter_4 = StreamFilter(Gate=toggle_3, Stream0=panel_31, Stream1=neg_5)  # disabled

number_slider_31 = Slider(300, range=0..1000)  # disabled
number_slider_32 = Slider(1.5, range=0..10)  # disabled

number_slider_33 = Slider(300, range=0..1000)  # disabled
number_slider_34 = Slider(1.5, range=0..10)  # disabled

number_slider_35 = Slider(300, range=0..1000)  # disabled
number_slider_36 = Slider(1.5, range=0..10)  # disabled

# ----
# 显示"False"时要选择线段延长
list_8 = ValueList({"线段不延长": 0, "线段延长": 1}, selected="线段延长")  # disabled

filter_5 = StreamFilter(Gate=list_8, Stream0=crv_55, Stream1=ext)  # disabled

disc_8 = Discontinuity(Curve=graft(filter_5), Level=1)  # -> Points, Parameters; disabled
crv_cp_4 = CurveClosestPoint(Point=disc_8.Points, Curve=graft(filter_5))  # -> Point, Parameter, Distance; disabled
eval_6 = EvaluateCurve(Curve=graft(filter_5), Parameter=crv_cp_4.Parameter)  # -> flatten(Point), Tangent, flatten(Angle); disabled
deg_4 = Degrees(Radians=eval_6.Angle)  # disabled
offset_13 = OffsetCurve(Curve=filter_5, Distance=expr("-X", filter_2), Corners=1)  # disabled
panel_32 = Panel(deg_4)  # disabled
larger_5 = LargerThan(FirstNumber=deg_4, SecondNumber=number_slider_28)  # -> LargerThan, OrEqualTo; disabled
disc_9 = Discontinuity(Curve=offset_13, Level=1)  # -> flatten(Points), Parameters; disabled
dispatch_15 = Dispatch(List=eval_6.Point, DispatchPattern=larger_5.LargerThan)  # -> ListA, ListB; disabled
end = EndPoints(Curve=filter_5)  # -> Start, End; disabled
data_14 = Data(dispatch_15.ListA)  # disabled
pull_4 = PullPoint(Point=data_14, Geometry=flatten(offset_13), ClosestOnly=True)  # -> ClosestPoint, Distance; disabled
testpoint_3 = TestPoint(archPoint=pull_4.ClosestPoint, crvPoint=disc_9.Points)  # -> out, specialPt; inputs archPoint: list of Point3d, crvPoint: list of Point3d; disabled; same code as testpoint

# ----
# 阴角
item_6 = ListItem(List=data_14, Index=testpoint_3.specialPt, Wrap=True)  # disabled

# ----
# SmoothCurve-阴角&阳角
# 阳角
cull_i_3 = CullIndex(List=data_14, Indices=testpoint_3.specialPt, Wrap=True)  # disabled

dist = Distance(PointA=pull_3.ClosestPoint, PointB=data_14)  # disabled
sort_3 = SortList(Keys=dist)  # -> Keys, ValuesA; disabled
panel_33 = Panel(sort_3.Keys)  # disabled
smaller_4 = SmallerThan(FirstNumber=dist, SecondNumber=number_slider_29)  # -> SmallerThan, OrEqualTo; disabled
dispatch_16 = Dispatch(List=geo_2, DispatchPattern=smaller_4.SmallerThan)  # -> ListA, ListB; disabled
crv_57 = Curve(filter_5)  # disabled

data_15 = Data(dispatch_16.ListA)  # disabled
explode_2 = Explode(Curve=data_15, Recursive=True)  # -> Segments, Vertices; disabled
len_3 = Length(Curve=explode_2.Segments)  # disabled
sort_4 = SortList(Keys=reverse(len_3), ValuesA=explode_2.Segments)  # -> Keys, ValuesA; disabled
item_7 = ListItem(List=sort_4.ValuesA, Index=0, Wrap=True)  # -> flatten(Item); disabled
area_9 = Area(Geometry=data_15)  # -> Area, Centroid; disabled
midpt = CurveMiddle(Curve=item_7)  # disabled
move2pt_2 = MoveToPoint(Geometry=item_7, PointA=midpt, PointB=area_9.Centroid)  # -> Moved, Vector, Transform; disabled
end_2 = EndPoints(Curve=move2pt_2.Moved)  # -> Start, End; disabled
ln = Line(StartPoint=end_2.Start, EndPoint=end_2.End)  # disabled
xy_15 = XYPlane(Origin=end_2.End)  # disabled
rotate = Rotate(Geometry=ln, Angle=filter_3, Plane=xy_15)  # -> Geometry, Transform; disabled
pl = ConstructPlane(Origin=end_2.End, XAxis=rotate.Geometry, YAxis=ln)  # disabled

data_16 = Data(dispatch_16.ListB)  # disabled
explode_3 = Explode(Curve=data_16, Recursive=True)  # -> Segments, Vertices; disabled
len_4 = Length(Curve=explode_3.Segments)  # disabled
sort_5 = SortList(Keys=reverse(len_4), ValuesA=explode_3.Segments)  # -> Keys, ValuesA; disabled
item_8 = ListItem(List=sort_5.ValuesA, Index=0, Wrap=True)  # -> flatten(Item); disabled
area_10 = Area(Geometry=data_16)  # -> Area, Centroid; disabled
midpt_2 = CurveMiddle(Curve=item_8)  # disabled
move2pt_3 = MoveToPoint(Geometry=item_8, PointA=midpt_2, PointB=area_10.Centroid)  # -> Moved, Vector, Transform; disabled
end_3 = EndPoints(Curve=move2pt_3.Moved)  # -> Start, End; disabled
ln_2 = Line(StartPoint=end_3.Start, EndPoint=end_3.End)  # disabled
xy_16 = XYPlane(Origin=end_3.End)  # disabled
rotate_2 = Rotate(Geometry=ln_2, Angle=filter_4, Plane=xy_16)  # -> Geometry, Transform; disabled
pl_2 = ConstructPlane(Origin=end_3.End, XAxis=rotate_2.Geometry, YAxis=ln_2)  # disabled

data_17 = Data(flatten(pl_2))  # disabled
deplane_2 = DeconstructPlane(Plane=data_17)  # -> Origin, XAxis, YAxis, ZAxis; disabled
amp_2 = Amplitude(Vector=deplane_2.YAxis, Amplitude=number_slider_33)  # disabled
move_2 = Move(Geometry=deplane_2.Origin, Motion=amp_2)  # -> Geometry, Transform; disabled
ln_3 = Line(StartPoint=deplane_2.Origin, EndPoint=move_2.Geometry)  # disabled
midpt_3 = CurveMiddle(Curve=ln_3)  # disabled
scale = Scale(Geometry=ln_3, Center=midpt_3, Factor=number_slider_34)  # -> Geometry, Transform; disabled
ccx = CurveCurve(CurveA=scale.Geometry, CurveB=crv_57)  # -> Points, ParamsA, ParamsB; disabled

dist_2 = Distance(PointA=graft(end_2.End), PointB=cull_i_3)  # disabled
sort_6 = SortList(Keys=dist_2)  # -> Keys, ValuesA; disabled
item_9 = ListItem(List=sort_6.Keys, Index=0, Wrap=True)  # disabled
smaller_5 = SmallerThan(FirstNumber=item_9, SecondNumber=number_slider_30)  # -> SmallerThan, OrEqualTo; disabled
flatten = FlattenTree(Tree=item_9, Path="{0}")  # disabled
dispatch_17 = Dispatch(List=graft(pl), DispatchPattern=smaller_5.SmallerThan)  # -> ListA, ListB; disabled
panel_34 = Panel(flatten)  # disabled
flatten_2 = FlattenTree(Tree=ccx.Points, Path="{0}")  # disabled
lng = ListLength(List=scale.Geometry)  # disabled
lng_2 = ListLength(List=flatten_2)  # disabled

data_18 = Data(flatten(dispatch_17.ListA))  # disabled
deplane_3 = DeconstructPlane(Plane=data_18)  # -> Origin, XAxis, YAxis, ZAxis; disabled
amp_3 = Amplitude(Vector=deplane_3.YAxis, Amplitude=number_slider_31)  # disabled
move_3 = Move(Geometry=deplane_3.Origin, Motion=amp_3)  # -> Geometry, Transform; disabled
ln_4 = Line(StartPoint=deplane_3.Origin, EndPoint=move_3.Geometry)  # disabled
midpt_4 = CurveMiddle(Curve=ln_4)  # disabled
scale_2 = Scale(Geometry=ln_4, Center=midpt_4, Factor=number_slider_32)  # -> Geometry, Transform; disabled
ccx_2 = CurveCurve(CurveA=scale_2.Geometry, CurveB=crv_57)  # -> Points, ParamsA, ParamsB; disabled

data_19 = Data(flatten(dispatch_17.ListB))  # disabled
deplane_4 = DeconstructPlane(Plane=data_19)  # -> Origin, XAxis, YAxis, ZAxis; disabled
amp_4 = Amplitude(Vector=deplane_4.YAxis, Amplitude=number_slider_35)  # disabled
move_4 = Move(Geometry=deplane_4.Origin, Motion=amp_4)  # -> Geometry, Transform; disabled
ln_5 = Line(StartPoint=deplane_4.Origin, EndPoint=move_4.Geometry)  # disabled
midpt_5 = CurveMiddle(Curve=ln_5)  # disabled
scale_3 = Scale(Geometry=ln_5, Center=midpt_5, Factor=number_slider_36)  # -> Geometry, Transform; disabled
ccx_3 = CurveCurve(CurveA=scale_3.Geometry, CurveB=crv_57)  # -> Points, ParamsA, ParamsB; disabled

equals = Equality(FirstNumber=lng, SecondNumber=lng_2)  # -> Equality, Inequality; disabled
panel_35 = Panel(equals.Equality)  # disabled

# ----
# InsideCurve-大面
move2pt_4 = MoveToPoint(Geometry=data_17, PointA=flatten(deplane_2.Origin), PointB=flatten(ccx.Points))  # -> Moved, Vector, Transform; disabled

# ----
# InsideCurve-阳角
move2pt_5 = MoveToPoint(Geometry=data_18, PointA=deplane_3.Origin, PointB=ccx_2.Points)  # -> Moved, Vector, Transform; disabled

# ----
# InsideCurve-阴角
move2pt_6 = MoveToPoint(Geometry=data_19, PointA=deplane_4.Origin, PointB=ccx_3.Points)  # -> Moved, Vector, Transform; disabled

# ----
# 生成埋件编号
# 注意：
# 可以选择机动生成or手动输入埋件Tag可以参考下方右侧的”涉及到的梁编号“来手动输入对应的埋件编号
list_9 = ValueList({"机动生成埋件Tags": 0, "手动输入埋件Tags": 1}, selected="机动生成埋件Tags")

swatch_2 = ColourSwatch(SwatchColor=RGB(140, 140, 140))
# (9)Bake Me!!
# 埋件和阴阳角定位
panel_36 = Panel("阴阳角定位-F1+F2")

layer_5 = DefineLayer(Name=panel_36, Color=swatch_2)
attributes = DefineObjectAttributes(Layer=layer_5, Color=swatch_2)

# ---- group: 檐口埋件
panel_37 = Panel("Embed::1-1-02钢板焊埋件")
panel_38 = Panel("Tag::1-1-02钢板焊埋件")
swatch_3 = ColourSwatch(SwatchColor=RGB(255, 212, 0))

# ---- group: 上下幕墙连续
panel_39 = Panel("Tag::1-0-01钢板焊埋件")
swatch_4 = ColourSwatch(SwatchColor=RGB(255, 242, 66))
panel_40 = Panel("Embed::1-0-01钢板焊埋件")

# ---- group: 有吊顶的范围，檐口处内侧埋件
panel_41 = Panel("Embed::2-1-03钢板焊埋件")
panel_42 = Panel("Tag::2-1-03钢板焊埋件")
swatch_5 = ColourSwatch(SwatchColor=RGB(255, 242, 66))

# ---- group: 框架顶部，埋件在幕墙线外侧
panel_43 = Panel("Embed::3-1-03钢板焊埋件")
panel_44 = Panel("Tag::3-1-03钢板焊埋件")
swatch_6 = ColourSwatch(SwatchColor=RGB(180, 255, 66))

# ---- group: 框架顶部，埋件在幕墙线内侧
panel_45 = Panel("Embed::3-2-03钢板焊埋件")
panel_46 = Panel("Tag::3-2-03钢板焊埋件")
swatch_7 = ColourSwatch(SwatchColor=RGB(66, 255, 69))

# ---- group: 钢结构下底埋
panel_47 = Panel("Embed::4-1钢板焊底埋")
panel_48 = Panel("Tag::4-1钢板焊底埋")
swatch_8 = ColourSwatch(SwatchColor=RGB(66, 255, 236))

# ---- group: 范围内没有钢梁，默认幕墙线向内300有一个埋件
panel_49 = Panel("Embed::4-0-03默认钢板焊")
panel_50 = Panel("Tag::4-0-03默认钢板焊")
swatch_9 = ColourSwatch(SwatchColor=RGB(66, 167, 255))

# ---- group: 幕墙底部接地埋件
panel_51 = Panel("Embed::5-04板埋")
panel_52 = Panel("Tag::5-04板埋")
swatch_10 = ColourSwatch(SwatchColor=RGB(66, 98, 255))

# ----
# 1.1-掩口出侧埋遗漏
panel_53 = Panel("1.1-掩口出侧埋遗漏")
layer_6 = DefineLayer(Name=panel_53)
attributes_2 = DefineObjectAttributes(Layer=layer_6)

layer_7 = DefineLayer(Name=panel_38, Color=swatch_3)
layer_8 = DefineLayer(Name=panel_37, Color=swatch_3)
entwine = Entwine(Branch00=layer_8, Branch01=layer_7, FlattenInputs=True)
attributes_3 = DefineObjectAttributes(Layer=entwine, Color=swatch_3)

layer_9 = DefineLayer(Name=panel_42, Color=swatch_5)
layer_10 = DefineLayer(Name=panel_41, Color=swatch_5)
entwine_2 = Entwine(Branch00=layer_10, Branch01=layer_9, FlattenInputs=True)
attributes_4 = DefineObjectAttributes(Layer=entwine_2, Color=swatch_5)

layer_11 = DefineLayer(Name=panel_39, Color=swatch_4)
layer_12 = DefineLayer(Name=panel_40, Color=swatch_4)
entwine_3 = Entwine(Branch00=layer_12, Branch01=layer_11, FlattenInputs=True)
attributes_5 = DefineObjectAttributes(Layer=entwine_3, Color=swatch_4)

layer_13 = DefineLayer(Name=panel_44, Color=swatch_6)
layer_14 = DefineLayer(Name=panel_43, Color=swatch_6)
entwine_4 = Entwine(Branch00=layer_14, Branch01=layer_13, FlattenInputs=True)
attributes_6 = DefineObjectAttributes(Layer=entwine_4, Color=swatch_6)

layer_15 = DefineLayer(Name=panel_46, Color=swatch_7)
layer_16 = DefineLayer(Name=panel_45, Color=swatch_7)
entwine_5 = Entwine(Branch00=layer_16, Branch01=layer_15, FlattenInputs=True)
attributes_7 = DefineObjectAttributes(Layer=entwine_5, Color=swatch_7)

layer_17 = DefineLayer(Name=panel_48, Color=swatch_8)
layer_18 = DefineLayer(Name=panel_47, Color=swatch_8)
entwine_6 = Entwine(Branch00=layer_18, Branch01=layer_17, FlattenInputs=True)
attributes_8 = DefineObjectAttributes(Layer=entwine_6, Color=swatch_8)

layer_19 = DefineLayer(Name=panel_52, Color=swatch_10)
layer_20 = DefineLayer(Name=panel_51, Color=swatch_10)
entwine_7 = Entwine(Branch00=layer_20, Branch01=layer_19, FlattenInputs=True)
attributes_9 = DefineObjectAttributes(Layer=entwine_7, Color=swatch_10)

layer_21 = DefineLayer(Name=panel_50, Color=swatch_9)
layer_22 = DefineLayer(Name=panel_49, Color=swatch_9)
entwine_8 = Entwine(Branch00=layer_22, Branch01=layer_21, FlattenInputs=True)
attributes_10 = DefineObjectAttributes(Layer=entwine_8, Color=swatch_9)

# ----
# 板埋：制作板埋三视图
max = Maximum(A=s_x, B=s_y)
filter_6 = StreamFilter(Gate=list, Stream0=7.2, Stream1=9.6, Stream2=11.9, Stream3=14.3, Stream4=16.7, Stream5=19.1)
filter_7 = StreamFilter(Gate=list_2, Stream0=270, Stream1=360)
filter_8 = StreamFilter(Gate=list_3, Stream0=10, Stream1=12, Stream2=16, Stream3=18, Stream4=20, Stream5=25)
filter_9 = StreamFilter(Gate=list, Stream0=0.91, Stream1=1.1, Stream2=1.27, Stream3=1.43, Stream4=1.57, Stream5=1.71)
filter_10 = StreamFilter(Gate=list_2, Stream0=0.16, Stream1=0.14)
addition = Addition(A=list_4, B=1)
addition_2 = Addition(A=list_5, B=1)
division_2 = Division(A=max, B=8)
t = Integer(division_2)
panel_54 = Panel(filter_9)
panel_55 = Panel(filter_6)
panel_56 = Panel(filter_10)
min = Minimum(A=filter_7, B=300)
panel_57 = Panel(min)
expression = Expression(A=filter_10, fy=filter_7, ft=filter_9, d=filter_8, Expression="(int((0.6*1.1*A*fy/ft*d)/5)+1)*5")

# ----
# 生成底埋钢埋件
rectangle = Rectangle(Plane=PlaneXY(0, 0, 0), XSize=panel_11, YSize=panel_12, Radius=0)  # -> Rectangle, Length
pln_3 = Plane(rectangle.Rectangle)
rec = Rectangle(rectangle.Rectangle)

deplane_5 = DeconstructPlane(Plane=pln_3)  # -> Origin, XAxis, YAxis, ZAxis
dedomain = DeconstructDomain(Domain=panel_12)  # -> Start, End
amp_5 = Amplitude(Vector=deplane_5.YAxis, Amplitude=dedomain.End)
move_5 = Move(Geometry=deplane_5.Origin, Motion=amp_5)  # -> Geometry, Transform
ln_6 = Line(StartPoint=deplane_5.Origin, EndPoint=move_5.Geometry)
amp_6 = Amplitude(Vector=ln_6, Amplitude=Slider(190, range=0..1000))
move_6 = Move(Geometry=deplane_5.Origin, Motion=amp_6)  # -> Geometry, Transform

text = DefineTextObject(Text=panel_14, Plane=move_6.Geometry, DimensionStyle=panel_4, OutputType="Text")
group = Group(Objects=[rec, text])

# ---- group: 底埋埋件单体
merge_8 = Merge(Data1=group, Data2=pln_3)

# ----
data_20 = Data(merge_8)
item_10 = ListItem(List=data_20, Index=0, Wrap=True)  # -> Item, Item1

crv_58 = Curve(project_4.Geometry)
panel_58 = Panel("""Dimension::Dim1
Dimension::Dim2
Dimension::Dim3
Dimension::Dim4""")
layer_23 = DefineLayer(Name=panel_58)  # -> graft(Layer)
attributes_11 = DefineObjectAttributes(Layer=layer_23)

crv_59 = Curve(project_4.Geometry)
panel_59 = Panel("""Dimension::Dim1
Dimension::Dim2
Dimension::Dim3
Dimension::Dim4""")
layer_24 = DefineLayer(Name=panel_59)  # -> graft(Layer)
attributes_12 = DefineObjectAttributes(Layer=layer_24)

# ---- group: 根据color分类梁和tags
rhatt = GetRhinoAttributes(Geometry=reflay)  # -> Name, Layer, Color
C = CreateSet(Data=rhatt.Color)  # -> Data, Map, Number
panel_60 = Panel(C.Data)
filtercolor = FilterByColor(Geometry=reflay_2, Color=C.Data)  # -> simplify(Geometry)
detext = DeconstructText(TextObject=filtercolor)  # -> Text, Plane, Height, Justification

# ---- group: 根据color分类梁和tags / Beam
filtercolor_2 = FilterByColor(Geometry=reflay, Color=C.Data)  # -> simplify(Geometry)

# ---- group: 根据color分类梁和tags (continued)
crv_60 = Curve(filtercolor_2)

# ---- group: Text
item_11 = ListItem(List=detext.Text, Index=0, Wrap=True)

# ----
# 涉及到的梁编号
panel_61 = Panel(item_11)

# ---- group: Create Tags
tstat = TreeStatistics(Tree=detext.Text)  # -> Paths, Length, Count
series = Series(Start="1", Step=1, Count=tstat.Count)
concat = Concatenate(FragmentA=series, FragmentB="-")
concat_2 = Concatenate(FragmentA=concat, FragmentB=series)  # -> simplify(graft(Result))

# ----
filter_11 = StreamFilter(Gate=list_9, Stream0=concat_2, Stream1=simplify(graft(panel_6)))

# ----
# 埋件Tag预览
panel_62 = Panel(filter_11)

flatten_3 = FlattenTree(Tree=item_11, Path="{0}")
addition_3 = Addition(A=钢埋板厚度_2, B=division)
addition_4 = Addition(A=neg_2, B=division)
dom_3 = ConstructDomain(DomainStart=addition_4, DomainEnd=addition_3)
panel_63 = Panel(split_2.ListB)
钢埋板_侧视图 = Rectangle(Plane=PlaneXY(0, 0, 0), XSize=dom_2, YSize=dom, Radius=0)  # -> Rectangle, Length
xz = XZPlane(Origin=Point(0, 0, 0))
txt_2 = Text(item_11)
col = Colour(simplify(graft(C.Data)))
concat_3 = Concatenate(FragmentA="Embed", FragmentB=txt_2)
attributes_13 = DefineObjectAttributes(Color=col)
xy_17 = XYPlane(Origin=Point(0, 0, 0))
dedomain_2 = DeconstructDomain(Domain=dom)  # -> Start, End
multiplication = Multiplication(A=dedomain_2.Start, B=dedomain_2.Start)
txt_3 = Text(filter_11)
project_13 = Project(Geometry=crv_60, Plane=xy_17)  # -> Geometry, Transform

# ----
# 求出对应输入编号的钢结构截面尺寸
fsim = FindSimilarMember(Data=flatten_3, Set=split_2.ListA)  # -> Hit, Index
item_12 = ListItem(List=split_2.ListB, Index=fsim.Index, Wrap=True)

# ----
# 要连接的梁中线curve
crv_61 = Curve(project_13.Geometry)

# ---- group: 梁中线
crv_62 = Curve(crv_61)

# ---- group: 梁中线-中点
midpt_6 = CurveMiddle(Curve=crv_62)

# ---- group: 梁中线
crv_63 = Curve(crv_62)

crv_64 = Curve(crv_62)

crv_65 = Curve(crv_64)

# ---- group: 筛选定位点里的阴阳角
pull_5 = PullPoint(Point=flatten(pt), Geometry=graft(data_11), ClosestOnly=True)  # -> ClosestPoint, Distance
sort_7 = SortList(Keys=pull_5.Distance, ValuesA=flatten(pt))  # -> Keys, ValuesA
item_13 = ListItem(List=sort_7.Keys, Index=0, Wrap=True)  # -> Item, Item1
item_14 = ListItem(List=sort_7.ValuesA, Index=0, Wrap=True)  # -> Item, Item1
merge_9 = Merge(Data1=item_13.Item, Data2=item_13.Item1)
merge_10 = Merge(Data1=item_14.Item, Data2=item_14.Item1)
panel_64 = Panel(merge_9)
smaller_6 = SmallerThan(FirstNumber=merge_9, SecondNumber="100")  # -> SmallerThan, OrEqualTo
dispatch_18 = Dispatch(List=merge_10, DispatchPattern=smaller_6.SmallerThan)  # -> ListA, ListB
crv_66 = Curve(flatten(offset_3))

# ---- group: 筛选定位点里的阴阳角 / F1-阴阳角-点
data_21 = Data(dispatch_18.ListA)

# ---- group: 筛选定位点里的阴阳角 (continued)
check_same_points = CheckSamePoints(archPoint=flatten(pt), crvPoint=flatten(data_21))  # -> out, specialPt; inputs archPoint: list of Point3d, crvPoint: list of Point3d; same code as testpoint
cull_i_4 = CullIndex(List=flatten(pt), Indices=check_same_points.specialPt, Wrap=True)
pull_6 = PullPoint(Point=cull_i_4, Geometry=crv_66, ClosestOnly=True)  # -> ClosestPoint, Distance
ln_7 = Line(StartPoint=pull_6.ClosestPoint, EndPoint=cull_i_4)
rotate_3 = Rotate(Geometry=ln_7, Angle=1.570796327, Plane=cull_i_4)  # -> Geometry, Transform
pl_3 = ConstructPlane(Origin=cull_i_4, XAxis=rotate_3.Geometry, YAxis=ln_7)

# ----
project_14 = Project(Geometry=pl_3, Plane=xy_11)  # -> Geometry, Transform

# ---- group: 下层定位点Plane-去阴阳角
pln_4 = Plane(project_14.Geometry)

# ---- group: 下层定位平面-All
pln_5 = Plane(pln_4)

# ----
# 1.是否有檐口线-下层定位点
toggle_4 = BooleanToggle(True)
clean = CleanTree(RemoveNulls=True, RemoveInvalid=True, RemoveEmpty=toggle_4, Tree=pln_5)
deplane_6 = DeconstructPlane(Plane=clean)  # -> Origin, XAxis, YAxis, ZAxis
incurve = PointInCurve(Point=deplane_6.Origin, Curve=crv_27)  # -> Relationship, Point
equals_2 = Equality(FirstNumber=incurve.Relationship, SecondNumber="2")  # -> Equality, Inequality
dispatch_19 = Dispatch(List=clean, DispatchPattern=equals_2.Equality)  # -> ListA, ListB

# ----
# Site - 有檐口线的定位点
pln_6 = Plane(dispatch_19.ListA)

# ----
# Site - 无檐口线的定位点
pln_7 = Plane(dispatch_19.ListB)

# ---- group: 檐口线-Site
pln_8 = Plane(pln_6)

# ----
incurve_2 = PointInCurve(Point=pln_7, Curve=crv_30)  # -> Relationship, Point
equals_3 = Equality(FirstNumber=incurve_2.Relationship, SecondNumber="2")  # -> Equality, Inequality
dispatch_20 = Dispatch(List=pln_7, DispatchPattern=equals_3.Equality)  # -> ListA, ListB

incurve_3 = PointInCurve(Point=pln_8, Curve=crv_30)  # -> Relationship, Point
equals_4 = Equality(FirstNumber=incurve_3.Relationship, SecondNumber="2")  # -> Equality, Inequality
dispatch_21 = Dispatch(List=pln_8, DispatchPattern=equals_4.Equality)  # -> ListA, ListB

# ---- group: 建筑单体-下层-有檐口线定位点
pln_9 = Plane(dispatch_21.ListA)

# ---- group: 建筑单体-下层-无檐口线定位点
pln_10 = Plane(dispatch_20.ListA)

# ----
# 1.0无檐口线初筛-下层定位点
pln_11 = Plane(pln_10)

project_15 = Project(Geometry=pln_11, Plane=PlaneXY(0, 0, 0))  # -> Geometry, Transform

# ---- group: All-下层定位点
# 1.1有檐口线
pln_12 = Plane(pln_9)

# ----
pln_13 = Plane(pln_12)

cull_i_5 = CullIndex(Wrap=True)
merge_11 = Merge(Data1=cull_i_5, Data2=pln_13)  # -> flatten(Result)

# ----
# 和下层楼板发生关系的定位点
pln_14 = Plane(merge_11)

# ---- group: 起始Plane
pln_15 = Plane(pln_14)

# ----
# 板埋Modeling
multiplication_2 = Multiplication(A=s_x, B=addition)
multiplication_3 = Multiplication(A=s_y, B=addition_2)
recgrid = Rectangular(Plane=PlaneXY(0, 0, 0), SizeX=s_x, SizeY=s_y, ExtentX=addition, ExtentY=addition_2)  # -> Cells, Points
直径 = Text(filter_8)
division_3 = Division(A=multiplication_2, B=2)
division_4 = Division(A=multiplication_3, B=2)
vec = VectorXYZ(XComponent=expr("-x", division_3), YComponent=expr("-x", division_4), ZComponent=0)  # -> Vector, Length
move_7 = Move(Geometry=recgrid.Points, Motion=vec.Vector)  # -> Geometry, Transform
division_5 = Division(A=直径, B=2)
cyl = Cylinder(Base=move_7.Geometry, Radius=division_5, Length=expr("-x", expression))
X = UnitX(Factor=直径)
multiplication_4 = Multiplication(A=直径, B=6)
edges = BrepEdges(Brep=cyl)  # -> Naked, Interior, NonManifold
item_15 = ListItem(List=edges.Naked, Index=0, Wrap=True)
max_2 = Maximum(A=multiplication_4, B=70)
move_8 = Move(Geometry=item_15, Motion=X)  # -> Geometry, Transform
multiplication_5 = Multiplication(A=max_2, B=2)
addition_5 = Addition(A=multiplication_2, B=multiplication_5)
addition_6 = Addition(A=multiplication_3, B=multiplication_5)
division_6 = Division(A=t, B=2)
expression_2 = Expression(x=addition_6, Expression="Ceiling(x/10)*10/2")
expression_3 = Expression(x=addition_5, Expression="Ceiling(x/10)*10/2")
round = Round(Number=division_6)  # -> Nearest, Floor, Ceiling
multiplication_6 = Multiplication(A=round.Ceiling, B=2)
dom_4 = ConstructDomain(DomainStart=expr("-x", expression_2), DomainEnd=expression_2)
dom_5 = ConstructDomain(DomainStart=expr("-x", expression_3), DomainEnd=expression_3)
box = DomainBox(Base=PlaneXY(0, 0, 0), X=dom_5, Y=dom_4, Z=multiplication_6)
Z = UnitZ(Factor=expr("-x", multiplication_6))

multiplication_7 = Multiplication(A=直径, B=5)

Z_2 = UnitZ(Factor=multiplication_7)
extr = Extrude(Base=move_8.Geometry, Direction=Z_2)
cap = CapHoles(Brep=[extr, cyl])
merge_12 = Merge(Data1=cap, Data2=box)
flatten_4 = FlattenTree(Tree=merge_12, Path="{0}")
move_9 = Move(Geometry=flatten_4, Motion=Z)  # -> Geometry, Transform

# ---- group: 筛选阴阳角
pull_7 = PullPoint(Point=flatten(pt_2), Geometry=graft(merge_5), ClosestOnly=True)  # -> ClosestPoint, Distance
sort_8 = SortList(Keys=pull_7.Distance, ValuesA=flatten(pt_2))  # -> Keys, ValuesA
item_16 = ListItem(List=sort_8.Keys, Index=0, Wrap=True)  # -> Item, Item1
item_17 = ListItem(List=sort_8.ValuesA, Index=0, Wrap=True)  # -> Item, Item1
merge_13 = Merge(Data1=item_16.Item, Data2=item_16.Item1)
merge_14 = Merge(Data1=item_17.Item, Data2=item_17.Item1)
panel_65 = Panel(merge_13)
smaller_7 = SmallerThan(FirstNumber=merge_13, SecondNumber="100")  # -> SmallerThan, OrEqualTo
dispatch_22 = Dispatch(List=merge_14, DispatchPattern=smaller_7.SmallerThan)  # -> ListA, ListB
crv_67 = Curve(flatten(offset))

# ---- group: 筛选阴阳角 / F1-阴阳角-点
data_22 = Data(dispatch_22.ListA)

# ---- group: 筛选阴阳角 (continued)
check_same_points_2 = CheckSamePoints(archPoint=flatten(pt_2), crvPoint=flatten(data_22))  # -> out, specialPt; inputs archPoint: list of Point3d, crvPoint: list of Point3d; same code as testpoint
cull_i_6 = CullIndex(List=flatten(pt_2), Indices=check_same_points_2.specialPt, Wrap=True)
pull_8 = PullPoint(Point=cull_i_6, Geometry=crv_67, ClosestOnly=True)  # -> ClosestPoint, Distance
ln_8 = Line(StartPoint=pull_8.ClosestPoint, EndPoint=cull_i_6)
rotate_4 = Rotate(Geometry=ln_8, Angle=1.570796327, Plane=cull_i_6)  # -> Geometry, Transform
pl_4 = ConstructPlane(Origin=cull_i_6, XAxis=rotate_4.Geometry, YAxis=ln_8)

# ----
project_16 = Project(Geometry=pl_4, Plane=xy_12)  # -> Geometry, Transform

# ---- group: 檐口定位点Plane-去阴阳角
pln_16 = Plane(project_16.Geometry)

# ---- group: 檐口定位平面-All
pln_17 = Plane(pln_16)

# ----
split_3 = TextSplit(Text=item_12, Separators="x")
split_4 = TextSplit(Text=split_3, Separators="Q")
item_18 = ListItem(List=split_4, Index="0", Wrap=True)

shift = ShiftPaths(Data=item_18, Offset=-1)
subtraction = Subtraction(A=division, B=钢埋板厚度_2)
subtraction_2 = Subtraction(A=division, B=钢埋板厚度_2)
subtraction_3 = Subtraction(A=division, B=钢埋板厚度_2)
neg_6 = Negative(Value=钢埋板厚度_2)
neg_7 = Negative(Value=钢埋板厚度_2)
neg_8 = Negative(Value=钢埋板厚度_2)
subtraction_4 = Subtraction(A=division, B=钢埋板厚度_2)
addition_7 = Addition(A=subtraction, B=number_slider_5)
addition_8 = Addition(A=subtraction_2, B=number_slider_5)
subtraction_5 = Subtraction(A=neg_6, B=number_slider_5)
subtraction_6 = Subtraction(A=neg_7, B="2")
subtraction_7 = Subtraction(A=division, B=钢埋板厚度_2)
addition_9 = Addition(A=subtraction_3, B="2")
subtraction_8 = Subtraction(A=neg_8, B="2")
neg_9 = Negative(Value=钢埋板厚度_2)
neg_10 = Negative(Value=钢埋板厚度_2)
工字钢_h = ListItem(List=shift, Index=0, Wrap=True)
工字钢_b = ListItem(List=shift, Index=1, Wrap=True)
工字钢_tf = ListItem(List=shift, Index=3, Wrap=True)
工字钢_tw = ListItem(List=shift, Index=2, Wrap=True)
pt_4 = ConstructPoint(XCoordinate=neg_9, YCoordinate=subtraction_4, ZCoordinate=0)
pt_5 = ConstructPoint(XCoordinate=neg_10, YCoordinate=addition_7, ZCoordinate=0)
pt_6 = ConstructPoint(XCoordinate=subtraction_5, YCoordinate=addition_8, ZCoordinate=0)
pt_7 = ConstructPoint(XCoordinate=subtraction_6, YCoordinate=subtraction_7, ZCoordinate=0)
pt_8 = ConstructPoint(XCoordinate=subtraction_8, YCoordinate=addition_9, ZCoordinate=0)
subtraction_9 = Subtraction(A=工字钢_b, B=工字钢_tw)
merge_15 = Merge(Data1=pt_4, Data2=pt_5, Data3=pt_6, Data4=pt_8, Data5=pt_7)
division_7 = Division(A=subtraction_9, B="2")
pline = PolyLine(Vertices=merge_15, Closed=True)
division_8 = Division(A=division_7, B="2")
subtraction_10 = Subtraction(A=division_8, B=number_slider_5)
subtraction_11 = Subtraction(A=division_8, B=钢埋板厚度_2)
neg_11 = Negative(Value=division_8)
subtraction_12 = Subtraction(A=neg_11, B=subtraction_11)
addition_10 = Addition(A=subtraction_12, B=number_slider_4)
dom_6 = ConstructDomain(DomainStart=addition_10, DomainEnd=subtraction_12)
dom_7 = ConstructDomain(DomainStart=addition_4, DomainEnd=addition_3)
subtraction_13 = Subtraction(A=subtraction_10, B=subtraction_11)
subtraction_14 = Subtraction(A=neg_11, B=subtraction_11)
dom_8 = ConstructDomain(DomainStart=subtraction_13, DomainEnd=subtraction_14)

# ---- group: 筛选定位点里的阴阳角
pull_9 = PullPoint(Point=flatten(pt_3), Geometry=graft(merge_4), ClosestOnly=True)  # -> ClosestPoint, Distance
sort_9 = SortList(Keys=pull_9.Distance, ValuesA=flatten(pt_3))  # -> Keys, ValuesA
item_19 = ListItem(List=sort_9.Keys, Index=0, Wrap=True)  # -> Item, Item1
item_20 = ListItem(List=sort_9.ValuesA, Index=0, Wrap=True)  # -> Item, Item1
merge_16 = Merge(Data1=item_19.Item, Data2=item_19.Item1)
merge_17 = Merge(Data1=item_20.Item, Data2=item_20.Item1)
panel_66 = Panel(merge_16)
smaller_8 = SmallerThan(FirstNumber=merge_16, SecondNumber="100")  # -> SmallerThan, OrEqualTo
dispatch_23 = Dispatch(List=merge_17, DispatchPattern=smaller_8.SmallerThan)  # -> ListA, ListB
crv_68 = Curve(flatten(offset_2))

# ---- group: 筛选定位点里的阴阳角 / F1-阴阳角-点
data_23 = Data(dispatch_23.ListA)

# ---- group: 上-阴阳角
pt_9 = Point(data_23)

# ----
merge_18 = Merge(Data1=data_4, Data2=pt_9)

bake = BakeObjects(Geometry=merge_18, Attributes=attributes, BakeName=panel_36, Bake=False)

# ---- group: 筛选定位点里的阴阳角 (continued)
check_same_points_3 = CheckSamePoints(archPoint=flatten(pt_3), crvPoint=flatten(data_23))  # -> out, specialPt; inputs archPoint: list of Point3d, crvPoint: list of Point3d; same code as testpoint
cull_i_7 = CullIndex(List=flatten(pt_3), Indices=check_same_points_3.specialPt, Wrap=True)
pull_10 = PullPoint(Point=cull_i_7, Geometry=crv_68, ClosestOnly=True)  # -> ClosestPoint, Distance
ln_9 = Line(StartPoint=pull_10.ClosestPoint, EndPoint=cull_i_7)
rotate_5 = Rotate(Geometry=ln_9, Angle=1.570796327, Plane=cull_i_7)  # -> Geometry, Transform
pl_5 = ConstructPlane(Origin=cull_i_7, XAxis=rotate_5.Geometry, YAxis=ln_9)

# ----
project_17 = Project(Geometry=pl_5, Plane=xy_13)  # -> Geometry, Transform

# ---- group: 上层定位点Plane-去阴阳角
pln_18 = Plane(project_17.Geometry)

# ---- group: 上层定位平面-All
pln_19 = Plane(pln_18)

# ----
panel_67 = Panel(工字钢_b)
tstat_2 = TreeStatistics(Tree=工字钢_h)  # -> Paths, Length, Count
钢肋板倒角_侧视图 = Rectangle(Plane=PlaneXY(0, 0, 0), XSize=dom_6, YSize=dom_7, Radius=0)  # -> Rectangle, Length
钢肋板_侧视图 = Rectangle(Plane=PlaneXY(0, 0, 0), XSize=dom_8, YSize=dom_3, Radius=0)  # -> Rectangle, Length
repeat = RepeatData(Data=pline, Length=tstat_2.Length)  # -> simplify(Data)
merge_19 = Merge(Data1=simplify(钢肋板_侧视图.Rectangle), Data2=simplify(repeat), Data3=simplify(钢肋板倒角_侧视图.Rectangle))
division_9 = Division(A=工字钢_h, B="2")
subtraction_15 = Subtraction(A=division_9, B=工字钢_tf)
division_10 = Division(A=工字钢_b, B=2)
repeat_2 = RepeatData(Data=钢埋板_侧视图.Rectangle, Length=tstat_2.Length)  # -> simplify(Data)
mirror = Mirror(Geometry=merge_19, Plane=xz)  # -> Geometry, Transform
addition_11 = Addition(A=subtraction_15, B=Slider(200, range=0..1000))
addition_12 = Addition(A=addition_11, B=division_7)
merge_20 = Merge(Data1=repeat_2, Data2=merge_19, Data3=mirror.Geometry)
X_2 = UnitX(Factor=addition_12)

# ---- group: 所以钢埋件geo
move_10 = Move(Geometry=merge_20, Motion=X_2)  # -> Geometry, Transform

# ---- group: 对齐geo
group_2 = Group(Objects=move_10.Geometry)
rotate_6 = Rotate(Geometry=group_2, Angle=3.141592654, Plane=PlaneXY(0, 0, 0))  # -> Geometry, Transform
boxprop = BoxProperties(Box=rotate_6.Geometry)  # -> Center, Diagonal, Area, Volume, Degeneracy
bbox_2 = BoundingBox(Content=rotate_6.Geometry, Plane=PlaneXY(0, 0, 0))  # -> Box, Box_2
debox = DeconstructBox(Box=bbox_2.Box)  # -> Plane, X, Y, Z
pdecon = Deconstruct(Point=boxprop.Center)  # -> XComponent, YComponent, ZComponent
dedomain_3 = DeconstructDomain(Domain=debox.Y)  # -> Start, End
pt_10 = ConstructPoint(XCoordinate=pdecon.XComponent, YCoordinate=dedomain_3.Start, ZCoordinate=pdecon.ZComponent)
xy_18 = XYPlane(Origin=Point(0, 0, 0))
pl_origin = PlaneOrigin(Base=xy_18, Origin=pt_10)
orient = Orient(Geometry=rotate_6.Geometry, Source=pl_origin, Target=xy_18)  # -> Geometry, Transform
ungroup_2 = Ungroup(Group=orient.Geometry)  # -> simplify(Objects)

# ----
# 要连接的梁中线Offest值
num = Number(simplify(division_10))

# ---- group: 梁Offset
num_2 = Number(num)

# ----
# 三视图
# hidden lines of top+pers view
# move to center
# 如果无法完整的生成埋件的三视图，
# 建议选择埋件的3D在Rhino中将
# Top/Perspective/Front/Right 试图缩放至合适大小后重新运行
panel_68 = Panel("""Top
Perspective
Front
Right""")
m2d_rhino = Make2DRhinoView(Name=panel_68, Clip=True)
number_slider_37 = Slider(1, range=0..10)
pt_11 = Point(Point(957.9296072, 367.7685097, 0))
pt_12 = Point("0,0,0")
recgrid_2 = Rectangular(
    Plane=pt_11,
    SizeX=Slider(12, range=1..20, expression="X*50"),
    SizeY=Slider(10, range=1..20, expression="X*50"),
    ExtentX=number_slider_37,
    ExtentY=number_slider_37)  # -> Cells, Points
flatten_5 = FlattenTree(Tree=recgrid_2.Points, Path="{0}")

# ----
# （6）生成板埋埋件
# 注意：
# 1.记得点一下Compute按钮
# 2.如果无法完整的生成埋件的三视图，
# 建议选择埋件的3D在Rhino中将
# Top/Perspective/Front/Right 试图缩放至合适大小后重新运行
make2d = Make2D(Geometry=move_9.Geometry, View=m2d_rhino, TangentEdges=False, TangentSeams=False, AutoComputeMake2D=False)  # -> VisibleCurves, VisibleIndex, VisibleType, HiddenCurves, HiddenIndex, HiddenType

bang = ExplodeTree(Data=make2d.VisibleCurves)  # -> Branch0, Branch1, Branch2, Branch3, Branch4, Branch5, Branch6, Branch7
divdist = DivideDistance(Curve=make2d.HiddenCurves, Distance=Slider(1, range=0..10))  # -> Points, Tangents, Parameters
graft = GraftTree(Tree=make2d.HiddenCurves, IncludeEmptyLists=True, IncludeNullItems=True)
shatter = Shatter(Curve=graft, Parameters=divdist.Parameters)
dispatch_24 = Dispatch(List=shatter, DispatchPattern=[True, False])  # -> ListA, ListB
crv_69 = Curve(dispatch_24.ListA)
pshift = ShiftPaths(Data=crv_69, Offset=-1)
pshift_2 = ShiftPaths(Data=pshift, Offset=-1)
bang_2 = ExplodeTree(Data=pshift_2)  # -> Branch0, Branch1, Branch2, Branch3, Branch4, Branch5, Branch6, Branch7
entwine_9 = Entwine(Branch00=bang_2.Branch0, Branch01=bang.Branch0, FlattenInputs=True)  # -> flatten(Result)
entwine_10 = Entwine(Branch00=bang_2.Branch1, Branch01=bang.Branch1, FlattenInputs=True)  # -> flatten(Result)
entwine_11 = Entwine(Branch00=entwine_9, Branch01=entwine_10, Branch02=bang.Branch2, Branch03=bang.Branch3, FlattenInputs=True)
group_3 = Group(Objects=entwine_11)
pshift_3 = ShiftPaths(Data=group_3, Offset=-1)
pshift_4 = ShiftPaths(Data=group_3, Offset=-1)
boxprop_2 = BoxProperties(Box=pshift_3)  # -> Center, Diagonal, Area, Volume, Degeneracy
vec2pt = Vector2Pt(PointA=boxprop_2.Center, PointB=pt_12, Unitize=False)  # -> Vector, Length
move_11 = Move(Geometry=pshift_4, Motion=vec2pt.Vector)  # -> flatten(Geometry), Transform
orient_2 = Orient(Geometry=flatten(move_11.Geometry), Source=PlaneXY(0, 0, 0), Target=flatten_5)  # -> Geometry, Transform
cull_i_8 = CullIndex(List=orient_2.Geometry, Indices="-1", Wrap=True)
split_5 = SplitList(List=cull_i_8, Index="4")  # -> ListA, ListB
geo_4 = Geometry(split_5.ListA)

# ---- group: 单体定Top/Side
item_21 = ListItem(List=geo_4, Index=Slider(0, range=0..10), Wrap=True)
item_22 = ListItem(List=geo_4, Index=2, Wrap=True)
cluster_2 = Cluster(G=item_21)
cluster_3 = Cluster(G=item_22)

# ----
block = DefineBlock(Geometry=ungroup_2, Attributes=attributes_13, BlockName=concat_3, BasePlane=PlaneXY(0, 0, 0))
deblock_4 = DeconstructBlock(Block=block)  # -> Name, Plane, Geometry
group_4 = Group(Objects=deblock_4.Geometry)
bbox_3 = BoundingBox(Content=group_4, Plane=PlaneXY(0, 0, 0))  # -> Box, Box_2
deplane_7 = DeconstructPlane(Plane=deblock_4.Plane)  # -> Origin, XAxis, YAxis, ZAxis
area_11 = Area(Geometry=bbox_3.Box)  # -> Area, Centroid
move2pt_7 = MoveToPoint(Geometry=deplane_7.Origin, PointA=deplane_7.Origin, PointB=area_11.Centroid)  # -> Moved, Vector, Transform
pl_6 = ConstructPlane(Origin=move2pt_7.Moved, XAxis=deplane_7.YAxis, YAxis=deplane_7.XAxis)
deplane_8 = DeconstructPlane(Plane=pl_6)  # -> Origin, XAxis, YAxis, ZAxis
rotate_7 = Rotate(Geometry=pl_6, Angle="Pi", Plane=pl_6)  # -> Geometry, Transform
amp_7 = Amplitude(Vector=deplane_8.YAxis, Amplitude=multiplication)
move_12 = Move(Geometry=deplane_8.Origin, Motion=amp_7)  # -> Geometry, Transform
srf = Surface(bbox_3.Box)
crv_70 = Curve(srf)
ln_10 = Line(StartPoint=move_12.Geometry, EndPoint=deplane_8.Origin)
ccx_4 = CurveCurve(CurveA=ln_10, CurveB=crv_70)  # -> Points, ParamsA, ParamsB
ln_11 = Line(StartPoint=deplane_8.Origin, EndPoint=ccx_4.Points)
move_13 = Move(Geometry=rotate_7.Geometry, Motion=ln_11)  # -> simplify(Geometry), Transform
amp_8 = Amplitude(Vector=ln_11, Amplitude=expr("-x", number_slider_6))
move_14 = Move(Geometry=move_13.Geometry, Motion=amp_8)  # -> Geometry, Transform

# ---- group: 生成埋件定位plane
neg_12 = Negative(Value=multiplication)
amp_9 = Amplitude(Vector=deplane_8.YAxis, Amplitude=neg_12)
move_15 = Move(Geometry=deplane_8.Origin, Motion=amp_9)  # -> Geometry, Transform
ln_12 = Line(StartPoint=move_15.Geometry, EndPoint=deplane_8.Origin)
ccx_5 = CurveCurve(CurveA=ln_12, CurveB=crv_70)  # -> Points, ParamsA, ParamsB
ln_13 = Line(StartPoint=deplane_8.Origin, EndPoint=ccx_5.Points)
move_16 = Move(Geometry=rotate_7.Geometry, Motion=ln_13)  # -> simplify(Geometry), Transform

# ---- group: tag
text_2 = DefineTextObject(Text=txt_3, Plane=simplify(move_14.Geometry), DimensionStyle=panel_4, OutputType="Text")
group_5 = Group(Objects=[block, text_2])

# ----
merge_21 = Merge(Data1=group_5, Data2=move_16.Geometry)

# ----
# 要连接的embed
data_24 = Data(merge_21)

# ----
# 第一层
# 
# Curves(location point)+ Smooth Curves(architecture line)
# 测试Smooth Curve是否与每个Block相切
# blocks + smooth curves
# remove duplicate blocks
# blocks + special curves
# 测试Smooth Curve是否与每个Block相切
# blocks + smooth curves
# remove duplicate blocks
# blocks + special curves
# 第一层
# 
# Angular Curves(architecture line)
# 第一层
# 
# Special Curves(architecture line)
# 第一层
# 
# Angular Curves(architecture line)
data_25 = Data(data_24)
# 阳角
# 阴角
# 转角点
item_23 = ListItem(List=data_25, Index=0, Wrap=True)
item_24 = ListItem(List=data_25, Index="-1", Wrap=True)
data_26 = Data(data_24)
item_25 = ListItem(List=data_26, Index="-1", Wrap=True)
# 阴阳角
item_26 = ListItem(List=data_26, Index=0, Wrap=True)
data_27 = Data(data_24)
item_27 = ListItem(List=data_27, Index=0, Wrap=True)
item_28 = ListItem(List=data_27, Index="-1", Wrap=True)
rotate_8 = Rotate(Geometry=item_28, Angle="Pi", Plane=item_28)  # -> Geometry, Transform
data_28 = Data(data_24)
data_29 = Data(data_24)
item_29 = ListItem(List=data_28, Index=0, Wrap=True)
item_30 = ListItem(List=data_28, Index="-1", Wrap=True)
item_31 = ListItem(List=data_29, Index=0, Wrap=True)
item_32 = ListItem(List=data_29, Index="-1", Wrap=True)
rotate_9 = Rotate(Geometry=item_30, Angle="Pi", Plane=item_30)  # -> Geometry, Transform

ungroup_3 = Ungroup(Group=cluster_3)
ungroup_4 = Ungroup(Group=cluster_2)

# ---- group: Top/Side
filter_12 = StreamFilter(Gate=list_6, Stream0=ungroup_4, Stream1=ungroup_3)

# ---- group: Block
attributes_14 = DefineObjectAttributes(Color=ColourSwatch(SwatchColor=RGB(255, 0, 0)))
block_2 = DefineBlock(Geometry=ungroup_4, Attributes=attributes_14, BlockName="Board Plate", BasePlane=PlaneXY(0, 0, 0))

# ----
deblock_5 = DeconstructBlock(Block=block_2)  # -> Name, flatten(Plane), flatten(Geometry)
boundary_2 = BoundarySurfaces(Edges=deblock_5.Geometry)
deplane_9 = DeconstructPlane(Plane=deblock_5.Plane)  # -> Origin, XAxis, YAxis, ZAxis
area_12 = Area(Geometry=boundary_2)  # -> Area, Centroid
move2pt_8 = MoveToPoint(Geometry=flatten(deplane_9.Origin), PointA=flatten(deplane_9.Origin), PointB=flatten(area_12.Centroid))  # -> Moved, Vector, Transform
pl_7 = ConstructPlane(Origin=move2pt_8.Moved, XAxis=deplane_9.XAxis, YAxis=deplane_9.YAxis)  # -> graft(Plane)

deplane_10 = DeconstructPlane(Plane=deblock_5.Plane)  # -> Origin, XAxis, YAxis, ZAxis
amp_10 = Amplitude(Vector=deplane_10.YAxis, Amplitude=number_slider_7)
move_17 = Move(Geometry=deplane_10.Origin, Motion=amp_10)  # -> Geometry, Transform

text_3 = DefineTextObject(Text=panel_13, Plane=move_17.Geometry, DimensionStyle=panel_4, OutputType="Text")
group_6 = Group(Objects=flatten([block_2, text_3]))

# ---- group: 板埋埋件单体
entwine_12 = Entwine(Branch00=group_6, Branch01=pl_7, FlattenInputs=True)

# ----
data_30 = Data(flatten(entwine_12))
item_33 = ListItem(List=data_30, Index=0, Wrap=True)
item_34 = ListItem(List=data_30, Index="-1", Wrap=True)

ungroup_5 = Ungroup(Group=item_33)
item_35 = ListItem(List=ungroup_5, Index="-1", Wrap=True)
deblock_6 = DeconstructBlock(Block=item_35)  # -> Name, Plane, Geometry
boundary_3 = BoundarySurfaces(Edges=deblock_6.Geometry)
debrep_2 = DeconstructBrep(Brep=boundary_3)  # -> Faces, Edges, Vertices
len_5 = Length(Curve=debrep_2.Edges)
sort_10 = SortList(Keys=len_5, ValuesA=debrep_2.Edges)  # -> Keys, ValuesA
item_36 = ListItem(List=sort_10.ValuesA, Index=0, Wrap=True)
len_6 = Length(Curve=item_36)  # -> expr("x/2", Length)

# ----
# 1.是否有檐口线-上层定位点
toggle_5 = BooleanToggle(True)
clean_2 = CleanTree(RemoveNulls=True, RemoveInvalid=True, RemoveEmpty=toggle_5, Tree=pln_19)

# ---- group: Input ???
deplane_11 = DeconstructPlane(Plane=clean_2)  # -> Origin, XAxis, YAxis, ZAxis

# ----
incurve_4 = PointInCurve(Point=deplane_11.Origin, Curve=crv_26)  # -> Relationship, Point
equals_5 = Equality(FirstNumber=incurve_4.Relationship, SecondNumber="2")  # -> Equality, Inequality
dispatch_25 = Dispatch(List=clean_2, DispatchPattern=equals_5.Equality)  # -> ListA, ListB

# ----
# Site - 无檐口线的定位点
pln_20 = Plane(dispatch_25.ListB)

incurve_5 = PointInCurve(Point=pln_20, Curve=crv_30)  # -> Relationship, Point
equals_6 = Equality(FirstNumber=incurve_5.Relationship, SecondNumber="2")  # -> Equality, Inequality
dispatch_26 = Dispatch(List=pln_20, DispatchPattern=equals_6.Equality)  # -> ListA, ListB
pln_21 = Plane(dispatch_26.ListB)

# ---- group: 建筑单体-上层-无檐口线定位点
pln_22 = Plane(dispatch_26.ListA)

# ----
# 1.0无檐口线初筛-上层定位点
pln_23 = Plane(pln_22)

deplane_12 = DeconstructPlane(Plane=pln_23)  # -> Origin, XAxis, YAxis, ZAxis
incurves = PointInCurves(Point=deplane_12.Origin, Curves=flatten(reb_2))  # -> Relationship, Index, Point
equals_7 = Equality(FirstNumber=incurves.Relationship, SecondNumber="2")  # -> Equality, Inequality
dispatch_27 = Dispatch(List=pln_23, DispatchPattern=equals_7.Equality)  # -> ListA, ListB
data_31 = Data(dispatch_27.ListB)

pln_24 = Plane(dispatch_27.ListA)

# ---- group: 下层交点-除重
# 1.0无檐口线-上层定位点
pln_25 = Plane(data_31)

# ----
# 1.是否有檐口线-檐口线定位点
toggle_6 = BooleanToggle(True)
clean_3 = CleanTree(RemoveNulls=True, RemoveInvalid=True, RemoveEmpty=toggle_6, Tree=pln_17)

# ---- group: Input ???
deplane_13 = DeconstructPlane(Plane=clean_3)  # -> Origin, XAxis, YAxis, ZAxis

# ----
incurve_6 = PointInCurve(Point=deplane_13.Origin, Curve=crv_28)  # -> Relationship, Point
equals_8 = Equality(FirstNumber=incurve_6.Relationship, SecondNumber="2")  # -> Equality, Inequality
dispatch_28 = Dispatch(List=clean_3, DispatchPattern=equals_8.Equality)  # -> ListA, ListB

# ----
# Site - 檐口线的定位点
pln_26 = Plane(dispatch_28.ListB)

incurve_7 = PointInCurve(Point=pln_26, Curve=crv_30)  # -> Relationship, Point
equals_9 = Equality(FirstNumber=incurve_7.Relationship, SecondNumber="2")  # -> Equality, Inequality
dispatch_29 = Dispatch(List=pln_26, DispatchPattern=equals_9.Equality)  # -> ListA, ListB
pln_27 = Plane(dispatch_29.ListB)

# ---- group: 建筑单体-檐口定位点
pln_28 = Plane(dispatch_29.ListA)

# ---- group: 檐口处定位点
pln_29 = Plane(pln_28)

# ----
# 区分内外梁边线
# 2.根据是否相交判定内外梁(平行于建筑边线方向）
crv_71 = Curve(filter)
offcrv = OffsetCurve(Curve=crv_62, Plane=PlaneXY(0, 0, 0), Distance=num_2, BothSides=expr("-x", num_2), Kinks=0, CapType="0")
midpt_7 = CurveMiddle(Curve=offcrv)
offcrv_2 = OffsetCurve(Curve=crv_62, Plane=PlaneXY(0, 0, 0), Distance=num_2, BothSides=expr("-x", num_2), Kinks=0, CapType="1")
crv_72 = Curve(offcrv)
item_37 = ListItem(List=midpt_7, Index=0, Wrap=True)
item_38 = ListItem(List=crv_72, Index=0, Wrap=True)
item_39 = ListItem(List=crv_72, Index="-1", Wrap=True)
graft_2 = GraftTree(Tree=crv_62, IncludeEmptyLists=True, IncludeNullItems=True)
# 要连接的梁中线Offest值
# 要连接的梁中线curve
# 要连接的embed
panel_69 = Panel(num_2)

# ---- group: Pull到轮廓线
pull_11 = PullPoint(Point=midpt_6, Geometry=flatten(crv_71), ClosestOnly=True)  # -> ClosestPoint, Distance

# ----
# 梁线闭合
shift_2 = ShiftPaths(Data=offcrv_2, Offset=-1)

# ---- group: 和某组梁边线相连
ln_14 = Line(StartPoint=item_37, EndPoint=graft(pull_11.ClosestPoint))

# ---- group: 有交点为内
ccx_6 = CurveCurve(CurveA=ln_14, CurveB=graft_2)  # -> Points, ParamsA, ParamsB

# ----
null_5 = NullItem(Item=ccx_6.Points)  # -> NullFlags, InvalidFlags, Description
dispatch_30 = Dispatch(List=item_38, DispatchPattern=null_5.InvalidFlags)  # -> ListA, ListB
dispatch_31 = Dispatch(List=item_39, DispatchPattern=null_5.InvalidFlags)  # -> ListA, ListB

# ----
# 梁边线-内
merge_22 = Merge(Data1=dispatch_30.ListB, Data2=dispatch_31.ListA)

# ----
# 梁边线-外
merge_23 = Merge(Data1=dispatch_30.ListA, Data2=dispatch_31.ListB)

# ---- group: 梁中线
crv_73 = Curve(shift_2)

# ---- group: 梁-外侧
crv_74 = Curve(merge_23)

# ---- group: 梁内测
crv_75 = Curve(merge_22)

# ----
crv_76 = Curve(shift_2)

# ---- group: 下层交点-除重 / 梁外侧
crv_77 = Curve(merge_23)

# ---- group: 梁内侧
crv_78 = Curve(merge_22)

crv_79 = Curve(merge_22)

# ---- group: 梁内测
crv_80 = Curve(merge_22)

# ---- group: 梁外侧
crv_81 = Curve(merge_23)

# ----
crv_82 = Curve(shift_2)

# ---- group: 梁外侧
crv_83 = Curve(merge_23)

crv_84 = Curve(merge_23)

# ----
# 初筛： 最近的梁到定位点距离在300-600间保留
pln_30 = Plane(pln_15)
deplane_14 = DeconstructPlane(Plane=pln_30)  # -> Origin, XAxis, YAxis, ZAxis
amp_11 = Amplitude(Vector=deplane_14.YAxis, Amplitude=expr("-x", Slider(2000, range=0..10000)))
move_18 = Move(Geometry=deplane_14.Origin, Motion=amp_11)  # -> Geometry, Transform
ln_15 = Line(StartPoint=deplane_14.Origin, EndPoint=move_18.Geometry)
ccx_7 = CurveCurve(CurveA=flatten(crv_84), CurveB=simplify(graft(ln_15)))  # -> Points, ParamsA, ParamsB
shift_3 = ShiftPaths(Data=ccx_7.Points, Offset=-1)
graft_3 = GraftTree(Tree=deplane_14.Origin, IncludeEmptyLists=True, IncludeNullItems=True)  # -> simplify(Tree)
pull_12 = PullPoint(Point=shift_3, Geometry=graft_3, ClosestOnly=True)  # -> ClosestPoint, Distance
sort_11 = SortList(Keys=pull_12.Distance, ValuesA=shift_3)  # -> Keys, ValuesA
graft_4 = GraftTree(Tree=pln_30, IncludeEmptyLists=True, IncludeNullItems=True)  # -> flatten(Tree)
item_40 = ListItem(List=sort_11.Keys, Index=0, Wrap=True)  # -> flatten(Item)
c_script = CSharpScript(num=item_40, Max="600", Min="300")  # -> out, A, Distance; inputs num: list of Double, Max: Double
# ---------- c_script: C# ----------
    for(int i = 0; i < num.Count; i++){
      if(num[i] > 300 && num[i] < 600){
        Print(i.ToString());
        index.Add(i);
        dist.Add(num[i]);

      }
    }

    A = index;
    Distance = dist;
# ---------- c_script: C# additional code ----------
  List<double> index = new List<double>();
  List<double> dist = new List<double>();
# ---------- end c_script ----------
item_41 = ListItem(List=graft_4, Index=c_script.A, Wrap=True)

item_42 = ListItem(List=sort_11.ValuesA, Index=0, Wrap=True)  # -> flatten(Item)

# ---- group: 梁外侧
crv_85 = Curve(merge_23)

# ----
item_43 = ListItem(List=item_42, Index=c_script.A, Wrap=True)

pln_31 = Plane(item_41)
boundary_4 = BoundarySurfaces(Edges=[offset_6, offset_5])
number_slider_38 = Slider(3584, range=0..10000)
deplane_15 = DeconstructPlane(Plane=pln_31)  # -> Origin, XAxis, YAxis, ZAxis
scx = SurfaceCurve(Surface=boundary_4, Curve=crv_85)  # -> flatten(Curves), Points, UVPoints, Normals, Parameters, Tangents
amp_12 = Amplitude(Vector=deplane_15.YAxis, Amplitude=number_slider_38)
amp_13 = Amplitude(Vector=deplane_15.YAxis, Amplitude=expr("-x", number_slider_38))
move_19 = Move(Geometry=deplane_15.Origin, Motion=amp_13)  # -> Geometry, Transform
move_20 = Move(Geometry=deplane_15.Origin, Motion=amp_12)  # -> Geometry, Transform
ln_16 = Line(StartPoint=move_19.Geometry, EndPoint=move_20.Geometry)
ccx_8 = CurveCurve(CurveA=graft(ln_16), CurveB=scx.Curves)  # -> Points, ParamsA, ParamsB
shift_4 = ShiftPaths(Data=ccx_8.Points, Offset=-1)
pull_13 = PullPoint(Point=graft(pln_31), Geometry=shift_4, ClosestOnly=True)  # -> ClosestPoint, Distance
sort_12 = SortList(Keys=pull_13.Distance, ValuesA=pull_13.ClosestPoint)  # -> Keys, ValuesA
item_44 = ListItem(List=sort_12.ValuesA, Index=0, Wrap=True)
null_6 = NullItem(Item=item_44)  # -> NullFlags, simplify(InvalidFlags), Description
null_7 = NullItem(Item=sort_12.ValuesA)  # -> NullFlags, simplify(InvalidFlags), Description
dispatch_32 = Dispatch(List=simplify(graft(pln_31)), DispatchPattern=null_7.InvalidFlags)  # -> ListA, ListB
dispatch_33 = Dispatch(List=simplify(graft(item_44)), DispatchPattern=null_6.InvalidFlags)  # -> ListA, ListB
pt_13 = Point(item_43)
pln_32 = Plane(dispatch_32.ListB)
pln_33 = Plane(dispatch_32.ListA)

# ---- group: 内侧梁线
crv_86 = Curve(merge_22)

# ----
# 按照梁分类定位点
crv_87 = Curve(shift_2)
pt_14 = Point(pt_13)
incurves_2 = PointInCurves(Point=flatten(pt_14), Curves=crv_87)  # -> Relationship, Index, Point
equals_10 = Equality(FirstNumber=incurves_2.Relationship, SecondNumber="0")  # -> Equality, Inequality
dispatch_34 = Dispatch(List=flatten(pt_14), DispatchPattern=equals_10.Inequality)  # -> ListA, ListB

# ---- group: 梁外侧
crv_88 = Curve(crv_81)

# ---- group: 梁内侧
crv_89 = Curve(crv_86)

# ---- group: 交点-属于哪个梁
data_32 = Data(dispatch_34.ListA)

# ----
# 可能的结构交点-大量
null_8 = NullItem(Item=item_42)  # -> NullFlags, InvalidFlags, Description
dispatch_35 = Dispatch(List=pln_30, DispatchPattern=null_8.NullFlags)  # -> ListA, ListB
pln_34 = Plane(dispatch_35.ListA)

# ----
# 0 檐口出定位点
# 与结构无交点
pln_35 = Plane(flatten(pln_34))

# ---- group: 梁外侧
crv_90 = Curve(merge_23)

crv_91 = Curve(merge_23)

# ----
crv_92 = Curve(shift_2)

# ---- group: 梁外侧
crv_93 = Curve(crv_81)

# ---- group: 梁内侧
crv_94 = Curve(crv_86)

# ---- group: 内侧梁线
crv_95 = Curve(merge_22)

# ---- group: 梁外侧
crv_96 = Curve(merge_23)

# ----
crv_97 = Curve([crv_96, crv_95])
boundary_5 = BoundarySurfaces(Edges=[offset_9, offset_10])
flatten_6 = FlattenTree(Tree=crv_97, Path="{0}")
scx_2 = SurfaceCurve(Surface=boundary_5, Curve=flatten_6)  # -> simplify(Curves), Points, UVPoints, Normals, Parameters, Tangents

# ---- group: All BEAMS
crv_98 = Curve(scx_2.Curves)

# ---- group: 梁内侧
crv_99 = Curve(crv_86)

crv_100 = Curve(crv_86)

# ----
# 1.1 有檐口-整个site一起处理
deplane_16 = DeconstructPlane(Plane=pln_29)  # -> Origin, XAxis, YAxis, ZAxis
amp_14 = Amplitude(Vector=deplane_16.YAxis, Amplitude=number_slider_20)
amp_15 = Amplitude(Vector=deplane_16.YAxis, Amplitude=number_slider_19)
move_21 = Move(Geometry=deplane_16.Origin, Motion=expr("-x", amp_15))  # -> Geometry, Transform
move_22 = Move(Geometry=deplane_16.Origin, Motion=amp_14)  # -> Geometry, Transform
merge_24 = Merge(Data1=crv_31, Data2=crv_32)
ln_17 = Line(StartPoint=move_21.Geometry, EndPoint=move_22.Geometry)
project_18 = Project(Geometry=ln_17, Plane=PlaneXY(0, 0, 0))  # -> Geometry, Transform
project_19 = Project(Geometry=crv_74, Plane=PlaneXY(0, 0, 0))  # -> Geometry, Transform
project_20 = Project(Geometry=merge_24, Plane=PlaneXY(0, 0, 0))  # -> Geometry, Transform
ccx_9 = CurveCurve(CurveA=graft(project_18.Geometry), CurveB=flatten(project_19.Geometry))  # -> Points, ParamsA, ParamsB
shift_5 = ShiftPaths(Data=ccx_9.Points, Offset=-1)
pull_14 = PullPoint(Point=shift_5, Geometry=flatten(project_20.Geometry), ClosestOnly=True)  # -> ClosestPoint, Distance
sort_13 = SortList(Keys=pull_14.Distance, ValuesA=shift_5)  # -> Keys, ValuesA
item_45 = ListItem(List=sort_13.ValuesA, Index=0, Wrap=True)
null_9 = NullItem(Item=flatten(item_45))  # -> NullFlags, InvalidFlags, Description
dispatch_36 = Dispatch(List=flatten(item_45), DispatchPattern=null_9.InvalidFlags)  # -> ListA, ListB
dispatch_37 = Dispatch(List=pln_29, DispatchPattern=null_9.InvalidFlags)  # -> ListA, ListB

# ---- group: 交点对应的初始Plane
data_33 = Data(dispatch_37.ListB)

# ---- group: 交点Point
data_34 = Data(dispatch_36.ListB)

# ----
# 按照梁分类定位点
pt_15 = Point(data_34)
incurves_3 = PointInCurves(Point=flatten(pt_15), Curves=crv_73)  # -> Relationship, Index, Point
equals_11 = Equality(FirstNumber=incurves_3.Relationship, SecondNumber="0")  # -> Equality, Inequality
dispatch_38 = Dispatch(List=flatten(pt_15), DispatchPattern=equals_11.Inequality)  # -> ListA, ListB

check_same_points_4 = CheckSamePoints(archPoint=pln_29, crvPoint=data_33)  # -> out, specialPt; inputs archPoint: list of Point3d, crvPoint: list of Point3d; same code as testpoint

# ----
# 0无檐口线 与梁不相交
cull_i_9 = CullIndex(List=pln_29, Indices=check_same_points_4.specialPt, Wrap=True)

# ---- group: 交点-属于哪个梁
data_35 = Data(dispatch_38.ListA)

# ----
# 0 檐口出定位点
# 与结构无交点
pln_36 = Plane(cull_i_9)

# ----
# 二次筛选檐口处
# 埋件定位点Offset，没有找到和梁的交点
deplane_17 = DeconstructPlane(Plane=pln_36)  # -> Origin, XAxis, YAxis, ZAxis
amp_16 = Amplitude(Vector=deplane_17.YAxis, Amplitude=expr("-X", number_slider_19))
move_23 = Move(Geometry=deplane_17.Origin, Motion=amp_16)  # -> Geometry, Transform
ln_18 = Line(StartPoint=move_23.Geometry, EndPoint=deplane_17.Origin)
amp_17 = Amplitude(Vector=deplane_17.XAxis, Amplitude=number_slider_11)
amp_18 = Amplitude(Vector=deplane_17.XAxis, Amplitude=expr("-x", number_slider_11))

# ---- group: 2条Offset的探针找交点
move_24 = Move(Geometry=ln_18, Motion=amp_18)  # -> Geometry, Transform
move_25 = Move(Geometry=ln_18, Motion=amp_17)  # -> Geometry, Transform

# ----
deplane_18 = DeconstructPlane(Plane=project_15.Geometry)  # -> Origin, XAxis, YAxis, ZAxis

pt_16 = Point(deplane_18.Origin)

incurves_4 = PointInCurves(Point=pt_16, Curves=flatten(reb_2))  # -> Relationship, Index, Point
equals_12 = Equality(FirstNumber=incurves_4.Relationship, SecondNumber="2")  # -> Equality, Inequality
dispatch_39 = Dispatch(List=project_15.Geometry, DispatchPattern=equals_12.Equality)  # -> ListA, ListB
data_36 = Data(dispatch_39.ListB)

pln_37 = Plane(dispatch_39.ListA)

data_37 = Data(dispatch_39.ListA)

# ---- group: 下层交点-除重
# 1.0无檐口线-下层定位点
pln_38 = Plane(data_36)

# ----
# 按照梁分类定位PLANE
cullduppoints_2 = RemoveDuplicatePoints(InputPoints=data_35, Tolerance=0.001)  # -> OutputPoints, FirstPointIndexes
shift_6 = ShiftPaths(Data=crv_75, Offset=-1)
shift_7 = ShiftPaths(Data=shift_6, Offset=-1)
pull_15 = PullPoint(Point=cullduppoints_2.OutputPoints, Geometry=simplify(shift_7), ClosestOnly=True)  # -> ClosestPoint, Distance
ln_19 = Line(StartPoint=pull_15.ClosestPoint, EndPoint=cullduppoints_2.OutputPoints)
movetoplane_4 = MoveToPlane(Geometry=crv_34, Plane=PlaneXY(0, 0, 0), Above=True, Below=True)  # -> Geometry, Transform

# ---- group: Y Axis Line-All
crv_101 = Curve(ln_19)

# ----
end_4 = EndPoints(Curve=graft(crv_101))  # -> Start, End
merge_25 = Merge(Data1=end_4.Start, Data2=end_4.End)
pull_16 = PullPoint(Point=merge_25, Geometry=movetoplane_4.Geometry, ClosestOnly=True)  # -> ClosestPoint, Distance
sort_14 = SortList(Keys=pull_16.Distance, ValuesA=merge_25)  # -> Keys, ValuesA
item_46 = ListItem(List=sort_14.ValuesA, Index="-1", Wrap=True)
item_47 = ListItem(List=sort_14.ValuesA, Index=0, Wrap=True)
null_10 = NullItem(Item=item_46)  # -> NullFlags, InvalidFlags, Description
null_11 = NullItem(Item=item_47)  # -> NullFlags, InvalidFlags, Description
dispatch_40 = Dispatch(List=item_47, DispatchPattern=null_11.NullFlags)  # -> ListA, ListB
dispatch_41 = Dispatch(List=item_46, DispatchPattern=null_10.NullFlags)  # -> ListA, ListB
pt_17 = Point(dispatch_40.ListB)
pt_18 = Point(dispatch_41.ListB)
ln_20 = Line(StartPoint=pt_18, EndPoint=pt_17)
end_5 = EndPoints(Curve=graft(ln_20))  # -> Start, End
rotate_10 = Rotate(Geometry=ln_20, Angle=1.570796327, Plane=pt_17)  # -> Geometry, Transform
pt_19 = Point(end_5.End)
pl_8 = ConstructPlane(Origin=pt_19, XAxis=rotate_10.Geometry, YAxis=ln_20)
null_12 = NullItem(Item=pl_8)  # -> NullFlags, InvalidFlags, Description
dispatch_42 = Dispatch(List=pl_8, DispatchPattern=null_12.NullFlags)  # -> ListA, ListB
pln_39 = Plane(dispatch_42.ListB)

shift_8 = ShiftPaths(Data=pln_39, Offset=-1)
shift_9 = ShiftPaths(Data=shift_8, Offset=-1)  # -> simplify(Data)

# ---- group: 檐口-首次筛选的有效起始Plane
data_38 = Data(shift_9)

# ----
# 1.1 檐口处侧埋，钢板焊
# 02：钢板焊埋件[钢梁外侧]
# @钢边梁宽@钢边梁高
pln_40 = Plane(data_38)

ccx_10 = CurveCurve(CurveA=graft(move_24.Geometry), CurveB=flatten(merge_23))  # -> Points, ParamsA, ParamsB
shift_10 = ShiftPaths(Data=ccx_10.Points, Offset=-1)
pull_17 = PullPoint(Point=shift_10, Geometry=graft(pln_36), ClosestOnly=True)  # -> ClosestPoint, Distance
sort_15 = SortList(Keys=pull_17.Distance, ValuesA=pull_17.ClosestPoint)  # -> Keys, ValuesA

# ---- group: 最远交点
item_48 = ListItem(List=sort_15.ValuesA, Index="-1", Wrap=True)

# ----
null_13 = NullItem(Item=flatten(item_48))  # -> NullFlags, InvalidFlags, Description
dispatch_43 = Dispatch(List=simplify(item_48), DispatchPattern=simplify(graft(null_13.InvalidFlags)))  # -> ListA, ListB
dispatch_44 = Dispatch(List=pln_36, DispatchPattern=null_13.InvalidFlags)  # -> ListA, ListB
pt_20 = Point(dispatch_43.ListB)
pln_41 = Plane(dispatch_44.ListB)
move2pt_9 = MoveToPoint(Geometry=pln_41, PointA=pln_41, PointB=flatten(pt_20))  # -> Moved, Vector, Transform

pln_42 = Plane(dispatch_44.ListA)

# ----
# 按照梁分类定位点
pt_21 = Point(pt_20)
incurves_5 = PointInCurves(Point=flatten(pt_21), Curves=crv_76)  # -> Relationship, Index, Point
equals_13 = Equality(FirstNumber=incurves_5.Relationship, SecondNumber="0")  # -> Equality, Inequality
dispatch_45 = Dispatch(List=flatten(pt_21), DispatchPattern=equals_13.Inequality)  # -> ListA, ListB

# ---- group: 交点-属于哪个梁
data_39 = Data(dispatch_45.ListA)

# ----
ccx_11 = CurveCurve(CurveA=graft(move_25.Geometry), CurveB=flatten(merge_23))  # -> Points, ParamsA, ParamsB
shift_11 = ShiftPaths(Data=ccx_11.Points, Offset=-1)
pull_18 = PullPoint(Point=shift_11, Geometry=graft(pln_36), ClosestOnly=True)  # -> ClosestPoint, Distance
sort_16 = SortList(Keys=pull_18.Distance, ValuesA=pull_18.ClosestPoint)  # -> Keys, ValuesA

# ---- group: 最远交点
item_49 = ListItem(List=sort_16.ValuesA, Index="-1", Wrap=True)

# ----
null_14 = NullItem(Item=flatten(item_49))  # -> NullFlags, InvalidFlags, Description
dispatch_46 = Dispatch(List=simplify(item_49), DispatchPattern=simplify(graft(null_14.InvalidFlags)))  # -> ListA, ListB
dispatch_47 = Dispatch(List=pln_36, DispatchPattern=null_14.InvalidFlags)  # -> ListA, ListB
pt_22 = Point(dispatch_46.ListB)
pln_43 = Plane(dispatch_47.ListB)
move2pt_10 = MoveToPoint(Geometry=pln_43, PointA=pln_43, PointB=flatten(pt_22))  # -> Moved, Vector, Transform

pln_44 = Plane(dispatch_47.ListA)
check_same_points_5 = CheckSamePoints(archPoint=pln_44, crvPoint=pln_42)  # -> out, specialPt; inputs archPoint: list of Point3d, crvPoint: list of Point3d; same code as testpoint
cset = CreateSet(List=check_same_points_5.specialPt)  # -> Set, Map

# ----
# 按照梁分类定位点
pt_23 = Point(pt_22)
incurves_6 = PointInCurves(Point=flatten(pt_23), Curves=crv_76)  # -> Relationship, Index, Point
equals_14 = Equality(FirstNumber=incurves_6.Relationship, SecondNumber="0")  # -> Equality, Inequality
dispatch_48 = Dispatch(List=flatten(pt_23), DispatchPattern=equals_14.Inequality)  # -> ListA, ListB

item_50 = ListItem(List=pln_44, Index=cset.Set, Wrap=True)

# ---- group: 交点-属于哪个梁
data_40 = Data(dispatch_48.ListA)

# ----
# 未生成檐口线
pt_24 = Point(item_50)

# ----
# （10）需人工排布
pt_25 = Point(pt_24)
bake_2 = BakeObjects(Geometry=pt_25, Attributes=attributes_2, BakeName=panel_53, Bake=False)

# ---- group: 下层交点-除重
# 1.0 无檐口线+上下层幕墙边线连续
pln_45 = Plane(pln_25)
pln_46 = Plane(pln_38)
deplane_19 = DeconstructPlane(Plane=pln_45)  # -> Origin, XAxis, YAxis, ZAxis
deplane_20 = DeconstructPlane(Plane=pln_46)  # -> Origin, XAxis, YAxis, ZAxis
number_slider_39 = Slider(3584, range=0..10000)
number_slider_40 = Slider(3584, range=0..10000)
amp_19 = Amplitude(Vector=deplane_20.YAxis, Amplitude=expr("-x", number_slider_40))
amp_20 = Amplitude(Vector=deplane_20.YAxis, Amplitude=number_slider_40)
amp_21 = Amplitude(Vector=deplane_19.YAxis, Amplitude=expr("-x", number_slider_39))
amp_22 = Amplitude(Vector=deplane_19.YAxis, Amplitude=number_slider_39)
move_26 = Move(Geometry=deplane_20.Origin, Motion=amp_19)  # -> Geometry, Transform
move_27 = Move(Geometry=deplane_20.Origin, Motion=amp_20)  # -> Geometry, Transform
move_28 = Move(Geometry=deplane_19.Origin, Motion=amp_21)  # -> Geometry, Transform
move_29 = Move(Geometry=deplane_19.Origin, Motion=amp_22)  # -> Geometry, Transform
ln_21 = Line(StartPoint=move_28.Geometry, EndPoint=move_29.Geometry)
ln_22 = Line(StartPoint=move_26.Geometry, EndPoint=move_27.Geometry)
number_slider_41 = Slider(20, range=0..100)

# ---- group: 下层点+上层线
ccx_12 = CurveCurve(CurveA=graft(ln_22), CurveB=crv_35)  # -> Points, ParamsA, ParamsB

# ---- group: 下层交点-除重 / 下层点+下层线
ccx_13 = CurveCurve(CurveA=graft(ln_22), CurveB=crv_36)  # -> Points, ParamsA, ParamsB

# ---- group: 下层交点-除重 / 上层点+上层线
ccx_14 = CurveCurve(CurveA=graft(ln_21), CurveB=crv_35)  # -> Points, ParamsA, ParamsB

# ---- group: 上层点+下层线
ccx_15 = CurveCurve(CurveA=graft(ln_21), CurveB=crv_36)  # -> Points, ParamsA, ParamsB

# ---- group: 下层交点-除重 (continued)
pull_19 = PullPoint(Point=ccx_14.Points, Geometry=ccx_15.Points, ClosestOnly=True)  # -> ClosestPoint, Distance
pull_20 = PullPoint(Point=ccx_13.Points, Geometry=ccx_12.Points, ClosestOnly=True)  # -> ClosestPoint, Distance
panel_70 = Panel(pull_20.Distance)
smaller_9 = SmallerThan(FirstNumber=pull_20.Distance, SecondNumber=number_slider_41)  # -> SmallerThan, OrEqualTo
smaller_10 = SmallerThan(FirstNumber=pull_19.Distance, SecondNumber=number_slider_41)  # -> SmallerThan, OrEqualTo
dispatch_49 = Dispatch(List=pln_46, DispatchPattern=flatten(smaller_9.SmallerThan))  # -> ListA, ListB
dispatch_50 = Dispatch(List=pln_45, DispatchPattern=flatten(smaller_10.SmallerThan))  # -> ListA, ListB

# ---- group: 下层交点-除重 / 下层有效点
pln_47 = Plane(dispatch_49.ListA)

# ---- group: 下层交点-除重 / 上层有效点
pln_48 = Plane(dispatch_50.ListA)

# ----
# 按照梁分类定位PLANE
crv_102 = Curve(merge_22)
shift_12 = ShiftPaths(Data=crv_102, Offset=-1)
shift_13 = ShiftPaths(Data=shift_12, Offset=-1)
pull_21 = PullPoint(Point=data_39, Geometry=simplify(shift_13), ClosestOnly=True)  # -> ClosestPoint, Distance
ln_23 = Line(StartPoint=pull_21.ClosestPoint, EndPoint=data_39)
crv_103 = Curve(crv_28)
movetoplane_5 = MoveToPlane(Geometry=crv_103, Plane=PlaneXY(0, 0, 0), Above=True, Below=True)  # -> Geometry, Transform

# ---- group: Y Axis Line-All
crv_104 = Curve(ln_23)

# ----
# 按照梁分类定位PLANE
crv_105 = Curve(merge_22)
shift_14 = ShiftPaths(Data=crv_105, Offset=-1)
shift_15 = ShiftPaths(Data=shift_14, Offset=-1)
pull_22 = PullPoint(Point=data_40, Geometry=simplify(shift_15), ClosestOnly=True)  # -> ClosestPoint, Distance
ln_24 = Line(StartPoint=pull_22.ClosestPoint, EndPoint=data_40)
crv_106 = Curve(crv_28)
movetoplane_6 = MoveToPlane(Geometry=crv_106, Plane=PlaneXY(0, 0, 0), Above=True, Below=True)  # -> Geometry, Transform

# ---- group: Y Axis Line-All
crv_107 = Curve(ln_24)

# ---- group: 下层交点-除重 (continued)
pt_26 = Point(pln_48)
pt_27 = Point(pln_47)
pull_23 = PullPoint(Point=pt_26, Geometry=pt_27, ClosestOnly=True)  # -> ClosestPoint, Distance
larger_6 = LargerThan(FirstNumber=pull_23.Distance, SecondNumber=number_slider_21)  # -> LargerThan, OrEqualTo
dispatch_51 = Dispatch(List=pln_48, DispatchPattern=larger_6.LargerThan)  # -> ListA, ListB
pln_49 = Plane(dispatch_51.ListA)

# ---- group: 下层交点-除重 / 上下层共同有效点
merge_26 = Merge(Data1=pln_47, Data2=pln_49)

# ----
end_6 = EndPoints(Curve=graft(crv_104))  # -> Start, End
merge_27 = Merge(Data1=end_6.Start, Data2=end_6.End)
pull_24 = PullPoint(Point=merge_27, Geometry=movetoplane_5.Geometry, ClosestOnly=True)  # -> ClosestPoint, Distance
sort_17 = SortList(Keys=pull_24.Distance, ValuesA=merge_27)  # -> Keys, ValuesA
item_51 = ListItem(List=sort_17.ValuesA, Index="-1", Wrap=True)
item_52 = ListItem(List=sort_17.ValuesA, Index=0, Wrap=True)
pt_28 = Point(item_52)
pt_29 = Point(item_51)
ln_25 = Line(StartPoint=pt_29, EndPoint=pt_28)
rotate_11 = Rotate(Geometry=ln_25, Angle=1.570796327, Plane=pt_28)  # -> Geometry, Transform

pt_30 = Point(end_6.End)

pl_9 = ConstructPlane(Origin=pt_30, XAxis=rotate_11.Geometry, YAxis=ln_25)
null_15 = NullItem(Item=pl_9)  # -> NullFlags, InvalidFlags, Description
dispatch_52 = Dispatch(List=pl_9, DispatchPattern=null_15.NullFlags)  # -> ListA, ListB

pln_50 = Plane(dispatch_52.ListB)
shift_16 = ShiftPaths(Data=pln_50, Offset=-1)  # -> simplify(Data)

end_7 = EndPoints(Curve=graft(crv_107))  # -> Start, End
merge_28 = Merge(Data1=end_7.Start, Data2=end_7.End)
pull_25 = PullPoint(Point=merge_28, Geometry=movetoplane_6.Geometry, ClosestOnly=True)  # -> ClosestPoint, Distance
sort_18 = SortList(Keys=pull_25.Distance, ValuesA=merge_28)  # -> Keys, ValuesA
item_53 = ListItem(List=sort_18.ValuesA, Index="-1", Wrap=True)
item_54 = ListItem(List=sort_18.ValuesA, Index=0, Wrap=True)
pt_31 = Point(item_54)
pt_32 = Point(item_53)
ln_26 = Line(StartPoint=pt_32, EndPoint=pt_31)
rotate_12 = Rotate(Geometry=ln_26, Angle=1.570796327, Plane=pt_31)  # -> Geometry, Transform

pt_33 = Point(end_7.End)

pl_10 = ConstructPlane(Origin=pt_33, XAxis=rotate_12.Geometry, YAxis=ln_26)
null_16 = NullItem(Item=pl_10)  # -> NullFlags, InvalidFlags, Description
dispatch_53 = Dispatch(List=pl_10, DispatchPattern=null_16.NullFlags)  # -> ListA, ListB

pln_51 = Plane(dispatch_53.ListB)
shift_17 = ShiftPaths(Data=pln_51, Offset=-1)  # -> simplify(Data)

# ----
# 撞到梁交点
pln_52 = Plane(shift_16)
pln_53 = Plane(shift_17)

merge_29 = Merge(Data1=pln_40, Data2=pln_53, Data3=pln_52)
orient_3 = Orient(Geometry=item_23, Source=item_24, Target=merge_29)  # -> Geometry, Transform

data_41 = Data(orient_3.Geometry)
ungroup_6 = Ungroup(Group=data_41)
item_55 = ListItem(List=ungroup_6, Index=0, Wrap=True)  # -> flatten(Item)
item_56 = ListItem(List=ungroup_6, Index="-1", Wrap=True)  # -> flatten(Item)

# ---- group: 檐口埋件 (continued)
entwine_13 = Entwine(Branch00=item_55, Branch01=item_56, FlattenInputs=True)
bake_3 = BakeObjects(Geometry=entwine_13, Attributes=attributes_3, BakeName=panel_37, Bake=False)

# ---- group: 下层交点-除重 (continued)
deplane_21 = DeconstructPlane(Plane=merge_26)  # -> Origin, XAxis, YAxis, ZAxis
amp_23 = Amplitude(Vector=deplane_21.YAxis, Amplitude=expr("-x", Slider(2756, range=0..10000)))
move_30 = Move(Geometry=deplane_21.Origin, Motion=amp_23)  # -> Geometry, Transform

# ---- group: 下层交点-除重 / 相内探索
ln_27 = Line(StartPoint=deplane_21.Origin, EndPoint=move_30.Geometry)

# ---- group: 下层交点-除重 (continued)
ccx_16 = CurveCurve(CurveA=graft(ln_27), CurveB=flatten(crv_77))  # -> Points, ParamsA, ParamsB
shift_18 = ShiftPaths(Data=ccx_16.Points, Offset=-1)
pull_26 = PullPoint(Point=deplane_21.Origin, Geometry=shift_18, ClosestOnly=True)  # -> ClosestPoint, Distance
sort_19 = SortList(Keys=pull_26.Distance, ValuesA=pull_26.ClosestPoint)  # -> Keys, ValuesA

# ---- group: 下层交点-除重 / 与梁最近交点
item_57 = ListItem(List=sort_19.ValuesA, Index=0, Wrap=True)
# ---- group: 下层交点-除重 (continued)
null_17 = NullItem(Item=flatten(item_57))  # -> NullFlags, InvalidFlags, Description
dispatch_54 = Dispatch(List=flatten(item_57), DispatchPattern=null_17.InvalidFlags)  # -> ListA, ListB
dispatch_55 = Dispatch(List=merge_26, DispatchPattern=null_17.InvalidFlags)  # -> ListA, ListB

# ---- group: 下层交点-除重 / 去除Null的交点
data_42 = Data(dispatch_54.ListB)

# ----
# 1.0
data_43 = Data(data_42)
crv_108 = Curve(shift_2)

pt_34 = Point(data_43)
incurves_7 = PointInCurves(Point=flatten(pt_34), Curves=crv_108)  # -> Relationship, Index, Point
equals_15 = Equality(FirstNumber=incurves_7.Relationship, SecondNumber="0")  # -> Equality, Inequality
dispatch_56 = Dispatch(List=flatten(pt_34), DispatchPattern=equals_15.Inequality)  # -> ListA, ListB

panel_71 = Panel(dispatch_56.ListA)

# ---- group: 交点-属于哪个梁
data_44 = Data(dispatch_56.ListA)

# ----
# 1.0无檐口线
# 与梁不相交
# 与梁无交点的定位点
pln_54 = Plane(dispatch_55.ListA)

# ----
# 0 檐口出定位点
# 与结构无交点
pln_55 = Plane(flatten(pln_54))

# ----
# 按照梁分类定位PLANE
shift_19 = ShiftPaths(Data=crv_78, Offset=-1)
shift_20 = ShiftPaths(Data=shift_19, Offset=-1)
pull_27 = PullPoint(Point=data_44, Geometry=simplify(shift_20), ClosestOnly=True)  # -> ClosestPoint, Distance
ln_28 = Line(StartPoint=pull_27.ClosestPoint, EndPoint=data_44)
movetoplane_7 = MoveToPlane(Geometry=crv_37, Plane=PlaneXY(0, 0, 0), Above=True, Below=True)  # -> Geometry, Transform

# ---- group: Y Axis Line-All
crv_109 = Curve(ln_28)

# ----
end_8 = EndPoints(Curve=graft(crv_109))  # -> Start, End
merge_30 = Merge(Data1=end_8.Start, Data2=end_8.End)
pull_28 = PullPoint(Point=merge_30, Geometry=movetoplane_7.Geometry, ClosestOnly=True)  # -> ClosestPoint, Distance
sort_20 = SortList(Keys=pull_28.Distance, ValuesA=merge_30)  # -> Keys, ValuesA
item_58 = ListItem(List=sort_20.ValuesA, Index="-1", Wrap=True)
item_59 = ListItem(List=sort_20.ValuesA, Index=0, Wrap=True)
pt_35 = Point(item_59)
pt_36 = Point(item_58)
ln_29 = Line(StartPoint=pt_36, EndPoint=pt_35)
rotate_13 = Rotate(Geometry=ln_29, Angle=1.570796327, Plane=pt_35)  # -> Geometry, Transform

pt_37 = Point(end_8.End)

pl_11 = ConstructPlane(Origin=pt_37, XAxis=rotate_13.Geometry, YAxis=ln_29)
null_18 = NullItem(Item=pl_11)  # -> NullFlags, InvalidFlags, Description
dispatch_57 = Dispatch(List=pl_11, DispatchPattern=null_18.NullFlags)  # -> ListA, ListB
pln_56 = Plane(dispatch_57.ListB)

# ---- group: 檐口-首次筛选的有效起始Plane
data_45 = Data(pln_56)

# ----
shift_21 = ShiftPaths(Data=data_45, Offset=-1)

# ----
# 1.0无檐口线+上下层幕墙边线连续
# 01：钢板焊埋件[钢梁外侧]
# @钢边梁宽@钢边梁高
pln_57 = Plane(shift_21)

# ----
# 1.0.Missing Point
# 埋件定位点Offset，没有找到和梁的交点
number_slider_42 = Slider(5000, range=0..10000)
deplane_22 = DeconstructPlane(Plane=pln_55)  # -> Origin, XAxis, YAxis, ZAxis
amp_24 = Amplitude(Vector=deplane_22.YAxis, Amplitude=expr("-x", number_slider_42))
move_31 = Move(Geometry=deplane_22.Origin, Motion=amp_24)  # -> Geometry, Transform
ln_30 = Line(StartPoint=move_31.Geometry, EndPoint=deplane_22.Origin)
crv_110 = Curve(crv_77)
amp_25 = Amplitude(Vector=deplane_22.XAxis, Amplitude=number_slider_11)
amp_26 = Amplitude(Vector=deplane_22.XAxis, Amplitude=expr("-x", number_slider_11))

# ---- group: 2组探索针
move_32 = Move(Geometry=ln_30, Motion=amp_26)  # -> Geometry, Transform
move_33 = Move(Geometry=ln_30, Motion=amp_25)  # -> Geometry, Transform

# ----
ccx_17 = CurveCurve(CurveA=graft(move_32.Geometry), CurveB=flatten(crv_110))  # -> Points, ParamsA, ParamsB
shift_22 = ShiftPaths(Data=ccx_17.Points, Offset=-1)
sort_21 = SortList(Keys=shift_22, ValuesA=shift_22)  # -> Keys, ValuesA
pull_29 = PullPoint(Point=sort_21.ValuesA, Geometry=graft(pln_55), ClosestOnly=True)  # -> ClosestPoint, Distance
sort_22 = SortList(Keys=pull_29.Distance, ValuesA=sort_21.ValuesA)  # -> Keys, ValuesA
item_60 = ListItem(List=sort_22.ValuesA, Index="0", Wrap=True)
null_19 = NullItem(Item=flatten(item_60))  # -> NullFlags, InvalidFlags, Description
dispatch_58 = Dispatch(List=simplify(item_60), DispatchPattern=simplify(graft(null_19.InvalidFlags)))  # -> ListA, ListB
dispatch_59 = Dispatch(List=pln_55, DispatchPattern=null_19.InvalidFlags)  # -> ListA, ListB
pln_58 = Plane(dispatch_59.ListB)
pt_38 = Point(dispatch_58.ListB)
move2pt_11 = MoveToPoint(Geometry=pln_58, PointA=pln_58, PointB=pt_38)  # -> Moved, Vector, Transform

ccx_18 = CurveCurve(CurveA=graft(move_33.Geometry), CurveB=flatten(crv_110))  # -> Points, ParamsA, ParamsB
shift_23 = ShiftPaths(Data=ccx_18.Points, Offset=-1)
sort_23 = SortList(Keys=shift_23, ValuesA=shift_23)  # -> Keys, ValuesA
pull_30 = PullPoint(Point=sort_23.ValuesA, Geometry=graft(pln_55), ClosestOnly=True)  # -> ClosestPoint, Distance
sort_24 = SortList(Keys=pull_30.Distance, ValuesA=sort_23.ValuesA)  # -> Keys, ValuesA
item_61 = ListItem(List=sort_24.ValuesA, Index="0", Wrap=True)
null_20 = NullItem(Item=flatten(item_61))  # -> NullFlags, InvalidFlags, Description
dispatch_60 = Dispatch(List=simplify(item_61), DispatchPattern=simplify(graft(null_20.InvalidFlags)))  # -> ListA, ListB
dispatch_61 = Dispatch(List=pln_55, DispatchPattern=null_20.InvalidFlags)  # -> ListA, ListB
pt_39 = Point(dispatch_60.ListB)
pln_59 = Plane(dispatch_61.ListB)
move2pt_12 = MoveToPoint(Geometry=pln_59, PointA=pln_59, PointB=pt_39)  # -> Moved, Vector, Transform

pln_60 = Plane([dispatch_61.ListA, dispatch_59.ListA])

# ----
# 按照梁分类定位点
merge_31 = Merge(Data1=move2pt_12.Moved, Data2=move2pt_11.Moved)
crv_111 = Curve(crv_108)
pt_40 = Point(merge_31)
incurves_8 = PointInCurves(Point=flatten(pt_40), Curves=crv_111)  # -> Relationship, Index, Point
equals_16 = Equality(FirstNumber=incurves_8.Relationship, SecondNumber="0")  # -> Equality, Inequality
dispatch_62 = Dispatch(List=flatten(pt_40), DispatchPattern=equals_16.Inequality)  # -> ListA, ListB

# ---- group: 交点-属于哪个梁
data_46 = Data(dispatch_62.ListA)

# ----
# 按照梁分类定位PLANE
shift_24 = ShiftPaths(Data=crv_79, Offset=-1)
shift_25 = ShiftPaths(Data=shift_24, Offset=-1)
pull_31 = PullPoint(Point=data_46, Geometry=simplify(shift_25), ClosestOnly=True)  # -> ClosestPoint, Distance
ln_31 = Line(StartPoint=pull_31.ClosestPoint, EndPoint=data_46)
movetoplane_8 = MoveToPlane(Geometry=crv_38, Plane=PlaneXY(0, 0, 0), Above=True, Below=True)  # -> Geometry, Transform

# ---- group: Y Axis Line-All
crv_112 = Curve(ln_31)

# ----
end_9 = EndPoints(Curve=graft(crv_112))  # -> Start, End
merge_32 = Merge(Data1=end_9.Start, Data2=end_9.End)
pull_32 = PullPoint(Point=merge_32, Geometry=movetoplane_8.Geometry, ClosestOnly=True)  # -> ClosestPoint, Distance
sort_25 = SortList(Keys=pull_32.Distance, ValuesA=merge_32)  # -> Keys, ValuesA
item_62 = ListItem(List=sort_25.ValuesA, Index="-1", Wrap=True)
item_63 = ListItem(List=sort_25.ValuesA, Index=0, Wrap=True)
pt_41 = Point(item_63)
pt_42 = Point(item_62)
ln_32 = Line(StartPoint=pt_42, EndPoint=pt_41)
rotate_14 = Rotate(Geometry=ln_32, Angle=1.570796327, Plane=pt_41)  # -> Geometry, Transform

pt_43 = Point(end_9.End)

pl_12 = ConstructPlane(Origin=pt_43, XAxis=rotate_14.Geometry, YAxis=ln_32)
null_21 = NullItem(Item=pl_12)  # -> NullFlags, InvalidFlags, Description
dispatch_63 = Dispatch(List=pl_12, DispatchPattern=null_21.NullFlags)  # -> ListA, ListB
pln_61 = Plane(dispatch_63.ListB)

shift_26 = ShiftPaths(Data=pln_61, Offset=-1)

# ---- group: 檐口-首次筛选的有效起始Plane
data_47 = Data(shift_26)

# ----
# 撞到梁交点
data_48 = Data(data_47)

merge_33 = Merge(Data1=pln_57, Data2=data_48)
orient_4 = Orient(Geometry=item_26, Source=item_25, Target=merge_33)  # -> Geometry, Transform

data_49 = Data(orient_4.Geometry)
ungroup_7 = Ungroup(Group=data_49)
item_64 = ListItem(List=ungroup_7, Index=0, Wrap=True)  # -> flatten(Item)
item_65 = ListItem(List=ungroup_7, Index="-1", Wrap=True)  # -> flatten(Item)

# ---- group: 上下幕墙连续 (continued)
entwine_14 = Entwine(Branch00=item_64, Branch01=item_65, FlattenInputs=True)
bake_4 = BakeObjects(Geometry=entwine_14, Attributes=attributes_5, BakeName=panel_40, Bake=False)

# ----
# 2是否有吊顶
# 梁以内>350
deplane_23 = DeconstructPlane(Plane=pln_14)  # -> Origin, XAxis, YAxis, ZAxis
number_slider_43 = Slider(5000, range=0..10000)
amp_27 = Amplitude(Vector=deplane_23.YAxis, Amplitude=expr("-x", number_slider_43))
amp_28 = Amplitude(Vector=deplane_23.YAxis, Amplitude=number_slider_43)
move_34 = Move(Geometry=deplane_23.Origin, Motion=amp_28)  # -> Geometry, Transform
move_35 = Move(Geometry=deplane_23.Origin, Motion=amp_27)  # -> Geometry, Transform
ln_33 = Line(StartPoint=move_34.Geometry, EndPoint=move_35.Geometry)
crv_113 = Curve()

# ---- group: 和下层建筑的交点
ccx_19 = CurveCurve(CurveA=ln_33, CurveB=crv_113)  # -> Points, ParamsA, ParamsB

# ----
null_22 = NullItem(Item=ccx_19.Points)  # -> NullFlags, InvalidFlags, Description
dispatch_64 = Dispatch(List=simplify(ccx_19.Points), DispatchPattern=simplify(null_22.NullFlags))  # -> ListA, ListB
dispatch_65 = Dispatch(List=simplify(graft(pln_14)), DispatchPattern=simplify(null_22.NullFlags))  # -> ListA, ListB
pt_44 = Point(dispatch_64.ListB)
pln_62 = Plane(flatten(dispatch_65.ListB))
pt_45 = Point(pln_62)
pull_33 = PullPoint(Point=flatten(pt_45), Geometry=flatten(pt_44), ClosestOnly=True)  # -> ClosestPoint, Distance
ln_34 = Line(StartPoint=pln_62, EndPoint=pull_33.ClosestPoint)

# ----
# 定位点Project到下层建筑线
move2pt_13 = MoveToPoint(Geometry=pln_62, PointA=pln_62, PointB=pull_33.ClosestPoint)  # -> Moved, Vector, Transform

# ----
# 可能的点-离结构很远
pln_63 = Plane(dispatch_65.ListA)

deplane_24 = DeconstructPlane(Plane=move2pt_13.Moved)  # -> Origin, XAxis, YAxis, ZAxis
amp_29 = Amplitude(Vector=deplane_24.YAxis, Amplitude=Slider(5000, range=0..10000))
move_36 = Move(Geometry=deplane_24.Origin, Motion=amp_29)  # -> Geometry, Transform
ln_35 = Line(StartPoint=move_36.Geometry, EndPoint=deplane_24.Origin)

# ---- group: 和内测梁交点
ccx_20 = CurveCurve(CurveA=graft(ln_35), CurveB=flatten(crv_80))  # -> simplify(Points), ParamsA, ParamsB

# ----
shift_27 = ShiftPaths(Data=ccx_20.Points, Offset=-1)
null_23 = NullItem(Item=shift_27)  # -> NullFlags, InvalidFlags, Description
dispatch_66 = Dispatch(List=simplify(graft(move2pt_13.Moved)), DispatchPattern=null_23.NullFlags)  # -> ListA, ListB
dispatch_67 = Dispatch(List=simplify(graft(ln_35)), DispatchPattern=null_23.NullFlags)  # -> ListA, ListB
pln_64 = Plane(dispatch_66.ListA)
crv_114 = Curve(dispatch_67.ListB)
pln_65 = Plane(dispatch_66.ListB)
ccx_21 = CurveCurve(CurveA=graft(crv_114), CurveB=flatten(crv_80))  # -> Points, ParamsA, ParamsB
shift_28 = ShiftPaths(Data=simplify(ccx_21.Points), Offset=-1)
pull_34 = PullPoint(Point=pln_65, Geometry=shift_28, ClosestOnly=True)  # -> ClosestPoint, Distance
sort_26 = SortList(Keys=pull_34.Distance, ValuesA=pull_34.ClosestPoint)  # -> Keys, ValuesA

# ---- group: 交点对应的起始定位点
item_66 = ListItem(List=sort_26.ValuesA, Index=0, Wrap=True)

# ----
ln_36 = Line(StartPoint=pln_65, EndPoint=item_66)
len_7 = Length(Curve=ln_36)
larger_7 = LargerThan(FirstNumber=len_7, SecondNumber=number_slider_22)  # -> LargerThan, OrEqualTo
panel_72 = Panel(len_7)
dispatch_68 = Dispatch(List=pln_65, DispatchPattern=larger_7.LargerThan)  # -> ListA, ListB
dispatch_69 = Dispatch(List=item_66, DispatchPattern=larger_7.LargerThan)  # -> ListA, ListB
pln_66 = Plane(dispatch_68.ListB)

# ---- group: 起始点
pt_46 = Point(dispatch_69.ListA)

# ---- group: 最终Plane
pln_67 = Plane(dispatch_68.ListA)

# ----
# 按照梁分类定位点
pt_47 = Point(pt_46)
crv_115 = Curve(shift_2)
incurves_9 = PointInCurves(Point=flatten(pt_47), Curves=crv_115)  # -> Relationship, Index, Point
equals_17 = Equality(FirstNumber=incurves_9.Relationship, SecondNumber="0")  # -> Equality, Inequality
dispatch_70 = Dispatch(List=flatten(pt_47), DispatchPattern=equals_17.Inequality)  # -> ListA, ListB

# ---- group: 交点-属于哪个梁
data_50 = Data(dispatch_70.ListA)

# ----
# 可能的结构交点-大量
pln_68 = Plane(pln_64)

# ----
# 可能的结构交点
pln_69 = Plane(pln_66)

# ----
# 按照梁分类定位PLANE
shift_29 = ShiftPaths(Data=crv_81, Offset=-1)
shift_30 = ShiftPaths(Data=shift_29, Offset=-1)
pull_35 = PullPoint(Point=data_50, Geometry=simplify(shift_30), ClosestOnly=True)  # -> ClosestPoint, Distance
ln_37 = Line(StartPoint=pull_35.ClosestPoint, EndPoint=data_50)
movetoplane_9 = MoveToPlane(Geometry=crv_39, Plane=PlaneXY(0, 0, 0), Above=True, Below=True)  # -> Geometry, Transform

# ---- group: Y Axis Line-All
crv_116 = Curve(ln_37)

# ----
end_10 = EndPoints(Curve=graft(crv_116))  # -> Start, End
merge_34 = Merge(Data1=end_10.Start, Data2=end_10.End)
pull_36 = PullPoint(Point=merge_34, Geometry=movetoplane_9.Geometry, ClosestOnly=True)  # -> ClosestPoint, Distance
sort_27 = SortList(Keys=pull_36.Distance, ValuesA=merge_34)  # -> Keys, ValuesA
item_67 = ListItem(List=sort_27.ValuesA, Index="-1", Wrap=True)
item_68 = ListItem(List=sort_27.ValuesA, Index=0, Wrap=True)
pt_48 = Point(item_68)
pt_49 = Point(item_67)
ln_38 = Line(StartPoint=pt_49, EndPoint=pt_48)
rotate_15 = Rotate(Geometry=ln_38, Angle=1.570796327, Plane=pt_48)  # -> Geometry, Transform

pt_50 = Point(end_10.End)

pl_13 = ConstructPlane(Origin=pt_50, XAxis=rotate_15.Geometry, YAxis=ln_38)
null_24 = NullItem(Item=pl_13)  # -> NullFlags, InvalidFlags, Description
dispatch_71 = Dispatch(List=pl_13, DispatchPattern=null_24.NullFlags)  # -> ListA, ListB
pln_70 = Plane(dispatch_71.ListB)

shift_31 = ShiftPaths(Data=pln_70, Offset=-1)

# ---- group: 檐口-首次筛选的有效起始Plane
data_51 = Data(simplify(shift_31))

# ----
# 2.1 梁以内>350
# 
# 侧埋，钢板焊
# 03：钢板焊埋件[钢梁内侧]
# @钢边梁宽@钢边梁高
pln_71 = Plane(data_51)

# ----
# 2.1 Missing Point
# 埋件定位点Offset，没有找到和梁的交点
merge_35 = Merge(Data1=pln_63, Data2=pln_69, Data3=pln_68)
crv_117 = Curve(crv_80)

# ----
# 0 檐口出定位点
# 与结构无交点
pln_72 = Plane(flatten(merge_35))

deplane_25 = DeconstructPlane(Plane=pln_72)  # -> Origin, XAxis, YAxis, ZAxis
amp_30 = Amplitude(Vector=deplane_25.YAxis, Amplitude=Slider(5000, range=0..10000))
move_37 = Move(Geometry=deplane_25.Origin, Motion=amp_30)  # -> Geometry, Transform
ln_39 = Line(StartPoint=move_37.Geometry, EndPoint=deplane_25.Origin)
amp_31 = Amplitude(Vector=deplane_25.XAxis, Amplitude=number_slider_11)
amp_32 = Amplitude(Vector=deplane_25.XAxis, Amplitude=expr("-x", number_slider_11))
move_38 = Move(Geometry=ln_39, Motion=amp_31)  # -> Geometry, Transform
move_39 = Move(Geometry=ln_39, Motion=amp_32)  # -> Geometry, Transform

ccx_22 = CurveCurve(CurveA=graft(move_38.Geometry), CurveB=flatten(crv_117))  # -> Points, ParamsA, ParamsB
shift_32 = ShiftPaths(Data=ccx_22.Points, Offset=-1)
sort_28 = SortList(Keys=shift_32, ValuesA=shift_32)  # -> Keys, ValuesA
pull_37 = PullPoint(Point=sort_28.ValuesA, Geometry=graft(pln_72), ClosestOnly=True)  # -> ClosestPoint, Distance
sort_29 = SortList(Keys=pull_37.Distance, ValuesA=sort_28.ValuesA)  # -> Keys, ValuesA
item_69 = ListItem(List=sort_29.ValuesA, Index="-1", Wrap=True)
null_25 = NullItem(Item=flatten(item_69))  # -> NullFlags, InvalidFlags, Description
end_11 = EndPoints(Curve=move_38.Geometry)  # -> Start, End
dispatch_72 = Dispatch(List=graft(pln_72), DispatchPattern=graft(null_25.InvalidFlags))  # -> ListA, ListB
dispatch_73 = Dispatch(List=simplify(item_69), DispatchPattern=simplify(graft(null_25.InvalidFlags)))  # -> ListA, ListB
pln_73 = Plane(dispatch_72.ListB)
pt_51 = Point(dispatch_73.ListB)
dispatch_74 = Dispatch(List=simplify(graft(end_11.End)), DispatchPattern=simplify(graft(null_25.InvalidFlags)))  # -> ListA, ListB
pt_52 = Point(dispatch_74.ListB)
ln_40 = Line(StartPoint=pt_52, EndPoint=pt_51)
len_8 = Length(Curve=ln_40)
larger_8 = LargerThan(FirstNumber=len_8, SecondNumber=Slider(350, range=0..1000))  # -> LargerThan, OrEqualTo
dispatch_75 = Dispatch(List=pln_73, DispatchPattern=larger_8.LargerThan)  # -> ListA, ListB
dispatch_76 = Dispatch(List=pt_51, DispatchPattern=larger_8.LargerThan)  # -> ListA, ListB
pln_74 = Plane(dispatch_75.ListA)
pt_53 = Point(dispatch_76.ListA)
move2pt_14 = MoveToPoint(Geometry=pln_74, PointA=pln_74, PointB=pt_53)  # -> Moved, Vector, Transform

ccx_23 = CurveCurve(CurveA=graft(move_39.Geometry), CurveB=flatten(crv_117))  # -> Points, ParamsA, ParamsB
shift_33 = ShiftPaths(Data=ccx_23.Points, Offset=-1)
sort_30 = SortList(Keys=shift_33, ValuesA=shift_33)  # -> Keys, ValuesA
pull_38 = PullPoint(Point=sort_30.ValuesA, Geometry=graft(pln_72), ClosestOnly=True)  # -> ClosestPoint, Distance
sort_31 = SortList(Keys=pull_38.Distance, ValuesA=sort_30.ValuesA)  # -> Keys, ValuesA
item_70 = ListItem(List=sort_31.ValuesA, Index="-1", Wrap=True)
null_26 = NullItem(Item=flatten(item_70))  # -> NullFlags, InvalidFlags, Description
end_12 = EndPoints(Curve=move_39.Geometry)  # -> Start, End
dispatch_77 = Dispatch(List=simplify(item_70), DispatchPattern=simplify(graft(null_26.InvalidFlags)))  # -> ListA, ListB
dispatch_78 = Dispatch(List=graft(pln_72), DispatchPattern=flatten(null_26.InvalidFlags))  # -> ListA, ListB
dispatch_79 = Dispatch(List=simplify(graft(end_12.End)), DispatchPattern=simplify(graft(null_26.InvalidFlags)))  # -> ListA, ListB
pln_75 = Plane(dispatch_78.ListB)
pt_54 = Point(dispatch_77.ListB)
pt_55 = Point(dispatch_79.ListB)
ln_41 = Line(StartPoint=pt_55, EndPoint=pt_54)
len_9 = Length(Curve=ln_41)
larger_9 = LargerThan(FirstNumber=len_9, SecondNumber=Slider(350, range=0..1000))  # -> LargerThan, OrEqualTo
dispatch_80 = Dispatch(List=pln_75, DispatchPattern=larger_9.LargerThan)  # -> ListA, ListB
dispatch_81 = Dispatch(List=pt_54, DispatchPattern=larger_9.LargerThan)  # -> ListA, ListB
pln_76 = Plane(dispatch_80.ListA)
pt_56 = Point(dispatch_81.ListA)
move2pt_15 = MoveToPoint(Geometry=pln_76, PointA=pln_76, PointB=pt_56)  # -> Moved, Vector, Transform

merge_36 = Merge(Data1=move2pt_14.Moved, Data2=move2pt_15.Moved)

# ----
# 按照梁分类定位点
pt_57 = Point(pt_53)
incurves_10 = PointInCurves(Point=flatten(merge_36), Curves=crv_82)  # -> Relationship, Index, Point
equals_18 = Equality(FirstNumber=incurves_10.Relationship, SecondNumber="0")  # -> Equality, Inequality
dispatch_82 = Dispatch(List=flatten(pt_57), DispatchPattern=equals_18.Inequality)  # -> ListA, ListB

# ---- group: 交点-属于哪个梁
data_52 = Data(dispatch_82.ListA)

# ----
# 按照梁分类定位PLANE
shift_34 = ShiftPaths(Data=crv_83, Offset=-1)
shift_35 = ShiftPaths(Data=shift_34, Offset=-1)
pull_39 = PullPoint(Point=data_52, Geometry=simplify(shift_35), ClosestOnly=True)  # -> ClosestPoint, Distance
ln_42 = Line(StartPoint=pull_39.ClosestPoint, EndPoint=data_52)
movetoplane_10 = MoveToPlane(Geometry=crv_40, Plane=PlaneXY(0, 0, 0), Above=True, Below=True)  # -> Geometry, Transform

# ---- group: Y Axis Line-All
crv_118 = Curve(ln_42)

# ----
end_13 = EndPoints(Curve=graft(crv_118))  # -> Start, End
merge_37 = Merge(Data1=end_13.Start, Data2=end_13.End)
pull_40 = PullPoint(Point=merge_37, Geometry=movetoplane_10.Geometry, ClosestOnly=True)  # -> ClosestPoint, Distance
sort_32 = SortList(Keys=pull_40.Distance, ValuesA=merge_37)  # -> Keys, ValuesA
item_71 = ListItem(List=sort_32.ValuesA, Index="-1", Wrap=True)
item_72 = ListItem(List=sort_32.ValuesA, Index=0, Wrap=True)
pt_58 = Point(item_72)
pt_59 = Point(item_71)
ln_43 = Line(StartPoint=pt_59, EndPoint=pt_58)
rotate_16 = Rotate(Geometry=ln_43, Angle=1.570796327, Plane=pt_58)  # -> Geometry, Transform

pt_60 = Point(end_13.End)

pl_14 = ConstructPlane(Origin=pt_60, XAxis=rotate_16.Geometry, YAxis=ln_43)
null_27 = NullItem(Item=pl_14)  # -> NullFlags, InvalidFlags, Description
dispatch_83 = Dispatch(List=pl_14, DispatchPattern=null_27.NullFlags)  # -> ListA, ListB
pln_77 = Plane(dispatch_83.ListB)

shift_36 = ShiftPaths(Data=pln_77, Offset=-1)

# ---- group: 檐口-首次筛选的有效起始Plane
data_53 = Data(shift_36)

# ----
# 撞到梁交点
merge_38 = Merge(Data1=data_53)

merge_39 = Merge(Data1=pln_71, Data2=merge_38)
orient_5 = Orient(Geometry=item_27, Source=rotate_8.Geometry, Target=merge_39)  # -> Geometry, Transform

data_54 = Data(orient_5.Geometry)
ungroup_8 = Ungroup(Group=data_54)
item_73 = ListItem(List=ungroup_8, Index=0, Wrap=True)  # -> flatten(Item)
item_74 = ListItem(List=ungroup_8, Index="-1", Wrap=True)  # -> flatten(Item)

# ---- group: 有吊顶的范围，檐口处内侧埋件 (continued)
entwine_15 = Entwine(Branch00=item_73, Branch01=item_74, FlattenInputs=True)
bake_5 = BakeObjects(Geometry=entwine_15, Attributes=attributes_4, BakeName=panel_41, Bake=False)

# ----
deplane_26 = DeconstructPlane(Plane=pln_15)  # -> Origin, XAxis, YAxis, ZAxis
number_slider_44 = Slider(3584, range=0..10000)
amp_33 = Amplitude(Vector=deplane_26.YAxis, Amplitude=number_slider_44)
amp_34 = Amplitude(Vector=deplane_26.YAxis, Amplitude=expr("-x", number_slider_44))
boundary_6 = BoundarySurfaces(Edges=[offset_8, offset_7])
move_40 = Move(Geometry=deplane_26.Origin, Motion=amp_34)  # -> Geometry, Transform
move_41 = Move(Geometry=deplane_26.Origin, Motion=amp_33)  # -> Geometry, Transform
ln_44 = Line(StartPoint=move_40.Geometry, EndPoint=move_41.Geometry)

# ---- group: 50-350建筑结构交点
scx_3 = SurfaceCurve(Surface=boundary_6, Curve=crv_86)  # -> flatten(Curves), Points, UVPoints, Normals, Parameters, Tangents

# ---- group: 该区间的定位点
ccx_24 = CurveCurve(CurveA=graft(ln_44), CurveB=scx_3.Curves)  # -> Points, ParamsA, ParamsB

# ----
shift_37 = ShiftPaths(Data=ccx_24.Points, Offset=-1)
pull_41 = PullPoint(Point=graft(pln_15), Geometry=shift_37, ClosestOnly=True)  # -> ClosestPoint, Distance
sort_33 = SortList(Keys=pull_41.Distance, ValuesA=pull_41.ClosestPoint)  # -> Keys, ValuesA
null_28 = NullItem(Item=sort_33.ValuesA)  # -> NullFlags, simplify(InvalidFlags), Description
item_75 = ListItem(List=sort_33.ValuesA, Index=0, Wrap=True)
dispatch_84 = Dispatch(List=simplify(graft(pln_15)), DispatchPattern=null_28.InvalidFlags)  # -> ListA, ListB
dispatch_85 = Dispatch(List=simplify(graft(item_75)), DispatchPattern=null_28.InvalidFlags)  # -> ListA, ListB
pln_78 = Plane(dispatch_84.ListB)
pln_79 = Plane(dispatch_84.ListA)
pt_61 = Point(dispatch_85.ListB)

# ----
# 按照梁分类定位点
crv_119 = Curve(shift_2)
pt_62 = Point(pt_61)
incurves_11 = PointInCurves(Point=flatten(pt_62), Curves=crv_119)  # -> Relationship, Index, Point
equals_19 = Equality(FirstNumber=incurves_11.Relationship, SecondNumber="0")  # -> Equality, Inequality
dispatch_86 = Dispatch(List=flatten(pt_62), DispatchPattern=equals_19.Inequality)  # -> ListA, ListB

# ---- group: 交点-属于哪个梁
data_55 = Data(dispatch_86.ListA)

# ----
# 可能的结构交点-大量
pln_80 = Plane(pln_79)

# ----
# 0 檐口出定位点
# 与结构无交点
pln_81 = Plane(flatten(pln_80))

pln_82 = Plane(pln_78)

# ----
# 按照梁分类定位PLANE
shift_38 = ShiftPaths(Data=crv_88, Offset=-1)
shift_39 = ShiftPaths(Data=shift_38, Offset=-1)
pull_42 = PullPoint(Point=data_55, Geometry=simplify(shift_39), ClosestOnly=True)  # -> ClosestPoint, Distance
ln_45 = Line(StartPoint=pull_42.ClosestPoint, EndPoint=data_55)
movetoplane_11 = MoveToPlane(Geometry=crv_44, Plane=PlaneXY(0, 0, 0), Above=True, Below=True)  # -> Geometry, Transform

# ---- group: Y Axis Line-All
crv_120 = Curve(ln_45)

# ----
# 按照梁分类定位PLANE
shift_40 = ShiftPaths(Data=crv_89, Offset=-1)
shift_41 = ShiftPaths(Data=shift_40, Offset=-1)
pull_43 = PullPoint(Point=data_32, Geometry=simplify(shift_41), ClosestOnly=True)  # -> ClosestPoint, Distance
ln_46 = Line(StartPoint=pull_43.ClosestPoint, EndPoint=data_32)
movetoplane_12 = MoveToPlane(Geometry=crv_45, Plane=PlaneXY(0, 0, 0), Above=True, Below=True)  # -> Geometry, Transform

# ---- group: Y Axis Line-All
crv_121 = Curve(ln_46)

# ----
end_14 = EndPoints(Curve=graft(crv_120))  # -> Start, End
merge_40 = Merge(Data1=end_14.Start, Data2=end_14.End)
pull_44 = PullPoint(Point=merge_40, Geometry=movetoplane_11.Geometry, ClosestOnly=True)  # -> ClosestPoint, Distance
sort_34 = SortList(Keys=pull_44.Distance, ValuesA=merge_40)  # -> Keys, ValuesA
item_76 = ListItem(List=sort_34.ValuesA, Index="-1", Wrap=True)
item_77 = ListItem(List=sort_34.ValuesA, Index=0, Wrap=True)
pt_63 = Point(item_77)
pt_64 = Point(item_76)
ln_47 = Line(StartPoint=pt_64, EndPoint=pt_63)
rotate_17 = Rotate(Geometry=ln_47, Angle=1.570796327, Plane=pt_63)  # -> Geometry, Transform

pt_65 = Point(end_14.End)

pl_15 = ConstructPlane(Origin=pt_65, XAxis=rotate_17.Geometry, YAxis=ln_47)
null_29 = NullItem(Item=pl_15)  # -> NullFlags, InvalidFlags, Description
dispatch_87 = Dispatch(List=pl_15, DispatchPattern=null_29.NullFlags)  # -> ListA, ListB
pln_83 = Plane(dispatch_87.ListB)

shift_42 = ShiftPaths(Data=pln_83, Offset=-1)

# ---- group: 檐口-首次筛选的有效起始Plane
data_56 = Data(shift_42)

# ----
# Rhino 文件中导入的块名
# 3.1
# 下层建筑边线外侧50-350mm
# 03：钢板焊埋件[钢梁内侧]
# @钢边梁宽@钢边梁高
pln_84 = Plane(data_56)

end_15 = EndPoints(Curve=graft(crv_121))  # -> Start, End
merge_41 = Merge(Data1=end_15.Start, Data2=end_15.End)
pull_45 = PullPoint(Point=merge_41, Geometry=movetoplane_12.Geometry, ClosestOnly=True)  # -> ClosestPoint, Distance
sort_35 = SortList(Keys=pull_45.Distance, ValuesA=merge_41)  # -> Keys, ValuesA
item_78 = ListItem(List=sort_35.ValuesA, Index="-1", Wrap=True)
item_79 = ListItem(List=sort_35.ValuesA, Index=0, Wrap=True)
pt_66 = Point(item_79)
pt_67 = Point(item_78)
ln_48 = Line(StartPoint=pt_67, EndPoint=pt_66)
rotate_18 = Rotate(Geometry=ln_48, Angle=1.570796327, Plane=pt_66)  # -> Geometry, Transform

pt_68 = Point(end_15.End)

pl_16 = ConstructPlane(Origin=pt_68, XAxis=rotate_18.Geometry, YAxis=ln_48)
null_30 = NullItem(Item=pl_16)  # -> NullFlags, InvalidFlags, Description
dispatch_88 = Dispatch(List=pl_16, DispatchPattern=null_30.NullFlags)  # -> ListA, ListB
pln_85 = Plane(dispatch_88.ListB)

shift_43 = ShiftPaths(Data=pln_85, Offset=-1)

# ---- group: 檐口-首次筛选的有效起始Plane
data_57 = Data(shift_43)

# ----
# 3.2
# 下层建筑边线内侧300-600mm范围
# 03：钢板焊埋件[钢梁外侧]
# @钢边梁宽@钢边梁高
pln_86 = Plane(data_57)

# ----
# 3.1 Missing Point
# 埋件定位点Offset，没有找到和梁的交点
number_slider_45 = Slider(5000, range=0..10000)
deplane_27 = DeconstructPlane(Plane=pln_81)  # -> Origin, XAxis, YAxis, ZAxis
amp_35 = Amplitude(Vector=deplane_27.YAxis, Amplitude=number_slider_45)
crv_122 = Curve(scx_3.Curves)
move_42 = Move(Geometry=deplane_27.Origin, Motion=amp_35)  # -> Geometry, Transform
ln_49 = Line(StartPoint=move_42.Geometry, EndPoint=deplane_27.Origin)
amp_36 = Amplitude(Vector=deplane_27.XAxis, Amplitude=expr("-x", number_slider_11))
amp_37 = Amplitude(Vector=deplane_27.XAxis, Amplitude=number_slider_11)
move_43 = Move(Geometry=ln_49, Motion=amp_37)  # -> Geometry, Transform
move_44 = Move(Geometry=ln_49, Motion=amp_36)  # -> Geometry, Transform
move_45 = Move(Geometry=pln_81, Motion=amp_36)  # -> Geometry, Transform
move_46 = Move(Geometry=pln_81, Motion=amp_37)  # -> Geometry, Transform

ccx_25 = CurveCurve(CurveA=graft(move_44.Geometry), CurveB=flatten(crv_122))  # -> Points, ParamsA, ParamsB
shift_44 = ShiftPaths(Data=ccx_25.Points, Offset=-1)
sort_36 = SortList(Keys=shift_44, ValuesA=shift_44)  # -> Keys, ValuesA
pull_46 = PullPoint(Point=sort_36.ValuesA, Geometry=graft(pln_81), ClosestOnly=True)  # -> ClosestPoint, Distance
sort_37 = SortList(Keys=pull_46.Distance, ValuesA=sort_36.ValuesA)  # -> Keys, ValuesA
item_80 = ListItem(List=sort_37.ValuesA, Index="-1", Wrap=True)
null_31 = NullItem(Item=flatten(item_80))  # -> NullFlags, InvalidFlags, Description
dispatch_89 = Dispatch(List=flatten(item_80), DispatchPattern=null_31.InvalidFlags)  # -> ListA, ListB
dispatch_90 = Dispatch(List=pln_81, DispatchPattern=null_31.InvalidFlags)  # -> ListA, ListB
pt_69 = Point(dispatch_89.ListB)
pln_87 = Plane(dispatch_90.ListB)

ccx_26 = CurveCurve(CurveA=graft(move_43.Geometry), CurveB=flatten(crv_122))  # -> Points, ParamsA, ParamsB
shift_45 = ShiftPaths(Data=ccx_26.Points, Offset=-1)
sort_38 = SortList(Keys=shift_45, ValuesA=shift_45)  # -> Keys, ValuesA
pull_47 = PullPoint(Point=sort_38.ValuesA, Geometry=graft(pln_81), ClosestOnly=True)  # -> ClosestPoint, Distance
sort_39 = SortList(Keys=pull_47.Distance, ValuesA=sort_38.ValuesA)  # -> Keys, ValuesA
item_81 = ListItem(List=sort_39.ValuesA, Index="-1", Wrap=True)
null_32 = NullItem(Item=flatten(item_81))  # -> NullFlags, InvalidFlags, Description
dispatch_91 = Dispatch(List=flatten(item_81), DispatchPattern=null_32.InvalidFlags)  # -> ListA, ListB
dispatch_92 = Dispatch(List=pln_81, DispatchPattern=null_32.InvalidFlags)  # -> ListA, ListB
pln_88 = Plane(dispatch_92.ListB)
pt_70 = Point(dispatch_91.ListB)

merge_42 = Merge(Data1=pln_88, Data2=pln_87)  # -> flatten(Result)

# ----
# 使用过的点
merge_43 = Merge(Data1=merge_42, Data2=pln_82)

merge_44 = Merge(Data1=pt_70, Data2=pt_69)

# ----
# 按照梁分类定位点
incurves_12 = PointInCurves(Point=flatten(merge_44), Curves=crv_92)  # -> Relationship, Index, Point
equals_20 = Equality(FirstNumber=incurves_12.Relationship, SecondNumber="0")  # -> Equality, Inequality
dispatch_93 = Dispatch(List=flatten(merge_44), DispatchPattern=equals_20.Inequality)  # -> ListA, ListB

# ---- group: 交点-属于哪个梁
data_58 = Data(dispatch_93.ListA)

# ----
# 3.2  Missing Point
# 埋件定位点Offset，没有找到和梁的交点
number_slider_46 = Slider(5000, range=0..10000)
deplane_28 = DeconstructPlane(Plane=pln_35)  # -> Origin, XAxis, YAxis, ZAxis
amp_38 = Amplitude(Vector=deplane_28.YAxis, Amplitude=expr("-x", number_slider_46))
move_47 = Move(Geometry=deplane_28.Origin, Motion=amp_38)  # -> Geometry, Transform
ln_50 = Line(StartPoint=move_47.Geometry, EndPoint=deplane_28.Origin)
amp_39 = Amplitude(Vector=deplane_28.XAxis, Amplitude=number_slider_11)
amp_40 = Amplitude(Vector=deplane_28.XAxis, Amplitude=expr("-x", number_slider_11))
move_48 = Move(Geometry=ln_50, Motion=amp_40)  # -> Geometry, Transform
move_49 = Move(Geometry=ln_50, Motion=amp_39)  # -> Geometry, Transform
move_50 = Move(Geometry=pln_35, Motion=amp_40)  # -> Geometry, Transform
move_51 = Move(Geometry=pln_35, Motion=amp_39)  # -> Geometry, Transform

pln_89 = Plane(move_51.Geometry)
deplane_29 = DeconstructPlane(Plane=pln_89)  # -> Origin, XAxis, YAxis, ZAxis
amp_41 = Amplitude(Vector=deplane_29.YAxis, Amplitude=expr("-x", Slider(2000, range=0..10000)))
move_52 = Move(Geometry=deplane_29.Origin, Motion=amp_41)  # -> Geometry, Transform
ln_51 = Line(StartPoint=deplane_29.Origin, EndPoint=move_52.Geometry)
ccx_27 = CurveCurve(CurveA=flatten(crv_90), CurveB=simplify(graft(move_49.Geometry)))  # -> Points, ParamsA, ParamsB
shift_46 = ShiftPaths(Data=ccx_27.Points, Offset=-1)
graft_5 = GraftTree(Tree=deplane_29.Origin, IncludeEmptyLists=True, IncludeNullItems=True)  # -> simplify(Tree)
pull_48 = PullPoint(Point=shift_46, Geometry=graft_5, ClosestOnly=True)  # -> ClosestPoint, Distance
sort_40 = SortList(Keys=pull_48.Distance, ValuesA=shift_46)  # -> Keys, ValuesA
graft_6 = GraftTree(Tree=pln_89, IncludeEmptyLists=True, IncludeNullItems=True)  # -> flatten(Tree)
item_82 = ListItem(List=sort_40.Keys, Index=0, Wrap=True)  # -> flatten(Item)
c_script_2 = CSharpScript(num=item_82, Max="600", Min="300")  # -> out, A, Distance; inputs num: list of Double, Max: Double; same code as c_script
item_83 = ListItem(List=graft_6, Index=c_script_2.out, Wrap=True)

pln_90 = Plane(move_50.Geometry)
# 阳角
# 阴角
# 阳角
# 阴角
number_slider_47 = Slider(2000, range=0..10000)
deplane_30 = DeconstructPlane(Plane=pln_90)  # -> Origin, XAxis, YAxis, ZAxis
amp_42 = Amplitude(Vector=deplane_30.YAxis, Amplitude=expr("-x", number_slider_47))
move_53 = Move(Geometry=deplane_30.Origin, Motion=amp_42)  # -> Geometry, Transform
ln_52 = Line(StartPoint=deplane_30.Origin, EndPoint=move_53.Geometry)
ccx_28 = CurveCurve(CurveA=flatten(crv_91), CurveB=simplify(graft(move_48.Geometry)))  # -> Points, ParamsA, ParamsB
shift_47 = ShiftPaths(Data=ccx_28.Points, Offset=-1)
graft_7 = GraftTree(Tree=deplane_30.Origin, IncludeEmptyLists=True, IncludeNullItems=True)  # -> simplify(Tree)
pull_49 = PullPoint(Point=shift_47, Geometry=graft_7, ClosestOnly=True)  # -> ClosestPoint, Distance
sort_41 = SortList(Keys=pull_49.Distance, ValuesA=shift_47)  # -> Keys, ValuesA
graft_8 = GraftTree(Tree=pln_90, IncludeEmptyLists=True, IncludeNullItems=True)  # -> flatten(Tree)
item_84 = ListItem(List=sort_41.Keys, Index=0, Wrap=True)  # -> flatten(Item)
c_script_3 = CSharpScript(num=item_84, Max="600", Min="300")  # -> out, A, Distance; inputs num: list of Double, Max: Double; same code as c_script
item_85 = ListItem(List=graft_8, Index=c_script_3.out, Wrap=True)

item_86 = ListItem(List=sort_40.ValuesA, Index=0, Wrap=True)  # -> flatten(Item)
item_87 = ListItem(List=sort_41.ValuesA, Index=0, Wrap=True)  # -> flatten(Item)
item_88 = ListItem(List=item_86, Index=c_script_2.out, Wrap=True)
item_89 = ListItem(List=item_87, Index=c_script_3.out, Wrap=True)

# ----
# 使用过的点
item_90 = ListItem(List=pln_35, Index=c_script_2.out, Wrap=True)
item_91 = ListItem(List=pln_35, Index=c_script_3.out, Wrap=True)
item_92 = ListItem(List=pln_30, Index=c_script.A, Wrap=True)
merge_45 = Merge(Data1=item_90, Data2=item_91, Data3=item_92)

merge_46 = Merge(Data1=item_88, Data2=item_89)

# ----
# 按照梁分类定位点
crv_123 = Curve(shift_2)
incurves_13 = PointInCurves(Point=flatten(merge_46), Curves=crv_123)  # -> Relationship, Index, Point
equals_21 = Equality(FirstNumber=incurves_13.Relationship, SecondNumber="0")  # -> Equality, Inequality
dispatch_94 = Dispatch(List=flatten(merge_46), DispatchPattern=equals_21.Inequality)  # -> ListA, ListB
data_59 = Data(dispatch_94.ListA)

# ---- group: 交点-属于哪个梁
data_60 = Data(data_59)

# ----
# 按照梁分类定位PLANE
shift_48 = ShiftPaths(Data=crv_93, Offset=-1)
shift_49 = ShiftPaths(Data=shift_48, Offset=-1)
pull_50 = PullPoint(Point=data_58, Geometry=simplify(shift_49), ClosestOnly=True)  # -> ClosestPoint, Distance
ln_53 = Line(StartPoint=pull_50.ClosestPoint, EndPoint=data_58)
movetoplane_13 = MoveToPlane(Geometry=crv_46, Plane=PlaneXY(0, 0, 0), Above=True, Below=True)  # -> Geometry, Transform

# ---- group: Y Axis Line-All
crv_124 = Curve(ln_53)

# ----
# 按照梁分类定位PLANE
shift_50 = ShiftPaths(Data=crv_94, Offset=-1)
shift_51 = ShiftPaths(Data=shift_50, Offset=-1)
pull_51 = PullPoint(Point=data_60, Geometry=simplify(shift_51), ClosestOnly=True)  # -> ClosestPoint, Distance
ln_54 = Line(StartPoint=pull_51.ClosestPoint, EndPoint=data_60)
movetoplane_14 = MoveToPlane(Geometry=crv_47, Plane=PlaneXY(0, 0, 0), Above=True, Below=True)  # -> Geometry, Transform

# ---- group: Y Axis Line-All
crv_125 = Curve(ln_54)

# ----
end_16 = EndPoints(Curve=graft(crv_124))  # -> Start, End
merge_47 = Merge(Data1=end_16.Start, Data2=end_16.End)
pull_52 = PullPoint(Point=merge_47, Geometry=movetoplane_13.Geometry, ClosestOnly=True)  # -> ClosestPoint, Distance
sort_42 = SortList(Keys=pull_52.Distance, ValuesA=merge_47)  # -> Keys, ValuesA
item_93 = ListItem(List=sort_42.ValuesA, Index="-1", Wrap=True)
item_94 = ListItem(List=sort_42.ValuesA, Index=0, Wrap=True)
pt_71 = Point(item_94)
pt_72 = Point(item_93)
ln_55 = Line(StartPoint=pt_72, EndPoint=pt_71)
rotate_19 = Rotate(Geometry=ln_55, Angle=1.570796327, Plane=pt_71)  # -> Geometry, Transform

pt_73 = Point(end_16.End)

pl_17 = ConstructPlane(Origin=pt_73, XAxis=rotate_19.Geometry, YAxis=ln_55)
null_33 = NullItem(Item=pl_17)  # -> NullFlags, InvalidFlags, Description
dispatch_95 = Dispatch(List=pl_17, DispatchPattern=null_33.NullFlags)  # -> ListA, ListB
pln_91 = Plane(dispatch_95.ListB)

shift_52 = ShiftPaths(Data=pln_91, Offset=-1)
data_61 = Data(shift_52)

# ----
# 撞到梁交点
merge_48 = Merge(Data1=data_61)

merge_49 = Merge(Data1=pln_84, Data2=merge_48)
# 这里如果跑红也不要紧，
# 说明单体没有出现相撞的情况
orient_6 = Orient(Geometry=item_29, Source=rotate_9.Geometry, Target=merge_49)  # -> Geometry, Transform

data_62 = Data(orient_6.Geometry)
ungroup_9 = Ungroup(Group=data_62)
item_95 = ListItem(List=ungroup_9, Index=0, Wrap=True)  # -> flatten(Item)
item_96 = ListItem(List=ungroup_9, Index="-1", Wrap=True)  # -> flatten(Item)

# ---- group: 框架顶部，埋件在幕墙线外侧 (continued)
entwine_16 = Entwine(Branch00=item_95, Branch01=item_96, FlattenInputs=True)
bake_6 = BakeObjects(Geometry=entwine_16, Attributes=attributes_6, BakeName=panel_43, Bake=False)

# ----
end_17 = EndPoints(Curve=graft(crv_125))  # -> Start, End
merge_50 = Merge(Data1=end_17.Start, Data2=end_17.End)
pull_53 = PullPoint(Point=merge_50, Geometry=movetoplane_14.Geometry, ClosestOnly=True)  # -> ClosestPoint, Distance
sort_43 = SortList(Keys=pull_53.Distance, ValuesA=merge_50)  # -> Keys, ValuesA
item_97 = ListItem(List=sort_43.ValuesA, Index="-1", Wrap=True)
item_98 = ListItem(List=sort_43.ValuesA, Index=0, Wrap=True)
pt_74 = Point(item_98)
pt_75 = Point(item_97)
ln_56 = Line(StartPoint=pt_75, EndPoint=pt_74)
rotate_20 = Rotate(Geometry=ln_56, Angle=1.570796327, Plane=pt_74)  # -> Geometry, Transform

pt_76 = Point(end_17.End)

pl_18 = ConstructPlane(Origin=pt_76, XAxis=rotate_20.Geometry, YAxis=ln_56)
null_34 = NullItem(Item=pl_18)  # -> NullFlags, InvalidFlags, Description
dispatch_96 = Dispatch(List=pl_18, DispatchPattern=null_34.NullFlags)  # -> ListA, ListB
pln_92 = Plane(dispatch_96.ListB)

shift_53 = ShiftPaths(Data=pln_92, Offset=-1)

# ---- group: 檐口-首次筛选的有效起始Plane
data_63 = Data(shift_53)

# ----
# 撞到梁交点
merge_51 = Merge(Data1=data_63)

merge_52 = Merge(Data1=pln_86, Data2=merge_51)
orient_7 = Orient(Geometry=item_31, Source=item_32, Target=merge_52)  # -> Geometry, Transform

data_64 = Data(orient_7.Geometry)
ungroup_10 = Ungroup(Group=data_64)
item_99 = ListItem(List=ungroup_10, Index=0, Wrap=True)  # -> flatten(Item)
item_100 = ListItem(List=ungroup_10, Index="-1", Wrap=True)  # -> flatten(Item)

# ---- group: 框架顶部，埋件在幕墙线内侧 (continued)
entwine_17 = Entwine(Branch00=item_99, Branch01=item_100, FlattenInputs=True)
bake_7 = BakeObjects(Geometry=entwine_17, Attributes=attributes_7, BakeName=panel_45, Bake=False)

# ----
# 4.0下层建筑内侧到300到外侧50内
# 无钢结构
# 要求主体结构提供钢结构梁，默认位置为建筑边线向内300mm
pln_93 = Plane(pln_12)
deplane_31 = DeconstructPlane(Plane=pln_93)  # -> Origin, XAxis, YAxis, ZAxis
amp_43 = Amplitude(Vector=deplane_31.YAxis, Amplitude=expr("-x", Slider(5000, range=0..10000)))
move_54 = Move(Geometry=deplane_31.Origin, Motion=amp_43)  # -> Geometry, Transform
ln_57 = Line(StartPoint=move_54.Geometry, EndPoint=deplane_31.Origin)
amp_44 = Amplitude(Vector=deplane_31.XAxis, Amplitude=number_slider_11)
amp_45 = Amplitude(Vector=deplane_31.XAxis, Amplitude=expr("-x", number_slider_11))
move_55 = Move(Geometry=ln_57, Motion=amp_45)  # -> Geometry, Transform
move_56 = Move(Geometry=ln_57, Motion=amp_44)  # -> Geometry, Transform
move_57 = Move(Geometry=pln_93, Motion=amp_45)  # -> Geometry, Transform
move_58 = Move(Geometry=pln_93, Motion=amp_44)  # -> Geometry, Transform

pln_94 = Plane(move_58.Geometry)
deplane_32 = DeconstructPlane(Plane=pln_94)  # -> Origin, XAxis, YAxis, ZAxis
amp_46 = Amplitude(Vector=deplane_32.YAxis, Amplitude=expr("-x", Slider(2000, range=0..10000)))
move_59 = Move(Geometry=deplane_32.Origin, Motion=amp_46)  # -> Geometry, Transform
ln_58 = Line(StartPoint=deplane_32.Origin, EndPoint=move_59.Geometry)
ccx_29 = CurveCurve(CurveA=flatten(crv_98), CurveB=simplify(graft(move_56.Geometry)))  # -> Points, ParamsA, ParamsB

pln_95 = Plane(pln_93)
# SmoothCurve-阴角
# SmoothCurve-阳角
# SmoothCurve-阴角
# SmoothCurve-正常
# Angular Curve - All
# Special Curve(with location)- All
# Curve for this project only - All
number_slider_48 = Slider(2000, range=0..10000)
deplane_33 = DeconstructPlane(Plane=pln_95)  # -> Origin, XAxis, YAxis, ZAxis
amp_47 = Amplitude(Vector=deplane_33.YAxis, Amplitude=expr("-x", number_slider_48))
move_60 = Move(Geometry=deplane_33.Origin, Motion=amp_47)  # -> Geometry, Transform
ln_59 = Line(StartPoint=deplane_33.Origin, EndPoint=move_60.Geometry)
ccx_30 = CurveCurve(CurveA=flatten(crv_98), CurveB=simplify(graft(move_55.Geometry)))  # -> Points, ParamsA, ParamsB

pln_96 = Plane(move_57.Geometry)
deplane_34 = DeconstructPlane(Plane=pln_96)  # -> Origin, XAxis, YAxis, ZAxis
amp_48 = Amplitude(Vector=deplane_34.YAxis, Amplitude=expr("-x", Slider(2000, range=0..10000)))
move_61 = Move(Geometry=deplane_34.Origin, Motion=amp_48)  # -> Geometry, Transform
ln_60 = Line(StartPoint=deplane_34.Origin, EndPoint=move_61.Geometry)
ccx_31 = CurveCurve(CurveA=flatten(crv_98), CurveB=simplify(graft(move_55.Geometry)))  # -> Points, ParamsA, ParamsB

shift_54 = ShiftPaths(Data=ccx_29.Points, Offset=-1)
shift_55 = ShiftPaths(Data=ccx_30.Points, Offset=-1)
shift_56 = ShiftPaths(Data=ccx_31.Points, Offset=-1)
merge_53 = Merge(Data1=shift_54, Data2=shift_56, Data3=shift_55)
item_101 = ListItem(List=merge_53, Index=0, Wrap=True)
null_35 = NullItem(Item=item_101)  # -> flatten(NullFlags), InvalidFlags, Description
pln_97 = Plane(pln_95)
dispatch_97 = Dispatch(List=pln_97, DispatchPattern=null_35.NullFlags)  # -> ListA, ListB
panel_73 = Panel(null_35.NullFlags)
pln_98 = Plane(dispatch_97.ListA)
deplane_35 = DeconstructPlane(Plane=pln_98)  # -> Origin, XAxis, YAxis, ZAxis
amp_49 = Amplitude(Vector=deplane_35.YAxis, Amplitude="-300")
move_62 = Move(Geometry=deplane_35.Origin, Motion=amp_49)  # -> Geometry, Transform
move2pt_16 = MoveToPoint(Geometry=pln_98, PointA=deplane_35.Origin, PointB=move_62.Geometry)  # -> Moved, Vector, Transform

# ----
# 4.0 默认位置为建筑边线向内300mm
# 侧埋，钢板焊
# 03：钢板焊埋件[钢梁外侧]@钢边梁宽@钢边梁高
data_65 = Data(flatten(merge_3))
pln_99 = Plane(move2pt_16.Moved)
item_102 = ListItem(List=data_65, Index=0, Wrap=True)
item_103 = ListItem(List=data_65, Index="-1", Wrap=True)
orient_8 = Orient(Geometry=item_102, Source=item_103, Target=pln_99)  # -> Geometry, Transform

data_66 = Data(orient_8.Geometry)
ungroup_11 = Ungroup(Group=data_66)
item_104 = ListItem(List=ungroup_11, Index=0, Wrap=True)  # -> flatten(Item)
item_105 = ListItem(List=ungroup_11, Index="-1", Wrap=True)  # -> flatten(Item)

# ---- group: 范围内没有钢梁，默认幕墙线向内300有一个埋件 (continued)
entwine_18 = Entwine(Branch00=item_104, Branch01=item_105, FlattenInputs=True)
bake_8 = BakeObjects(Geometry=entwine_18, Attributes=attributes_10, BakeName=panel_49, Bake=False)

# ----
# 3.1下层建筑内侧到300到外侧50内是否有钢结构
merge_54 = Merge(Data1=flatten(merge_43), Data2=flatten(merge_45), Data3=flatten(pln_98))
pln_100 = Plane(pln_93)
deplane_36 = DeconstructPlane(Plane=merge_54)  # -> Origin, XAxis, YAxis, ZAxis
deplane_37 = DeconstructPlane(Plane=pln_100)  # -> Origin, XAxis, YAxis, ZAxis
check_same_points_6 = CheckSamePoints(archPoint=deplane_37.Origin, crvPoint=deplane_36.Origin)  # -> out, specialPt; inputs archPoint: list of Point3d, crvPoint: list of Point3d; same code as testpoint

# ---- group: 有效筛选点
cull_i_10 = CullIndex(List=pln_100, Indices=check_same_points_6.specialPt, Wrap=True)

# ----
# 现在选取建筑向内最近的梁中线放埋件
pln_101 = Plane(cull_i_10)
flatten_7 = FlattenTree(Tree=crv_63, Path="{0}")
number_slider_49 = Slider(3584, range=0..10000)
deplane_38 = DeconstructPlane(Plane=pln_101)  # -> Origin, XAxis, YAxis, ZAxis
boundary_7 = BoundarySurfaces(Edges=[offset_12, offset_11])
amp_50 = Amplitude(Vector=deplane_38.YAxis, Amplitude=number_slider_49)
amp_51 = Amplitude(Vector=deplane_38.YAxis, Amplitude=expr("-x", number_slider_49))
scx_4 = SurfaceCurve(Surface=boundary_7, Curve=flatten_7)  # -> flatten(Curves), Points, UVPoints, Normals, Parameters, Tangents
move_63 = Move(Geometry=deplane_38.Origin, Motion=amp_51)  # -> Geometry, Transform
move_64 = Move(Geometry=deplane_38.Origin, Motion=amp_50)  # -> Geometry, Transform
ln_61 = Line(StartPoint=move_63.Geometry, EndPoint=move_64.Geometry)
ccx_32 = CurveCurve(CurveA=graft(ln_61), CurveB=crv_64)  # -> Points, ParamsA, ParamsB

ccx_33 = CurveCurve(CurveA=graft(ln_61), CurveB=flatten(crv_64))  # -> Points, ParamsA, ParamsB

shift_57 = ShiftPaths(Data=ccx_33.Points, Offset=-1)
pull_54 = PullPoint(Point=graft(pln_101), Geometry=shift_57, ClosestOnly=True)  # -> ClosestPoint, Distance
sort_44 = SortList(Keys=pull_54.Distance, ValuesA=pull_54.ClosestPoint)  # -> Keys, ValuesA
item_106 = ListItem(List=sort_44.ValuesA, Index=0, Wrap=True)
null_36 = NullItem(Item=sort_44.ValuesA)  # -> NullFlags, simplify(InvalidFlags), Description
dispatch_98 = Dispatch(List=simplify(graft(pln_101)), DispatchPattern=null_36.InvalidFlags)  # -> ListA, ListB
pln_102 = Plane(dispatch_98.ListA)
pln_103 = Plane(dispatch_98.ListB)
move2pt_17 = MoveToPoint(Geometry=pln_103, PointA=pln_103, PointB=simplify(item_106))  # -> flatten(Moved), Vector, Transform

# ---- group: 交点-属于哪个梁
data_67 = Data(move2pt_17.Moved)

# ----
# 按照梁分类定位点
crv_126 = Curve(shift_2)
incurves_14 = PointInCurves(Point=flatten(data_67), Curves=crv_126)  # -> Relationship, Index, Point
equals_22 = Equality(FirstNumber=incurves_14.Relationship, SecondNumber="0")  # -> Equality, Inequality
dispatch_99 = Dispatch(List=flatten(data_67), DispatchPattern=equals_22.Inequality)  # -> ListA, ListB

pt_77 = Point(dispatch_99.ListA)

# ----
# 可能的结构交点-大量
pln_104 = Plane(pln_102)

# ----
# 0 檐口出定位点
# 与结构无交点
pln_105 = Plane(flatten(pln_104))

# ----
# 4 Missing Point
# 埋件定位点Offset，没有找到和梁的交点
number_slider_50 = Slider(5000, range=0..10000)
deplane_39 = DeconstructPlane(Plane=pln_105)  # -> Origin, XAxis, YAxis, ZAxis
amp_52 = Amplitude(Vector=deplane_39.YAxis, Amplitude=expr("-x", number_slider_50))
move_65 = Move(Geometry=deplane_39.Origin, Motion=amp_52)  # -> Geometry, Transform
ln_62 = Line(StartPoint=move_65.Geometry, EndPoint=deplane_39.Origin)
amp_53 = Amplitude(Vector=deplane_39.XAxis, Amplitude=number_slider_11)
amp_54 = Amplitude(Vector=deplane_39.XAxis, Amplitude=expr("-x", number_slider_11))
move_66 = Move(Geometry=ln_62, Motion=amp_53)  # -> Geometry, Transform
move_67 = Move(Geometry=ln_62, Motion=amp_54)  # -> Geometry, Transform

ccx_34 = CurveCurve(CurveA=graft(move_67.Geometry), CurveB=flatten(crv_65))  # -> Points, ParamsA, ParamsB
shift_58 = ShiftPaths(Data=ccx_34.Points, Offset=-1)
sort_45 = SortList(Keys=shift_58, ValuesA=shift_58)  # -> Keys, ValuesA
pull_55 = PullPoint(Point=sort_45.ValuesA, Geometry=graft(pln_105), ClosestOnly=True)  # -> ClosestPoint, Distance
sort_46 = SortList(Keys=pull_55.Distance, ValuesA=sort_45.ValuesA)  # -> Keys, ValuesA
item_107 = ListItem(List=sort_46.ValuesA, Index="-1", Wrap=True)
null_37 = NullItem(Item=flatten(item_107))  # -> NullFlags, InvalidFlags, Description
dispatch_100 = Dispatch(List=flatten(item_107), DispatchPattern=null_37.InvalidFlags)  # -> ListA, ListB
dispatch_101 = Dispatch(List=pln_105, DispatchPattern=null_37.InvalidFlags)  # -> ListA, ListB
pt_78 = Point(dispatch_100.ListB)
pln_106 = Plane(dispatch_101.ListB)
move2pt_18 = MoveToPoint(Geometry=pln_106, PointA=pln_106, PointB=pt_78)  # -> Moved, Vector, Transform

ccx_35 = CurveCurve(CurveA=graft(move_66.Geometry), CurveB=flatten(crv_65))  # -> Points, ParamsA, ParamsB
shift_59 = ShiftPaths(Data=ccx_35.Points, Offset=-1)
sort_47 = SortList(Keys=shift_59, ValuesA=shift_59)  # -> Keys, ValuesA
pull_56 = PullPoint(Point=sort_47.ValuesA, Geometry=graft(pln_105), ClosestOnly=True)  # -> ClosestPoint, Distance
sort_48 = SortList(Keys=pull_56.Distance, ValuesA=sort_47.ValuesA)  # -> Keys, ValuesA
item_108 = ListItem(List=sort_48.ValuesA, Index="-1", Wrap=True)
null_38 = NullItem(Item=flatten(item_108))  # -> NullFlags, InvalidFlags, Description
dispatch_102 = Dispatch(List=pln_105, DispatchPattern=null_38.InvalidFlags)  # -> ListA, ListB
dispatch_103 = Dispatch(List=flatten(item_108), DispatchPattern=null_38.InvalidFlags)  # -> ListA, ListB
pln_107 = Plane(dispatch_102.ListB)
pt_79 = Point(dispatch_103.ListB)
move2pt_19 = MoveToPoint(Geometry=pln_107, PointA=pln_107, PointB=pt_79)  # -> Moved, Vector, Transform

merge_55 = Merge(Data1=move2pt_19.Moved, Data2=move2pt_18.Moved)

# ---- group: 交点-属于哪个梁
data_68 = Data(merge_55)

# ----
# 按照梁分类定位点
crv_127 = Curve(shift_2)
incurves_15 = PointInCurves(Point=flatten(data_68), Curves=crv_127)  # -> Relationship, Index, Point
equals_23 = Equality(FirstNumber=incurves_15.Relationship, SecondNumber="0")  # -> Equality, Inequality
dispatch_104 = Dispatch(List=flatten(data_68), DispatchPattern=equals_23.Inequality)  # -> ListA, ListB

pt_80 = Point(dispatch_104.ListA)

# ----
# 按照梁分类定位PLANE
shift_60 = ShiftPaths(Data=crv_99, Offset=-1)
shift_61 = ShiftPaths(Data=shift_60, Offset=-1)
pull_57 = PullPoint(Point=pt_77, Geometry=simplify(shift_61), ClosestOnly=True)  # -> ClosestPoint, Distance
ln_63 = Line(StartPoint=pull_57.ClosestPoint, EndPoint=pt_77)
movetoplane_15 = MoveToPlane(Geometry=crv_50, Plane=PlaneXY(0, 0, 0), Above=True, Below=True)  # -> Geometry, Transform

# ---- group: Y Axis Line-All
crv_128 = Curve(ln_63)

# ----
end_18 = EndPoints(Curve=graft(crv_128))  # -> Start, End
merge_56 = Merge(Data1=end_18.Start, Data2=end_18.End)
pull_58 = PullPoint(Point=merge_56, Geometry=movetoplane_15.Geometry, ClosestOnly=True)  # -> ClosestPoint, Distance
sort_49 = SortList(Keys=pull_58.Distance, ValuesA=merge_56)  # -> Keys, ValuesA
item_109 = ListItem(List=sort_49.ValuesA, Index="-1", Wrap=True)
item_110 = ListItem(List=sort_49.ValuesA, Index=0, Wrap=True)
pt_81 = Point(item_110)
pt_82 = Point(item_109)
ln_64 = Line(StartPoint=pt_82, EndPoint=pt_81)
rotate_21 = Rotate(Geometry=ln_64, Angle=1.570796327, Plane=pt_81)  # -> Geometry, Transform

pt_83 = Point(end_18.End)

pl_19 = ConstructPlane(Origin=pt_83, XAxis=rotate_21.Geometry, YAxis=ln_64)
null_39 = NullItem(Item=pl_19)  # -> NullFlags, InvalidFlags, Description
dispatch_105 = Dispatch(List=pl_19, DispatchPattern=null_39.NullFlags)  # -> ListA, ListB
pln_108 = Plane(dispatch_105.ListB)

shift_62 = ShiftPaths(Data=pln_108, Offset=-1)

# ---- group: 檐口-首次筛选的有效起始Plane
data_69 = Data(shift_62)

# ----
# 4.1下层建筑内侧300到外侧50内
# 03底埋，钢板焊
pln_109 = Plane(data_69)
data_70 = Data(data_24)
item_111 = ListItem(List=data_70, Index="-1", Wrap=True)
item_112 = ListItem(List=data_70, Index=0, Wrap=True)

# ----
# 按照梁分类定位PLANE
shift_63 = ShiftPaths(Data=crv_100, Offset=-1)
shift_64 = ShiftPaths(Data=shift_63, Offset=-1)
pull_59 = PullPoint(Point=pt_80, Geometry=simplify(shift_64), ClosestOnly=True)  # -> ClosestPoint, Distance
ln_65 = Line(StartPoint=pull_59.ClosestPoint, EndPoint=pt_80)
movetoplane_16 = MoveToPlane(Geometry=crv_51, Plane=PlaneXY(0, 0, 0), Above=True, Below=True)  # -> Geometry, Transform

# ---- group: Y Axis Line-All
crv_129 = Curve(ln_65)

# ----
end_19 = EndPoints(Curve=graft(crv_129))  # -> Start, End
merge_57 = Merge(Data1=end_19.Start, Data2=end_19.End)
pull_60 = PullPoint(Point=merge_57, Geometry=movetoplane_16.Geometry, ClosestOnly=True)  # -> ClosestPoint, Distance
sort_50 = SortList(Keys=pull_60.Distance, ValuesA=merge_57)  # -> Keys, ValuesA
item_113 = ListItem(List=sort_50.ValuesA, Index="-1", Wrap=True)
item_114 = ListItem(List=sort_50.ValuesA, Index=0, Wrap=True)
pt_84 = Point(item_114)
pt_85 = Point(item_113)
ln_66 = Line(StartPoint=pt_85, EndPoint=pt_84)
rotate_22 = Rotate(Geometry=ln_66, Angle=1.570796327, Plane=pt_84)  # -> Geometry, Transform

pt_86 = Point(end_19.End)

pl_20 = ConstructPlane(Origin=pt_86, XAxis=rotate_22.Geometry, YAxis=ln_66)
null_40 = NullItem(Item=pl_20)  # -> NullFlags, InvalidFlags, Description
dispatch_106 = Dispatch(List=pl_20, DispatchPattern=null_40.NullFlags)  # -> ListA, ListB
pln_110 = Plane(dispatch_106.ListB)

shift_65 = ShiftPaths(Data=pln_110, Offset=-1)

# ---- group: 檐口-首次筛选的有效起始Plane
data_71 = Data(shift_65)

# ----
# 撞到梁交点
pln_111 = Plane(data_71)

merge_58 = Merge(Data1=pln_109, Data2=pln_111)

# ---- group: All Location Point
merge_59 = Merge(Data1=merge_39, Data2=merge_49, Data3=merge_52, Data4=merge_58)

# ----
orient_9 = Orient(Geometry=item_10.Item, Source=item_10.Item1, Target=merge_58)  # -> Geometry, Transform

data_72 = Data(orient_9.Geometry)
ungroup_12 = Ungroup(Group=data_72)
item_115 = ListItem(List=ungroup_12, Index=0, Wrap=True)  # -> flatten(Item)
item_116 = ListItem(List=ungroup_12, Index="-1", Wrap=True)  # -> flatten(Item)

# ---- group: 钢结构下底埋 (continued)
entwine_19 = Entwine(Branch00=item_115, Branch01=item_116, FlattenInputs=True)
bake_9 = BakeObjects(Geometry=entwine_19, Attributes=attributes_8, BakeName=panel_47, Bake=False)

# ----
null_41 = NullItem(Item=merge_59)  # -> NullFlags, InvalidFlags, Description
dispatch_107 = Dispatch(List=merge_59, DispatchPattern=null_41.InvalidFlags)  # -> ListA, ListB

# ---- group: 下层图纸-标注定位点
pt_87 = Point(dispatch_107.ListB)

# ----
cluster_4 = Cluster_2(
    outline_curve=标准范围_符合单一轴网方向,
    dim_offset_1=number_slider_12,
    dim_offset_2=number_slider_9,
    axis_direction_crv1=crv_14,
    axis_direction_crv2=crv_15,
    f2_arch_outline=crv_58,
    location_point=pt_87,
    dim_style=panel_21,
    directed_outline=seam,
    移除重复位置点_容差=number_slider_10)  # -> D_3, D_4, D, D_2
dimension1 = Data(cluster_4.D_3)

# ---- group: Dimension4
data_73 = Data(cluster_4.D_2)

# ---- group: Dimension2
data_74 = Data(cluster_4.D_4)

# ---- group: Dimension3
data_75 = Data(cluster_4.D)

# ----
entwine_20 = Entwine(Branch00=dimension1, Branch01=data_74, Branch02=data_75, Branch03=data_73, FlattenInputs=True)

# ---- group: Refrash Data
# 将所有Input都输入完后要Refresh data
dam = DataDam(DataA=entwine_20, BufferDelay=10000000, BufferMode=0)

# ----
dedim = DeconstructDimension(DimensionObject=dam)  # -> Value, Text, Plane, Points, Style
shift_66 = ShiftPaths(Data=dedim.Text, Offset=-1)
smaller_11 = SmallerThan(FirstNumber=shift_66, SecondNumber=Slider(1, range=0..10))  # -> SmallerThan, OrEqualTo
dispatch_108 = Dispatch(List=dam, DispatchPattern=smaller_11.SmallerThan)  # -> ListA, ListB

# ---- group: Bake Me
bake_10 = BakeObjects(Geometry=dispatch_108.ListB, Attributes=attributes_11, Bake=False)

# ----
data_76 = Data(dispatch_108.ListB)

# ----
# 1.0无檐口线初筛-上层定位点
crv_130 = Curve(reb_2)
pln_112 = Plane(pln_19)
project_21 = Project(Geometry=crv_130, Plane=PlaneXY(0, 0, 0))  # -> Geometry, Transform
clscrv_8 = CloseCurve(Curve=project_21.Geometry, CloseType=0, Bulge=0.5, Tolerance=0)  # -> Closed, R

deplane_40 = DeconstructPlane(Plane=pln_112)  # -> Origin, XAxis, YAxis, ZAxis

pt_88 = Point(deplane_40.Origin)
incurve_8 = PointInCurve(Point=pt_88, Curve=clscrv_8.Closed)  # -> Relationship, Point

equals_24 = Equality(FirstNumber=incurve_8.Relationship, SecondNumber="2")  # -> Equality, Inequality
dispatch_109 = Dispatch(List=pln_112, DispatchPattern=equals_24.Equality)  # -> ListA, ListB
data_77 = Data(dispatch_109.ListB)

panel_74 = Panel(incurve_8.Relationship)

pln_113 = Plane(dispatch_109.ListA)

# ---- group: 1.0N的情况的Plane
pln_114 = Plane(pln_113)

# ----
# 5 上层建筑边线,
# 默认建筑提供上翻，如主结构提供示意则使用结构定位【该项目无】，
# 如无则使用建筑边线向内50mm作为埋件定位
deplane_41 = DeconstructPlane(Plane=pln_114)  # -> Origin, XAxis, YAxis, ZAxis
number_slider_51 = Slider(3584, range=0..10000)
amp_55 = Amplitude(Vector=deplane_41.YAxis, Amplitude=number_slider_51)
amp_56 = Amplitude(Vector=deplane_41.YAxis, Amplitude=expr("-x", number_slider_51))
move_68 = Move(Geometry=deplane_41.Origin, Motion=amp_56)  # -> Geometry, Transform
move_69 = Move(Geometry=deplane_41.Origin, Motion=amp_55)  # -> Geometry, Transform
ln_67 = Line(StartPoint=move_68.Geometry, EndPoint=move_69.Geometry)
ccx_36 = CurveCurve(CurveA=ln_67, CurveB=crv_52)  # -> simplify(Points), ParamsA, ParamsB
ln_68 = Line(StartPoint=ccx_36.Points, EndPoint=simplify(graft(pln_114)))
len_10 = Length(Curve=ln_68)
null_42 = NullItem(Item=ccx_36.Points)  # -> NullFlags, InvalidFlags, Description
sort_51 = SortList(Keys=len_10, ValuesA=simplify(ccx_36.Points))  # -> Keys, ValuesA
dispatch_110 = Dispatch(List=simplify(graft(pln_114)), DispatchPattern=null_42.NullFlags)  # -> ListA, ListB
item_117 = ListItem(List=sort_51.ValuesA, Index=0, Wrap=True)

# ----
# 可能的双点
pln_115 = Plane(dispatch_110.ListA)

# ----
# 0 檐口出定位点
# 与结构无交点
pln_116 = Plane(flatten(pln_115))

# ----
# 5 上层建筑边线,
# 默认建筑提供上翻
# 04：板埋埋件[混凝土楼板上侧]
# @板埋参数xn
move2pt_20 = MoveToPoint(Geometry=simplify(graft(pln_114)), PointA=simplify(graft(pln_114)), PointB=item_117)  # -> flatten(Moved), Vector, Transform

# ----
# 5  Missing Point
# 埋件定位点Offset，没有找到和梁的交点
number_slider_52 = Slider(5000, range=0..10000)
deplane_42 = DeconstructPlane(Plane=pln_116)  # -> Origin, XAxis, YAxis, ZAxis
crv_131 = Curve(crv_52)
amp_57 = Amplitude(Vector=deplane_42.YAxis, Amplitude=number_slider_52)
move_70 = Move(Geometry=deplane_42.Origin, Motion=amp_57)  # -> Geometry, Transform
ln_69 = Line(StartPoint=move_70.Geometry, EndPoint=deplane_42.Origin)
amp_58 = Amplitude(Vector=deplane_42.XAxis, Amplitude=number_slider_11)
amp_59 = Amplitude(Vector=deplane_42.XAxis, Amplitude=expr("-x", number_slider_11))
move_71 = Move(Geometry=ln_69, Motion=amp_58)  # -> Geometry, Transform
move_72 = Move(Geometry=ln_69, Motion=amp_59)  # -> Geometry, Transform
pln_117 = Plane(pln_116)

ccx_37 = CurveCurve(CurveA=graft(move_72.Geometry), CurveB=flatten(crv_131))  # -> Points, ParamsA, ParamsB
shift_67 = ShiftPaths(Data=ccx_37.Points, Offset=-1)
sort_52 = SortList(Keys=shift_67, ValuesA=shift_67)  # -> Keys, ValuesA
pull_61 = PullPoint(Point=sort_52.ValuesA, Geometry=graft(pln_116), ClosestOnly=True)  # -> ClosestPoint, Distance
sort_53 = SortList(Keys=pull_61.Distance, ValuesA=sort_52.ValuesA)  # -> Keys, ValuesA
item_118 = ListItem(List=sort_53.ValuesA, Index="-1", Wrap=True)
null_43 = NullItem(Item=flatten(item_118))  # -> NullFlags, InvalidFlags, Description
dispatch_111 = Dispatch(List=simplify(item_118), DispatchPattern=simplify(graft(null_43.InvalidFlags)))  # -> ListA, ListB
dispatch_112 = Dispatch(List=pln_116, DispatchPattern=null_43.InvalidFlags)  # -> ListA, ListB
pln_118 = Plane(dispatch_112.ListB)
pt_89 = Point(dispatch_111.ListB)

ccx_38 = CurveCurve(CurveA=graft(move_71.Geometry), CurveB=flatten(crv_131))  # -> Points, ParamsA, ParamsB
shift_68 = ShiftPaths(Data=ccx_38.Points, Offset=-1)
sort_54 = SortList(Keys=shift_68, ValuesA=shift_68)  # -> Keys, ValuesA
pull_62 = PullPoint(Point=sort_54.ValuesA, Geometry=graft(pln_116), ClosestOnly=True)  # -> ClosestPoint, Distance
sort_55 = SortList(Keys=pull_62.Distance, ValuesA=sort_54.ValuesA)  # -> Keys, ValuesA
item_119 = ListItem(List=sort_55.ValuesA, Index="-1", Wrap=True)
null_44 = NullItem(Item=flatten(item_119))  # -> NullFlags, InvalidFlags, Description
dispatch_113 = Dispatch(List=simplify(item_119), DispatchPattern=simplify(graft(null_44.InvalidFlags)))  # -> ListA, ListB
dispatch_114 = Dispatch(List=pln_116, DispatchPattern=null_44.InvalidFlags)  # -> ListA, ListB
pln_119 = Plane(dispatch_114.ListB)
pt_90 = Point(dispatch_113.ListB)

merge_60 = Merge(Data1=pln_119, Data2=pln_118)  # -> flatten(Result)
check_same_points_7 = CheckSamePoints(archPoint=flatten(pln_117), crvPoint=merge_60)  # -> out, specialPt; inputs archPoint: list of Point3d, crvPoint: list of Point3d; same code as testpoint

# ----
# 撞到结构
move2pt_21 = MoveToPoint(Geometry=flatten(pln_119), PointA=flatten(pln_119), PointB=flatten(pt_90))  # -> Moved, Vector, Transform
move2pt_22 = MoveToPoint(Geometry=flatten(pln_118), PointA=flatten(pln_118), PointB=flatten(pt_89))  # -> Moved, Vector, Transform

# ----
# pass
cull_i_11 = CullIndex(List=flatten(pln_117), Indices=check_same_points_7.specialPt, Wrap=True)  # -> simplify(graft(List))

# ----
# 撞到梁交点
merge_61 = Merge(Data1=flatten(move2pt_21.Moved), Data2=flatten(move2pt_22.Moved))

merge_62 = Merge(Data1=flatten(move2pt_20.Moved), Data2=flatten(merge_61))

# ---- group: All Location Point
merge_63 = Merge(Data1=merge_29, Data2=merge_33, Data3=merge_62)

# ----
deplane_43 = DeconstructPlane(Plane=merge_62)  # -> Origin, XAxis, YAxis, ZAxis
amp_60 = Amplitude(Vector=deplane_43.YAxis, Amplitude=len_6)
move_73 = Move(Geometry=merge_62, Motion=amp_60)  # -> Geometry, Transform
incurve_9 = PointInCurve(Point=move_73.Geometry, Curve=crv_53)  # -> Relationship, Point
panel_75 = Panel(incurve_9.Relationship)
equals_25 = Equality(FirstNumber=incurve_9.Relationship, SecondNumber="0")  # -> Equality, Inequality
dispatch_115 = Dispatch(List=move_73.Geometry, DispatchPattern=equals_25.Equality)  # -> ListA, ListB
data_78 = Data(dispatch_115.ListA)
data_79 = Data(dispatch_115.ListB)
amp_61 = Amplitude(Vector=deplane_43.YAxis, Amplitude=len_6)
move_74 = Move(Geometry=data_78, Motion=expr("-X", amp_61))  # -> Geometry, Transform
move_75 = Move(Geometry=move_74.Geometry, Motion=expr("-X", amp_61))  # -> Geometry, Transform
merge_64 = Merge(Data1=move_75.Geometry, Data2=data_79)
orient_10 = Orient(Geometry=item_33, Source=item_34, Target=merge_64)  # -> Geometry, Transform

data_80 = Data(orient_10.Geometry)
ungroup_13 = Ungroup(Group=data_80)
item_120 = ListItem(List=ungroup_13, Index=0, Wrap=True)  # -> flatten(Item)
item_121 = ListItem(List=ungroup_13, Index="-1", Wrap=True)  # -> flatten(Item)

# ---- group: 幕墙底部接地埋件 (continued)
entwine_21 = Entwine(Branch00=item_120, Branch01=item_121, FlattenInputs=True)
bake_11 = BakeObjects(Geometry=entwine_21, Attributes=attributes_9, BakeName=panel_51, Bake=False)

# ----
null_45 = NullItem(Item=merge_63)  # -> NullFlags, InvalidFlags, Description
dispatch_116 = Dispatch(List=merge_63, DispatchPattern=null_45.InvalidFlags)  # -> ListA, ListB

# ---- group: 下层图纸-标注定位点
pt_91 = Point(dispatch_116.ListB)

# ----
cluster_5 = Cluster_2(
    outline_curve=标准范围_符合单一轴网方向_2,
    dim_offset_1=number_slider_16,
    dim_offset_2=number_slider_15,
    axis_direction_crv1=crv_17,
    axis_direction_crv2=crv_18,
    f2_arch_outline=crv_59,
    location_point=pt_91,
    dim_style=panel_22,
    directed_outline=seam_2,
    移除重复位置点_容差=number_slider_13)  # -> D_3, D_4, D, D_2
dimension1_2 = Data(cluster_5.D_3)

# ---- group: Dimension2
data_81 = Data(cluster_5.D_4)

# ---- group: Dimension4
data_82 = Data(cluster_5.D_2)

# ---- group: Dimension3
data_83 = Data(cluster_5.D)

# ----
entwine_22 = Entwine(Branch00=dimension1_2, Branch01=data_81, Branch02=data_83, Branch03=data_82, FlattenInputs=True)

# ---- group: Refrash Data
# 将所有Input都输入完后要Refresh data
dam_2 = DataDam(DataA=entwine_22, BufferDelay=10000000, BufferMode=0)

# ----
dedim_2 = DeconstructDimension(DimensionObject=dam_2)  # -> Value, Text, Plane, Points, Style
shift_69 = ShiftPaths(Data=dedim_2.Text, Offset=-1)
smaller_12 = SmallerThan(FirstNumber=shift_69, SecondNumber=Slider(1, range=0..10))  # -> SmallerThan, OrEqualTo
dispatch_117 = Dispatch(List=dam_2, DispatchPattern=smaller_12.SmallerThan)  # -> ListA, ListB

# ---- group: Bake Me
bake_12 = BakeObjects(Geometry=dispatch_117.ListB, Attributes=attributes_12, Bake=False)

# ----
data_84 = Data(dispatch_117.ListB)

crv_132 = Curve(project_12.Geometry)
crv_133 = Curve([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])
merge_65 = Merge(Data1=crv_132, Data2=crv_133)  # -> flatten(Result)

# ----
# curve
crv_134 = Curve(merge_65)

angle = Angle(VectorA=crv_134, VectorB="1,0,0")  # -> Angle, Reflex
deg_5 = Degrees(Radians=angle.Angle)
number = NumberGroups(Number=deg_5, Difference="0.2")  # -> Groups, Indices
item_122 = ListItem(List=crv_134, Index=number.Indices, Wrap=True)  # -> simplify(Item)
panel_76 = Panel(number.Groups)
item_123 = ListItem(List=item_122, Index=0, Wrap=True)  # -> flatten(Item)
item_124 = ListItem(List=item_122, Index=0, Wrap=True)
bang_3 = ExplodeTree(Data=item_122)  # -> Branch0, Branch1, Branch2, Branch3, Branch4, Branch5
crv_135 = Curve(bang_3.Branch0)
crv_136 = Curve(bang_3.Branch1)
crv_137 = Curve(bang_3.Branch2)
crv_138 = Curve(bang_3.Branch3)
angle_2 = Angle(VectorA=item_124, VectorB=item_123)  # -> Angle, Reflex
deg_6 = Degrees(Radians=angle_2.Angle)
round_2 = Round(Number=deg_6, DecimalPlace="0")  # -> Nearest, Floor, Ceiling
equals_26 = Equality(FirstNumber=round_2.Nearest, SecondNumber="90")  # -> Equality, Inequality
panel_77 = Panel(round_2.Nearest)
dispatch_118 = Dispatch(List=item_123, DispatchPattern=equals_26.Equality)  # -> ListA, ListB
crv_139 = Curve(flatten(dispatch_118.ListA))
index = ItemIndex(List=item_123, Item=crv_139)
concat_4 = Concatenate(FragmentA="{", FragmentB=index)
concat_5 = Concatenate(FragmentA=concat_4, FragmentB="}")
tstat_3 = TreeStatistics(Tree=item_122)  # -> Paths, Length, Count
item_125 = ListItem(List=tstat_3.Paths, Index=0, Wrap=True)  # -> Item, Item1
item_126 = ListItem(List=concat_5, Index=0, Wrap=True)
# Sort Text
branch = TreeBranch(Tree=item_122, Path=item_125.Item, MaintainPaths=True)
branch_2 = TreeBranch(Tree=item_122, Path=item_126, MaintainPaths=True)

# ==== cluster Cluster
G = ClusterInput()
rotate = Rotate(Geometry=G, Angle=3.141592654, Plane=PlaneXY(0, 0, 0))  # -> Geometry, Transform
boxprop = BoxProperties(Box=rotate.Geometry)  # -> Center, Diagonal, Area, Volume, Degeneracy
bbox = BoundingBox(Content=rotate.Geometry, Plane=PlaneXY(0, 0, 0))  # -> Box, Box_2
debox = DeconstructBox(Box=bbox.Box)  # -> Plane, X, Y, Z
pdecon = Deconstruct(Point=boxprop.Center)  # -> XComponent, YComponent, ZComponent
dedomain = DeconstructDomain(Domain=debox.Y)  # -> Start, End
pt = ConstructPoint(XCoordinate=pdecon.XComponent, YCoordinate=dedomain.Start, ZCoordinate=pdecon.ZComponent)
xy = XYPlane(Origin=Point(0, 0, 0))
pl_origin = PlaneOrigin(Base=xy, Origin=pt)
orient = Orient(Geometry=rotate.Geometry, Source=pl_origin, Target=xy)  # -> Geometry, Transform
G_2 = ClusterOutput(orient.Geometry)

# ==== cluster Cluster_2
f2_arch_outline = ClusterInput()
directed_outline = ClusterInput()
location_point = ClusterInput()
移除重复位置点_容差 = ClusterInput()
dim_offset_1 = ClusterInput()
dim_offset_2 = ClusterInput()
axis_direction_crv1 = ClusterInput()
axis_direction_crv2 = ClusterInput()
dim_style = ClusterInput()
outline_curve = ClusterInput()
pt = Point(location_point)
merge = Merge(Data1=axis_direction_crv1, Data2=axis_direction_crv2)
crv = Curve(f2_arch_outline)
number_slider = Slider(61, range=0..100)

incurve = PointInCurve(Point=flatten(pt), Curve=outline_curve)  # -> Relationship, Point
equals = Equality(FirstNumber=incurve.Relationship, SecondNumber="0")  # -> Equality, Inequality
dispatch = Dispatch(List=flatten(pt), DispatchPattern=equals.Inequality)  # -> ListA, ListB
pt_2 = Point(dispatch.ListA)
crv_cp = CurveClosestPoint(Point=pt_2, Curve=directed_outline)  # -> Point, Parameter, Distance
sort = SortList(Keys=crv_cp.Parameter, ValuesA=pt_2)  # -> Keys, ValuesA
pt_3 = Point(sort.ValuesA)
item = ListItem(List=merge, Index=0, Wrap=True)  # -> Item, Item1

# ----
# remove重复定位点生成的2个点
pt_4 = Point(pt_3)
shift = ShiftList(List=pt_4, Shift=1, Wrap=invert(True))
pt_5 = Point(pt_3)
pt_6 = Point(shift)
dist = Distance(PointA=pt_5, PointB=pt_6)
larger = LargerThan(FirstNumber=dist, SecondNumber=移除重复位置点_容差)  # -> LargerThan, OrEqualTo
dispatch_2 = Dispatch(List=pt_5, DispatchPattern=larger.LargerThan)  # -> ListA, ListB
pt_7 = Point(dispatch_2.ListA)
pt_8 = Point(dispatch_2.ListB)

dispatch_3 = Dispatch(List=pt_7, DispatchPattern=[True, False])  # -> ListA, ListB
pt_9 = Point(dispatch_3.ListB)
pt_10 = Point(dispatch_3.ListA)
pl = ConstructPlane(Origin=pt_10, XAxis=item.Item1, YAxis=item.Item)
pl_2 = ConstructPlane(Origin=pt_10, XAxis=item.Item, YAxis=item.Item1)

item_2 = ListItem(List=pt_7, Index=number_slider, Wrap=True)
shift_2 = ShiftList(List=pt_7, Shift=1, Wrap=invert(True))
item_3 = ListItem(List=shift_2, Index=number_slider, Wrap=True)

dispatch_4 = Dispatch(List=shift_2, DispatchPattern=[True, False])  # -> ListA, ListB
item_4 = ListItem(List=merge, Index=0, Wrap=True)  # -> Item, Item1
pt_11 = Point(dispatch_4.ListB)
pt_12 = Point(dispatch_4.ListA)
pl_3 = ConstructPlane(Origin=pt_12, XAxis=item_4.Item1, YAxis=item_4.Item)
pl_4 = ConstructPlane(Origin=pt_12, XAxis=item_4.Item, YAxis=item_4.Item1)

ln = Line(StartPoint=pt_10, EndPoint=pt_9)
ln_2 = Line(StartPoint=pt_12, EndPoint=pt_11)

crv_2 = Curve(crv)
deplane = DeconstructPlane(Plane=pl_3)  # -> Origin, XAxis, YAxis, ZAxis
amp = Amplitude(Vector=deplane.YAxis, Amplitude=Slider(3000, range=0..10000))
move = Move(Geometry=deplane.Origin, Motion=amp)  # -> Geometry, Transform
clscrv = CloseCurve(Curve=crv_2, CloseType=0, Bulge=0.5, Tolerance=0)  # -> Closed, R
pt_13 = Point(move.Geometry)
incurve_2 = PointInCurve(Point=pt_13, Curve=clscrv.Closed)  # -> Relationship, Point
equals_2 = Equality(FirstNumber=incurve_2.Relationship, SecondNumber="2")  # -> Equality, Inequality
lng = ListLength(List=equals_2.Equality)
lng_2 = ListLength(List=equals_2.Equality)
neg = Negative(Value=dim_offset_1)
repeat = RepeatData(Data=graft(neg), Length=lng)
repeat_2 = RepeatData(Data=graft(dim_offset_1), Length=lng_2)
panel = Panel(equals_2.Equality)
dispatch_5 = Dispatch(List=graft(repeat_2), DispatchPattern=graft(equals_2.Equality))  # -> ListA, ListB
dispatch_6 = Dispatch(List=graft(repeat), DispatchPattern=graft(equals_2.Equality))  # -> ListA, ListB
merge_2 = Merge(Data1=dispatch_5.ListA, Data2=dispatch_6.ListB)  # -> flatten(Result)

crv_3 = Curve(crv)
deplane_2 = DeconstructPlane(Plane=pl_4)  # -> Origin, XAxis, YAxis, ZAxis
amp_2 = Amplitude(Vector=deplane_2.YAxis, Amplitude=Slider(3000, range=0..10000))
move_2 = Move(Geometry=deplane_2.Origin, Motion=amp_2)  # -> Geometry, Transform
clscrv_2 = CloseCurve(Curve=crv_3, CloseType=0, Bulge=0.5, Tolerance=0)  # -> Closed, R
pt_14 = Point(move_2.Geometry)
incurve_3 = PointInCurve(Point=pt_14, Curve=clscrv_2.Closed)  # -> Relationship, Point
equals_3 = Equality(FirstNumber=incurve_3.Relationship, SecondNumber="2")  # -> Equality, Inequality
lng_3 = ListLength(List=equals_3.Equality)
neg_2 = Negative(Value=dim_offset_1)
lng_4 = ListLength(List=equals_3.Equality)
repeat_3 = RepeatData(Data=graft(neg_2), Length=lng_4)
repeat_4 = RepeatData(Data=graft(dim_offset_1), Length=lng_3)
panel_2 = Panel(equals_3.Equality)
dispatch_7 = Dispatch(List=graft(repeat_4), DispatchPattern=graft(equals_3.Equality))  # -> ListA, ListB
dispatch_8 = Dispatch(List=graft(repeat_3), DispatchPattern=graft(equals_3.Equality))  # -> ListA, ListB
merge_3 = Merge(Data1=dispatch_7.ListA, Data2=dispatch_8.ListB)  # -> flatten(Result)

crv_4 = Curve(crv)
deplane_3 = DeconstructPlane(Plane=pl)  # -> Origin, XAxis, YAxis, ZAxis
amp_3 = Amplitude(Vector=deplane_3.YAxis, Amplitude=Slider(3000, range=0..10000))
move_3 = Move(Geometry=deplane_3.Origin, Motion=amp_3)  # -> Geometry, Transform
clscrv_3 = CloseCurve(Curve=crv_4, CloseType=0, Bulge=0.5, Tolerance=0)  # -> Closed, R
pt_15 = Point(move_3.Geometry)
incurve_4 = PointInCurve(Point=pt_15, Curve=clscrv_3.Closed)  # -> Relationship, Point
equals_4 = Equality(FirstNumber=incurve_4.Relationship, SecondNumber="2")  # -> Equality, Inequality
lng_5 = ListLength(List=equals_4.Equality)
neg_3 = Negative(Value=dim_offset_2)
lng_6 = ListLength(List=equals_4.Equality)
repeat_5 = RepeatData(Data=graft(neg_3), Length=lng_6)
repeat_6 = RepeatData(Data=graft(dim_offset_2), Length=lng_5)
panel_3 = Panel(equals_4.Equality)
dispatch_9 = Dispatch(List=graft(repeat_6), DispatchPattern=graft(equals_4.Equality))  # -> ListA, ListB
dispatch_10 = Dispatch(List=graft(repeat_5), DispatchPattern=graft(equals_4.Equality))  # -> ListA, ListB
merge_4 = Merge(Data1=dispatch_9.ListA, Data2=dispatch_10.ListB)  # -> flatten(Result)

crv_5 = Curve(crv)
deplane_4 = DeconstructPlane(Plane=pl_2)  # -> Origin, XAxis, YAxis, ZAxis
amp_4 = Amplitude(Vector=deplane_4.YAxis, Amplitude=Slider(3000, range=0..10000))
move_4 = Move(Geometry=deplane_4.Origin, Motion=amp_4)  # -> Geometry, Transform
clscrv_4 = CloseCurve(Curve=crv_5, CloseType=0, Bulge=0.5, Tolerance=0)  # -> Closed, R
pt_16 = Point(move_4.Geometry)
incurve_5 = PointInCurve(Point=pt_16, Curve=clscrv_4.Closed)  # -> Relationship, Point
equals_5 = Equality(FirstNumber=incurve_5.Relationship, SecondNumber="2")  # -> Equality, Inequality
lng_7 = ListLength(List=equals_5.Equality)
neg_4 = Negative(Value=dim_offset_2)
lng_8 = ListLength(List=equals_5.Equality)
repeat_7 = RepeatData(Data=graft(neg_4), Length=lng_8)
repeat_8 = RepeatData(Data=graft(dim_offset_2), Length=lng_7)
panel_4 = Panel(equals_5.Equality)
dispatch_11 = Dispatch(List=graft(repeat_8), DispatchPattern=graft(equals_5.Equality))  # -> ListA, ListB
dispatch_12 = Dispatch(List=graft(repeat_7), DispatchPattern=graft(equals_5.Equality))  # -> ListA, ListB
merge_5 = Merge(Data1=dispatch_11.ListA, Data2=dispatch_12.ListB)  # -> flatten(Result)

lineardim = DefineLinearDimension(
    Point1=simplify(pt_12),
    Point2=simplify(pt_11),
    DimensionPlane=simplify(pl_3),
    Offset=expr("-x", merge_2),
    DimensionStyle=dim_style)
lineardim_2 = DefineLinearDimension(
    Point1=simplify(pt_12),
    Point2=simplify(pt_11),
    DimensionPlane=simplify(pl_4),
    Offset=expr("-x", merge_3),
    DimensionStyle=dim_style)
lineardim_3 = DefineLinearDimension(
    Point1=simplify(pt_10),
    Point2=simplify(pt_9),
    DimensionPlane=simplify(pl),
    Offset=expr("-x", merge_4),
    DimensionStyle=dim_style)
lineardim_4 = DefineLinearDimension(
    Point1=simplify(pt_10),
    Point2=simplify(pt_9),
    DimensionPlane=simplify(pl_2),
    Offset=expr("-x", merge_5),
    DimensionStyle=dim_style)
D = ClusterOutput(lineardim)
D_2 = ClusterOutput(lineardim_2)
D_3 = ClusterOutput(lineardim_3)
D_4 = ClusterOutput(lineardim_4)

# ==== cluster Cluster_3
structure_number = ClusterInput()
tag_text = ClusterInput()
text_offset = ClusterInput()
embed_color = ClusterInput()
T = ClusterInput()
G = ClusterInput()
A = ClusterInput()
A_2 = ClusterInput()
B = ClusterInput()
dimension_style = ClusterInput()

# ----
# 列表文字以空格进行分割
panel = Panel(" ")
split = TextSplit(Text=T, Separators=panel)

钢埋板长度_2 = Division(A=A, B=2)
neg = Negative(Value=钢埋板长度_2)
dom = ConstructDomain(DomainStart=neg, DomainEnd=钢埋板长度_2)
panel_2 = Panel(dom)

钢埋板厚度_2 = Division(A=A_2, B=2)
neg_2 = Negative(Value=钢埋板厚度_2)
dom_2 = ConstructDomain(DomainStart=neg_2, DomainEnd=钢埋板厚度_2)
panel_3 = Panel(dom_2)

# ----
# 钢埋板肋板位置 1/4处
panel_4 = Panel("4")
division = Division(A=A, B=panel_4)

# ----
# 编号和截面尺寸分区
panel_5 = Panel("1")
split_2 = SplitList(List=split, Index=panel_5)  # -> flatten(ListA), flatten(ListB)

# ----
# 求出对应输入编号的钢结构截面尺寸
fsim = FindSimilarMember(Data=structure_number, Set=split_2.ListA)  # -> Hit, Index
item = ListItem(List=split_2.ListB, Index=fsim.Index, Wrap=True)

addition = Addition(A=neg_2, B=division)
addition_2 = Addition(A=钢埋板厚度_2, B=division)
dom_3 = ConstructDomain(DomainStart=addition, DomainEnd=addition_2)
panel_6 = Panel(split_2.ListB)
split_3 = TextSplit(Text=item, Separators="x")
split_4 = TextSplit(Text=split_3, Separators="Q")
item_2 = ListItem(List=split_4, Index="0", Wrap=True)  # -> flatten(Item)
subtraction = Subtraction(A=division, B=钢埋板厚度_2)
subtraction_2 = Subtraction(A=division, B=钢埋板厚度_2)
subtraction_3 = Subtraction(A=division, B=钢埋板厚度_2)
neg_3 = Negative(Value=钢埋板厚度_2)
neg_4 = Negative(Value=钢埋板厚度_2)
neg_5 = Negative(Value=钢埋板厚度_2)
subtraction_4 = Subtraction(A=division, B=钢埋板厚度_2)
addition_3 = Addition(A=subtraction, B=A_2)
addition_4 = Addition(A=subtraction_2, B=A_2)
subtraction_5 = Subtraction(A=neg_3, B=A_2)
subtraction_6 = Subtraction(A=neg_4, B="2")
subtraction_7 = Subtraction(A=division, B=钢埋板厚度_2)
addition_5 = Addition(A=subtraction_3, B="2")
subtraction_8 = Subtraction(A=neg_5, B="2")
neg_6 = Negative(Value=钢埋板厚度_2)
neg_7 = Negative(Value=钢埋板厚度_2)
工字钢_h = ListItem(List=item_2, Index=0, Wrap=True)
工字钢_b = ListItem(List=item_2, Index=1, Wrap=True)
工字钢_tf = ListItem(List=item_2, Index=3, Wrap=True)
工字钢_tw = ListItem(List=item_2, Index=2, Wrap=True)
pt = ConstructPoint(XCoordinate=neg_6, YCoordinate=subtraction_4, ZCoordinate=0)
pt_2 = ConstructPoint(XCoordinate=neg_7, YCoordinate=addition_3, ZCoordinate=0)
pt_3 = ConstructPoint(XCoordinate=subtraction_5, YCoordinate=addition_4, ZCoordinate=0)
pt_4 = ConstructPoint(XCoordinate=subtraction_6, YCoordinate=subtraction_7, ZCoordinate=0)
pt_5 = ConstructPoint(XCoordinate=subtraction_8, YCoordinate=addition_5, ZCoordinate=0)
subtraction_9 = Subtraction(A=工字钢_b, B=工字钢_tw)
division_2 = Division(A=subtraction_9, B="2")
merge = Merge(Data1=pt, Data2=pt_2, Data3=pt_3, Data4=pt_5, Data5=pt_4)
pline = PolyLine(Vertices=merge, Closed=True)
division_3 = Division(A=division_2, B="2")
subtraction_10 = Subtraction(A=division_3, B=A_2)
subtraction_11 = Subtraction(A=division_3, B=钢埋板厚度_2)
neg_8 = Negative(Value=division_3)
subtraction_12 = Subtraction(A=neg_8, B=subtraction_11)
addition_6 = Addition(A=subtraction_12, B=B)
dom_4 = ConstructDomain(DomainStart=addition_6, DomainEnd=subtraction_12)
dom_5 = ConstructDomain(DomainStart=addition, DomainEnd=addition_2)
钢肋板倒角_侧视图 = Rectangle(Plane=PlaneXY(0, 0, 0), XSize=dom_4, YSize=dom_5, Radius=0)  # -> Rectangle, Length
subtraction_13 = Subtraction(A=subtraction_10, B=subtraction_11)
subtraction_14 = Subtraction(A=neg_8, B=subtraction_11)
dom_6 = ConstructDomain(DomainStart=subtraction_13, DomainEnd=subtraction_14)
钢肋板_侧视图 = Rectangle(Plane=PlaneXY(0, 0, 0), XSize=dom_6, YSize=dom_3, Radius=0)  # -> Rectangle, Length
merge_2 = Merge(Data1=钢肋板_侧视图.Rectangle, Data2=pline, Data3=钢肋板倒角_侧视图.Rectangle)
xz = XZPlane(Origin=Point(0, 0, 0))
mirror = Mirror(Geometry=merge_2, Plane=xz)  # -> Geometry, Transform
钢埋板_侧视图 = Rectangle(Plane=PlaneXY(0, 0, 0), XSize=dom_2, YSize=dom, Radius=0)  # -> Rectangle, Length
division_4 = Division(A=工字钢_b, B=2)
侧视图 = Entwine(Branch00=钢埋板_侧视图.Rectangle, Branch01=merge_2, Branch02=mirror.Geometry, FlattenInputs=True)
R = ClusterOutput(division_4)
division_5 = Division(A=工字钢_h, B="2")
subtraction_15 = Subtraction(A=division_5, B=工字钢_tf)
addition_7 = Addition(A=subtraction_15, B=Slider(200, range=0..1000))
addition_8 = Addition(A=addition_7, B=division_2)
X = UnitX(Factor=addition_8)
move = Move(Geometry=侧视图, Motion=X)  # -> Geometry, Transform
split_tree = SplitTree(Data=move.Geometry, Masks=flatten("{0;0}"))  # -> Positive, Negative
dispatch = Dispatch(List=split_tree.Negative, DispatchPattern=[True, False])  # -> flatten(ListA), ListB
merge_3 = Merge(Data1=split_tree.Positive, Data2=dispatch.ListA)
entwine = Entwine(Branch00=merge_3, Branch01=dispatch.ListB, FlattenInputs=True)
flatten = FlattenTree(Tree=entwine, Path="{0}")
group = Group(Objects=flatten)
rotate = Rotate(Geometry=group, Angle=3.141592654, Plane=PlaneXY(0, 0, 0))  # -> Geometry, Transform
boxprop = BoxProperties(Box=rotate.Geometry)  # -> Center, Diagonal, Area, Volume, Degeneracy
bbox = BoundingBox(Content=rotate.Geometry, Plane=PlaneXY(0, 0, 0))  # -> Box, Box_2
debox = DeconstructBox(Box=bbox.Box)  # -> Plane, X, Y, Z
pdecon = Deconstruct(Point=boxprop.Center)  # -> XComponent, YComponent, ZComponent
dedomain = DeconstructDomain(Domain=debox.Y)  # -> Start, End
pt_6 = ConstructPoint(XCoordinate=pdecon.XComponent, YCoordinate=dedomain.Start, ZCoordinate=pdecon.ZComponent)
xy = XYPlane(Origin=Point(0, 0, 0))
concat = Concatenate(FragmentA="Embed", FragmentB=tag_text)
pl_origin = PlaneOrigin(Base=xy, Origin=pt_6)
orient = Orient(Geometry=rotate.Geometry, Source=pl_origin, Target=xy)  # -> Geometry, Transform
xy_2 = XYPlane(Origin=Point(0, 0, 0))
attributes = DefineObjectAttributes(Color=embed_color)
ungroup = Ungroup(Group=orient.Geometry)
block = DefineBlock(Geometry=ungroup, Attributes=attributes, BlockName=concat, BasePlane=PlaneXY(0, 0, 0))
deblock = DeconstructBlock(Block=block)  # -> Name, flatten(Plane), flatten(Geometry)
group_2 = Group(Objects=deblock.Geometry)
bbox_2 = BoundingBox(Content=group_2, Plane=PlaneXY(0, 0, 0))  # -> Box, Box_2
deplane = DeconstructPlane(Plane=deblock.Plane)  # -> Origin, XAxis, YAxis, ZAxis
area = Area(Geometry=bbox_2.Box)  # -> Area, Centroid
move2pt = MoveToPoint(Geometry=flatten(deplane.Origin), PointA=flatten(deplane.Origin), PointB=flatten(area.Centroid))  # -> Moved, Vector, Transform
pl = ConstructPlane(Origin=move2pt.Moved, XAxis=deplane.YAxis, YAxis=deplane.XAxis)  # -> graft(Plane)
deplane_2 = DeconstructPlane(Plane=pl)  # -> Origin, XAxis, YAxis, ZAxis
rotate_2 = Rotate(Geometry=pl, Angle="Pi", Plane=pl)  # -> Geometry, Transform
dedomain_2 = DeconstructDomain(Domain=dom)  # -> Start, End
multiplication = Multiplication(A=dedomain_2.Start, B=dedomain_2.Start)
amp = Amplitude(Vector=deplane_2.YAxis, Amplitude=multiplication)
move_2 = Move(Geometry=deplane_2.Origin, Motion=amp)  # -> Geometry, Transform
srf = Surface(bbox_2.Box)
crv = Curve(srf)
ln = Line(StartPoint=move_2.Geometry, EndPoint=deplane_2.Origin)
ccx = CurveCurve(CurveA=ln, CurveB=crv)  # -> Points, ParamsA, ParamsB
ln_2 = Line(StartPoint=deplane_2.Origin, EndPoint=ccx.Points)
move_3 = Move(Geometry=rotate_2.Geometry, Motion=ln_2)  # -> Geometry, Transform

ln_3 = Line(StartPoint=ccx.Points, EndPoint=deplane_2.Origin)
amp_2 = Amplitude(Vector=ln_3, Amplitude=text_offset)
move_4 = Move(Geometry=rotate_2.Geometry, Motion=amp_2)  # -> Geometry, Transform
text = DefineTextObject(Text=tag_text, Plane=move_4.Geometry, DimensionStyle=dimension_style, OutputType="Text")
group_3 = Group(Objects=[block, text])

entwine_2 = Entwine(Branch00=group_3, Branch01=move_3.Geometry, FlattenInputs=True)
project = Project(Geometry=G, Plane=xy_2)  # -> Geometry, Transform
R_2 = ClusterOutput(entwine_2)
G_2 = ClusterOutput(project.Geometry)
