# Grasshopper definition FacadeEmbed_jinqiao.gh (Grasshopper 1.0.7)
# plug-ins: EleFront, Wombat, Hare

# ---- group: 钢结构预埋
crv = Curve([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])

# ---- group: 板槽
inblock = InsertBlock(BlockName="xxx", SourcePlane=PlaneXY(0, 0, 0))

# ---- group: 锚筋间距
s_x = Slider(25, range=14..60, expression="X*5")
s_y = Slider(20, range=14..60, expression="X*5")

s_x_2 = Slider(25, range=14..60, expression="X*5")
s_y_2 = Slider(20, range=14..60, expression="X*5")

# ----
# 单体选型
list = ValueList({"板埋": 0, "槽埋": 1, "板槽": 2, "钢板槽": 3}, selected="板槽")
list_2 = ValueList({"顶埋": 0, "侧埋": 1}, selected="顶埋")
panel = Panel(list)
panel_2 = Panel(list_2)

# ---- group: 螺栓直径
list_3 = ValueList({"10": 0, "12": 1, "16": 2, "18": 3, "20": 4, "25": 5}, selected="16")

# ---- group: 锚筋直径
list_4 = ValueList({"10": 0, "12": 1, "16": 2, "18": 3, "20": 4, "25": 5}, selected="12")

# ---- group: 列
list_5 = ValueList({"2X": 0, "3X": 1, "4X": 2}, selected="3X")

# ---- group: 行
list_6 = ValueList({"2Y": 0, "3Y": 1, "4Y": 2}, selected="2Y")

# ---- group: 螺栓直径
list_7 = ValueList({"10": 0, "12": 1, "16": 2, "18": 3, "20": 4, "25": 5}, selected="16")

# ---- group: 锚筋直径
list_8 = ValueList({"10": 0, "12": 1, "16": 2, "18": 3, "20": 4, "25": 5}, selected="12")

# ---- group: 列
list_9 = ValueList({"2X": 0, "3X": 1, "4X": 2}, selected="3X")

# ---- group: 行
list_10 = ValueList({"2Y": 0, "3Y": 1, "4Y": 2}, selected="2Y")

# ---- group: 混凝土
# 板埋几何INPUT
list_11 = ValueList({"C15": 0, "C20": 1, "C25": 2, "C30": 3, "C35": 4, "C40": 5}, selected="C35")

# ---- group: 钢筋牌号
list_12 = ValueList({"HPB300": 0, "HRB400": 1}, selected="HPB300")

# ---- group: 直径
list_13 = ValueList({"10": 0, "12": 1, "16": 2, "18": 3, "20": 4, "25": 5}, selected="12")

# ---- group: 列
list_14 = ValueList({"2X": 0, "3X": 1, "4X": 2}, selected="3X")

# ---- group: 行
list_15 = ValueList({"2Y": 0, "3Y": 1, "4Y": 2}, selected="2Y")

# ---- group: 锚筋间距
s_x_3 = Slider(22, range=14..60, expression="X*5")
s_y_3 = Slider(22, range=14..60, expression="X*5")

# ----
# 槽埋-角部选择
list_16 = ValueList({"槽埋角部-L形": 0, "槽埋角部-I形": 1}, selected="槽埋角部-I形")

# ---- group: 钢结构预埋
# 随文件数据请勿覆盖
crv_2 = Curve([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])

# ---- group: 槽埋3D
brep = Brep(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)

# ----
max = Maximum(A=s_x_3, B=s_y_3)
filter = StreamFilter(Gate=list_11, Stream0=7.2, Stream1=9.6, Stream2=11.9, Stream3=14.3, Stream4=16.7, Stream5=19.1)
filter_2 = StreamFilter(Gate=list_12, Stream0=270, Stream1=360)
filter_3 = StreamFilter(Gate=list_13, Stream0=10, Stream1=12, Stream2=16, Stream3=18, Stream4=20, Stream5=25)
filter_4 = StreamFilter(Gate=list_11, Stream0=0.91, Stream1=1.1, Stream2=1.27, Stream3=1.43, Stream4=1.57, Stream5=1.71)
filter_5 = StreamFilter(Gate=list_12, Stream0=0.16, Stream1=0.14)
addition = Addition(A=list_14, B=1)
addition_2 = Addition(A=list_15, B=1)
division = Division(A=max, B=8)
t = Integer(division)
panel_3 = Panel(filter_4)
panel_4 = Panel(filter)
panel_5 = Panel(filter_5)
min = Minimum(A=filter_2, B=300)
brep_2 = Brep(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)
panel_6 = Panel(min)
expression = Expression(A=filter_5, fy=filter_2, ft=filter_4, d=filter_3, Expression="(int((0.6*1.1*A*fy/ft*d)/5)+1)*5")

# ----
# 导入槽埋模型
brep_3 = Brep(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)

# ---- group: 槽埋
# 槽埋Modeling
brep_4 = Brep(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)
bbox = BoundingBox(Content=brep_3, Plane=PlaneXY(0, 0, 0))  # -> Box, Box_2
debox = DeconstructBox(Box=bbox.Box)  # -> Plane, X, Y, Z
area = Area(Geometry=brep_3)  # -> Area, Centroid
pdecon = Deconstruct(Point=area.Centroid)  # -> XComponent, YComponent, ZComponent
dedomain = DeconstructDomain(Domain=debox.Z)  # -> Start, End
xy = XYPlane(Origin=Point(0, 0, 0))
pt = ConstructPoint(XCoordinate=pdecon.XComponent, YCoordinate=pdecon.YComponent, ZCoordinate=dedomain.End)
pl_origin = PlaneOrigin(Base=xy, Origin=pt)
xy_2 = XYPlane(Origin=Point(0, 0, 0))
orient = Orient(Geometry=brep_3, Source=pl_origin, Target=xy_2)  # -> Geometry, Transform

# ----
edges = BrepEdges(Brep=bbox.Box)  # -> Naked, Interior, NonManifold
item = ListItem(List=edges.Interior, Index="5", Wrap=True)
item_2 = ListItem(List=edges.Interior, Index="4", Wrap=True)
clx = CurveLine(Curve=item_2, Line=item)  # -> Points, Params, Count
Y = UnitY(Factor=item)
rotate = Rotate(Geometry=brep_3, Angle=1.570796327, Plane=clx.Points)  # -> Geometry, Transform
move = Move(Geometry=rotate.Geometry, Motion=Y)  # -> Geometry, Transform
merge = Merge(Data1=brep_3, Data2=move.Geometry)  # -> flatten(Result)
sunion = SolidUnion(Breps=merge)
bbox_2 = BoundingBox(Content=sunion, Plane=PlaneXY(0, 0, 0))  # -> Box, Box_2
area_2 = Area(Geometry=sunion)  # -> Area, Centroid
debox_2 = DeconstructBox(Box=bbox_2.Box)  # -> Plane, X, Y, Z
pdecon_2 = Deconstruct(Point=area_2.Centroid)  # -> XComponent, YComponent, ZComponent
dedomain_2 = DeconstructDomain(Domain=debox_2.Z)  # -> Start, End
pt_2 = ConstructPoint(XCoordinate=pdecon_2.XComponent, YCoordinate=pdecon_2.YComponent, ZCoordinate=dedomain_2.End)
xy_3 = XYPlane(Origin=Point(0, 0, 0))
pl_origin_2 = PlaneOrigin(Base=xy_3, Origin=pt_2)
xy_4 = XYPlane(Origin=Point(0, 0, 0))
orient_2 = Orient(Geometry=sunion, Source=pl_origin_2, Target=xy_4)  # -> Geometry, Transform

filter_6 = StreamFilter(Gate=list_16, Stream0=orient_2.Geometry, Stream1=orient.Geometry)
entwine = Entwine(Branch00=orient.Geometry, Branch01=filter_6, FlattenInputs=True)

# ----
# column lines
crv_3 = Curve([<curve referenced from the Rhino model> x16])

# ---- group: 结构线
crv_4 = Curve(<curve referenced from the Rhino model>)

# ----
# 平面定位INPUT
number_slider = Slider(341, range=0..1000)

# ----
# beam lines
crv_5 = Curve(<curve referenced from the Rhino model>)

# ----
# arch lines
crv_6 = Curve(<curve referenced from the Rhino model>)

flip = FlipCurve(Curve=crv_5)  # -> Curve, Flag
filter_7 = StreamFilter(Gate=Toggle(False), Stream0=crv_5, Stream1=flip.Curve)
offset = OffsetCurve(Curve=filter_7, Distance=Slider(100, range=0..100), Corners=1)
disc = Discontinuity(Curve=offset, Level=1)  # -> Points, Parameters

disc_2 = Discontinuity(Curve=crv_6, Level=1)  # -> Points, Parameters
flip_2 = FlipCurve(Curve=crv_6)  # -> Curve, Flag
filter_8 = StreamFilter(Gate=Toggle(False), Stream0=crv_6, Stream1=flip_2.Curve)
pull = PullPoint(Point=disc_2.Points, Geometry=disc.Points, ClosestOnly=True)  # -> ClosestPoint, Distance
entwine_2 = Entwine(Branch00=pull.ClosestPoint, Branch01=disc_2.Points, FlattenInputs=True)
offset_2 = OffsetCurve(Curve=filter_8, Distance=expr("-x", number_slider), Corners=1)
flip_3 = FlipMatrix(Data=entwine_2)
crv_7 = Curve(offset_2)
item_3 = ListItem(List=flip_3, Index="0", Wrap=True)  # -> flatten(Item)
item_4 = ListItem(List=flip_3, Index="1", Wrap=True)  # -> flatten(Item)
pt_3 = Point(item_4)
disc_3 = Discontinuity(Curve=crv_7, Level=1)  # -> Points, Parameters
crv_cp = CurveClosestPoint(Point=pt_3, Curve=crv_7)  # -> Point, Parameter, Distance
c_script = CSharpScript(archPoint=crv_cp.Point, crvPoint=disc_3.Points)  # -> out, specialPt; inputs archPoint: list of Point3d, crvPoint: list of Point3d
# ---------- c_script: C# ----------
    List<int> passIndex = new List<int>();

    for(int i = 0; i < archPoint.Count; i++){
      foreach(Point3d t in crvPoint){
        if(archPoint[i].X == t.X && archPoint[i].Y == t.Y && archPoint[i].Z == t.Z){
          Print("pass");
          passIndex.Add(i);}
      }
    }

    specialPt = passIndex;
# ---------- end c_script ----------
item_5 = ListItem(List=pt_3, Index=c_script.specialPt, Wrap=True)
item_6 = ListItem(List=item_3, Index=c_script.specialPt, Wrap=True)
cull_i = CullIndex(List=pt_3, Indices=c_script.specialPt, Wrap=True)
cull_i_2 = CullIndex(List=item_3, Indices=c_script.specialPt, Wrap=True)
item_7 = ListItem(List=pt_3, Index=c_script.specialPt, Wrap=True)

# ----
# board lines
crv_8 = Curve(<curve referenced from the Rhino model>)

shift = ShiftList(List=item_5, Shift="1", Wrap=True)
panel_7 = Panel("1")
pt_4 = Point(graft(item_5))
pt_5 = Point(graft(shift))
pt_6 = Point(graft(cull_i))
panel_8 = Panel("""0
-1""")
disc_4 = Discontinuity(Curve=crv_8, Level=1)  # -> Points, Parameters
pt_7 = Point(item_3)
cull_i_3 = CullIndex(List=disc_4.Points, Indices=panel_8, Wrap=True)
ln = Line(StartPoint=pt_5, EndPoint=pt_6)
ln_2 = Line(StartPoint=pt_4, EndPoint=pt_6)
pull_2 = PullPoint(Point=pt_7, Geometry=cull_i_3, ClosestOnly=True)  # -> ClosestPoint, Distance
angle = Angle(VectorA=ln, VectorB=ln_2)  # -> flatten(Angle), Reflex
larger = LargerThan(FirstNumber=pull_2.Distance, SecondNumber=Slider(1, range=0..10))  # -> LargerThan, OrEqualTo
deg = Degrees(Radians=angle.Angle)
dispatch = Dispatch(List=pt_7, DispatchPattern=larger.LargerThan)  # -> ListA, ListB
pt_8 = Point(dispatch.ListA)
pt_9 = Point(dispatch.ListB)
larger_2 = LargerThan(FirstNumber=deg, SecondNumber="96")  # -> LargerThan, OrEqualTo
dispatch_2 = Dispatch(List=flatten(cull_i_2), DispatchPattern=larger_2.LargerThan)  # -> ListA, ListB
dispatch_3 = Dispatch(List=flatten(pt_6), DispatchPattern=larger_2.LargerThan)  # -> ListA, ListB
panel_9 = Panel("0")  # disabled

pt_10 = Point(item_6)
pt_11 = Point(dispatch_2.ListA)
pt_12 = Point(dispatch_2.ListB)

pt_13 = Point(item_7)
pt_14 = Point(dispatch_3.ListA)
pt_15 = Point(dispatch_3.ListB)

c_script_2 = CSharpScript(archPoint=pt_8, crvPoint=pt_10)  # -> out, specialPt; inputs archPoint: list of Point3d, crvPoint: list of Point3d; same code as c_script
c_script_3 = CSharpScript(archPoint=pt_8, crvPoint=pt_11)  # -> out, specialPt; inputs archPoint: list of Point3d, crvPoint: list of Point3d; same code as c_script
c_script_4 = CSharpScript(archPoint=pt_8, crvPoint=pt_12)  # -> out, specialPt; inputs archPoint: list of Point3d, crvPoint: list of Point3d; same code as c_script
c_script_5 = CSharpScript(archPoint=pt_9, crvPoint=pt_10)  # -> out, specialPt; inputs archPoint: list of Point3d, crvPoint: list of Point3d; same code as c_script
c_script_6 = CSharpScript(archPoint=pt_9, crvPoint=pt_11)  # -> out, specialPt; inputs archPoint: list of Point3d, crvPoint: list of Point3d; same code as c_script
c_script_7 = CSharpScript(archPoint=pt_9, crvPoint=pt_12)  # -> out, specialPt; inputs archPoint: list of Point3d, crvPoint: list of Point3d; same code as c_script

item_8 = ListItem(List=pt_8, Index=c_script_3.specialPt, Wrap=True)
item_9 = ListItem(List=pt_8, Index=c_script_4.specialPt, Wrap=True)
item_10 = ListItem(List=pt_8, Index=c_script_2.specialPt, Wrap=True)  # -> graft(Item)

item_11 = ListItem(List=pt_9, Index=c_script_5.specialPt, Wrap=True)  # -> graft(Item)
item_12 = ListItem(List=pt_9, Index=c_script_6.specialPt, Wrap=True)
item_13 = ListItem(List=pt_9, Index=c_script_7.specialPt, Wrap=True)

cull_i_4 = CullIndex(List=pt_7, Indices="0", Wrap=True)
dispatch_4 = Dispatch(List=cull_i_4, DispatchPattern=[True, False])  # -> ListA, ListB
pt_16 = Point(dispatch_4.ListA)
pt_17 = Point(dispatch_4.ListB)
pt_18 = Point(pt_6)
ln_3 = Line(StartPoint=pt_16, EndPoint=pt_17)
crv_cp_2 = CurveClosestPoint(Point=graft(pt_18), Curve=graft(ln_3))  # -> flatten(Point), Parameter, Distance

crv_9 = Curve([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])  # disabled
crv_10 = Curve(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)  # disabled
merge_2 = Merge(Data1=crv_9, Data2=crv_10)  # disabled

锚筋末端焊板厚度 = Slider(12, range=0..100)
锚筋长度 = Slider(12, range=0..30, expression="x*10")
锚筋末端焊板边长 = Slider(40, range=0..100)
锚板厚度 = Slider(12, range=0..100)
槽长 = Slider(270, range=0..1000)
value_list = ValueList({"锚筋": 0, "锚焊": 1}, selected="锚焊")
锚筋到边 = Panel("75")
curve = Curve(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)
subtraction = Subtraction(A=锚筋长度, B=锚板厚度)
filter_9 = StreamFilter(Gate=list_4, Stream0=10, Stream1=12, Stream2=16, Stream3=18, Stream4=20, Stream5=25)
filter_10 = StreamFilter(Gate=list_3, Stream0=10, Stream1=12, Stream2=16, Stream3=18, Stream4=20, Stream5=25)
addition_3 = Addition(A=list_6, B=1)
addition_4 = Addition(A=list_5, B=1)

yz_plane = YZPlane(Origin=Point(0, 0, 0))
orient_3 = Orient(Geometry=curve, Source=PlaneXY(0, 0, 0), Target=yz_plane)  # -> Geometry, Transform
unit_x = UnitX(Factor=槽长)
division_2 = Division(A=槽长, B=2)
extrude = Extrude(Base=orient_3.Geometry, Direction=unit_x)
unit_x_2 = UnitX(Factor=division_2)
move_2 = Move(Geometry=extrude, Motion=expr("-x", unit_x_2))  # -> Geometry, Transform
cap_holes = CapHoles(Brep=move_2.Geometry)

锚筋末端焊板厚度_2 = Slider(12, range=0..100)
锚筋长度_2 = Slider(12, range=0..30, expression="x*10")
锚筋末端焊板边长_2 = Slider(40, range=0..100)
锚板厚度_2 = Slider(12, range=0..100)
板凳厚度 = Slider(16, range=0..100)
槽长_2 = Slider(270, range=0..1000)
value_list_2 = ValueList({"锚筋": 0, "锚焊": 1}, selected="锚焊")
锚筋到边_2 = Panel("75")
list_17 = ValueList({"板埋": 0, "槽埋": 1}, selected="板埋")
list_18 = ValueList({"顶埋": 0, "侧埋": 1}, selected="顶埋")
curve_2 = Curve(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)
subtraction_2 = Subtraction(A=锚筋长度_2, B=锚板厚度_2)
filter_11 = StreamFilter(Gate=list_8, Stream0=10, Stream1=12, Stream2=16, Stream3=18, Stream4=20, Stream5=25)
filter_12 = StreamFilter(Gate=list_7, Stream0=10, Stream1=12, Stream2=16, Stream3=18, Stream4=20, Stream5=25)
addition_5 = Addition(A=list_10, B=1)
addition_6 = Addition(A=list_9, B=1)

# ----
# 钢板槽Modeling
recgrid = Rectangular(Plane=PlaneXY(0, 0, 0), SizeX=s_x_2, SizeY=s_y_2, ExtentX=addition_6, ExtentY=addition_5)  # -> Cells, Points
multiplication = Multiplication(A=s_x_2, B=addition_6)
multiplication_2 = Multiplication(A=s_y_2, B=addition_5)
division_3 = Division(A=multiplication, B=2)
division_4 = Division(A=multiplication_2, B=2)
vec = VectorXYZ(XComponent=expr("-x", division_3), YComponent=expr("-x", division_4), ZComponent=0)  # -> Vector, Length
division_5 = Division(A=filter_11, B=2)
move_3 = Move(Geometry=recgrid.Points, Motion=vec.Vector)  # -> Geometry, Transform
multiplication_3 = Multiplication(A=division_5, B=2)
yz_plane_2 = YZPlane(Origin=Point(0, 0, 0))
orient_4 = Orient(Geometry=curve_2, Source=PlaneXY(0, 0, 0), Target=yz_plane_2)  # -> Geometry, Transform
divide_curve = DivideCurve(Curve=orient_4.Geometry, Count=Slider(50, range=0..100), Kinks=False)  # -> Points, Tangents, Parameters
unit_x_3 = UnitX(Factor=槽长_2)
division_6 = Division(A=槽长_2, B=2)
extrude_2 = Extrude(Base=orient_4.Geometry, Direction=unit_x_3)
unit_x_4 = UnitX(Factor=division_6)
convex_hull = ConvexHull(Points=divide_curve.Points, Plane=yz_plane_2)  # -> Hull, HullZ, Indices
move_4 = Move(Geometry=extrude_2, Motion=expr("-x", unit_x_4))  # -> Geometry, Transform
boundary_surfaces = BoundarySurfaces(Edges=convex_hull.Hull)
multiplication_4 = Multiplication(A=Slider(10, range=0..100), B=2)
subtraction_3 = Subtraction(A=槽长_2, B=multiplication_4)
unit_z = UnitZ(Factor=expr("-X", subtraction_2))
cap_holes_2 = CapHoles(Brep=move_4.Geometry)
unit_x_5 = UnitX(Factor=subtraction_3)
extrude_3 = Extrude(Base=boundary_surfaces, Direction=unit_x_5)
division_7 = Division(A=unit_x_5, B=2)
extrude_4 = Extrude(Base=boundary_surfaces, Direction=unit_x_3)
move_5 = Move(Geometry=extrude_3, Motion=expr("-x", division_7))  # -> Geometry, Transform
move_6 = Move(Geometry=extrude_4, Motion=expr("-x", unit_x_4))  # -> Geometry, Transform
solid_difference = SolidDifference(BrepsA=move_6.Geometry, BrepsB=move_5.Geometry)
Z = UnitZ(Factor=expr("-x", 锚板厚度_2))
xy_plane = XYPlane(Origin=Point(0, 0, 0))
deconstruct_plane = DeconstructPlane(Plane=xy_plane)  # -> Origin, XAxis, YAxis, ZAxis

multiplication_5 = Multiplication(A=multiplication_3, B=6)
max_2 = Maximum(A=multiplication_5, B=70)
multiplication_6 = Multiplication(A=锚筋到边_2, B=2)
addition_7 = Addition(A=multiplication, B=multiplication_6)
addition_8 = Addition(A=multiplication_2, B=multiplication_6)
expression_2 = Expression(x=addition_7, Expression="Ceiling(x/10)*10/2")
expression_3 = Expression(x=addition_8, Expression="Ceiling(x/10)*10/2")
dom = ConstructDomain(DomainStart=expr("-x", expression_2), DomainEnd=expression_2)
dom_2 = ConstructDomain(DomainStart=expr("-x", expression_3), DomainEnd=expression_3)
box = DomainBox(Base=PlaneXY(0, 0, 0), X=dom, Y=dom_2, Z=锚板厚度_2)

flip_matrix = FlipMatrix(Data=move_3.Geometry)
cull_first_last = CullFirstLast(List=flip_matrix)  # -> CullFirst, CullLast, CullFirstAndEnd
point = Point(cull_first_last.CullFirstAndEnd)
flip_matrix_2 = FlipMatrix(Data=point)
number_slider_2 = Slider(50, range=0..100)
polyline = PolyLine(Vertices=flip_matrix_2, Closed=False)
extend_curve = ExtendCurve(Curve=polyline, Type=0, Start=number_slider_2, End=number_slider_2)
xy_plane_2 = XYPlane(Origin=Point(0, 0, 0))
average = Average(Input=move_3.Geometry)
addition_9 = Addition(A=filter_12, B=Slider(1, range=0..1))
multiplication_7 = Multiplication(A=filter_11, B=2.5)
division_8 = Division(A=addition_9, B=2)
polyline_2 = PolyLine(Vertices=flatten(average), Closed=False)
negative = Negative(Value=division_8)
offset_curve = OffsetCurve(
    Curve=extend_curve,
    Distance=[Slider(25, range=0..100), Slider(25, range=0..100, expression="-x")],
    Plane=xy_plane_2,
    Corners=1)
circle = Circle(Plane=move_3.Geometry, Radius=multiplication_7)
shift_paths = ShiftPaths(Data=offset_curve, Offset=-1)
region_union = RegionUnion(Curves=circle)
offset_curve_2 = OffsetCurve(Curve=polyline_2, Distance=[division_8, negative], Plane=xy_plane_2, Corners=1)
boundary_surfaces_2 = BoundarySurfaces(Edges=region_union)
loft = Loft(Curves=shift_paths, Options={Adjust=False, Closed=False, LoftEnds=0, LoftSimp=0, LoftType=0, Rebuild=10, Refit=0.01})
trim_with_regions = TrimWithRegions(Curve=offset_curve_2, Regions=flatten(boundary_surfaces_2))  # -> Inside, Outside
trim_with_regions_2 = TrimWithRegions(Curve=trim_with_regions.Outside, Regions=flatten(loft))  # -> Inside, Outside
curve_3 = Curve(trim_with_regions_2.Outside)
flip_matrix_3 = FlipMatrix(Data=curve_3)
loft_2 = Loft(Curves=flip_matrix_3, Options={Adjust=False, Closed=False, LoftEnds=0, LoftSimp=0, LoftType=0, Rebuild=10, Refit=0.01})
length = Length(Curve=flip_matrix_3)  # -> flatten(Length)
brep_edges = BrepEdges(Brep=loft_2)  # -> Naked, Interior, NonManifold
max_min = MaxMin(Numbers=length)  # -> Max, MaxIndex, Min, MinIndex
join_curves = JoinCurves(Curves=brep_edges.Naked, Preserve=False)
number_slider_3 = Slider(100, range=0..100)
subtraction_4 = Subtraction(A=max_min.Min, B=filter_12)
fillet = Fillet(Curve=join_curves, Radius=division_8)
unit_z_2 = UnitZ(Factor=expr("-x", number_slider_3))
unit_z_3 = UnitZ(Factor=number_slider_3)
boundary_surfaces_3 = BoundarySurfaces(Edges=fillet)
extrude_5 = Extrude(Base=boundary_surfaces_3, Direction=[unit_z_3, unit_z_2])
solid_difference_2 = SolidDifference(BrepsA=box, BrepsB=flatten(extrude_5))

最短槽长 = Panel(subtraction_4)

subtraction_5 = Subtraction(A=expression_3, B=板凳厚度)
dom_3 = ConstructDomain(DomainStart=expr("-x", subtraction_5), DomainEnd=subtraction_5)
rectangle = Rectangle(Plane=PlaneXY(0, 0, 0), XSize=dom, YSize=dom_3, Radius=0)  # -> Rectangle, Length
rectangle_2 = Rectangle(Plane=PlaneXY(0, 0, 0), XSize=dom, YSize=dom_2, Radius=0)  # -> Rectangle, Length
region_difference = RegionDifference(CurvesA=rectangle_2.Rectangle, CurvesB=rectangle.Rectangle)
boundary_surfaces_4 = BoundarySurfaces(Edges=region_difference)
extrude_6 = Extrude(Base=boundary_surfaces_4, Direction=unit_z)
merge_3 = Merge(Data1=extrude_6, Data2=solid_difference_2, Data3=cap_holes_2, Data4=solid_difference)
flatten = FlattenTree(Tree=merge_3, Path="{0}")

move_7 = Move(Geometry=flatten, Motion=Z)  # -> Geometry, Transform
centre_point = Point(deconstruct_plane.Origin)

# ----
# 板槽Modeling
recgrid_2 = Rectangular(Plane=PlaneXY(0, 0, 0), SizeX=s_x, SizeY=s_y, ExtentX=addition_4, ExtentY=addition_3)  # -> Cells, Points
multiplication_8 = Multiplication(A=s_x, B=addition_4)
multiplication_9 = Multiplication(A=s_y, B=addition_3)
division_9 = Division(A=multiplication_8, B=2)
division_10 = Division(A=multiplication_9, B=2)
vec_2 = VectorXYZ(XComponent=expr("-x", division_9), YComponent=expr("-x", division_10), ZComponent=0)  # -> Vector, Length
move_8 = Move(Geometry=recgrid_2.Points, Motion=vec_2.Vector)  # -> Geometry, Transform
division_11 = Division(A=filter_9, B=2)
divide_curve_2 = DivideCurve(Curve=orient_3.Geometry, Count=Slider(50, range=0..100), Kinks=False)  # -> Points, Tangents, Parameters
convex_hull_2 = ConvexHull(Points=divide_curve_2.Points, Plane=yz_plane)  # -> Hull, HullZ, Indices
boundary_surfaces_5 = BoundarySurfaces(Edges=convex_hull_2.Hull)
multiplication_10 = Multiplication(A=Slider(10, range=0..100), B=2)
subtraction_6 = Subtraction(A=槽长, B=multiplication_10)
unit_x_6 = UnitX(Factor=subtraction_6)
extrude_7 = Extrude(Base=boundary_surfaces_5, Direction=unit_x_6)
division_12 = Division(A=unit_x_6, B=2)
extrude_8 = Extrude(Base=boundary_surfaces_5, Direction=unit_x)
move_9 = Move(Geometry=extrude_7, Motion=expr("-x", division_12))  # -> Geometry, Transform
move_10 = Move(Geometry=extrude_8, Motion=expr("-x", unit_x_2))  # -> Geometry, Transform
solid_difference_3 = SolidDifference(BrepsA=move_10.Geometry, BrepsB=move_9.Geometry)
Z_2 = UnitZ(Factor=expr("-x", 锚板厚度))
xy_plane_3 = XYPlane(Origin=Point(0, 0, 0))
deconstruct_plane_2 = DeconstructPlane(Plane=xy_plane_3)  # -> Origin, XAxis, YAxis, ZAxis

unit_z_4 = UnitZ(Factor=expr("x", 锚筋末端焊板厚度))
unit_z_5 = UnitZ(Factor=expr("-x", subtraction))
division_13 = Division(A=锚筋末端焊板边长, B=2)
construct_domain = ConstructDomain(DomainStart=expr("-x", division_13), DomainEnd=division_13)
move_11 = Move(Geometry=move_8.Geometry, Motion=unit_z_5)  # -> Geometry, Transform
rectangle_3 = Rectangle(Plane=move_11.Geometry, XSize=construct_domain, YSize=construct_domain, Radius=0)  # -> Rectangle, Length
extrude_9 = Extrude(Base=rectangle_3.Rectangle, Direction=unit_z_4)

multiplication_11 = Multiplication(A=division_11, B=2)
cyl = Cylinder(Base=move_8.Geometry, Radius=division_11, Length=expr("-x", subtraction))
edges_2 = BrepEdges(Brep=cyl)  # -> Naked, Interior, NonManifold
multiplication_12 = Multiplication(A=multiplication_11, B=5)
item_14 = ListItem(List=edges_2.Naked, Index=0, Wrap=True)
X = UnitX(Factor=multiplication_11)
Z_3 = UnitZ(Factor=multiplication_12)
move_12 = Move(Geometry=item_14, Motion=X)  # -> Geometry, Transform
extr = Extrude(Base=move_12.Geometry, Direction=Z_3)

multiplication_13 = Multiplication(A=multiplication_11, B=6)
max_3 = Maximum(A=multiplication_13, B=70)
multiplication_14 = Multiplication(A=锚筋到边, B=2)
addition_10 = Addition(A=multiplication_8, B=multiplication_14)
addition_11 = Addition(A=multiplication_9, B=multiplication_14)
expression_4 = Expression(x=addition_10, Expression="Ceiling(x/10)*10/2")
expression_5 = Expression(x=addition_11, Expression="Ceiling(x/10)*10/2")
dom_4 = ConstructDomain(DomainStart=expr("-x", expression_4), DomainEnd=expression_4)
dom_5 = ConstructDomain(DomainStart=expr("-x", expression_5), DomainEnd=expression_5)
box_2 = DomainBox(Base=PlaneXY(0, 0, 0), X=dom_4, Y=dom_5, Z=锚板厚度)

flip_matrix_4 = FlipMatrix(Data=move_8.Geometry)
cull_first_last_2 = CullFirstLast(List=flip_matrix_4)  # -> CullFirst, CullLast, CullFirstAndEnd
point_2 = Point(cull_first_last_2.CullFirstAndEnd)
flip_matrix_5 = FlipMatrix(Data=point_2)
number_slider_4 = Slider(50, range=0..100)
polyline_3 = PolyLine(Vertices=flip_matrix_5, Closed=False)
extend_curve_2 = ExtendCurve(Curve=polyline_3, Type=0, Start=number_slider_4, End=number_slider_4)
xy_plane_4 = XYPlane(Origin=Point(0, 0, 0))
average_2 = Average(Input=move_8.Geometry)
addition_12 = Addition(A=filter_10, B=Slider(1, range=0..1))
multiplication_15 = Multiplication(A=filter_9, B=2.5)
division_14 = Division(A=addition_12, B=2)
polyline_4 = PolyLine(Vertices=flatten(average_2), Closed=False)
negative_2 = Negative(Value=division_14)
offset_curve_3 = OffsetCurve(
    Curve=extend_curve_2,
    Distance=[Slider(25, range=0..100), Slider(25, range=0..100, expression="-x")],
    Plane=xy_plane_4,
    Corners=1)
circle_2 = Circle(Plane=move_8.Geometry, Radius=multiplication_15)
shift_paths_2 = ShiftPaths(Data=offset_curve_3, Offset=-1)
region_union_2 = RegionUnion(Curves=circle_2)
offset_curve_4 = OffsetCurve(Curve=polyline_4, Distance=[division_14, negative_2], Plane=xy_plane_4, Corners=1)
boundary_surfaces_6 = BoundarySurfaces(Edges=region_union_2)
loft_3 = Loft(Curves=shift_paths_2, Options={Adjust=False, Closed=False, LoftEnds=0, LoftSimp=0, LoftType=0, Rebuild=10, Refit=0.01})
trim_with_regions_3 = TrimWithRegions(Curve=offset_curve_4, Regions=flatten(boundary_surfaces_6))  # -> Inside, Outside
trim_with_regions_4 = TrimWithRegions(Curve=trim_with_regions_3.Outside, Regions=flatten(loft_3))  # -> Inside, Outside
curve_4 = Curve(trim_with_regions_4.Outside)
flip_matrix_6 = FlipMatrix(Data=curve_4)
loft_4 = Loft(Curves=flip_matrix_6, Options={Adjust=False, Closed=False, LoftEnds=0, LoftSimp=0, LoftType=0, Rebuild=10, Refit=0.01})
length_2 = Length(Curve=flip_matrix_6)  # -> flatten(Length)
brep_edges_2 = BrepEdges(Brep=loft_4)  # -> Naked, Interior, NonManifold
max_min_2 = MaxMin(Numbers=length_2)  # -> Max, MaxIndex, Min, MinIndex
join_curves_2 = JoinCurves(Curves=brep_edges_2.Naked, Preserve=False)
number_slider_5 = Slider(100, range=0..100)
subtraction_7 = Subtraction(A=max_min_2.Min, B=filter_10)
fillet_2 = Fillet(Curve=join_curves_2, Radius=division_14)
unit_z_6 = UnitZ(Factor=expr("-x", number_slider_5))
unit_z_7 = UnitZ(Factor=number_slider_5)
boundary_surfaces_7 = BoundarySurfaces(Edges=fillet_2)
extrude_10 = Extrude(Base=boundary_surfaces_7, Direction=[unit_z_7, unit_z_6])
solid_difference_4 = SolidDifference(BrepsA=box_2, BrepsB=flatten(extrude_10))

最短槽长_2 = Panel(subtraction_7)

stream_filter = StreamFilter(Gate=value_list, Stream0=extr, Stream1=extrude_9)
cap = CapHoles(Brep=[cyl, stream_filter])
merge_4 = Merge(Data1=cap, Data2=solid_difference_4, Data3=cap_holes, Data4=solid_difference_3)
flatten_2 = FlattenTree(Tree=merge_4, Path="{0}")

move_13 = Move(Geometry=flatten_2, Motion=Z_2)  # -> Geometry, Transform
centre_point_2 = Point(deconstruct_plane_2.Origin)

entwine_3 = Entwine(Branch00=move_13.Geometry, Branch01=move_7.Geometry, FlattenInputs=True)

# ----
# 三视图
# hidden lines of top+pers view
# move to center
# 如果无法完整的生成埋件的三视图，
# 建议选择埋件的3D在Rhino中将
# Top/Perspective/Front/Right 试图缩放至合适大小后重新运行
panel_10 = Panel("""Top
Perspective
Front
Right""")
m2d_rhino = Make2DRhinoView(Name=panel_10, Clip=True)
make2d = Make2D(Geometry=entwine_3, View=m2d_rhino, TangentEdges=False, TangentSeams=False, AutoComputeMake2D=False)  # -> VisibleCurves, VisibleIndex, VisibleType, HiddenCurves, HiddenIndex, HiddenType
bang = ExplodeTree(Data=make2d.VisibleCurves)  # -> Branch0, Branch1, Branch2, Branch3, Branch4, Branch5, Branch6, Branch7
bang_2 = ExplodeTree(Data=make2d.VisibleCurves)  # -> Branch0, Branch1, Branch2, Branch3, Branch4, Branch5, Branch6, Branch7
divdist = DivideDistance(Curve=make2d.HiddenCurves, Distance=Slider(1, range=0..10))  # -> Points, Tangents, Parameters
graft = GraftTree(Tree=make2d.HiddenCurves, IncludeEmptyLists=True, IncludeNullItems=True)
shatter = Shatter(Curve=graft, Parameters=divdist.Parameters)
dispatch_5 = Dispatch(List=shatter, DispatchPattern=[True, False])  # -> ListA, ListB
crv_11 = Curve(dispatch_5.ListA)
pshift = ShiftPaths(Data=crv_11, Offset=-1)
pshift_2 = ShiftPaths(Data=pshift, Offset=-1)
bang_3 = ExplodeTree(Data=pshift_2)  # -> Branch0, Branch1, Branch2, Branch3, Branch4, Branch5, Branch6, Branch7
bang_4 = ExplodeTree(Data=pshift_2)  # -> Branch0, Branch1, Branch2, Branch3, Branch4, Branch5, Branch6, Branch7
entwine_4 = Entwine(Branch00=bang_4.Branch4, Branch01=bang_2.Branch4, FlattenInputs=True)  # -> flatten(Result)
entwine_5 = Entwine(Branch00=bang_4.Branch5, Branch01=bang_2.Branch5, FlattenInputs=True)  # -> flatten(Result)
entwine_6 = Entwine(Branch00=bang_3.Branch0, Branch01=bang.Branch0, FlattenInputs=True)  # -> flatten(Result)
entwine_7 = Entwine(Branch00=bang_3.Branch1, Branch01=bang.Branch1, FlattenInputs=True)  # -> flatten(Result)
entwine_8 = Entwine(Branch00=entwine_6, Branch01=entwine_7, Branch02=bang.Branch2, Branch03=bang.Branch3, FlattenInputs=True)
entwine_9 = Entwine(Branch00=entwine_4, Branch01=entwine_5, Branch02=bang_2.Branch6, Branch03=bang_2.Branch7, FlattenInputs=True)
group = Group(Objects=entwine_8)
group_2 = Group(Objects=entwine_9)
entwine_10 = Entwine(Branch00=group, Branch01=group_2, FlattenInputs=True)
pshift_3 = ShiftPaths(Data=entwine_10, Offset=-1)
pshift_4 = ShiftPaths(Data=entwine_10, Offset=-1)
number_slider_6 = Slider(2, range=0..10)
boxprop = BoxProperties(Box=pshift_3)  # -> Center, Diagonal, Area, Volume, Degeneracy
pt_19 = Point(Point(957.9296072, 367.7685097, 0))
pt_20 = Point("0,0,0")
recgrid_3 = Rectangular(
    Plane=pt_19,
    SizeX=Slider(12, range=1..20, expression="X*50"),
    SizeY=Slider(10, range=1..20, expression="X*50"),
    ExtentX=number_slider_6,
    ExtentY=number_slider_6)  # -> Cells, Points
vec2pt = Vector2Pt(PointA=boxprop.Center, PointB=pt_20, Unitize=False)  # -> Vector, Length
flatten_3 = FlattenTree(Tree=recgrid_3.Points, Path="{0}")
move_14 = Move(Geometry=pshift_4, Motion=vec2pt.Vector)  # -> flatten(Geometry), Transform
orient_5 = Orient(Geometry=flatten(move_14.Geometry), Source=PlaneXY(0, 0, 0), Target=flatten_3)  # -> Geometry, Transform
cull_i_5 = CullIndex(List=orient_5.Geometry, Indices="-1", Wrap=True)
split = SplitList(List=cull_i_5, Index="4")  # -> ListA, ListB
data = Data(split.ListA)
data_2 = Data(split.ListB)
entwine_11 = Entwine(Branch00=data, Branch01=data_2, FlattenInputs=True)
geo = Geometry(entwine_11)

# ---- group: 单体定Top/Side
item_15 = ListItem(List=geo, Index=2, Wrap=True)
item_16 = ListItem(List=geo, Index=Slider(0, range=0..10), Wrap=True)
cluster = Cluster(G=item_16)
cluster_2 = Cluster(G=item_15)

# ---- group: 单体定Top/Side / Top/Side
filter_13 = StreamFilter(Gate=list_2, Stream0=cluster, Stream1=cluster_2)

# ----
data_3 = Data(flatten(filter_13))

# ----
# 阳角埋件布置
# Rhino 文件中导入的块名
pt_21 = Point()  # disabled
number_slider_7 = Slider(150, range=0..1000)  # disabled
explode = Explode(Recursive=True)  # -> Segments, Vertices; disabled
cp = ClosestPoint(Point=pt_21, Cloud=explode.Vertices)  # -> ClosestPoint, CPIndex, Distance; disabled
cir = Circle(Plane=cp.ClosestPoint, Radius=number_slider_7)  # disabled
pt_22 = Point(cp.ClosestPoint)  # disabled
ccx = CurveCurve(CurveA=cir)  # -> Points, ParamsA, ParamsB; disabled
item_17 = ListItem(List=ccx.Points, Index=0, Wrap=True)  # -> Item, Item1; disabled
ln_4 = Line(StartPoint=graft(pt_22), EndPoint=graft(item_17.Item))  # -> flatten(Line); disabled
ln_5 = Line(StartPoint=graft(pt_22), EndPoint=graft(item_17.Item1))  # -> flatten(Line); disabled
panel_11 = Panel("1")  # disabled
pl = ConstructPlane(Origin=pt_22, XAxis=ln_4, YAxis=ln_5)  # disabled
item_18 = ListItem(List=data_3, Index=panel_11, Wrap=True)  # disabled
bbox_3 = BoundingBox(Content=graft(item_18), Plane=PlaneXY(0, 0, 0))  # -> Box, Box_2; disabled
srf = Surface(bbox_3.Box)  # disabled
explode_2 = Explode(Curve=srf, Recursive=True)  # -> Segments, Vertices; disabled
item_19 = ListItem(List=explode_2.Vertices, Index=0, Wrap=True)  # -> Item, Item1, Item2; disabled
ln_6 = Line(StartPoint=graft(item_19.Item1), EndPoint=graft(item_19.Item2))  # disabled
ln_7 = Line(StartPoint=graft(item_19.Item1), EndPoint=graft(item_19.Item))  # disabled
ln_8 = Line(StartPoint=graft(item_19.Item1), EndPoint=graft(item_19.Item))  # disabled
ln_9 = Line(StartPoint=graft(item_19.Item1), EndPoint=graft(item_19.Item2))  # disabled
pl_2 = ConstructPlane(Origin=item_19.Item1, XAxis=ln_9, YAxis=ln_8)  # disabled
pl_3 = ConstructPlane(Origin=item_19.Item1, XAxis=ln_7, YAxis=ln_6)  # disabled
orient_6 = Orient(Geometry=item_18, Source=pl_3, Target=pl)  # -> Geometry, Transform; disabled
orient_7 = Orient(Geometry=item_18, Source=pl_2, Target=pl)  # -> Geometry, Transform; disabled
merge_5 = Merge(Data1=orient_6.Geometry, Data2=orient_7.Geometry)  # disabled
filter_14 = StreamFilter(Gate=list_2, Stream0=orient_6.Geometry, Stream1=merge_5)  # disabled
bbox_4 = BoundingBox(Content=filter_14, Plane=PlaneXY(0, 0, 0))  # -> Box, Box_2; disabled
entwine_12 = Entwine(Branch00=filter_14, Branch01=bbox_4.Box, FlattenInputs=True)  # disabled
flip_4 = FlipMatrix(Data=entwine_12)  # disabled
panel_12 = Panel("0")  # disabled
item_20 = ListItem(List=flip_4, Index=-1, Wrap=True)  # -> flatten(Item); disabled
item_21 = ListItem(List=flip_4, Index=panel_12, Wrap=True)  # -> flatten(Item); disabled

# ---- group: Block
# 自定义块所在图层
# 自定义块所在图层颜色
# 自定义块名称
panel_13 = Panel("Embeded::Embeded")
layer = DefineLayer(Name=panel_13, Color=ColourSwatch(SwatchColor=RGB(255, 0, 0)))
attributes = DefineObjectAttributes(Layer=layer)
block = DefineBlock(Geometry=filter_13, Attributes=attributes, BlockName="Steel Plate", BasePlane=PlaneXY(0, 0, 0))

# ---- group: 阴角
# 阴角埋件布置
explode_3 = Explode(Recursive=True)  # -> Segments, Vertices; disabled
cp_2 = ClosestPoint(Cloud=explode_3.Vertices)  # -> ClosestPoint, CPIndex, Distance; disabled
pshift_5 = ShiftPaths(Offset=-1)  # disabled
crv_cp_3 = CurveClosestPoint(Point=pshift_5)  # -> Point, Parameter, Distance; disabled
crv_cp_4 = CurveClosestPoint(Point=pshift_5)  # -> Point, Parameter, Distance; disabled
vec2pt_2 = Vector2Pt(PointA=crv_cp_3.Point, PointB=crv_cp_4.Point, Unitize=False)  # -> expr("-x", Vector), Length; disabled
eval = EvaluateCurve(Parameter=crv_cp_4.Parameter)  # -> Point, Tangent, Angle; disabled
pl_4 = ConstructPlane(Origin=crv_cp_4.Point, XAxis=eval.Tangent, YAxis=vec2pt_2.Vector)  # disabled
orient_8 = Orient(Geometry=block, Source=PlaneXY(0, 0, 0), Target=pl_4)  # -> Geometry, Transform; disabled

# ----
pull_3 = PullPoint(Point=item_8, Geometry=crv_cp_2.Point, ClosestOnly=True)  # -> ClosestPoint, Distance
pt_23 = Point(item_8)
ln_10 = Line(StartPoint=pull_3.ClosestPoint, EndPoint=pt_23)
amp = Amplitude(Vector=ln_10, Amplitude=Slider(87, range=0..1000))
move_15 = Move(Geometry=pull_3.ClosestPoint, Motion=amp)  # -> Geometry, Transform
ln_11 = Line(StartPoint=move_15.Geometry, EndPoint=pull_3.ClosestPoint)
rotate_2 = Rotate(Geometry=ln_11, Angle=-1.570796327, Plane=move_15.Geometry)  # -> Geometry, Transform
line = Line(flatten(ln_11))
line_2 = Line(flatten(rotate_2.Geometry))
item_22 = ListItem(List=flatten(block), Index=0, Wrap=True)
pl_5 = ConstructPlane(Origin=flatten(move_15.Geometry), XAxis=line, YAxis=line_2)
bbox_5 = BoundingBox(Content=graft(item_22), Plane=PlaneXY(0, 0, 0))  # -> Box, Box_2
srf_2 = Surface(bbox_5.Box)
explode_4 = Explode(Curve=srf_2, Recursive=True)  # -> Segments, Vertices
item_23 = ListItem(List=explode_4.Vertices, Index=0, Wrap=True)  # -> Item, Item1, Item2
ln_12 = Line(StartPoint=graft(item_23.Item1), EndPoint=graft(item_23.Item2))
midpt = CurveMiddle(Curve=ln_12)
ln_13 = Line(StartPoint=midpt, EndPoint=item_23.Item1)
rotate_3 = Rotate(Geometry=ln_13, Angle=-1.570796327, Plane=PlaneXY(0, 0, 0))  # -> Geometry, Transform
pl_6 = ConstructPlane(Origin=midpt, XAxis=ln_13, YAxis=rotate_3.Geometry)
orient_9 = Orient(Geometry=block, Source=pl_6, Target=pl_5)  # -> Geometry, Transform
data_4 = Data(orient_9.Geometry)

pt_24 = Point(item_9)
pull_4 = PullPoint(Point=item_9, Geometry=crv_cp_2.Point, ClosestOnly=True)  # -> ClosestPoint, Distance
ln_14 = Line(StartPoint=pull_4.ClosestPoint, EndPoint=pt_24)
amp_2 = Amplitude(Vector=ln_14, Amplitude=Slider(140, range=0..1000))
move_16 = Move(Geometry=pull_4.ClosestPoint, Motion=amp_2)  # -> Geometry, Transform
ln_15 = Line(StartPoint=move_16.Geometry, EndPoint=pull_4.ClosestPoint)
rotate_4 = Rotate(Geometry=ln_15, Angle=-1.570796327, Plane=move_16.Geometry)  # -> Geometry, Transform
line_3 = Line(flatten(ln_15))
line_4 = Line(flatten(rotate_4.Geometry))
item_24 = ListItem(List=flatten(block), Index=0, Wrap=True)
pl_7 = ConstructPlane(Origin=flatten(move_16.Geometry), XAxis=line_3, YAxis=line_4)
bbox_6 = BoundingBox(Content=graft(item_24), Plane=PlaneXY(0, 0, 0))  # -> Box, Box_2
srf_3 = Surface(bbox_6.Box)
explode_5 = Explode(Curve=srf_3, Recursive=True)  # -> Segments, Vertices
item_25 = ListItem(List=explode_5.Vertices, Index=0, Wrap=True)  # -> Item, Item1, Item2
ln_16 = Line(StartPoint=graft(item_25.Item1), EndPoint=graft(item_25.Item2))
midpt_2 = CurveMiddle(Curve=ln_16)
ln_17 = Line(StartPoint=midpt_2, EndPoint=item_25.Item1)
rotate_5 = Rotate(Geometry=ln_17, Angle=-1.570796327, Plane=PlaneXY(0, 0, 0))  # -> Geometry, Transform
pl_8 = ConstructPlane(Origin=midpt_2, XAxis=ln_17, YAxis=rotate_5.Geometry)
orient_10 = Orient(Geometry=block, Source=pl_8, Target=pl_7)  # -> Geometry, Transform
data_5 = Data(orient_10.Geometry)

cull_i_6 = CullIndex(List=pt_8, Indices=c_script_2.specialPt, Wrap=True)  # -> graft(List)
ln_18 = Line(StartPoint=item_10, EndPoint=cull_i_6)
item_26 = ListItem(List=flatten(block), Index=0, Wrap=True)
rotate_6 = Rotate(Geometry=ln_18, Angle=-1.570796327, Plane=item_10)  # -> Geometry, Transform
line_5 = Line(flatten(ln_18))
line_6 = Line(flatten(rotate_6.Geometry))
bbox_7 = BoundingBox(Content=graft(item_26), Plane=PlaneXY(0, 0, 0))  # -> Box, Box_2
srf_4 = Surface(bbox_7.Box)
pl_9 = ConstructPlane(Origin=flatten(item_10), XAxis=line_6, YAxis=line_5)
explode_6 = Explode(Curve=srf_4, Recursive=True)  # -> Segments, Vertices
item_27 = ListItem(List=explode_6.Vertices, Index=0, Wrap=True)  # -> Item, Item1, Item2
ln_19 = Line(StartPoint=graft(item_27.Item1), EndPoint=graft(item_27.Item))
ln_20 = Line(StartPoint=graft(item_27.Item1), EndPoint=graft(item_27.Item2))
pt_25 = Point(item_27.Item1)
pl_10 = ConstructPlane(Origin=item_27.Item1, XAxis=ln_19, YAxis=ln_20)
orient_11 = Orient(Geometry=block, Source=pl_10, Target=pl_9)  # -> Geometry, Transform
data_6 = Data(orient_11.Geometry)

阴角 = Geometry(orient_8.Geometry)  # disabled

# ----
# 板埋Modeling
multiplication_16 = Multiplication(A=s_x_3, B=addition)
multiplication_17 = Multiplication(A=s_y_3, B=addition_2)
recgrid_4 = Rectangular(Plane=PlaneXY(0, 0, 0), SizeX=s_x_3, SizeY=s_y_3, ExtentX=addition, ExtentY=addition_2)  # -> Cells, Points
直径 = Text(filter_3)
division_15 = Division(A=multiplication_16, B=2)
division_16 = Division(A=multiplication_17, B=2)
vec_3 = VectorXYZ(XComponent=expr("-x", division_15), YComponent=expr("-x", division_16), ZComponent=0)  # -> Vector, Length
move_17 = Move(Geometry=recgrid_4.Points, Motion=vec_3.Vector)  # -> Geometry, Transform
division_17 = Division(A=直径, B=2)
cyl_2 = Cylinder(Base=move_17.Geometry, Radius=division_17, Length=expr("-x", expression))
X_2 = UnitX(Factor=直径)
multiplication_18 = Multiplication(A=直径, B=6)
edges_3 = BrepEdges(Brep=cyl_2)  # -> Naked, Interior, NonManifold
item_28 = ListItem(List=edges_3.Naked, Index=0, Wrap=True)
max_4 = Maximum(A=multiplication_18, B=70)
move_18 = Move(Geometry=item_28, Motion=X_2)  # -> Geometry, Transform
multiplication_19 = Multiplication(A=max_4, B=2)
addition_13 = Addition(A=multiplication_16, B=multiplication_19)
addition_14 = Addition(A=multiplication_17, B=multiplication_19)
division_18 = Division(A=t, B=2)
expression_6 = Expression(x=addition_14, Expression="Ceiling(x/10)*10/2")
expression_7 = Expression(x=addition_13, Expression="Ceiling(x/10)*10/2")
round = Round(Number=division_18)  # -> Nearest, Floor, Ceiling
multiplication_20 = Multiplication(A=round.Ceiling, B=2)
dom_6 = ConstructDomain(DomainStart=expr("-x", expression_6), DomainEnd=expression_6)
dom_7 = ConstructDomain(DomainStart=expr("-x", expression_7), DomainEnd=expression_7)
box_3 = DomainBox(Base=PlaneXY(0, 0, 0), X=dom_7, Y=dom_6, Z=multiplication_20)
Z_4 = UnitZ(Factor=expr("-x", multiplication_20))
move_19 = Move(Geometry=box_3, Motion=Z_4)  # -> Geometry, Transform
Z_5 = UnitZ(Factor=expr("-x", multiplication_20))

multiplication_21 = Multiplication(A=直径, B=5)

Z_6 = UnitZ(Factor=multiplication_21)
extr_2 = Extrude(Base=move_18.Geometry, Direction=Z_6)
cap_2 = CapHoles(Brep=[extr_2, cyl_2])
merge_6 = Merge(Data1=cap_2, Data2=box_3)
flatten_4 = FlattenTree(Tree=merge_6, Path="{0}")
move_20 = Move(Geometry=flatten_4, Motion=Z_5)  # -> Geometry, Transform

box_4 = DomainBox(Base=PlaneXY(0, 0, 0), X=dom_7, Y=dom_7, Z=multiplication_20)
merge_7 = Merge(Data1=cap_2, Data2=box_4)
flatten_5 = FlattenTree(Tree=merge_7, Path="{0}")
move_21 = Move(Geometry=flatten_5, Motion=Z_5)  # -> Geometry, Transform
entwine_13 = Entwine(Branch00=move_20.Geometry, Branch01=move_21.Geometry, FlattenInputs=True)

# ---- group: 大面
# 大面埋件布置
number_slider_8 = Slider(0.002, range=0..0.01)  # disabled
filter_15 = StreamFilter(Gate=list_2, Stream0=expression_6, Stream1=number_slider_8)  # disabled
filter_16 = StreamFilter(Gate=list, Stream0=filter_15, Stream1=expression_6, Stream2=filter_15)  # disabled
offset_3 = OffsetCurve(Distance=expr("-x", filter_16), Plane=PlaneXY(0, 0, 0), Corners=1)  # disabled
crv_cp_5 = CurveClosestPoint(Curve=offset_3)  # -> Point, Parameter, Distance; disabled
crv_cp_6 = CurveClosestPoint()  # -> Point, Parameter, Distance; disabled
vec2pt_3 = Vector2Pt(PointA=crv_cp_5.Point, PointB=crv_cp_6.Point, Unitize=False)  # -> expr("-x", Vector), Length; disabled
eval_2 = EvaluateCurve(Parameter=crv_cp_6.Parameter)  # -> Point, Tangent, Angle; disabled
pl_11 = ConstructPlane(Origin=crv_cp_6.Point, XAxis=eval_2.Tangent, YAxis=vec2pt_3.Vector)  # disabled
orient_12 = Orient(Geometry=block, Source=PlaneXY(0, 0, 0), Target=pl_11)  # -> flatten(Geometry), Transform; disabled

# ---- group: Datea / 2
lng = ListLength(List=orient_12.Geometry)  # disabled
division_19 = Division(A=lng, B=2)  # disabled
split_2 = SplitList(List=orient_12.Geometry, Index=division_19)  # -> ListA, ListB; disabled
data_7 = Data(split_2.ListA)  # disabled

# ----
bbox_8 = BoundingBox(Content=data_7, Plane=PlaneXY(0, 0, 0))  # -> Box, Box_2; disabled
entwine_14 = Entwine(Branch00=data_7, Branch01=bbox_8.Box, FlattenInputs=True)  # disabled
flip_5 = FlipMatrix(Data=entwine_14)  # disabled
item_29 = ListItem(List=flip_5, Index=-1, Wrap=True)  # -> flatten(Item); disabled
item_30 = ListItem(List=flip_5, Index=panel_9, Wrap=True)  # -> flatten(Item); disabled

# ---- group: Monomer + Side/Top / Monomer Type
filter_17 = StreamFilter(Gate=list, Stream0=item_20, Stream1=item_20, Stream2=item_20)  # disabled

# ----
# 槽埋-角部倾斜时
bbox_9 = BoundingBox(Content=item_20, Plane=PlaneXY(0, 0, 0))  # -> Box, Box_2; disabled
ln_21 = Line(StartPoint=pt_21, EndPoint=pt_22)  # disabled
number_slider_9 = Slider(63.5, range=10..100)  # disabled
debrep = DeconstructBrep(Brep=bbox_9.Box)  # -> Faces, Edges, Vertices; disabled
deplane = DeconstructPlane(Plane=ln_21)  # -> Origin, XAxis, YAxis, ZAxis; disabled
len = Length(Curve=debrep.Edges)  # disabled
sort = SortList(Keys=len, ValuesA=debrep.Edges)  # -> Keys, reverse(ValuesA); disabled
amp_3 = Amplitude(Vector=deplane.XAxis, Amplitude=number_slider_9)  # disabled
item_31 = ListItem(List=sort.ValuesA, Index=0, Wrap=True)  # -> Item, Item1, Item2; disabled
item_32 = ListItem(List=sort.ValuesA, Index=0, Wrap=True)  # disabled
move_22 = Move(Geometry=deplane.Origin, Motion=amp_3)  # -> Geometry, Transform; disabled
number_slider_10 = Slider(30, range=0..100)  # disabled
len_2 = Length(Curve=item_32)  # disabled
number_slider_11 = Slider(10, range=0..10)  # disabled
end = EndPoints(Curve=item_31.Item2)  # -> Start, End; disabled
end_2 = EndPoints(Curve=item_31.Item1)  # -> Start, End; disabled
ln_22 = Line(StartPoint=deplane.Origin, EndPoint=move_22.Geometry)  # disabled
toggle = BooleanToggle(True)  # disabled
ln_23 = Line(StartPoint=move_22.Geometry, EndPoint=deplane.Origin)  # disabled
avr = Average(Input=[end_2.Start, end_2.End])  # disabled
ln_24 = Line(StartPoint=end.Start, EndPoint=end.End)  # disabled
ln_25 = Line(StartPoint=end_2.Start, EndPoint=avr)  # disabled
c_script_8 = CSharpScript(iReset=toggle, turns=number_slider_10, steps=number_slider_11)  # -> out, num; inputs numDefault: Double, iReset: Boolean, turns: Int32, steps: Double; disabled
# ---------- c_script_8: C# ----------
    if(iReset){
      number = 0;}

    for(int i = 0; i < turns;i++){
      number = number + steps;
      numStore.Add(number);
      Print(number.ToString());}

    num = numStore;
# ---------- c_script_8: C# additional code ----------
  double number = 0;
  List <double> numStore = new List<double>();
# ---------- end c_script_8 ----------
pl_12 = ConstructPlane(Origin=avr, XAxis=ln_25, YAxis=ln_24)  # disabled
panel_14 = Panel(c_script_8.num)  # disabled
amp_4 = Amplitude(Vector=ln_21, Amplitude=graft(c_script_8.num))  # disabled
panel_15 = Panel("-1")  # disabled
panel_16 = Panel("-1")  # disabled

item_33 = ListItem(List=flatten(len_2), Index=0, Wrap=True)  # disabled

ln_26 = Line(StartPoint=pt_21, EndPoint=pt_22)  # disabled
move_23 = Move(Geometry=pt_22, Motion=ln_26)  # -> Geometry, Transform; disabled
ccx_2 = CurveCurve(CurveA=cir)  # -> Points, ParamsA, ParamsB; disabled
item_34 = ListItem(List=ccx_2.Points, Index=0, Wrap=True)  # -> flatten(Item), flatten(Item1); disabled
ln_27 = Line(StartPoint=pt_22, EndPoint=item_34.Item)  # disabled
ln_28 = Line(StartPoint=pt_22, EndPoint=move_23.Geometry)  # disabled
ln_29 = Line(StartPoint=pt_22, EndPoint=item_34.Item1)  # disabled
angle_2 = Angle(VectorA=ln_27, VectorB=ln_28)  # -> Angle, Reflex; disabled
number_slider_12 = Slider(3, range=0..4)  # disabled
angle_3 = Angle(VectorA=ln_29, VectorB=ln_28)  # -> Angle, Reflex; disabled
deg_2 = Degrees(Radians=angle_2.Angle)  # disabled
deg_3 = Degrees(Radians=angle_3.Angle)  # disabled
item_35 = ListItem(List=ln_28, Index=number_slider_12, Wrap=True)  # disabled
tan = Tangent(Value=degrees(deg_2))  # disabled
entwine_15 = Entwine(Branch00=ln_27, Branch01=tan, FlattenInputs=True)  # disabled
tan_2 = Tangent(Value=degrees(deg_3))  # disabled
division_20 = Division(A=tan, B=tan_2)  # disabled
panel_17 = Panel(deg_3)  # disabled
panel_18 = Panel(deg_2)  # disabled
addition_15 = Addition(A=division_20, B=1)  # disabled
panel_19 = Panel("1")  # disabled
panel_20 = Panel("1")  # disabled
division_21 = Division(A=panel_19, B=addition_15)  # disabled
subtraction_8 = Subtraction(A=panel_20, B=division_21)  # disabled
num = Number(division_21)  # disabled
larger_3 = LargerThan(FirstNumber=tan, SecondNumber=tan_2)  # -> LargerThan, OrEqualTo; disabled

amp_5 = Amplitude(Vector=ln_23, Amplitude=expr("x/2", flatten(item_33)))  # disabled
amp_6 = Amplitude(Vector=ln_22, Amplitude=expr("x/2", flatten(item_33)))  # disabled
move_24 = Move(Geometry=pt_22, Motion=amp_5)  # -> Geometry, Transform; disabled
move_25 = Move(Geometry=pt_22, Motion=amp_6)  # -> Geometry, Transform; disabled
ln_30 = Line(StartPoint=move_24.Geometry, EndPoint=move_25.Geometry)  # disabled

crv_12 = Curve(ln_30)  # disabled
mp = Midpoint(Curve=crv_12)  # disabled
eval_3 = EvaluateCurve(Curve=crv_12, Parameter=subtraction_8)  # -> Point, Tangent, Angle; disabled
eval_4 = EvaluateCurve(Curve=crv_12, Parameter=num)  # -> Point, Tangent, Angle; disabled
dispatch_6 = Dispatch(List=eval_3.Point, DispatchPattern=larger_3.OrEqualTo)  # -> ListA, ListB; disabled
dispatch_7 = Dispatch(List=eval_4.Point, DispatchPattern=larger_3.OrEqualTo)  # -> ListA, ListB; disabled
pt_26 = Point(dispatch_6.ListB)  # disabled
pt_27 = Point(dispatch_7.ListA)  # disabled
merge_8 = Merge(Data1=pt_27, Data2=pt_26)  # disabled
pull_5 = PullPoint(Point=merge_8, Geometry=graft(mp), ClosestOnly=True)  # -> ClosestPoint, Distance; disabled
panel_21 = Panel(merge_8)  # disabled
sort_2 = SortList(Keys=pull_5.Distance, ValuesA=merge_8)  # -> Keys, ValuesA; disabled
item_36 = ListItem(List=sort_2.ValuesA, Index=0, Wrap=True)  # -> flatten(Item); disabled
ln_31 = Line(StartPoint=item_36, EndPoint=mp)  # disabled
panel_22 = Panel(item_36)  # disabled
move_26 = Move(Geometry=crv_12, Motion=ln_31)  # -> Geometry, Transform; disabled

# ---- group: 正常和阳角 - BoundingBox — 测Intersection
number_slider_13 = Slider(1000000, range=0..1000000)  # disabled
entwine_16 = Entwine(FlattenInputs=True)  # disabled
flip_6 = FlipMatrix(Data=entwine_16)  # disabled
item_37 = ListItem(List=flip_6, Index=0, Wrap=True)  # -> Item, Item1; disabled
panel_23 = Panel("0")  # disabled
panel_24 = Panel("-1")  # disabled

# ----
move_27 = Move(Geometry=move_26.Geometry, Motion=amp_4)  # -> Geometry, Transform; disabled
ccx_3 = CurveCurve(CurveA=move_27.Geometry)  # -> Points, ParamsA, ParamsB; disabled
item_38 = ListItem(List=ccx_3.Points, Index=0, Wrap=True)  # disabled
item_39 = ListItem(List=ccx_3.Points, Index=panel_15, Wrap=True)  # disabled
pshift_6 = ShiftPaths(Data=item_38, Offset=-1)  # disabled
pshift_7 = ShiftPaths(Data=item_39, Offset=-1)  # disabled
flip_7 = FlipMatrix(Data=pshift_6)  # disabled
flip_8 = FlipMatrix(Data=pshift_7)  # disabled
pt_28 = Point(flip_7)  # disabled
pt_29 = Point(flip_8)  # disabled
pull_6 = PullPoint(Point=pt_28, Geometry=graft(mp), ClosestOnly=True)  # -> ClosestPoint, Distance; disabled
pull_7 = PullPoint(Point=pt_29, Geometry=graft(mp), ClosestOnly=True)  # -> ClosestPoint, Distance; disabled
sort_3 = SortList(Keys=pull_6.Distance, ValuesA=pt_28)  # -> Keys, ValuesA; disabled
sort_4 = SortList(Keys=pull_7.Distance, ValuesA=pt_29)  # -> Keys, ValuesA; disabled
item_40 = ListItem(List=sort_3.ValuesA, Index=panel_16, Wrap=True)  # disabled
item_41 = ListItem(List=sort_4.ValuesA, Index=panel_16, Wrap=True)  # disabled
ln_32 = Line(StartPoint=item_41, EndPoint=item_40)  # disabled

end_3 = EndPoints(Curve=ln_32)  # -> Start, End; disabled

avr_2 = Average(Input=[end_3.Start, end_3.End])  # disabled
pl_13 = ConstructPlane(Origin=avr_2, XAxis=ln_32, YAxis=graft(ln_21))  # disabled
orient_13 = Orient(Geometry=graft(item_21), Source=pl_12, Target=pl_13)  # -> Geometry, Transform; disabled
orient_14 = Orient(Geometry=graft(item_20), Source=pl_12, Target=pl_13)  # -> Geometry, Transform; disabled

filter_18 = StreamFilter(Gate=list_16, Stream0=item_20, Stream1=orient_14.Geometry)  # disabled

# ---- group: Monomer + Side/Top / Monomer Type (continued)
filter_19 = StreamFilter(Gate=list, Stream0=item_20, Stream1=filter_18, Stream2=item_20)  # disabled

# ---- group: Monomer + Side/Top / Top/Side
filter_20 = StreamFilter(Gate=list_2, Stream0=filter_19, Stream1=filter_17)  # disabled

# ----
filter_21 = StreamFilter(Gate=list_16, Stream0=item_21, Stream1=orient_13.Geometry)  # disabled

# ---- group: 阳角分类
filter_22 = StreamFilter(Gate=list, Stream0=item_21, Stream1=filter_21, Stream2=item_21)  # disabled
filter_23 = StreamFilter(Gate=list, Stream0=item_21, Stream1=item_21, Stream2=item_21)  # disabled
filter_24 = StreamFilter(Gate=list_2, Stream0=filter_22, Stream1=filter_23)  # disabled

# ----
阳角 = Geometry(filter_24)  # disabled

# ---- group: 正常和阳角 - BoundingBox — 测Intersection (continued)
c_script_9 = CSharpScript(BrepMain=item_29, BrepStay=filter_20)  # -> out, BrepInters, BrepRemain, IndexM, IndexS; inputs BrepMain: list of Brep, BrepStay: list of Brep; disabled
# ---------- c_script_9: C# ----------
    List<Brep> BrepI = new List<Brep>();
    List<Brep> BrepR = new List<Brep>();
    List<int> num = new List<int>();
    List<int> numS = new List<int>();


    double tolr = Rhino.RhinoDoc.ActiveDoc.ModelAbsoluteTolerance;

    for(int j = 0; j < BrepMain.Count;j++){
      for(int i = 0; i < BrepStay.Count;i++){
        bool test = Rhino.Geometry.Intersect.Intersection.BrepBrep(BrepMain[j], BrepStay[i], tolr, out crv, out pts);
        if(test && crv.Length != 0){
          tryThis = true;
          numS.Add(i);
          break;}
        else{
          tryThis = false;}
      }
      if(tryThis){
        BrepI.Add(BrepMain[j]);
        num.Add(j);
      }
      else{
        BrepR.Add(BrepMain[j]);
      }
    }



    BrepInters = BrepI;
    BrepRemain = BrepR;
    IndexM = num;
    IndexS = numS;
# ---------- c_script_9: C# additional code ----------
  Rhino.Geometry.Curve[] crv;
  Rhino.Geometry.Point3d[] pts;
  bool tryThis;
# ---------- end c_script_9 ----------
item_42 = ListItem(List=item_29, Index=c_script_9.IndexM, Wrap=True)  # -> graft(Item); disabled
item_43 = ListItem(List=filter_20, Index=c_script_9.IndexS, Wrap=True)  # -> graft(Item); disabled
cull_i_7 = CullIndex(List=item_30, Indices=c_script_9.IndexM, Wrap=True)  # disabled
item_44 = ListItem(List=item_30, Index=c_script_9.IndexM, Wrap=True)  # -> graft(Item); disabled
area_3 = Area(Geometry=item_42)  # -> Area, Centroid; disabled
bbx = BrepBrep(BrepA=item_42, BrepB=item_43)  # -> simplify(Curves), Points; disabled
area_4 = Area(Geometry=bbx.Curves)  # -> Area, Centroid; disabled
ln_33 = Line(StartPoint=area_3.Centroid, EndPoint=area_4.Centroid)  # disabled
mp_2 = Midpoint(Curve=ln_33)  # disabled
scale = Scale(Geometry=ln_33, Center=mp_2, Factor=number_slider_13)  # -> Geometry, Transform; disabled
ccx_4 = CurveCurve(CurveA=scale.Geometry, CurveB=bbx.Curves)  # -> Points, ParamsA, ParamsB; disabled
item_45 = ListItem(List=ccx_4.Points, Index=0, Wrap=True)  # -> Item, Item1; disabled
ln_34 = Line(StartPoint=item_45.Item1, EndPoint=item_45.Item)  # disabled
move_28 = Move(Geometry=item_44, Motion=ln_34)  # -> simplify(Geometry), Transform; disabled
bbox_10 = BoundingBox(Content=move_28.Geometry, Plane=PlaneXY(0, 0, 0))  # -> Box, Box_2; disabled

# ----
# 这里如果跑红也不要紧，
# 说明单体没有出现相撞的情况
area_5 = Area(Geometry=bbox_10.Box)  # -> Area, Centroid; disabled

# ---- group: 正常和阳角 - BoundingBox — 测Intersection (continued)
entwine_17 = Entwine(Branch00=move_28.Geometry, Branch01=area_5.Centroid, FlattenInputs=True)  # disabled
flip_9 = FlipMatrix(Data=entwine_17)  # disabled
item_46 = ListItem(List=flip_9, Index=panel_23, Wrap=True)  # -> flatten(Item); disabled
item_47 = ListItem(List=flip_9, Index=panel_24, Wrap=True)  # -> flatten(Item); disabled
pull_8 = PullPoint(Point=item_47, Geometry=item_37.Item, ClosestOnly=True)  # -> flatten(ClosestPoint), Distance; disabled
pull_9 = PullPoint(Point=item_47, Geometry=item_37.Item1, ClosestOnly=True)  # -> flatten(ClosestPoint), Distance; disabled
vec2pt_4 = Vector2Pt(PointA=item_47, PointB=pull_8.ClosestPoint, Unitize=False)  # -> Vector, Length; disabled
vec2pt_5 = Vector2Pt(PointA=item_47, PointB=pull_9.ClosestPoint, Unitize=False)  # -> Vector, Length; disabled
multiplication_22 = Multiplication(A=vec2pt_4.Vector, B=vec2pt_5.Vector)  # disabled
larger_4 = LargerThan(FirstNumber=multiplication_22, SecondNumber=0)  # -> LargerThan, OrEqualTo; disabled
dispatch_8 = Dispatch(List=item_46, DispatchPattern=larger_4.LargerThan)  # -> ListA, ListB; disabled

# ---- group: Normal
geo_2 = Geometry(cull_i_7)  # disabled

# ---- group: Normal-Move
移动 = Geometry(dispatch_8.ListA)  # disabled

# ----
# PLAN Results
merge_9 = Merge(Data1=geo_2, Data2=阳角, Data3=移动, Data4=阴角)  # disabled

# ==== cluster Cluster
G = ClusterInput()
rotate = Rotate(Geometry=G, Angle=3.141592654, Plane=PlaneXY(0, 0, 0))  # -> Geometry, Transform
boxprop = BoxProperties(Box=rotate.Geometry)  # -> Center, Diagonal, Area, Volume, Degeneracy
bbox = BoundingBox(Content=rotate.Geometry, Plane=PlaneXY(0, 0, 0))  # -> Box, Box_2
debox = DeconstructBox(Box=bbox.Box)  # -> Plane, X, Y, Z
pdecon = Deconstruct(Point=boxprop.Center)  # -> XComponent, YComponent, ZComponent
dedomain = DeconstructDomain(Domain=debox.Y)  # -> Start, End
pt = ConstructPoint(XCoordinate=pdecon.XComponent, YCoordinate=dedomain.Start, ZCoordinate=pdecon.ZComponent)
xy = XYPlane(Origin=Point(0, 0, 0))
pl_origin = PlaneOrigin(Base=xy, Origin=pt)
orient = Orient(Geometry=rotate.Geometry, Source=pl_origin, Target=xy)  # -> Geometry, Transform
G_2 = ClusterOutput(orient.Geometry)
