# Grasshopper definition simplifyStructurePlusTags.gh (Grasshopper 1.0.7)
# plug-ins: Wombat, treesloth01, EleFront

# ----
# Input Text Layer
panel = Panel("""T2-PLAN-F2$0$次梁编号
T2-PLAN-F2$0$框梁编号""")

# ----
# 1.Input Data
# F2结构线
crv = Curve([<curve referenced from the Rhino model> x404])

# ----
# F2建筑线
crv_2 = Curve(<curve referenced from the Rhino model>)

# ----
# F1建筑线
crv_3 = Curve(<curve referenced from the Rhino model>)

# ----
# F1建筑线Offset
number_slider = Slider(600, range=0..1000)

offset = OffsetCurve(Curve=crv_3, Distance=expr("-x", Slider(800, range=0..10000)), Corners=1)
offset_2 = OffsetCurve(Curve=crv_3, Distance=number_slider, Corners=1)
close = CloseCurve(Curve=offset, Tolerance=0)
close_2 = CloseCurve(Curve=offset_2, Tolerance=0)
close_3 = CloseCurve(Curve=crv_2, Tolerance=0)
boundary = BoundarySurfaces(Edges=[close_2, close])
boundary_2 = BoundarySurfaces(Edges=close_3)
boundary_3 = BoundarySurfaces(Edges=close_2)
sdiff = SolidDifference(BrepsA=boundary_2, BrepsB=boundary_3)
crv_4 = Curve(sdiff)
merge = Merge(Data1=sdiff, Data2=boundary)  # -> flatten(Result)
scx = SurfaceCurve(Surface=graft(merge), Curve=graft(crv))  # -> Curves, Points, UVPoints, Normals, Parameters, Tangents
null = NullItem(Item=scx.Curves)  # -> NullFlags, simplify(InvalidFlags), Description
shift = ShiftPaths(Data=null.InvalidFlags, Offset=-1)
swatch = ColourSwatch(SwatchColor=RGB(176, 176, 176))
dispatch = Dispatch(List=simplify(graft(crv)), DispatchPattern=null.InvalidFlags)  # -> ListA, ListB
layer = DefineLayer(Name="CleanStructureCurve", Color=swatch)
crv_5 = Curve(dispatch.ListB)
attributes = DefineObjectAttributes(Layer=layer, Color=swatch)

reflay = ReferenceByLayer(LayerName=panel)  # -> flatten(Geometry)
detext = DeconstructText(TextObject=reflay)  # -> Text, Plane, Height, Justification
tsort = SortText(Keys=detext.Text, Culture=127)  # -> Keys, Values
pt = Point(detext.Plane)
c_script = CSharpScript(text=tsort.Keys)  # -> out, eachName; inputs text: list of String
# ---------- c_script: C# ----------
    bool startSearch = false;

    List<string> textToSave = new List<string>();
    textToSave.Add(text[0]);

    for (int i = 0; i < text.Count - 1;i++){
      foreach(string t in textToSave){
        if(t == text[i]){
          startSearch = false;
        }
        else{
          startSearch = true;
        }
      }

      if(startSearch){
        textToSave.Add(text[i]);

      }
    }

    eachName = textToSave;
# ---------- end c_script ----------
tmatch = MatchText(Text=detext.Text, Pattern=graft(c_script.eachName), Case=True)
dispatch_2 = Dispatch(List=reflay, DispatchPattern=tmatch)  # -> ListA, ListB
project = Project(Geometry=dispatch_2.ListA, Plane=PlaneXY(0, 0, 0))  # -> Geometry, Transform
data = Data(project.Geometry)
reb = RebuildCurve(Curve=offset, Count=Slider(50, range=0..100), Tangents=False)
detext_2 = DeconstructText(TextObject=data)  # -> Text, Plane, Height, Justification
project_2 = Project(Geometry=reb, Plane=PlaneXY(0, 0, 0))  # -> Geometry, Transform
pt_2 = Point(detext_2.Plane)
incurve = PointInCurve(Point=pt_2, Curve=project_2.Geometry)  # -> Relationship, Point
equals = Equality(FirstNumber=incurve.Relationship, SecondNumber="0")  # -> Equality, Inequality
dispatch_3 = Dispatch(List=data, DispatchPattern=equals.Equality)  # -> ListA, ListB
data_2 = Data(dispatch_3.ListA)
detext_3 = DeconstructText(TextObject=data_2)  # -> simplify(Text), simplify(Plane), Height, Justification
data_3 = Data(c_script.eachName)
tstat = TreeStatistics(Tree=detext_3.Text)  # -> Paths, Length, Count
panel_2 = Panel(data_3)
text = DefineTextObject(Text=detext_3.Text, Plane=detext_3.Plane, DimensionStyle="图例2-地上$0$XD100$0", OutputType="Text")
series = Series(Start="1", Step=1, Count=tstat.Count)
gradient = Gradient(
    LowerLimit="1",
    UpperLimit=tstat.Count,
    Parameter=series,
    stops=[0: RGB(243, 57, 0), 0.1: RGB(236, 27, 60), 0.2: RGB(210, 0, 118), 0.3: RGB(103, 0, 120), 0.4: RGB(39, 72, 161), 0.5: RGB(1, 192, 229), 0.6: RGB(18, 178, 90), 0.7: RGB(79, 186, 8), 0.8: RGB(220, 237, 32), 0.9: RGB(247, 159, 20), 1: RGB(243, 57, 0)])
concat = Concatenate(FragmentA="Text::", FragmentB=data_3)
panel_3 = Panel(concat)
layer_2 = DefineLayer(Name=concat, Color=flatten(gradient))  # -> graft(Layer)
panel_4 = Panel(gradient)
attributes_2 = DefineObjectAttributes(Layer=layer_2)  # -> simplify(Attributes)

# ----
# 2.Bake Data
# Bake Structure Lines
panel_5 = Panel("CleanStructureCurve")
bake = BakeObjects(Geometry=crv_5, Attributes=attributes, BakeName=panel_5, Bake=False)

# ----
# Bake Tags
panel_6 = Panel("text")
bake_2 = BakeObjects(Geometry=text, Attributes=attributes_2, BakeName=panel_6, Bake=False)
